# Grasshopper definition .model_02_AA.gh (Grasshopper 0.9.76)
# plug-ins: Karamba, Python Interpreter

# ----
# ** ponto médio de toda a estrutura
# ** ponto médio banzo superior
# ** altura banzo superior
# ** ponto médio da barra
# ** altura das extremidades da barra
# ** ângulo dos banzos inferiores
ptmed = Slider(5, range=5..12)
ptmed_2 = Slider(3.72, range=2..6)
panel = Panel("ESTRUTURA A")
ptmed_3 = Slider(1, range=1..3)
alturasup = Slider(0, range=0..1)
barextrz = Slider(2, range=2..5)
ângulo = Slider(10, range=5..20)

# ----
# ** altura das extremidades dos banzos superiores
panel_2 = Panel("Banzos SUPERIORES")
eixo_x = Slider(0, range=0..1.5)

# ----
# ** altura das extremidades da barra
# ** ponto médio da barra
panel_3 = Panel("Barras CENTRAL")
bansupptmed = Slider(2.63, range=1..6)
# ** altura das extremidades da barra
barextrem = Slider(4, range=4..10)

# ----
# ** altura dos apoios A
# ** altura dos apoios B
panel_4 = Panel("100")
panel_5 = Panel("Dimensão Geral")

# ----
# ** ponto médio de toda a estrutura
# ** ponto médio banzo superior
# ** altura banzo superior
# ** ponto médio da barra
# ** altura das extremidades da barra
# ** ângulo dos banzos inferiores
panel_6 = Panel("ESTRUTURA B")
bansupptmed_2 = Slider(1, range=1..6)
bansup = Slider(0, range=0..1)
ângulo_2 = Slider(10, range=5..20)
sistptmed = Slider(5, range=5..12)
barptmed = Slider(2.81, range=2..6)
barraextrem = Slider(2, range=2..10)

# ----
# ** quantidades de diagonais
# *** este valor é multiplicado por 2
panel_7 = Panel("Diagonais")

# ----
# ** altura das extremidades das barras
panel_8 = Panel("Barras")
eixo_x_2 = Slider(0, range=0..2.5)

panel_9 = Panel("Geometria")
neg = Negative(Value=eixo_x)
addition = Addition(A=eixo_x, B=panel_4)
addition_2 = Addition(A=alturasup, B="1.80")
addition_3 = Addition(A=bansup, B="1.80")
addition_4 = Addition(A=eixo_x, B=panel_4)
neg_2 = Negative(Value=eixo_x)
addition_5 = Addition(A=sistptmed, B=bansupptmed_2)
addition_6 = Addition(A=ptmed, B=ptmed_3)

# ----
# ** geometria barras inferiores
# ***estrutura A
panel_10 = Panel("BANZOS INFERIORES 1")
pt = ConstructPoint(XCoordinate=neg_2, YCoordinate=0, ZCoordinate=addition_2)
pt_2 = ConstructPoint(XCoordinate=addition, YCoordinate=0, ZCoordinate=addition_2)
ln = Line(StartPoint=pt, EndPoint=pt_2)
eval = EvaluateCurve(Curve=reparameterize(ln), Parameter=0.5)  # -> Point, Tangent, Angle
Z = UnitZ(Factor=addition_6)
move = Move(Geometry=eval.Point, Motion=Z)  # -> Geometry, Transform
intcrv = Interpolate(Vertices=[pt, move.Geometry, pt_2], Degree=3, Periodic=False, KnotStyle=1)  # -> Curve, Length, Domain
end = EndPoints(Curve=intcrv.Curve)  # -> Start, End
ln_2 = Line(StartPoint=end.Start, EndPoint=end.End)
neg_3 = Negative(Value=ângulo)
rotax = RotateAxis(Geometry=intcrv.Curve, Angle=degrees(ângulo), Axis=ln_2)  # -> Geometry, Transform
rotax_2 = RotateAxis(Geometry=intcrv.Curve, Angle=degrees(neg_3), Axis=ln_2)  # -> Geometry, Transform

# ----
# ** geometria barra
# *** estrutura A
expression = Expression(x=ângulo, y=barextrz, Expression="-((x*π/180)*y)")
panel_11 = Panel("BARRA 1")
addition_7 = Addition(A=eixo_x_2, B=panel_4)
neg_4 = Negative(Value=eixo_x_2)
addition_8 = Addition(A="1.80", B=barextrz)
pt_3 = ConstructPoint(XCoordinate=neg_4, YCoordinate=expression, ZCoordinate=0)
pt_4 = ConstructPoint(XCoordinate=neg_4, YCoordinate=expression, ZCoordinate=addition_8)
pt_5 = ConstructPoint(XCoordinate=addition_7, YCoordinate=expression, ZCoordinate=addition_8)
pt_6 = ConstructPoint(XCoordinate=addition_7, YCoordinate=expression, ZCoordinate=0)
ln_3 = Line(StartPoint=pt_3, EndPoint=pt_6)
eval_2 = EvaluateCurve(Curve=reparameterize(ln_3), Parameter=0.5)  # -> Point, Tangent, Angle
addition_9 = Addition(A=addition_6, B=ptmed_2)
Z_2 = UnitZ(Factor=addition_9)
move_2 = Move(Geometry=eval_2.Point, Motion=Z_2)  # -> Geometry, Transform
merge = Merge(Data1=pt_4, Data2=move_2.Geometry, Data3=pt_5)
intcrv_2 = Interpolate(Vertices=merge, Degree=3, Periodic=False, KnotStyle=1)  # -> Curve, Length, Domain
end_2 = EndPoints(Curve=intcrv_2.Curve)  # -> Start, End
ln_4 = Line(StartPoint=end_2.Start, EndPoint=end_2.End)
rotax_3 = RotateAxis(Geometry=intcrv_2.Curve, Angle=degrees(ângulo), Axis=ln_4)  # -> Geometry, Transform

# ----
# ** geometria barra
# *** estrutura intermediária
panel_12 = Panel("BARRA 1/2")
neg_5 = Negative(Value=eixo_x_2)
division = Division(A="7.5", B=2)
addition_10 = Addition(A=eixo_x_2, B=panel_4)
pt_7 = ConstructPoint(XCoordinate=neg_5, YCoordinate=division, ZCoordinate=0)
pt_8 = ConstructPoint(XCoordinate=neg_5, YCoordinate=division, ZCoordinate=barextrem)
pt_9 = ConstructPoint(XCoordinate=addition_10, YCoordinate=division, ZCoordinate=barextrem)
pt_10 = ConstructPoint(XCoordinate=addition_10, YCoordinate=division, ZCoordinate=0)
ln_5 = Line(StartPoint=pt_7, EndPoint=pt_10)
eval_3 = EvaluateCurve(Curve=reparameterize(ln_5), Parameter=0.5)  # -> Point, Tangent, Angle
addition_11 = Addition(A=sistptmed, B=bansupptmed)
Z_3 = UnitZ(Factor=addition_11)
move_3 = Move(Geometry=eval_3.Point, Motion=Z_3)  # -> Geometry, Transform
merge_2 = Merge(Data1=pt_8, Data2=move_3.Geometry, Data3=pt_9)
intcrv_3 = Interpolate(Vertices=merge_2, Degree=3, Periodic=False, KnotStyle=1)  # -> Curve, Length, Domain
end_3 = EndPoints(Curve=intcrv_3.Curve)  # -> Start, End
ln_6 = Line(StartPoint=end_3.Start, EndPoint=end_3.End)
rotax_4 = RotateAxis(Geometry=intcrv_3.Curve, Angle=degrees("0.0"), Axis=ln_6)  # -> Geometry, Transform

# ----
# ** geometria barra superior
# *** estrutura B
panel_13 = Panel("BANZO SUPERIOR 2")
pt_11 = ConstructPoint(XCoordinate=0, YCoordinate="7.5", ZCoordinate="1.80")
pt_12 = ConstructPoint(XCoordinate=panel_4, YCoordinate="7.5", ZCoordinate="1.80")
ln_7 = Line(StartPoint=pt_11, EndPoint=pt_12)
eval_4 = EvaluateCurve(Curve=reparameterize(ln_7), Parameter=0.5)  # -> Point, Tangent, Angle
Z_4 = UnitZ(Factor=sistptmed)
move_4 = Move(Geometry=eval_4.Point, Motion=Z_4)  # -> Geometry, Transform
merge_3 = Merge(Data1=pt_11, Data2=move_4.Geometry, Data3=pt_12)
intcrv_4 = Interpolate(Vertices=merge_3, Degree=3, Periodic=False, KnotStyle=1)  # -> Curve, Length, Domain
end_4 = EndPoints(Curve=intcrv_4.Curve)  # -> Start, End
ln_8 = Line(StartPoint=end_4.Start, EndPoint=end_4.End)
rotax_5 = RotateAxis(Geometry=intcrv_4.Curve, Angle=degrees("0.0"), Axis=ln_8)  # -> Geometry, Transform

panel_14 = Panel("BANZOS INFERIORES 2")
pt_13 = ConstructPoint(XCoordinate=neg, YCoordinate="7.5", ZCoordinate=addition_3)
pt_14 = ConstructPoint(XCoordinate=addition_4, YCoordinate="7.5", ZCoordinate=addition_3)
ln_9 = Line(StartPoint=pt_13, EndPoint=pt_14)
eval_5 = EvaluateCurve(Curve=reparameterize(ln_9), Parameter=0.5)  # -> Point, Tangent, Angle
Z_5 = UnitZ(Factor=addition_5)
move_5 = Move(Geometry=eval_5.Point, Motion=Z_5)  # -> Geometry, Transform
merge_4 = Merge(Data1=pt_13, Data2=move_5.Geometry, Data3=pt_14)
intcrv_5 = Interpolate(Vertices=merge_4, Degree=3, Periodic=False, KnotStyle=1)  # -> Curve, Length, Domain
end_5 = EndPoints(Curve=intcrv_5.Curve)  # -> Start, End
ln_10 = Line(StartPoint=end_5.Start, EndPoint=end_5.End)
neg_6 = Negative(Value=ângulo_2)
rotax_6 = RotateAxis(Geometry=intcrv_5.Curve, Angle=degrees(ângulo_2), Axis=ln_10)  # -> Geometry, Transform
rotax_7 = RotateAxis(Geometry=intcrv_5.Curve, Angle=degrees(neg_6), Axis=ln_10)  # -> Geometry, Transform

expression_2 = Expression(x=ângulo_2, y=barraextrem, Expression=" (x*π/180) * y")
panel_15 = Panel("BARRA 2")
addition_12 = Addition(A=eixo_x_2, B=panel_4)
neg_7 = Negative(Value=eixo_x_2)
addition_13 = Addition(A=expression_2, B="7.5")
pt_15 = ConstructPoint(XCoordinate=neg_7, YCoordinate=addition_13, ZCoordinate=0)
pt_16 = ConstructPoint(XCoordinate=neg_7, YCoordinate=addition_13, ZCoordinate=barraextrem)
pt_17 = ConstructPoint(XCoordinate=addition_12, YCoordinate=addition_13, ZCoordinate=barraextrem)
pt_18 = ConstructPoint(XCoordinate=addition_12, YCoordinate=addition_13, ZCoordinate=0)
ln_11 = Line(StartPoint=pt_15, EndPoint=pt_18)
eval_6 = EvaluateCurve(Curve=reparameterize(ln_11), Parameter=0.5)  # -> Point, Tangent, Angle
addition_14 = Addition(A=addition_5, B=barptmed)
Z_6 = UnitZ(Factor=addition_14)
move_6 = Move(Geometry=eval_6.Point, Motion=Z_6)  # -> Geometry, Transform
merge_5 = Merge(Data1=pt_16, Data2=move_6.Geometry, Data3=pt_17)
intcrv_6 = Interpolate(Vertices=merge_5, Degree=3, Periodic=False, KnotStyle=1)  # -> Curve, Length, Domain
end_6 = EndPoints(Curve=intcrv_6.Curve)  # -> Start, End
ln_12 = Line(StartPoint=end_6.Start, EndPoint=end_6.End)
rotax_8 = RotateAxis(Geometry=intcrv_6.Curve, Angle=degrees(neg_6), Axis=ln_12)  # -> Geometry, Transform

# ----
# ** geometria barra superior
# *** estrutura A
panel_16 = Panel("BANZO SUPERIOR 1")
pt_19 = ConstructPoint(XCoordinate=0, YCoordinate=0, ZCoordinate="1.80")
pt_20 = ConstructPoint(XCoordinate=panel_4, YCoordinate=0, ZCoordinate="1.80")
ln_13 = Line(StartPoint=pt_19, EndPoint=pt_20)
eval_7 = EvaluateCurve(Curve=reparameterize(ln_13), Parameter=0.5)  # -> Point, Tangent, Angle
Z_7 = UnitZ(Factor=ptmed)
move_7 = Move(Geometry=eval_7.Point, Motion=Z_7)  # -> Geometry, Transform
merge_6 = Merge(Data1=pt_19, Data2=move_7.Geometry, Data3=pt_20)
intcrv_7 = Interpolate(Vertices=merge_6, Degree=3, Periodic=False, KnotStyle=1)  # -> Curve, Length, Domain
rotax_9 = RotateAxis(Geometry=intcrv_7.Curve, Angle="0.0", Axis=Line((0, 0, 0), (10, 0, 0)))  # -> Geometry, Transform

multiplication = Multiplication(A=Slider(15, range=5..15), B=2)
divide = DivideCurve(Curve=rotax_9.Geometry, Count=multiplication, Kinks=False)  # -> Points, Tangents, Parameters
divide_2 = DivideCurve(Curve=rotax.Geometry, Count=multiplication, Kinks=False)  # -> Points, Tangents, Parameters
divide_3 = DivideCurve(Curve=rotax_2.Geometry, Count=multiplication, Kinks=False)  # -> Points, Tangents, Parameters
divide_4 = DivideCurve(Curve=rotax_3.Geometry, Count=multiplication, Kinks=False)  # -> Points, Tangents, Parameters
divide_5 = DivideCurve(Curve=rotax_4.Geometry, Count=multiplication, Kinks=False)  # -> Points, Tangents, Parameters
divide_6 = DivideCurve(Curve=rotax_5.Geometry, Count=multiplication, Kinks=False)  # -> Points, Tangents, Parameters
divide_7 = DivideCurve(Curve=rotax_6.Geometry, Count=multiplication, Kinks=False)  # -> Points, Tangents, Parameters
divide_8 = DivideCurve(Curve=rotax_7.Geometry, Count=multiplication, Kinks=False)  # -> Points, Tangents, Parameters
divide_9 = DivideCurve(Curve=rotax_8.Geometry, Count=multiplication, Kinks=False)  # -> Points, Tangents, Parameters
ln_14 = Line(StartPoint=divide.Points, EndPoint=divide_2.Points)
ln_15 = Line(StartPoint=divide_2.Points, EndPoint=divide_3.Points)
ln_16 = Line(StartPoint=divide_3.Points, EndPoint=divide.Points)
ln_17 = Line(StartPoint=divide_3.Points, EndPoint=divide_4.Points)
ln_18 = Line(StartPoint=divide_2.Points, EndPoint=divide_4.Points)
ln_19 = Line(StartPoint=divide_6.Points, EndPoint=divide_5.Points)
ln_20 = Line(StartPoint=divide.Points, EndPoint=divide_5.Points)
ln_21 = Line(StartPoint=divide_5.Points, EndPoint=divide_3.Points)
ln_22 = Line(StartPoint=divide_7.Points, EndPoint=divide_5.Points)
ln_23 = Line(StartPoint=divide_6.Points, EndPoint=divide_7.Points)
ln_24 = Line(StartPoint=divide_7.Points, EndPoint=divide_8.Points)
ln_25 = Line(StartPoint=divide_8.Points, EndPoint=divide_6.Points)
ln_26 = Line(StartPoint=divide_8.Points, EndPoint=divide_9.Points)
ln_27 = Line(StartPoint=divide_7.Points, EndPoint=divide_9.Points)
merge_7 = Merge(
    Data1=ln_14,
    Data2=ln_15,
    Data3=ln_16,
    Data4=ln_17,
    Data5=ln_18,
    Data6=ln_23,
    Data7=ln_24,
    Data8=ln_25,
    Data9=ln_26,
    Data10=ln_27,
    Data11=ln_19,
    Data12=ln_20,
    Data13=ln_21,
    Data14=ln_22)
pline = PolyLine(Vertices=divide.Points, Closed=False)
pline_2 = PolyLine(Vertices=divide_6.Points, Closed=False)
pline_3 = PolyLine(Vertices=divide_2.Points, Closed=False)
pline_4 = PolyLine(Vertices=divide_3.Points, Closed=False)
pline_5 = PolyLine(Vertices=divide_7.Points, Closed=False)
pline_6 = PolyLine(Vertices=divide_8.Points, Closed=False)
pline_7 = PolyLine(Vertices=divide_4.Points, Closed=False)
pline_8 = PolyLine(Vertices=divide_5.Points, Closed=False)
pline_9 = PolyLine(Vertices=divide_9.Points, Closed=False)
explode = Explode(Curve=pline, Recursive=True)  # -> Segments, Vertices
explode_2 = Explode(Curve=pline_2, Recursive=True)  # -> Segments, Vertices
explode_3 = Explode(Curve=pline_3, Recursive=True)  # -> Segments, Vertices
explode_4 = Explode(Curve=pline_4, Recursive=True)  # -> Segments, Vertices
explode_5 = Explode(Curve=pline_5, Recursive=True)  # -> Segments, Vertices
explode_6 = Explode(Curve=pline_6, Recursive=True)  # -> Segments, Vertices
explode_7 = Explode(Curve=pline_7, Recursive=True)  # -> Segments, Vertices
explode_8 = Explode(Curve=pline_8, Recursive=True)  # -> Segments, Vertices
explode_9 = Explode(Curve=pline_9, Recursive=True)  # -> Segments, Vertices

vec2pt = Vector2Pt(PointA=pt_19, PointB=pt_20, Unitize=False)  # -> Vector, Length
align = AlignPlane(Plane=pt_19, Direction=vec2pt.Vector)  # -> Plane, Angle
merge_8 = Merge(Data1=pt_19, Data2=pt_20)
merge_9 = Merge(Data1=pt_11, Data2=pt_12)
pln = Plane(align.Plane)

index = Slider(12, range=0..29)
# Seção Tubular Circular (TC)
# 
#  0  >   D    --> dimensões externas (mm)
#  1  >   t     --> espessura da parede (mm)
#  2  >   m    --> massa por unidade de comp. (kg/m)
#  3  >   A    --> área da seção transversal (cm²)
#  4  >  Ix/Iy  --> momento de inércia (cm4)
#  5  > rx/ry  --> raio de giração (cm)
#  6  > Wx/Wy --> módulo de resistência elástico (cm³)
#  7  >  Zx/Zy --> módulo de resistência plástico (cm³)
#  8  >    J    --> const. torção (cm4)
#  9  >   Wt   --> módulo de resitência à torção (cm³)
#  10 >    U    --> área de superfície por unidade de comp. (m²/m)
# 
# ** As bitolas são as frequentemente produzidas e por isso adotadas como preferenciais.
# 
# *** Fonte: http://www.vallourec.com/COUNTRIES/BRAZIL/PT/Products-and-services/automotive-industrial-tubes/Documents/Catalogo%20Estruturais.pdf
index_2 = Slider(6, range=0..29)
index_3 = Slider(12, range=0..29)
index_4 = Slider(12, range=0..29)

merge_10 = Merge(Data1=divide_3.Points, Data2=divide_4.Points, Data3=divide_5.Points, Data4=divide_7.Points, Data5=divide_9.Points)
panel_17 = Panel("""Membrana 
translúcida""")
pt_21 = Point(merge_10)
del = DelaunayMesh(Points=pt_21, Plane=PlaneXY(0, 0, 0))
preview = CustomPreview(Geometry=del, Shader=ColourSwatch(SwatchColor=RGBA(255, 255, 255, 206)))
area = Area(Geometry=del)  # -> Area, Centroid
project = Project(Geometry=del, Plane=PlaneXY(0, 0, 0))  # -> Geometry, Transform

# ---- group: path of the .csv file
# GUIA DE BOA PRÁTICA E ESTILO PYTHON
# 
# https://wiki.python.org.br/GuiaDeEstilo
# 
# comentários:
# - primeira letra deve ser maiúscula;
# - usar dois espaços do ponto final permitindo que o Emacs ajuste a linha de maneira consistente.
# - progradores de lingua não-inglesa devem escrever em inglês;
# - deve ser separado por uma linha em branco no topo e embaixo;
# - não faça comentários em coisas óbvias. Eles distraem mais do que ajudam.
path = FilePath("C:\Users\Renato\OneDrive\github\generative_design_mecom\models_inputs\profiles2.csv")

# ----
python = PythonScript(f=path, indexU=index, indexB=index_3, indexD=index_4, indexT=index_2)  # -> out, profileU, DiameterU, ThicknessU, profileB, DiameterB, ThicknessB, profileD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; inputs indexU: Int32, indexB: Int32, indexD: Int32, indexT: Int32
# ---------- python: Python ----------
import rhinoscriptsyntax as rs

lista = []               # U

f = open(f, 'r')         # Open file for reading

for line in f:
    lista_line = line.rstrip().split('\t')
    lista.append(lista_line)

print lista

W = []                     # lista de Módulo de Resistência Elástico
I = []                     # lista de Momento de Inércia --> Ix == Iy
Z = []                     # lista de Módulo de Resistência Plástico (cm³)

proU = lista[indexU]       # profileU ####### 

pU = proU[0].split(',')    # split strings
diameterU = pU[0] 
DiameterU = float(diameterU) / 10 
thicknessU = pU[1]
ThicknessU = float(thicknessU) / 10 
profileU = diameterU, thicknessU
W.append (pU[6])
I.append (pU[5])
Z.append (pU[7])

proB = lista[indexB]       # profileB ####### 

pB = proB[0].split(',')    # split strings
diameterB = pB[0]
DiameterB = float(diameterB) / 10
thicknessB = pB[1]  
ThicknessB = float(thicknessB) / 10 
profileB = diameterB, thicknessB
W.append (pB[6])
I.append (pB[5])
Z.append (pB[7])

proD = lista[indexD]       # profileD ####### 

pD = proD[0].split(',')    # split strings
diameterD = pD[0]
DiameterD = float(diameterD) / 10
thicknessD = pD[1]
ThicknessD = float(thicknessD) / 10 
profileD = diameterD, thicknessD
W.append (pD[6])
I.append (pD[5])
Z.append (pD[7])

proT = lista[indexT]       # profileT ####### 

pT = proT[0].split(',')    # split strings
diameterT = pT[0]
DiameterT = float(diameterT) / 10
thicknessT = pT[1]
ThicknessT = float(thicknessT) / 10 
profileT = diameterT, thicknessT
W.append (pT[6])
I.append (pT[5])
Z.append (pT[7])
# ---------- end python ----------
profile_mm = Panel(python.profileU)
profile_mm_2 = Panel(python.profileB)
profile_mm_3 = Panel(python.profileT)
profile_mm_4 = Panel(python.profileD)

# ---- group: Módulo de Resistência Elástico (cm3)
panel_18 = Panel(python.W)

# ---- group: Momento de Inércia (cm4)
panel_19 = Panel(python.I)

# ---- group: Módulo de Resistência Plástico (cm³)
panel_20 = Panel(python.Z)

# ----
sobrecarga_kg_m² = Panel("30.0")
mass_kg_m² = Panel("0.7")

panel_21 = Panel("I")
panel_22 = Panel("D")
panel_23 = Panel("T")
panel_24 = Panel("S")
cross_sections = CrossSectionsKaramba(ElementsIdentifiers=panel_22, Diameter_cm=python.DiameterU, WallThickness_cm=python.ThicknessU, mode="Circular Hollow")
cross_sections_2 = CrossSectionsKaramba(ElementsIdentifiers=panel_21, Diameter_cm=python.DiameterB, WallThickness_cm=python.ThicknessB, mode="Circular Hollow")
cross_sections_3 = CrossSectionsKaramba(ElementsIdentifiers=panel_24, Diameter_cm=python.DiameterD, WallThickness_cm=python.ThicknessD, mode="Circular Hollow")
cross_sections_4 = CrossSectionsKaramba(ElementsIdentifiers=panel_23, Diameter_cm=python.DiameterT, WallThickness_cm=python.ThicknessT, mode="Circular Hollow")

multiplication_2 = Multiplication(A=area.Area, B=mass_kg_m²)
area_2 = Area(Geometry=project.Geometry)  # -> Area, Centroid
pt_22 = Point(merge_10)
multiplication_3 = Multiplication(A=area_2.Area, B=sobrecarga_kg_m²)
lng = ListLength(List=pt_22)
addition_15 = Addition(A=multiplication_2, B=multiplication_3)
carga_por_nó = Division(A=addition_15, B=lng)
multiplication_4 = Multiplication(A=carga_por_nó, B=-0.0098)
pt_23 = Point(flatten(pt_22))
num = Number(multiplication_4)
Z_8 = UnitZ(Factor=num)

merge_11 = Merge(Data1=explode.Segments, Data2=explode_2.Segments)
merge_12 = Merge(Data1=explode_7.Segments, Data2=explode_8.Segments, Data3=explode_9.Segments)
merge_13 = Merge(Data1=explode_3.Segments, Data2=explode_4.Segments, Data3=explode_5.Segments, Data4=explode_6.Segments)
entwine = Entwine(Branch00=merge_13, Branch01=merge_11, Branch02=merge_12, Branch03=merge_7, FlattenInputs=True)

crosec = CrossSectionKaramba([cross_sections, cross_sections_2, cross_sections_3, cross_sections_4])

# ----
# criar suporte para os banzos superiores e inferiores
supp = SupportKaramba(PlaneOfReference=pln, menu=[buttons(off, on, on, off, off, off)])

merge_14 = Merge(Data1=merge_8, Data2=merge_9)

# ----
# Valor de Χ em função do índice de esbeltez  λ0
# 
# ** fonte: NBR 8800
python_2 = PythonScript()  # -> out, a
# ---------- python_2: Python ----------
lista = {
         0.00: [1.000], 0.01: [1.000], 0.02: [1.000], 0.03: [1.000], 0.04: [0.999], 
         0.05: [0.999], 0.06: [0.998], 0.07: [0.998], 0.08: [0.997], 0.09: [0.997],
         0.10: [0.996], 0.11: [0.995], 0.02: [0.994], 0.13: [0.993], 0.14: [0.992], 
         0.15: [0.991], 0.16: [0.989], 0.17: [0.988], 0.18: [0.987], 0.19: [0.985],
         0.20: [0.983], 0.21: [0.982], 0.02: [0.980], 0.23: [0.978], 0.24: [0.976], 
         0.25: [0.974], 0.26: [0.972], 0.27: [0.970], 0.28: [0.968], 0.29: [0.965],
         0.30: [0.963], 0.31: [0.961], 0.32: [0.958], 0.33: [0.955], 0.34: [0.953], 
         0.35: [0.950], 0.36: [0.947], 0.37: [0.944], 0.38: [0.941], 0.39: [0.938],
         0.40: [0.935], 0.41: [0.932], 0.42: [0.929], 0.43: [0.926], 0.44: [0.922], 
         0.45: [0.919], 0.46: [0.915], 0.47: [0.912], 0.48: [0.908], 0.49: [0.904],
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         }

num = lista[0.26]
print num
# ---------- end python_2 ----------
python_3 = PythonScript()  # -> out, tabela
# ---------- python_3: Python ----------
tabela = {
         0.00: [1.000], 0.01: [1.000], 0.02: [1.000], 0.03: [1.000], 0.04: [0.999], 
         0.05: [0.999], 0.06: [0.998], 0.07: [0.998], 0.08: [0.997], 0.09: [0.997],
         0.10: [0.996], 0.11: [0.995], 0.02: [0.994], 0.13: [0.993], 0.14: [0.992], 
         0.15: [0.991], 0.16: [0.989], 0.17: [0.988], 0.18: [0.987], 0.19: [0.985],
         0.20: [0.983], 0.21: [0.982], 0.02: [0.980], 0.23: [0.978], 0.24: [0.976], 
         0.25: [0.974], 0.26: [0.972], 0.27: [0.970], 0.28: [0.968], 0.29: [0.965],
         0.30: [0.963], 0.31: [0.961], 0.32: [0.958], 0.33: [0.955], 0.34: [0.953], 
         0.35: [0.950], 0.36: [0.947], 0.37: [0.944], 0.38: [0.941], 0.39: [0.938],
         0.40: [0.935], 0.41: [0.932], 0.42: [0.929], 0.43: [0.926], 0.44: [0.922], 
         0.45: [0.919], 0.46: [0.915], 0.47: [0.912], 0.48: [0.908], 0.49: [0.904],
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         }

print (type(tabela))
# ---------- end python_3 ----------

supp_2 = SupportKaramba(PosInd=merge_14, PlaneOfReference=pln, menu=[buttons(on, on, on, off, off, off)])
panel_25 = Panel("Apoios")

panel_26 = Panel("Elementos")
panel_27 = Panel("S")
panel_28 = Panel("T")
panel_29 = Panel("I")
panel_30 = Panel("D")
panel_31 = Panel("""I
S
T
D""")
linetobeam = LineToBeamKaramba(Line=entwine, New=True, Remove=True, LimitDistance_m=0.005, BeamIdentifier=graft(panel_31))  # -> Points, flatten(Element), Info
modifyelem = ModifyElementKaramba(BeamIdentifier=panel_29, Alpha_deg="90", mode="Beam")
modifyelem_2 = ModifyElementKaramba(BeamIdentifier=panel_27, Alpha_deg="90", mode="Beam")
modifyelem_3 = ModifyElementKaramba(BeamIdentifier=panel_28, Alpha_deg="90", mode="Beam")
modifyelem_4 = ModifyElementKaramba(BeamIdentifier=panel_30, Bending=Toggle(True), mode="Beam")

panel_32 = Panel("""I
S
T
D""")
matselect = MaterialSelectionKaramba(ElementsIdentifiers=panel_32, menu=[dropdown(1), dropdown(54)])
panel_33 = Panel("Material")

panel_34 = Panel("Cargas")
loads = LoadsKaramba(ForceVector=Z_8, Local=True, PosInd=pt_23, LCase=0, mode="Point")
loads_2 = LoadsKaramba(Vector=Vector(0, 0, -1), LCase=0, mode="Gravity")

# ----
# Coeficiente de flambagem por flexão de elementos isolados
# 
# a --> Kx/Ky = 0.5; valor teórico --> 0.65; valor recomendado
# b --> Kx/Ky = 0.7; valor teórico --> 0.80; valor recomendado
# c --> Kx/Ky = 1.0; valor teórico --> 1.20; valor recomendado
# d --> Kx/Ky = 1.0; valor teórico --> 1.00; valor recomendado
# e --> Kx/Ky = 2.0; valor teórico --> 2.10; valor recomendado
# f --> Kx/Ky = 2.0; valor teórico --> 2.00; valor recomendado
# 
# * condição:
#   a - 1ª e 2º extremidade: rotação e translação impedidas;
#   b - 1ª extremidade: rotação livre, translação impedida
#       2º extremidade: rotação e translação impedida;
#   c - 1ª extremidade: rotação impedida, translação livre
#       2º extremidade: rotação e translação impedida;
#   d - 1ª e 2ª extremidade: rotação livre, translação impedida,
#   e - 1ª extremidade: rotação e translação livre,
#       2º extremidade: rotação e translação impedida;
#   f - 1ª extremidade: rotação impedida, translação livre,
#       2º extremidade: rotação livre, translação impedida;
# 
# ** fonte: Tabela E.1 - NBR 8800
panel_35 = Panel("2.10")

support = SupportKaramba(supp_2)
load = LoadKaramba(flatten([loads_2, loads]))
assemble = AssembleModelKaramba(
    Elem=[linetobeam.Element, modifyelem_4, modifyelem_3, modifyelem_2, modifyelem],
    Support=support,
    Load=load,
    CrossSection=crosec,
    Material=matselect,
    LimitDistance_m=0.005)  # -> Model, Info, Mass_kg, CenterOfGravity
analyzethi = AnalyzeThIKaramba(Model=assemble.Model)  # -> CalculatedModel, MaximumDisplacement_m, ResultingForceOfGravity_kN, ElasticEnergy_kNm
modelview = ModelViewKaramba(Model=analyzethi.CalculatedModel, LoadCaseFactorsForLinearSuperposition=1, IndexIncrementOfVisibleLoadcase=0)  # -> Model, DeformedMesh, DeformedAxes, DeformedModel
beamview = BeamViewKaramba(Model=modelview.Model)  # -> Model, MeshesOfRenderedBeams, DeformedBeamAxes, LegendColors, LegendTags

# ----
# * Resistência ao escoamento
#    do aço 250 MPa;
# 
# ** Resistance (KN/mm²)
panel_36 = Panel("0.25")
# * Módulo de elasticidade (KN/mm²)
# 
# ** E = 200 000 MPa
# ***ATENÇÃO***
# 
# verificar se os cálculos estão no mesmo sistema (SI)
# Tração - Dimensionamento
# 
# Ntsd ≤ Ntrd
# 
# onde:
# Ntsd = força axial de tração solicitante de cálculo;
# 
# Ntrd = força axial de tração solicitante de cálculo.
# 
# A força axial de tração resistente de cálculo deve ser o menor dos valores obtidos nas esquações abaixos:
# 
# Ntrd = Ag fy / γa1
# 
# Ntrd = Ae fu / γa2
# Compressão - Dimensionamento
# 
# Ncsd ≤ Ncrd
# 
# onde:
# Nc, sd = força axial de compressão solicitante de cálculo;
# Nc, rd = força axial de compressão resistente de cálculo;
# 
# A força axial resistente de cálculo é dada pela equação abaixo:
# 
# Ncrs = χ Q Ag fy / γa1
# 
# onde:
# 
# χ = fator de redução associado à resistência à compressão determinado:
# 
# λ ≤ 1.5 --> χ = 0.658 ** (λ**2)
# λ > 1.5 --> χ = 0.877 / (λ**2)
# 
# λ = √ (Q Ag fy) / Ne
# 
# *************
# Fator de redução para flambagem local -
# Elementos de seção tubular circular
# 
# Não é previsto utilização de seções com D/t > 0.45 E / fy (NBR 8800)
# 
# Q = 1.00, para D/t ≤ E/fy
# 
# Q = 0.038 E / fy(D/t) + 2/3, para 0.11E/fy < D/t ≤ 0.45 E/fy
panel_37 = Panel("200")
diameter = Merge(Data1=python.DiameterU, Data2=python.DiameterB, Data3=python.DiameterD, Data4=python.DiameterT)
thickness = Merge(Data1=python.ThicknessU, Data2=python.ThicknessB, Data3=python.ThicknessD, Data4=python.ThicknessT)
python_4 = PythonScript(diameterCm=diameter, thicknessCm=thickness, fy=panel_36, E=panel_37, I=python.I, K=panel_35)  # -> out, forceTraction, forceCompression; inputs diameterCm: list, thicknessCm: list, E: Int32, I: list
# ---------- python_4: Python ----------
import math

listDiameter = (diameterCm)
listThickness = (thicknessCm)
num = (len(listThickness))

cont = 0

momentInertia = I 

γa1 = 1.10

forceTraction = []
forceCompression = []

while cont < num:

    D = listDiameter[cont] * 10      # diameter (cm -> mm) ATENÇÃO (conferir se é em cm)
    t = listThickness[cont] * 10     # thickness (cm -> mm)
    
    Ag = math.pi * (D * t - t ** 2)  # profile area
    
    #traction

    Ntrd = (Ag * fy) / γa1           # força axial de tração resistente de cálculo
    forceTraction.append(Ntrd)
    print ('force traction %s: %.2f' % (cont, Ntrd))

    #compression

    if D/t <= E/fy:
        Q = 1.00
    else:
        Q = (0.038 * E) / ((fy * (D / t)) + 2 / 3)                  # para 0.11E/fy < D/t ≤ 0.45 E/fy
                                                                    # ATENÇÃO Não é previsto utilização de seções com D/t > 0.45 E / fy (NBR 8800)

    Ne = (((math.pi)** 2) * (E * momentInertia[cont])) / (K) ** 2   # KL tabela E.1 NBR 8800
    cont += 1
    λ = math.sqrt(Q * Ag * fy) / Ne                                 # índice de esbeltez reduzido    
    if λ <= 1.5:
        χ = 0.658 ** (λ ** 2)                                       # (χ)fator de redução associado à resistência à compressão
    else:
        χ = 0.877 / (λ ** 2)
    Ncrs = (χ * Q * Ag * fy) / γa1                                  # força axial de compressão resistente de cálculo
    forceCompression.append(Ncrs)
    print ('force compression %s: %.2f' % (cont, Ncrs))
    
#print λ
# ---------- end python_4 ----------

panel_38 = Panel("D")
panel_39 = Panel("I")
panel_40 = Panel("S")
panel_41 = Panel("T")
b_res_force = BeamResultantForcesKaramba(
    AnalyzedModel=analyzethi.CalculatedModel,
    BeamIdentifiers=panel_38,
    LoadCase=-1,
    MaximumProbingDistance_m=-1,
    NumberOfProbingPointsPerElement=3)  # -> AnalyzedModel, NormalForce_kN, ResultantBendingMoment_kNm, ResultantShearForce_kN
b_res_force_2 = BeamResultantForcesKaramba(
    AnalyzedModel=analyzethi.CalculatedModel,
    BeamIdentifiers=panel_39,
    LoadCase=-1,
    MaximumProbingDistance_m=-1,
    NumberOfProbingPointsPerElement=3)  # -> AnalyzedModel, NormalForce_kN, ResultantBendingMoment_kNm, ResultantShearForce_kN
b_res_force_3 = BeamResultantForcesKaramba(
    AnalyzedModel=analyzethi.CalculatedModel,
    BeamIdentifiers=panel_40,
    LoadCase=-1,
    MaximumProbingDistance_m=-1,
    NumberOfProbingPointsPerElement=3)  # -> AnalyzedModel, NormalForce_kN, ResultantBendingMoment_kNm, ResultantShearForce_kN
b_res_force_4 = BeamResultantForcesKaramba(
    AnalyzedModel=analyzethi.CalculatedModel,
    BeamIdentifiers=panel_41,
    LoadCase=-1,
    MaximumProbingDistance_m=-1,
    NumberOfProbingPointsPerElement=3)  # -> AnalyzedModel, NormalForce_kN, ResultantBendingMoment_kNm, ResultantShearForce_kN

max_displacement_m = Panel(analyzethi.MaximumDisplacement_m)
model_mass_kg = Panel(assemble.Mass_kg)
info = Panel(python_4.out)
# Momento fletor resistente de cálculo
# 
# para seções superiores com relação:
# D/t > 0.45 * E / fy
# 
# equação 67
# Mrd = Mp1/γa1 --> para λ <= λp
# 
# onde:
# Mpl - momento fletor de plastificação da seção transversal, igual ao produto do módulo de resistência plástico (Z) pela resistência ao escoamento do aço (fy). (NBR 8800, p. 147)
# 
# 
# equação 68
# Mrd = 1/γa1((0.021E / (D/t)) + fy) * w --> para λp < λ < λr
# 
# equação 69
# Mrd = (1 * 0.33E / γa1 * D/t) * W      --> para λ > λr
# 
# com:
# λ = D / t
# λp = 0.07 * (E / fy)
# λr = 0.31 * (E / fy)
# CRIAR penalidade para seções com D/t > 0.45 E / fy
panel_42 = Panel("200")
python_5 = PythonScript(diameterCm=diameter, thicknessCm=thickness, fy="0.25", E=panel_42, W=python.W, Z=python.Z)  # -> out, listMrd; inputs diameterCm: list, thicknessCm: list, W: list, Z: list
# ---------- python_5: Python ----------
import math

listDiameter = (diameterCm)
listThickness = (thicknessCm)
num = (len(listThickness))

ResistanceElastic = W

γa1 = 1.10

cont = 0

listMrd = []

while cont < num:

    D = listDiameter[cont] * 10      # diameter (cm -> mm) ATENÇÃO (conferir se é em cm)
    t = listThickness[cont] * 10     # thickness (cm -> mm)
    
    Ag = math.pi * (D * t - t ** 2)  # profile area
    print ('Area %.2f' % Ag)
    
    λ = D / t                        # parâmetro de esbeltez da seção transversal
    λp = 0.07 * (E / fy)             # parâmetro de esbeltez correspondente à plastificação
    λr = 0.31 * (E / fy)             # parâmetro de esbeltez correspondente ao início do escoamento
    #print ('P.E. seção trans: %s' %λ)
    #print ('P.E. plastiicação: %s' %λp)
    #print ('P.E. escoamento: %s' %λr)
    
    if λ <= λp:           # equação 67
        Mrd = ((Z[cont]) * fy) / γa1   # Mpl (Mom. Fletor de Plastificação)= Z * fy
        listMrd.append(Mrd)
    elif λp < λ < λr:     # equação 68
        Mrd = ((1/γa1) * ((0.021 * E) / (D / t)) + fy) * ResistanceElastic[cont]
        listMrd.append(Mrd)
    else:                 # equação 69
        Mrd = ((1 * 0.33 * E) / (γa1 * (D / t))) * ResistanceElastic[cont]
        listMrd.append(Mrd)
    cont += 1
    
    print ('momento fletor resistente de cálculo %s: %.2f' % (cont, Mrd))
# ---------- end python_5 ----------
legend = Legend(Colour=beamview.LegendColors, Tags=beamview.LegendTags, LegendType=1)
b_res_force_5 = BeamResultantForcesKaramba(AnalyzedModel=beamview.Model, LoadCase=-1, MaximumProbingDistance_m=-1, NumberOfProbingPointsPerElement=3)  # -> AnalyzedModel, NormalForce_kN, ResultantBendingMoment_kNm, ResultantShearForce_kN
python_6 = PythonScript(x=beamview.LegendTags)  # -> out, a; inputs x: list
# ---------- python_6: Python ----------
import re

a = []

x.pop(0)

for val in x:
    try:
        a.append( float(re.sub(r'[^\d.-e+]+', '', val)) )
    except ValueError:
        continue
# ---------- end python_6 ----------
info_2 = Panel(python_5.out)
abs = Absolute(Value=python_6.a)
bnd = Bounds(Numbers=b_res_force_5.NormalForce_kN)
bnd_2 = Bounds(Numbers=b_res_force_5.ResultantBendingMoment_kNm)
bnd_3 = Bounds(Numbers=b_res_force_5.ResultantShearForce_kN)
bnd_4 = Bounds(Numbers=abs)
dedomain = DeconstructDomain(Domain=bnd)  # -> Start, End
dedomain_2 = DeconstructDomain(Domain=bnd_2)  # -> Start, End
dedomain_3 = DeconstructDomain(Domain=bnd_3)  # -> Start, End
dedomain_4 = DeconstructDomain(Domain=bnd_4)  # -> Start, End
python_7 = PythonScript(normalForce=b_res_force.NormalForce_kN)  # -> out, traction, compression; inputs normalForce: list
# ---------- python_7: Python ----------
# ***** NORMAL FORCE *****
L = normalForce

listMax = map(abs, L)
listMax.sort()
forceMax = (listMax[-1])
print forceMax
traction = forceMax
compression = forceMax
# ---------- end python_7 ----------
python_8 = PythonScript(normalForce=b_res_force_2.NormalForce_kN)  # -> out, traction, compression; inputs normalForce: list; same code as python_7
python_9 = PythonScript(normalForce=b_res_force_3.NormalForce_kN)  # -> out, traction, compression; inputs normalForce: list; same code as python_7
python_10 = PythonScript(normalForce=b_res_force_4.NormalForce_kN)  # -> out, traction, compression; inputs normalForce: list; same code as python_7
abs_2 = Absolute(Value=dedomain.Start)

max_utilization_percentage = Panel(dedomain_4.End)
max_compression_kn = Panel(abs_2)
max_tension_kn = Panel(dedomain.End)
max_moment_knm = Panel(dedomain_2.End)
max_shear_kn = Panel(dedomain_3.End)

python_11 = PythonScript(bendingMoment=b_res_force.ResultantBendingMoment_kNm)  # -> out, maximumBendingMoment; inputs bendingMoment: list
# ---------- python_11: Python ----------
listBM = bendingMoment

listBM.sort()
maximumBendingMoment = listBM[-1]
# ---------- end python_11 ----------
python_12 = PythonScript(bendingMoment=b_res_force_2.ResultantBendingMoment_kNm)  # -> out, maximumBendingMoment; inputs bendingMoment: list; same code as python_11
python_13 = PythonScript(bendingMoment=b_res_force_3.ResultantBendingMoment_kNm)  # -> out, maximumBendingMoment; inputs bendingMoment: list; same code as python_11
python_14 = PythonScript(bendingMoment=b_res_force_4.ResultantBendingMoment_kNm)  # -> out, maximumBendingMoment; inputs bendingMoment: list; same code as python_11
panel_43 = Panel([python_7.traction, python_7.compression])
panel_44 = Panel([python_8.traction, python_8.compression])
panel_45 = Panel([python_9.traction, python_9.compression])
panel_46 = Panel([python_10.traction, python_10.compression])
compression = Merge(Data1=python_7.compression, Data2=python_8.compression, Data3=python_9.compression, Data4=python_10.compression)
traction = Merge(Data1=python_7.traction, Data2=python_8.traction, Data3=python_9.traction, Data4=python_10.traction)
panel_47 = Panel(python_13.maximumBendingMoment)
panel_48 = Panel(python_11.maximumBendingMoment)
panel_49 = Panel(python_12.maximumBendingMoment)
panel_50 = Panel(python_14.maximumBendingMoment)
merge_15 = Merge(
    Data1=python_11.maximumBendingMoment,
    Data2=python_12.maximumBendingMoment,
    Data3=python_13.maximumBendingMoment,
    Data4=python_14.maximumBendingMoment)
punishment = Slider(10000, range=1000..100000)
maximumdisplacement = Number(analyzethi.MaximumDisplacement_m)
forcecompression = Number(python_4.forceCompression)
forcetraction = Number(python_4.forceTraction)
support_2 = Number(panel_4)
division_2 = Division(A=support_2, B=300)
mass = Number(assemble.Mass_kg)
python_15 = PythonScript(
    support=support_2,
    maximumDisplacement=maximumdisplacement,
    traction=traction,
    forceTraction=forcetraction,
    compression=compression,
    forceCompression=forcecompression,
    flecha=merge_15,
    forceFlecha=python_5.listMrd,
    mass=mass,
    punishment=punishment)  # -> out, goal; inputs traction: list, forceTraction: list, compression: list, forceCompression: list, flecha: list, forceFlecha: list, punishment: Int32
# ---------- python_15: Python ----------
listSolMaxTraction = traction        # list traction
listResMaxTraction = forceTraction
listSolMaxCompression = compression  # list compression
listResMaxCompression = forceCompression
listSolMaxFlecha = flecha
listResMaxFlecha = forceFlecha


# Check Traction
num = (len(listSolMaxTraction))   # numero de valores
cont = 0
gTraction = []

while cont < num:
    if listResMaxTraction[cont] > listSolMaxTraction[cont]:
        print ('Traction %s is OK!' % cont)
    else:
        print ('Traction %s is NOT OK!' % cont)
        gTraction.append(listSolMaxTraction[cont] + punishment)
    cont += 1

# Check Compression
num2 = (len(listSolMaxCompression))
cont2 = 0
gCompression = []

while cont2 < num2:
    if listResMaxCompression[cont2] > listSolMaxCompression[cont2]:
        print ('Compression %s is OK!' % cont2)
    else:
        print ('compression %s is NOT OK!' % cont2)
        gCompression.append(listSolMaxCompression[cont2] + punishment)
    cont2 += 1

# Check Flecha
num2 = (len(listSolMaxFlecha))
cont2 = 0
gFlecha = []

while cont2 < num2:
    if listResMaxFlecha[cont2] > listSolMaxFlecha[cont2]:
        print ('M. Fletor %s is OK!' % cont2)
    else:
        print ('M. FLetor %s is NOT OK!' % cont2)
        gFlecha.append(listSolMaxFlecha[cont2] + punishment)
    cont2 += 1

# 2ª Parte
l = support                                   # *** FLECHA ***

if ((l / 300) > maximumDisplacement):
    print ('Flecha is OK!')
    disp = 0                                  # not punishment
else:
    print ('Fecha is NOT OK!')
    disp = (l + punishment+100)                   # punishment


addition = sum(gTraction) + sum(gCompression) + sum(gFlecha) # Somar os elementos da lista
goal = (mass + addition + disp)               # para otimização

print ('Total mass: %.2f kg' % mass)
print ('Mass to optimize: %.2f kg' % goal)
# ---------- end python_15 ----------
info_3 = Panel(python_15.out)
galapagos = Galapagos()

# ---- group: goal to optimize !
goal = Number(python_15.goal)

# ----
panel_51 = Panel([division_2, maximumdisplacement])
panel_52 = Panel("Fitness")
