# Grasshopper definition .model_02_BA.gh (Grasshopper 0.9.76)
# plug-ins: Karamba, Python Interpreter

# ----
# UNIVERSIDADE FEDERAL DE OURO PRETO
# _____________________
# 
# Mestrado Profissional em Construção Metálica
# 
# Departamento de Engenharia Civil
panel = Panel("Genoma")

# ----
# Catálogo Vallourec.As bitolas escolhidas são as mais frequentemente produzidas.
seção_d_t = Panel("""33.4,3.2
33.4,3.6
38.1,3.2
38.1,4.0
42.2,3.6
42.2,5.0
48.3,3.6
48.3,5.0
60.3,4.0
60.3,5.6
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""")

# ----
# ** ponto médio de toda a estrutura
# ** ponto médio banzo superior
# ** altura banzo superior
# ** ponto médio da barra
# ** altura das extremidades da barra
# ** ângulo dos banzos inferiores
ptmed = Slider(12, range=5..12)
ptmed_2 = Slider(2, range=2..6)
panel_2 = Panel("ESTRUTURA A")
ptmed_3 = Slider(3, range=1..3)
alturasup = Slider(1, range=0..1)
barextrz = Slider(5, range=2..5)
ângulo = Slider(20, range=5..20)

# ----
# ** altura das extremidades dos banzos superiores
panel_3 = Panel("Banzos SUPERIORES")
eixo_x = Slider(0, range=0..1.5)

# ----
# ** altura das extremidades da barra
# ** ponto médio da barra
panel_4 = Panel("Barras CENTRAL")
bansupptmed = Slider(6, range=1..6)
# ** altura das extremidades da barra
barextrem = Slider(5.32, range=4..10)

# ----
# ** perfil das barras diagonais
# ** perfil das barras inferiores
# ** perfil das barras superiores
# ** perfil das barras travessão
panel_5 = Panel("Escolha dos perfis")

# ----
# ** largura
# ** comprimento
# ** altura dos apoios A
# ** altura dos apoios B
panel_6 = Panel("100")
panel_7 = Panel("Dimensão Geral")

# ----
# ** ponto médio de toda a estrutura
# ** ponto médio banzo superior
# ** altura banzo superior
# ** ponto médio da barra
# ** altura das extremidades da barra
# ** ângulo dos banzos inferiores
panel_8 = Panel("ESTRUTURA B")
bansupptmed_2 = Slider(2, range=1..6)
bansup = Slider(3, range=0..3)
ângulo_2 = Slider(20, range=5..20)
sistptmed = Slider(12, range=5..12)
barptmed = Slider(6, range=2..6)
barraextrem = Slider(4.65, range=2..10)

# ----
# ** quantidades de diagonais
# *** este valor é multiplicado por 2
panel_9 = Panel("Diagonais")

# ----
# ** altura das extremidades das barras
panel_10 = Panel("Barras")
eixo_x_2 = Slider(1.44, range=0..2.5)

panel_11 = Panel("Geometria")

# ----
# ** geometria barras inferiores
# ***estrutura A
panel_12 = Panel("BANZOS INFERIORES 1")
pt = ConstructPoint(XCoordinate=0, YCoordinate=0, ZCoordinate="1.80")
pt_2 = ConstructPoint(XCoordinate=panel_6, YCoordinate=0, ZCoordinate="1.80")
ln = Line(StartPoint=pt, EndPoint=pt_2)
eval = EvaluateCurve(Curve=reparameterize(ln), Parameter=0.5)  # -> Point, Tangent, Angle
Z = UnitZ(Factor=ptmed)
move = Move(Geometry=eval.Point, Motion=Z)  # -> Geometry, Transform
intcrv = Interpolate(Vertices=[pt, move.Geometry, pt_2], Degree=3, Periodic=False, KnotStyle=1)  # -> Curve, Length, Domain
end = EndPoints(Curve=intcrv.Curve)  # -> Start, End
ln_2 = Line(StartPoint=end.Start, EndPoint=end.End)
neg = Negative(Value=ângulo)
rotax = RotateAxis(Geometry=intcrv.Curve, Angle=degrees(ângulo), Axis=ln_2)  # -> Geometry, Transform
rotax_2 = RotateAxis(Geometry=intcrv.Curve, Angle=degrees(neg), Axis=ln_2)  # -> Geometry, Transform

aligndim = AlignedDimension(Plane=PlaneXY(0, 0, 0), PointA=pt, PointB=pt_2, Offset=-5, Text="{0:0.00}", Size=1)

# ----
# ** geometria barra
# *** estrutura A
expression = Expression(x=ângulo, y=barextrz, Expression="-((x*π/180)*y)")
panel_13 = Panel("BARRA 1")
addition = Addition(A=eixo_x_2, B=panel_6)
neg_2 = Negative(Value=eixo_x_2)
addition_2 = Addition(A="1.80", B=barextrz)
pt_3 = ConstructPoint(XCoordinate=neg_2, YCoordinate=expression, ZCoordinate=0)
pt_4 = ConstructPoint(XCoordinate=neg_2, YCoordinate=expression, ZCoordinate=addition_2)
pt_5 = ConstructPoint(XCoordinate=addition, YCoordinate=expression, ZCoordinate=addition_2)
pt_6 = ConstructPoint(XCoordinate=addition, YCoordinate=expression, ZCoordinate=0)
ln_3 = Line(StartPoint=pt_3, EndPoint=pt_6)
eval_2 = EvaluateCurve(Curve=reparameterize(ln_3), Parameter=0.5)  # -> Point, Tangent, Angle
addition_3 = Addition(A=ptmed, B=ptmed_2)
Z_2 = UnitZ(Factor=addition_3)
move_2 = Move(Geometry=eval_2.Point, Motion=Z_2)  # -> Geometry, Transform
merge = Merge(Data1=pt_4, Data2=move_2.Geometry, Data3=pt_5)
intcrv_2 = Interpolate(Vertices=merge, Degree=3, Periodic=False, KnotStyle=1)  # -> Curve, Length, Domain
end_2 = EndPoints(Curve=intcrv_2.Curve)  # -> Start, End
ln_4 = Line(StartPoint=end_2.Start, EndPoint=end_2.End)
rotax_3 = RotateAxis(Geometry=intcrv_2.Curve, Angle=degrees(ângulo), Axis=ln_4)  # -> Geometry, Transform

# ----
# ** geometria barra
# *** estrutura intermediária
panel_14 = Panel("BARRA 1/2")
neg_3 = Negative(Value=eixo_x_2)
division = Division(A="10", B=2)
addition_4 = Addition(A=eixo_x_2, B=panel_6)
pt_7 = ConstructPoint(XCoordinate=neg_3, YCoordinate=division, ZCoordinate=0)
pt_8 = ConstructPoint(XCoordinate=neg_3, YCoordinate=division, ZCoordinate=barextrem)
pt_9 = ConstructPoint(XCoordinate=addition_4, YCoordinate=division, ZCoordinate=barextrem)
pt_10 = ConstructPoint(XCoordinate=addition_4, YCoordinate=division, ZCoordinate=0)
ln_5 = Line(StartPoint=pt_7, EndPoint=pt_10)
eval_3 = EvaluateCurve(Curve=reparameterize(ln_5), Parameter=0.5)  # -> Point, Tangent, Angle
addition_5 = Addition(A=sistptmed, B=bansupptmed)
Z_3 = UnitZ(Factor=addition_5)
move_3 = Move(Geometry=eval_3.Point, Motion=Z_3)  # -> Geometry, Transform
merge_2 = Merge(Data1=pt_8, Data2=move_3.Geometry, Data3=pt_9)
intcrv_3 = Interpolate(Vertices=merge_2, Degree=3, Periodic=False, KnotStyle=1)  # -> Curve, Length, Domain
end_3 = EndPoints(Curve=intcrv_3.Curve)  # -> Start, End
ln_6 = Line(StartPoint=end_3.Start, EndPoint=end_3.End)
rotax_4 = RotateAxis(Geometry=intcrv_3.Curve, Angle=degrees("0.0"), Axis=ln_6)  # -> Geometry, Transform

# ----
# ** geometria barra superior
# *** estrutura B
panel_15 = Panel("BANZO SUPERIOR 2")
neg_4 = Negative(Value=eixo_x)
addition_6 = Addition(A=bansup, B="1.80")
addition_7 = Addition(A=eixo_x, B=panel_6)
pt_11 = ConstructPoint(XCoordinate=neg_4, YCoordinate="10", ZCoordinate=addition_6)
pt_12 = ConstructPoint(XCoordinate=addition_7, YCoordinate="10", ZCoordinate=addition_6)
ln_7 = Line(StartPoint=pt_11, EndPoint=pt_12)
eval_4 = EvaluateCurve(Curve=reparameterize(ln_7), Parameter=0.5)  # -> Point, Tangent, Angle
addition_8 = Addition(A=sistptmed, B=bansupptmed_2)
Z_4 = UnitZ(Factor=addition_8)
move_4 = Move(Geometry=eval_4.Point, Motion=Z_4)  # -> Geometry, Transform
merge_3 = Merge(Data1=pt_11, Data2=move_4.Geometry, Data3=pt_12)
intcrv_4 = Interpolate(Vertices=merge_3, Degree=3, Periodic=False, KnotStyle=1)  # -> Curve, Length, Domain
end_4 = EndPoints(Curve=intcrv_4.Curve)  # -> Start, End
ln_8 = Line(StartPoint=end_4.Start, EndPoint=end_4.End)
rotax_5 = RotateAxis(Geometry=intcrv_4.Curve, Angle=degrees("0.0"), Axis=ln_8)  # -> Geometry, Transform

# ----
# ** geometria barras inferiores
# *** estrutura B
panel_16 = Panel("BANZOS INFERIORES 2")
pt_13 = ConstructPoint(XCoordinate=0, YCoordinate="10", ZCoordinate="1.80")
pt_14 = ConstructPoint(XCoordinate=panel_6, YCoordinate="10", ZCoordinate="1.80")
ln_9 = Line(StartPoint=pt_13, EndPoint=pt_14)
eval_5 = EvaluateCurve(Curve=reparameterize(ln_9), Parameter=0.5)  # -> Point, Tangent, Angle
Z_5 = UnitZ(Factor=sistptmed)
move_5 = Move(Geometry=eval_5.Point, Motion=Z_5)  # -> Geometry, Transform
merge_4 = Merge(Data1=pt_13, Data2=move_5.Geometry, Data3=pt_14)
intcrv_5 = Interpolate(Vertices=merge_4, Degree=3, Periodic=False, KnotStyle=1)  # -> Curve, Length, Domain
end_5 = EndPoints(Curve=intcrv_5.Curve)  # -> Start, End
ln_10 = Line(StartPoint=end_5.Start, EndPoint=end_5.End)
neg_5 = Negative(Value=ângulo_2)
rotax_6 = RotateAxis(Geometry=intcrv_5.Curve, Angle=degrees(ângulo_2), Axis=ln_10)  # -> Geometry, Transform
rotax_7 = RotateAxis(Geometry=intcrv_5.Curve, Angle=degrees(neg_5), Axis=ln_10)  # -> Geometry, Transform

aligndim_2 = AlignedDimension(Plane=PlaneXY(0, 0, 0), PointA=pt, PointB=pt_13, Offset=5, Text="{0:0.00}", Size=1)

# ----
# ** geometria barra
# *** estrutura B
expression_2 = Expression(x=ângulo_2, y=barraextrem, Expression=" (x*π/180) * y")
panel_17 = Panel("BARRA 2")
addition_9 = Addition(A=eixo_x_2, B=panel_6)
neg_6 = Negative(Value=eixo_x_2)
addition_10 = Addition(A=expression_2, B="10")
pt_15 = ConstructPoint(XCoordinate=neg_6, YCoordinate=addition_10, ZCoordinate=0)
pt_16 = ConstructPoint(XCoordinate=neg_6, YCoordinate=addition_10, ZCoordinate=barraextrem)
pt_17 = ConstructPoint(XCoordinate=addition_9, YCoordinate=addition_10, ZCoordinate=barraextrem)
pt_18 = ConstructPoint(XCoordinate=addition_9, YCoordinate=addition_10, ZCoordinate=0)
ln_11 = Line(StartPoint=pt_15, EndPoint=pt_18)
eval_6 = EvaluateCurve(Curve=reparameterize(ln_11), Parameter=0.5)  # -> Point, Tangent, Angle
addition_11 = Addition(A=sistptmed, B=barptmed)
Z_6 = UnitZ(Factor=addition_11)
move_6 = Move(Geometry=eval_6.Point, Motion=Z_6)  # -> Geometry, Transform
merge_5 = Merge(Data1=pt_16, Data2=move_6.Geometry, Data3=pt_17)
intcrv_6 = Interpolate(Vertices=merge_5, Degree=3, Periodic=False, KnotStyle=1)  # -> Curve, Length, Domain
end_6 = EndPoints(Curve=intcrv_6.Curve)  # -> Start, End
ln_12 = Line(StartPoint=end_6.Start, EndPoint=end_6.End)
rotax_8 = RotateAxis(Geometry=intcrv_6.Curve, Angle=degrees(neg_5), Axis=ln_12)  # -> Geometry, Transform

# ----
# ** geometria barra superior
# *** estrutura A
panel_18 = Panel("BANZO SUPERIOR 1")
addition_12 = Addition(A=eixo_x, B=panel_6)
addition_13 = Addition(A=alturasup, B="1.80")
neg_7 = Negative(Value=eixo_x)
pt_19 = ConstructPoint(XCoordinate=neg_7, YCoordinate=0, ZCoordinate=addition_13)
pt_20 = ConstructPoint(XCoordinate=addition_12, YCoordinate=0, ZCoordinate=addition_13)
ln_13 = Line(StartPoint=pt_19, EndPoint=pt_20)
eval_7 = EvaluateCurve(Curve=reparameterize(ln_13), Parameter=0.5)  # -> Point, Tangent, Angle
addition_14 = Addition(A=ptmed, B=ptmed_3)
Z_7 = UnitZ(Factor=addition_14)
move_7 = Move(Geometry=eval_7.Point, Motion=Z_7)  # -> Geometry, Transform
merge_6 = Merge(Data1=pt_19, Data2=move_7.Geometry, Data3=pt_20)
intcrv_7 = Interpolate(Vertices=merge_6, Degree=3, Periodic=False, KnotStyle=1)  # -> Curve, Length, Domain
rotax_9 = RotateAxis(Geometry=intcrv_7.Curve, Angle="0.0", Axis=Line((0, 0, 0), (10, 0, 0)))  # -> Geometry, Transform

multiplication = Multiplication(A=Slider(10, range=5..15), B=2)
divide = DivideCurve(Curve=rotax_9.Geometry, Count=multiplication, Kinks=False)  # -> Points, Tangents, Parameters
divide_2 = DivideCurve(Curve=rotax.Geometry, Count=multiplication, Kinks=False)  # -> Points, Tangents, Parameters
divide_3 = DivideCurve(Curve=rotax_2.Geometry, Count=multiplication, Kinks=False)  # -> Points, Tangents, Parameters
divide_4 = DivideCurve(Curve=rotax_3.Geometry, Count=multiplication, Kinks=False)  # -> Points, Tangents, Parameters
divide_5 = DivideCurve(Curve=rotax_4.Geometry, Count=multiplication, Kinks=False)  # -> Points, Tangents, Parameters
divide_6 = DivideCurve(Curve=rotax_5.Geometry, Count=multiplication, Kinks=False)  # -> Points, Tangents, Parameters
divide_7 = DivideCurve(Curve=rotax_6.Geometry, Count=multiplication, Kinks=False)  # -> Points, Tangents, Parameters
divide_8 = DivideCurve(Curve=rotax_7.Geometry, Count=multiplication, Kinks=False)  # -> Points, Tangents, Parameters
divide_9 = DivideCurve(Curve=rotax_8.Geometry, Count=multiplication, Kinks=False)  # -> Points, Tangents, Parameters
ln_14 = Line(StartPoint=divide.Points, EndPoint=divide_2.Points)
ln_15 = Line(StartPoint=divide_2.Points, EndPoint=divide_3.Points)
ln_16 = Line(StartPoint=divide_3.Points, EndPoint=divide.Points)
ln_17 = Line(StartPoint=divide.Points, EndPoint=divide_4.Points)
ln_18 = Line(StartPoint=divide_2.Points, EndPoint=divide_4.Points)
ln_19 = Line(StartPoint=divide_6.Points, EndPoint=divide_5.Points)
ln_20 = Line(StartPoint=divide.Points, EndPoint=divide_5.Points)
ln_21 = Line(StartPoint=divide_5.Points, EndPoint=divide_3.Points)
ln_22 = Line(StartPoint=divide_7.Points, EndPoint=divide_5.Points)
ln_23 = Line(StartPoint=divide_6.Points, EndPoint=divide_7.Points)
ln_24 = Line(StartPoint=divide_7.Points, EndPoint=divide_8.Points)
ln_25 = Line(StartPoint=divide_8.Points, EndPoint=divide_6.Points)
ln_26 = Line(StartPoint=divide_6.Points, EndPoint=divide_9.Points)
ln_27 = Line(StartPoint=divide_8.Points, EndPoint=divide_9.Points)
merge_7 = Merge(
    Data1=ln_14,
    Data2=ln_15,
    Data3=ln_16,
    Data4=ln_17,
    Data5=ln_18,
    Data6=ln_23,
    Data7=ln_24,
    Data8=ln_25,
    Data9=ln_26,
    Data10=ln_27,
    Data11=ln_19,
    Data12=ln_20,
    Data13=ln_21,
    Data14=ln_22)
pline = PolyLine(Vertices=divide.Points, Closed=False)
pline_2 = PolyLine(Vertices=divide_6.Points, Closed=False)
pline_3 = PolyLine(Vertices=divide_2.Points, Closed=False)
pline_4 = PolyLine(Vertices=divide_3.Points, Closed=False)
pline_5 = PolyLine(Vertices=divide_7.Points, Closed=False)
pline_6 = PolyLine(Vertices=divide_8.Points, Closed=False)
pline_7 = PolyLine(Vertices=divide_4.Points, Closed=False)
pline_8 = PolyLine(Vertices=divide_5.Points, Closed=False)
pline_9 = PolyLine(Vertices=divide_9.Points, Closed=False)
explode = Explode(Curve=pline, Recursive=True)  # -> Segments, Vertices
explode_2 = Explode(Curve=pline_2, Recursive=True)  # -> Segments, Vertices
explode_3 = Explode(Curve=pline_3, Recursive=True)  # -> Segments, Vertices
explode_4 = Explode(Curve=pline_4, Recursive=True)  # -> Segments, Vertices
explode_5 = Explode(Curve=pline_5, Recursive=True)  # -> Segments, Vertices
explode_6 = Explode(Curve=pline_6, Recursive=True)  # -> Segments, Vertices
explode_7 = Explode(Curve=pline_7, Recursive=True)  # -> Segments, Vertices
explode_8 = Explode(Curve=pline_8, Recursive=True)  # -> Segments, Vertices
explode_9 = Explode(Curve=pline_9, Recursive=True)  # -> Segments, Vertices

merge_8 = Merge(Data1=divide.Points, Data2=divide_4.Points, Data3=divide_5.Points, Data4=divide_6.Points, Data5=divide_9.Points)
panel_19 = Panel("""Membrana 
translúcida""")
pt_21 = Point(merge_8)
del = DelaunayMesh(Points=pt_21, Plane=PlaneXY(0, 0, 0))
preview = CustomPreview(Geometry=del, Shader=ColourSwatch(SwatchColor=RGBA(255, 255, 255, 206)))
area = Area(Geometry=del)  # -> Area, Centroid
project = Project(Geometry=del, Plane=PlaneXY(0, 0, 0))  # -> Geometry, Transform

panel_20 = Panel("Escolha do Perfil")

item = ListItem(List=seção_d_t, Index=Slider(11, range=0..29), Wrap=True)
split = TextSplit(Text=item, Separators=",")
item_2 = ListItem(List=split, Index=0, Wrap=True)
item_3 = ListItem(List=split, Index=1, Wrap=True)
division_2 = Division(A=item_2, B=10)
division_3 = Division(A=item_3, B=10)

item_4 = ListItem(List=seção_d_t, Index=Slider(15, range=0..34), Wrap=True)
split_2 = TextSplit(Text=item_4, Separators=",")
item_5 = ListItem(List=split_2, Index=0, Wrap=True)
item_6 = ListItem(List=split_2, Index=1, Wrap=True)
division_4 = Division(A=item_5, B=10)
division_5 = Division(A=item_6, B=10)

item_7 = ListItem(List=seção_d_t, Index=Slider(22, range=0..34), Wrap=True)
split_3 = TextSplit(Text=item_7, Separators=",")
item_8 = ListItem(List=split_3, Index=0, Wrap=True)
item_9 = ListItem(List=split_3, Index=1, Wrap=True)
division_6 = Division(A=item_8, B=10)
division_7 = Division(A=item_9, B=10)

item_10 = ListItem(List=seção_d_t, Index=Slider(21, range=0..34), Wrap=True)
split_4 = TextSplit(Text=item_10, Separators=",")
item_11 = ListItem(List=split_4, Index=0, Wrap=True)
item_12 = ListItem(List=split_4, Index=1, Wrap=True)
division_8 = Division(A=item_11, B=10)
division_9 = Division(A=item_12, B=10)

mass_kg_m² = Panel("0.7")
sobrecarga_kg_m² = Panel("30.0")

# ----
# ** escolha perfil Diagonal
# ** escolha perfil Inferior
# ** escolha perfil Superior
# ** escolha perfil Travessão
panel_21 = Panel("I")
panel_22 = Panel("D")
panel_23 = Panel("T")
panel_24 = Panel("S")
cross_sections = CrossSectionsKaramba(ElementsIdentifiers=panel_22, Diameter_cm=division_2, WallThickness_cm=division_3, mode="Circular Hollow")
cross_sections_2 = CrossSectionsKaramba(ElementsIdentifiers=panel_21, Diameter_cm=division_4, WallThickness_cm=division_5, mode="Circular Hollow")
cross_sections_3 = CrossSectionsKaramba(ElementsIdentifiers=panel_24, Diameter_cm=division_6, WallThickness_cm=division_7, mode="Circular Hollow")
cross_sections_4 = CrossSectionsKaramba(ElementsIdentifiers=panel_23, Diameter_cm=division_8, WallThickness_cm=division_9, mode="Circular Hollow")

merge_9 = Merge(Data1=divide.Points, Data2=divide_4.Points, Data3=divide_5.Points, Data4=divide_6.Points, Data5=divide_9.Points)
multiplication_2 = Multiplication(A=area.Area, B=mass_kg_m²)
area_2 = Area(Geometry=project.Geometry)  # -> Area, Centroid
multiplication_3 = Multiplication(A=area_2.Area, B=sobrecarga_kg_m²)
lng = ListLength(List=merge_9)
addition_15 = Addition(A=multiplication_2, B=multiplication_3)
carga_por_nó = Division(A=addition_15, B=lng)
multiplication_4 = Multiplication(A=carga_por_nó, B=-0.0098)
merge_10 = Merge(
    Data1=divide.Points,
    Data2=divide_4.Points,
    Data3=divide_6.Points,
    Data4=divide_6.Points,
    Data5=divide_9.Points,
    Data6=divide_5.Points)
pt_22 = Point(flatten(merge_10))
num = Number(multiplication_4)
Z_8 = UnitZ(Factor=num)

merge_11 = Merge(Data1=explode.Segments, Data2=explode_2.Segments)
merge_12 = Merge(Data1=explode_7.Segments, Data2=explode_8.Segments, Data3=explode_9.Segments)
merge_13 = Merge(Data1=explode_3.Segments, Data2=explode_4.Segments, Data3=explode_5.Segments, Data4=explode_6.Segments)
entwine = Entwine(Branch00=merge_13, Branch01=merge_11, Branch02=merge_12, Branch03=merge_7, FlattenInputs=True)

vec2pt = Vector2Pt(PointA=pt, PointB=pt_2, Unitize=False)  # -> Vector, Length
align = AlignPlane(Plane=pt, Direction=vec2pt.Vector)  # -> Plane, Angle
merge_14 = Merge(Data1=pt, Data2=pt_13)
merge_15 = Merge(Data1=pt_2, Data2=pt_14)
pln = Plane(align.Plane)

crosec = CrossSectionKaramba([cross_sections, cross_sections_2, cross_sections_3, cross_sections_4])
resistência_kn_mm² = Panel("0.25")

parede_mm = Panel(item_6)
parede_mm_2 = Panel(item_9)
parede_mm_3 = Panel(item_3)
diametro_mm = Panel(item_5)
diametro_mm_2 = Panel(item_8)
diametro_mm_3 = Panel(division_8)
parede_mm_4 = Panel(item_12)
diametro_mm_4 = Panel(item_2)

# ----
# ** apoios estrutura A
# ** apoios estrutura B
supp = SupportKaramba(PosInd=merge_14, PlaneOfReference=pln, menu=[buttons(on, on, on, off, off, off)])
supp_2 = SupportKaramba(PosInd=merge_15, PlaneOfReference=pln, menu=[buttons(off, on, on, off, off, off)])
# Difficulty: Moderate (PRO version only)
# A U-shaped bridge is analyzed using Second Order Theory to view the buckling modes. Scroll through the loadcases to see how the structure buckles. The diagonal members are treated as truss elements.
# The vibrations of the bridge can be view with the Natural Vibrations component.
panel_25 = Panel("Apoios")

eval_8 = Evaluate(F="(3.14159*x^2)/4", x=diametro_mm_4)
eval_9 = Evaluate(F="(3.14159*x^2)/4", x=diametro_mm)
eval_10 = Evaluate(F="(3.14159*x^2)/4", x=diametro_mm_2)
eval_11 = Evaluate(F="(3.14159*x^2)/4", x=diametro_mm_3)
eval_12 = Evaluate(F="(3.14159*(x-(y*2))^2)/4", x=diametro_mm_4, y=parede_mm_3)
eval_13 = Evaluate(F="(3.14159*(x-(y*2))^2)/4", x=diametro_mm, y=parede_mm)
eval_14 = Evaluate(F="(3.14159*(x-(y*2))^2)/4", x=diametro_mm_2, y=parede_mm_2)
eval_15 = Evaluate(F="(3.14159*(x-(y*2))^2)/4", x=diametro_mm_3, y=parede_mm_4)
subtraction = Subtraction(A=eval_8, B=eval_12)
subtraction_2 = Subtraction(A=eval_9, B=eval_13)
subtraction_3 = Subtraction(A=eval_10, B=eval_14)
subtraction_4 = Subtraction(A=eval_11, B=eval_15)

panel_26 = Panel("Elementos")
panel_27 = Panel("I")
panel_28 = Panel("S")
panel_29 = Panel("T")
panel_30 = Panel("D")
panel_31 = Panel("""I
S
T
D""")
linetobeam = LineToBeamKaramba(Line=entwine, New=True, Remove=True, LimitDistance_m=0.005, BeamIdentifier=graft(panel_31))  # -> Points, flatten(Element), Info
modifyelem = ModifyElementKaramba(BeamIdentifier=panel_27, Alpha_deg="90", mode="Beam")
modifyelem_2 = ModifyElementKaramba(BeamIdentifier=panel_28, Alpha_deg="90", mode="Beam")
modifyelem_3 = ModifyElementKaramba(BeamIdentifier=panel_29, Alpha_deg="90", mode="Beam")
modifyelem_4 = ModifyElementKaramba(BeamIdentifier=panel_30, Bending=Toggle(False), mode="Beam")

panel_32 = Panel("""I
S
T
D""")
matselect = MaterialSelectionKaramba(ElementsIdentifiers=panel_32, menu=[dropdown(1), dropdown(54)])
panel_33 = Panel("Material")

panel_34 = Panel("Cargas")
loads = LoadsKaramba(ForceVector=Z_8, Local=True, PosInd=pt_22, LCase=0, mode="Point")
loads_2 = LoadsKaramba(Vector=Vector(0, 0, -1), LCase=0, mode="Gravity")

área_do_perfil_mm2 = Panel(subtraction_3)
área_do_perfil_mm2_2 = Panel(subtraction_2)
área_do_perfil_mm2_3 = Panel(subtraction_4)
área_do_perfil_mm2_4 = Panel(subtraction)

multiplication_5 = Multiplication(A=área_do_perfil_mm2_4, B=resistência_kn_mm²)
multiplication_6 = Multiplication(A=área_do_perfil_mm2_2, B=resistência_kn_mm²)
multiplication_7 = Multiplication(A=área_do_perfil_mm2, B=resistência_kn_mm²)
multiplication_8 = Multiplication(A=área_do_perfil_mm2_3, B=resistência_kn_mm²)
flecha_máxima_aceitável_l_x = Panel("300")
vão_total = Panel("100")
division_10 = Division(A=vão_total, B=flecha_máxima_aceitável_l_x)

# ----
# Este "coeficiente" é "multa" pela estrutura estar levando bomba no cálculo estrutural. Eles permitem que o Galapagos vá se aproximando das soluções ideais.
panel_35 = Panel("100000")

# ----
# Karamba Output
# an ideal truss has hinged joints and
#  members carry only axial loads
# ROLLER support can translate in the x
# direction and rotate about the y axis
# PIN support cannot translate in any direction
# but  can rotate about the y axis
# restrain all nodes out of plane for 2d analysis
# ** note: low mesh density can
# result in uneven distribution of load
panel_36 = Panel("Fitness")

support = SupportKaramba([supp, supp_2])
load = LoadKaramba(flatten([loads_2, loads]))

# ----
# ** monta modelo
#     Karamba
assemble = AssembleModelKaramba(
    Elem=[linetobeam.Element, modifyelem_4, modifyelem_3, modifyelem_2, modifyelem],
    Support=support,
    Load=load,
    CrossSection=crosec,
    Material=matselect,
    LimitDistance_m=0.005)  # -> Model, Info, Mass_kg, CenterOfGravity

# ----
# ** Calcula as deflexões
#      do modelo
analyzethi = AnalyzeThIKaramba(Model=assemble.Model)  # -> CalculatedModel, MaximumDisplacement_m, ResultingForceOfGravity_kN, ElasticEnergy_kNm

panel_37 = Panel("D")
panel_38 = Panel("I")
panel_39 = Panel("S")
panel_40 = Panel("T")
b_res_force = BeamResultantForcesKaramba(
    AnalyzedModel=analyzethi.CalculatedModel,
    BeamIdentifiers=panel_37,
    LoadCase=-1,
    MaximumProbingDistance_m=-1,
    NumberOfProbingPointsPerElement=3)  # -> AnalyzedModel, NormalForce_kN, ResultantBendingMoment_kNm, ResultantShearForce_kN
b_res_force_2 = BeamResultantForcesKaramba(
    AnalyzedModel=analyzethi.CalculatedModel,
    BeamIdentifiers=panel_38,
    LoadCase=-1,
    MaximumProbingDistance_m=-1,
    NumberOfProbingPointsPerElement=3)  # -> AnalyzedModel, NormalForce_kN, ResultantBendingMoment_kNm, ResultantShearForce_kN
b_res_force_3 = BeamResultantForcesKaramba(
    AnalyzedModel=analyzethi.CalculatedModel,
    BeamIdentifiers=panel_39,
    LoadCase=-1,
    MaximumProbingDistance_m=-1,
    NumberOfProbingPointsPerElement=3)  # -> AnalyzedModel, NormalForce_kN, ResultantBendingMoment_kNm, ResultantShearForce_kN
b_res_force_4 = BeamResultantForcesKaramba(
    AnalyzedModel=analyzethi.CalculatedModel,
    BeamIdentifiers=panel_40,
    LoadCase=-1,
    MaximumProbingDistance_m=-1,
    NumberOfProbingPointsPerElement=3)  # -> AnalyzedModel, NormalForce_kN, ResultantBendingMoment_kNm, ResultantShearForce_kN

modelview = ModelViewKaramba(Model=analyzethi.CalculatedModel, LoadCaseFactorsForLinearSuperposition=1, IndexIncrementOfVisibleLoadcase=0)  # -> Model, DeformedMesh, DeformedAxes, DeformedModel
beamview = BeamViewKaramba(Model=modelview.Model)  # -> Model, MeshesOfRenderedBeams, DeformedBeamAxes, LegendColors, LegendTags

# ----
# 01 - Buckling Bridge
# modify elements
# assemble model
# analyze model using
# second order theory
# convert line to beam
# define supports
# define loads
max_displacement_m = Panel(analyzethi.MaximumDisplacement_m)
model_mass_kg = Panel(assemble.Mass_kg)
bnd = Bounds(Numbers=b_res_force.NormalForce_kN)
bnd_2 = Bounds(Numbers=b_res_force_2.NormalForce_kN)
bnd_3 = Bounds(Numbers=b_res_force_3.NormalForce_kN)
bnd_4 = Bounds(Numbers=b_res_force_4.NormalForce_kN)
dedomain = DeconstructDomain(Domain=bnd)  # -> Start, End
dedomain_2 = DeconstructDomain(Domain=bnd_2)  # -> Start, End
dedomain_3 = DeconstructDomain(Domain=bnd_3)  # -> Start, End
dedomain_4 = DeconstructDomain(Domain=bnd_4)  # -> Start, End
abs = Absolute(Value=dedomain.Start)
abs_2 = Absolute(Value=dedomain_2.Start)
abs_3 = Absolute(Value=dedomain_3.Start)
abs_4 = Absolute(Value=dedomain_4.Start)

tração_máxima_kn = Panel(dedomain_2.End)
compressão_máxima_kn = Panel(abs_2)

compressão_máxima_kn_2 = Panel(abs_4)
tração_máxima_kn_2 = Panel(dedomain_4.End)

compressão_máxima_kn_3 = Panel(abs)
tração_máxima_kn_3 = Panel(dedomain.End)

compressão_máxima_kn_4 = Panel(abs_3)
tração_máxima_kn_4 = Panel(dedomain_3.End)

legend = Legend(Colour=beamview.LegendColors, Tags=beamview.LegendTags, LegendType=1)
b_res_force_5 = BeamResultantForcesKaramba(AnalyzedModel=beamview.Model, LoadCase=-1, MaximumProbingDistance_m=-1, NumberOfProbingPointsPerElement=3)  # -> AnalyzedModel, NormalForce_kN, ResultantBendingMoment_kNm, ResultantShearForce_kN
python = PythonScript(x=beamview.LegendTags)  # -> out, a; inputs x: list
# ---------- python: Python ----------
import re

a = []

x.pop(0)

for val in x:
    try:
        a.append( float(re.sub(r'[^\d.-e+]+', '', val)) )
    except ValueError:
        continue
# ---------- end python ----------
abs_5 = Absolute(Value=python.a)
abs_6 = Absolute(Value=[compressão_máxima_kn_3, tração_máxima_kn_3])
abs_7 = Absolute(Value=[compressão_máxima_kn, tração_máxima_kn])
abs_8 = Absolute(Value=[compressão_máxima_kn_4, tração_máxima_kn_4])
abs_9 = Absolute(Value=[compressão_máxima_kn_2, tração_máxima_kn_2])
bnd_5 = Bounds(Numbers=b_res_force_5.NormalForce_kN)
bnd_6 = Bounds(Numbers=b_res_force_5.ResultantBendingMoment_kNm)
bnd_7 = Bounds(Numbers=b_res_force_5.ResultantShearForce_kN)
bnd_8 = Bounds(Numbers=abs_5)
sort = SortList(Keys=abs_6)  # -> Keys, ValuesA
sort_2 = SortList(Keys=abs_7)  # -> Keys, ValuesA
sort_3 = SortList(Keys=abs_8)  # -> Keys, ValuesA
sort_4 = SortList(Keys=abs_9)  # -> Keys, ValuesA
dedomain_5 = DeconstructDomain(Domain=bnd_5)  # -> Start, End
dedomain_6 = DeconstructDomain(Domain=bnd_6)  # -> Start, End
dedomain_7 = DeconstructDomain(Domain=bnd_7)  # -> Start, End
dedomain_8 = DeconstructDomain(Domain=bnd_8)  # -> Start, End
rev = ReverseList(List=sort.Keys)
rev_2 = ReverseList(List=sort_2.Keys)
rev_3 = ReverseList(List=sort_3.Keys)
rev_4 = ReverseList(List=sort_4.Keys)
abs_10 = Absolute(Value=dedomain_5.Start)
item_13 = ListItem(List=rev, Index=0, Wrap=True)
item_14 = ListItem(List=rev_2, Index=0, Wrap=True)
item_15 = ListItem(List=rev_3, Index=0, Wrap=True)
item_16 = ListItem(List=rev_4, Index=0, Wrap=True)

max_utilization_percentage = Panel(dedomain_8.End)
# Karamba Input
# to apply to a new model:
# right-click and set multiple curves;
# 
# ** pay close attention to intersections of rhino curves; karamba will not read joints if lines are not intersecting
max_compression_kn = Panel(abs_10)
max_tension_kn = Panel(dedomain_5.End)
max_moment_knm = Panel(dedomain_6.End)
max_shear_kn = Panel(dedomain_7.End)

solicitação_máxima = Panel(item_13)
resistência_máxima_de_cada_peça = Panel(multiplication_5)

solicitação_máxima_2 = Panel(item_14)
resistência_máxima_de_cada_peça_2 = Panel(multiplication_6)

solicitação_máxima_3 = Panel(item_15)
resistência_máxima_de_cada_peça_3 = Panel(multiplication_7)

solicitação_máxima_4 = Panel(item_16)
resistência_máxima_de_cada_peça_4 = Panel(multiplication_8)

flecha_máxima_aceitável_m = Panel(division_10)
flecha_máxima_m = Panel(analyzethi.MaximumDisplacement_m)

model_mass_kg_2 = Panel(assemble.Mass_kg)
subtraction_5 = Subtraction(A=flecha_máxima_m, B=flecha_máxima_aceitável_m)
subtraction_6 = Subtraction(A=solicitação_máxima, B=resistência_máxima_de_cada_peça)
subtraction_7 = Subtraction(A=solicitação_máxima_2, B=resistência_máxima_de_cada_peça_2)
subtraction_8 = Subtraction(A=solicitação_máxima_3, B=resistência_máxima_de_cada_peça_3)
subtraction_9 = Subtraction(A=solicitação_máxima_4, B=resistência_máxima_de_cada_peça_4)
max = Maximum(A=subtraction_5, B=0)
max_2 = Maximum(A=subtraction_6, B=0)
max_3 = Maximum(A=subtraction_7, B=0)
max_4 = Maximum(A=subtraction_8, B=0)
max_5 = Maximum(A=subtraction_9, B=0)
multiplication_9 = Multiplication(A=max, B=panel_35)
multiplication_10 = Multiplication(A=max_2, B=panel_35)
multiplication_11 = Multiplication(A=max_3, B=panel_35)
multiplication_12 = Multiplication(A=max_4, B=panel_35)
multiplication_13 = Multiplication(A=max_5, B=panel_35)
addition_16 = Addition(
    A=multiplication_9,
    B=multiplication_10,
    C=multiplication_11,
    D=multiplication_12,
    E=multiplication_13,
    F=model_mass_kg_2)
parâmetro_a_otimizar = Panel(addition_16)
equals = Equality(FirstNumber=parâmetro_a_otimizar, SecondNumber=model_mass_kg_2)  # -> Equality, Inequality
mass = Panel(model_mass_kg_2)
está_passando = Panel(equals.Equality)
