# Grasshopper definition cedufopFINAL.gh (Grasshopper 0.9.76)
# plug-ins: Karamba, Python Interpreter, LunchBox

# ----
# ** ponto médio de toda a estrutura
# ** ponto médio banzo superior
# ** altura banzo superior
# ** ponto médio da barra
# ** altura das extremidades da barra
# ** ângulo dos banzos inferiores
ângulo = Slider(16, range=10..20)
panel = Panel("ESTRUTURA 01")
ptmed = Slider(7.99, range=5..10)
ptmedb = Slider(1.54, range=1..4)
alturasup = Slider(0.46, range=0..1)
ptmed_2 = Slider(4.99, range=2..5)
barextrz = Slider(5.24, range=2..7)

# ----
# ** comprimento das extremidades
panel_2 = Panel("Elementos B")
eixo_x = Slider(1.5, range=0..1.5)

# ----
# ** altura das extremidades
# ** ponto médio
panel_3 = Panel("""elemento C
 CENTRAL""")
bansupptmed = Slider(3.62, range=1..5)
barextrem = Slider(4.4, range=4..10)

index_a = Slider(22, range=0..29)
index_b = Slider(0, range=0..29)
index_c = Slider(0, range=0..29)
index_d = Slider(19, range=0..29)

# ----
# ** ponto médio de toda a estrutura
# ** input13 --> comprimento extremidade elemento B
# ** input14 --> comprimento extremidade elemento B
# ** ponto médio banzo superior
# ** altura banzo superior
# ** ponto médio da barra
# ** altura das extremidades da barra
# ** ângulo dos banzos inferiores
ptmedb_2 = Slider(1.06, range=1..4)
# ** input09 --> altura extremidade elemento C
# ** input10 --> altura extremidade elemento C
panel_4 = Panel("ESTRUTURA 02")
# ** input11 --> ângulo elemento B
# ** input12 --> ângulo elemento B
sistptmed = Slider(8.23, range=5..10)
# ** input15 --> ponto médio elemento C central
bansup = Slider(0.41, range=0..1)
# ** input16 --> altura extremidade elemento C central
# ** input17 --> index perfil A
barptmed = Slider(2.18, range=2..5)
# ** input18 --> index perfil B
# ** input19--> index perfil C
barraextrem = Slider(4.4, range=2..7)
# ** input20 --> index perfil D
ângulo_2 = Slider(20, range=10..20)

# ----
# GUIA DE BOA PRÁTICA E ESTILO PYTHON
# 
# https://wiki.python.org.br/GuiaDeEstilo
# 
# comentários:
# - primeira letra deve ser maiúscula;
# - usar dois espaços do ponto final permitindo que o Emacs ajuste a linha de maneira consistente.
# - progradores de lingua não-inglesa devem escrever em inglês;
# - deve ser separado por uma linha em branco no topo e embaixo;
# - não faça comentários em coisas óbvias. Eles distraem mais do que ajudam.
# ** quantidades de diagonais
# *** este valor é multiplicado por 2
panel_5 = Panel("Diagonais")
number_slider = Slider(10, range=10..20)

# ----
# ** comprimento das extremidades
panel_6 = Panel("Elementos C")
eixo_x_2 = Slider(1.5, range=0..1.5)

# ----
# ** altura dos apoios A
# ** altura dos apoios B
panel_7 = Panel("Dimensão Geral")

# ----
# Transcrever para o arquivo 'Python' abaixo...
panel_8 = Panel("6.2, 0.0, 0.4")
srf4pt = _4PointSurface(CornerA="6.2, 0.0, 0", CornerB="6.6, 0.0, 0", CornerC="6.6, 0.0, 0.4", CornerD=panel_8)
xz = XZPlane(Origin=Point(0, 0, 0))
orient = Orient(Geometry=srf4pt, Source=PlaneXY(0, 0, 0), Target=xz)  # -> Geometry, Transform
vec = VectorXYZ(XComponent=0, YComponent=1, ZComponent=0.44)  # -> Vector, Length
geo = Geometry([srf4pt, orient.Geometry])
move = Move(Geometry=geo, Motion=vec.Vector)  # -> Geometry, Transform
arrlinear = LinearArray(Geometry=move.Geometry, Direction="0, 1.0, 0.40", Count=9)  # -> Geometry, Transform
rec_2pt = Rectangle2Pt(Plane=PlaneXY(0, 0, 0), PointA="0.0, 0.0, 0.0", PointB="0.60, 0.80, 0.0", Radius=0)  # -> Rectangle, Length
X = UnitX(Factor=Slider(15.1, range=0..100))
arrrec = RectangularArray(Geometry=arrlinear.Geometry, Cell=rec_2pt.Rectangle, XCount=Slider(21, range=0..1000), YCount="1")  # -> flatten(Geometry), Transform
move_2 = Move(Geometry=arrrec.Geometry, Motion=X)  # -> Geometry, Transform
move_3 = Move(Geometry=move_2.Geometry, Motion=X)  # -> Geometry, Transform
move_4 = Move(Geometry=move_3.Geometry, Motion=X)  # -> Geometry, Transform
move_5 = Move(Geometry=move_4.Geometry, Motion=X)  # -> Geometry, Transform
move_6 = Move(Geometry=move_5.Geometry, Motion=X)  # -> Geometry, Transform
preview = CustomPreview(
    Geometry=[arrrec.Geometry, move_2.Geometry, move_3.Geometry, move_4.Geometry, move_5.Geometry, move_6.Geometry],
    Shader=ColourSwatch(SwatchColor=RGBA(255, 255, 255, 107)))

# ----
# 1) input .epw file path
# 3) check the surface direction
# 2) input the surface
# 4) define the DC-to-AC derate factor
#       (use "0" for annualShading)
panel_9 = Panel("100.0, -62.2, 0.0")
panel_10 = Panel("football field")
rec_2pt_2 = Rectangle2Pt(Plane=PlaneXY(0, 0, 0), PointA="0.0, -2.2, 0.0", PointB=panel_9, Radius=0)  # -> Rectangle, Length
football_field = Surface(rec_2pt_2.Rectangle)
geo_2 = Geometry(rec_2pt_2.Rectangle)
quads = QuadPanels(Surface=rec_2pt_2.Rectangle, UDivisions=16, VDivisions=1)
dispatch = Dispatch(List=quads, DispatchPattern=[True, False])  # -> ListA, ListB
# 5) run!
swatch = ColourSwatch(SwatchColor=RGBA(19, 79, 17, 220))
preview_2 = CustomPreview(Geometry=dispatch.ListA, Shader=ColourSwatch(SwatchColor=RGBA(62, 176, 58, 220)))
preview_3 = CustomPreview(Geometry=dispatch.ListB, Shader=swatch)

input00 = Number(number_slider)
# ** input00 --> Divisão Diagonais
input01 = Number(sistptmed)
# ** input01 --> pt médio estrutura
input02 = Number(ptmed)
# ** input02 --> pt médio estrutura
input03 = Number(ptmedb_2)
# ** input03 --> pt médio elemento B
input04 = Number(ptmedb)
# ** input04 --> pt médio elemento B
input05 = Number(bansup)
# ** input05 --> altura elemento B
# ** geometria barra
# *** estrutura intermediária
input06 = Number(alturasup)
# ** input06 -->altura elemento B
input07 = Number(barptmed)
# ** input07 -->ponto médio elemento C
input08 = Number(ptmed_2)
# ** input08 --> ponto médio elemento C
input09 = Number(barraextrem)
input10 = Number(barextrz)
input11 = Number(ângulo_2)
input12 = Number(ângulo)
input13 = Number(eixo_x_2)
# ** geometria barra superior
# *** estrutura B
input14 = Number(eixo_x)
input15 = Number(bansupptmed)
input16 = Number(barextrem)
input17 = Number(index_a)
input18 = Number(index_b)
input19 = Number(index_c)
input20 = Number(index_d)
espaço_de_projeto = Panel("438939648 x 10³³")
idade_da_terra = Panel("4,54 x 10**9")
rec_2pt_3 = Rectangle2Pt(Plane=PlaneXY(0, 0, 0), PointA="4.0, 0.0, 0.0", PointB="96.0, 10.0, 0.0", Radius=0)  # -> Rectangle, Length
Z = UnitZ(Factor=-1)
move_7 = Move(Geometry=rec_2pt_3.Rectangle, Motion=Z)  # -> Geometry, Transform

panel_11 = Panel("Geometria")
neg = Negative(Value=input14)
addition = Addition(A=input14, B="100")
addition_2 = Addition(A=input06, B="1.80")
addition_3 = Addition(A=input05, B="1.80")
addition_4 = Addition(A=input14, B="100")
neg_2 = Negative(Value=input14)
addition_5 = Addition(A=input01, B=input03)
addition_6 = Addition(A=input02, B=input04)

# ----
# ** geometria barras inferiores
# ***estrutura A
panel_12 = Panel("BANZOS INFERIORES 1")
pt = ConstructPoint(XCoordinate=neg_2, YCoordinate=0, ZCoordinate=addition_2)
pt_2 = ConstructPoint(XCoordinate=addition, YCoordinate=0, ZCoordinate=addition_2)
ln = Line(StartPoint=pt, EndPoint=pt_2)
eval = EvaluateCurve(Curve=reparameterize(ln), Parameter=0.5)  # -> Point, Tangent, Angle
Z_2 = UnitZ(Factor=addition_6)
move_8 = Move(Geometry=eval.Point, Motion=Z_2)  # -> Geometry, Transform
intcrv = Interpolate(Vertices=[pt, move_8.Geometry, pt_2], Degree=3, Periodic=False, KnotStyle=1)  # -> Curve, Length, Domain
end = EndPoints(Curve=intcrv.Curve)  # -> Start, End
ln_2 = Line(StartPoint=end.Start, EndPoint=end.End)
neg_3 = Negative(Value=input12)
rotax = RotateAxis(Geometry=intcrv.Curve, Angle=degrees(input12), Axis=ln_2)  # -> Geometry, Transform
rotax_2 = RotateAxis(Geometry=intcrv.Curve, Angle=degrees(neg_3), Axis=ln_2)  # -> Geometry, Transform

# ----
# ** geometria barra
# *** estrutura A
expression = Expression(x=input12, y=input10, Expression="-((x*π/180)*y)")
panel_13 = Panel("BARRA 1")
addition_7 = Addition(A=input13, B="100")
neg_4 = Negative(Value=input13)
addition_8 = Addition(A="1.80", B=input10)
pt_3 = ConstructPoint(XCoordinate=neg_4, YCoordinate=expression, ZCoordinate=0)
pt_4 = ConstructPoint(XCoordinate=neg_4, YCoordinate=expression, ZCoordinate=addition_8)
pt_5 = ConstructPoint(XCoordinate=addition_7, YCoordinate=expression, ZCoordinate=addition_8)
pt_6 = ConstructPoint(XCoordinate=addition_7, YCoordinate=expression, ZCoordinate=0)
ln_3 = Line(StartPoint=pt_3, EndPoint=pt_6)
eval_2 = EvaluateCurve(Curve=reparameterize(ln_3), Parameter=0.5)  # -> Point, Tangent, Angle
addition_9 = Addition(A=addition_6, B=input08)
Z_3 = UnitZ(Factor=addition_9)
move_9 = Move(Geometry=eval_2.Point, Motion=Z_3)  # -> Geometry, Transform
merge = Merge(Data1=pt_4, Data2=move_9.Geometry, Data3=pt_5)
intcrv_2 = Interpolate(Vertices=merge, Degree=3, Periodic=False, KnotStyle=1)  # -> Curve, Length, Domain
end_2 = EndPoints(Curve=intcrv_2.Curve)  # -> Start, End
ln_4 = Line(StartPoint=end_2.Start, EndPoint=end_2.End)
rotax_3 = RotateAxis(Geometry=intcrv_2.Curve, Angle=degrees(input12), Axis=ln_4)  # -> Geometry, Transform

panel_14 = Panel("BARRA 1/2")
neg_5 = Negative(Value=input13)
division = Division(A="10", B=2)
addition_10 = Addition(A=input13, B="100")
pt_7 = ConstructPoint(XCoordinate=neg_5, YCoordinate=division, ZCoordinate=0)
pt_8 = ConstructPoint(XCoordinate=neg_5, YCoordinate=division, ZCoordinate=input16)
pt_9 = ConstructPoint(XCoordinate=addition_10, YCoordinate=division, ZCoordinate=input16)
pt_10 = ConstructPoint(XCoordinate=addition_10, YCoordinate=division, ZCoordinate=0)
ln_5 = Line(StartPoint=pt_7, EndPoint=pt_10)
eval_3 = EvaluateCurve(Curve=reparameterize(ln_5), Parameter=0.5)  # -> Point, Tangent, Angle
addition_11 = Addition(A=input01, B=input15)
Z_4 = UnitZ(Factor=addition_11)
move_10 = Move(Geometry=eval_3.Point, Motion=Z_4)  # -> Geometry, Transform
merge_2 = Merge(Data1=pt_8, Data2=move_10.Geometry, Data3=pt_9)
intcrv_3 = Interpolate(Vertices=merge_2, Degree=3, Periodic=False, KnotStyle=1)  # -> Curve, Length, Domain
end_3 = EndPoints(Curve=intcrv_3.Curve)  # -> Start, End
ln_6 = Line(StartPoint=end_3.Start, EndPoint=end_3.End)
rotax_4 = RotateAxis(Geometry=intcrv_3.Curve, Angle=degrees("0.0"), Axis=ln_6)  # -> Geometry, Transform

panel_15 = Panel("BANZO SUPERIOR 2")
pt_11 = ConstructPoint(XCoordinate=0, YCoordinate="10", ZCoordinate="1.80")
pt_12 = ConstructPoint(XCoordinate="100", YCoordinate="10", ZCoordinate="1.80")
ln_7 = Line(StartPoint=pt_11, EndPoint=pt_12)
eval_4 = EvaluateCurve(Curve=reparameterize(ln_7), Parameter=0.5)  # -> Point, Tangent, Angle
Z_5 = UnitZ(Factor=input01)
move_11 = Move(Geometry=eval_4.Point, Motion=Z_5)  # -> Geometry, Transform
merge_3 = Merge(Data1=pt_11, Data2=move_11.Geometry, Data3=pt_12)
intcrv_4 = Interpolate(Vertices=merge_3, Degree=3, Periodic=False, KnotStyle=1)  # -> Curve, Length, Domain
end_4 = EndPoints(Curve=intcrv_4.Curve)  # -> Start, End
ln_8 = Line(StartPoint=end_4.Start, EndPoint=end_4.End)
rotax_5 = RotateAxis(Geometry=intcrv_4.Curve, Angle=degrees("0.0"), Axis=ln_8)  # -> Geometry, Transform

panel_16 = Panel("BANZOS INFERIORES 2")
pt_13 = ConstructPoint(XCoordinate=neg, YCoordinate="10", ZCoordinate=addition_3)
pt_14 = ConstructPoint(XCoordinate=addition_4, YCoordinate="10", ZCoordinate=addition_3)
ln_9 = Line(StartPoint=pt_13, EndPoint=pt_14)
eval_5 = EvaluateCurve(Curve=reparameterize(ln_9), Parameter=0.5)  # -> Point, Tangent, Angle
Z_6 = UnitZ(Factor=addition_5)
move_12 = Move(Geometry=eval_5.Point, Motion=Z_6)  # -> Geometry, Transform
merge_4 = Merge(Data1=pt_13, Data2=move_12.Geometry, Data3=pt_14)
intcrv_5 = Interpolate(Vertices=merge_4, Degree=3, Periodic=False, KnotStyle=1)  # -> Curve, Length, Domain
end_5 = EndPoints(Curve=intcrv_5.Curve)  # -> Start, End
ln_10 = Line(StartPoint=end_5.Start, EndPoint=end_5.End)
neg_6 = Negative(Value=input11)
rotax_6 = RotateAxis(Geometry=intcrv_5.Curve, Angle=degrees(input11), Axis=ln_10)  # -> Geometry, Transform
rotax_7 = RotateAxis(Geometry=intcrv_5.Curve, Angle=degrees(neg_6), Axis=ln_10)  # -> Geometry, Transform

expression_2 = Expression(x=input11, y=input09, Expression=" (x*π/180) * y")
panel_17 = Panel("BARRA 2")
addition_12 = Addition(A=input13, B="100")
neg_7 = Negative(Value=input13)
addition_13 = Addition(A=expression_2, B="10")
pt_15 = ConstructPoint(XCoordinate=neg_7, YCoordinate=addition_13, ZCoordinate=0)
pt_16 = ConstructPoint(XCoordinate=neg_7, YCoordinate=addition_13, ZCoordinate=input09)
pt_17 = ConstructPoint(XCoordinate=addition_12, YCoordinate=addition_13, ZCoordinate=input09)
pt_18 = ConstructPoint(XCoordinate=addition_12, YCoordinate=addition_13, ZCoordinate=0)
ln_11 = Line(StartPoint=pt_15, EndPoint=pt_18)
eval_6 = EvaluateCurve(Curve=reparameterize(ln_11), Parameter=0.5)  # -> Point, Tangent, Angle
addition_14 = Addition(A=addition_5, B=input07)
Z_7 = UnitZ(Factor=addition_14)
move_13 = Move(Geometry=eval_6.Point, Motion=Z_7)  # -> Geometry, Transform
merge_5 = Merge(Data1=pt_16, Data2=move_13.Geometry, Data3=pt_17)
intcrv_6 = Interpolate(Vertices=merge_5, Degree=3, Periodic=False, KnotStyle=1)  # -> Curve, Length, Domain
end_6 = EndPoints(Curve=intcrv_6.Curve)  # -> Start, End
ln_12 = Line(StartPoint=end_6.Start, EndPoint=end_6.End)
rotax_8 = RotateAxis(Geometry=intcrv_6.Curve, Angle=degrees(neg_6), Axis=ln_12)  # -> Geometry, Transform

# ----
# ** geometria barra superior
# *** estrutura A
panel_18 = Panel("BANZO SUPERIOR 1")
pt_19 = ConstructPoint(XCoordinate=0, YCoordinate=0, ZCoordinate="1.80")
pt_20 = ConstructPoint(XCoordinate="100", YCoordinate=0, ZCoordinate="1.80")
ln_13 = Line(StartPoint=pt_19, EndPoint=pt_20)
eval_7 = EvaluateCurve(Curve=reparameterize(ln_13), Parameter=0.5)  # -> Point, Tangent, Angle
Z_8 = UnitZ(Factor=input02)
move_14 = Move(Geometry=eval_7.Point, Motion=Z_8)  # -> Geometry, Transform
merge_6 = Merge(Data1=pt_19, Data2=move_14.Geometry, Data3=pt_20)
intcrv_7 = Interpolate(Vertices=merge_6, Degree=3, Periodic=False, KnotStyle=1)  # -> Curve, Length, Domain
rotax_9 = RotateAxis(Geometry=intcrv_7.Curve, Angle="0.0", Axis=Line((0, 0, 0), (10, 0, 0)))  # -> Geometry, Transform

boxrec = BoxRectangle(Rectangle=move_7.Geometry, Height=Domain(0, 0.5))

multiplication = Multiplication(A=input00, B=1)
divide = DivideCurve(Curve=rotax_9.Geometry, Count=multiplication, Kinks=False)  # -> Points, Tangents, Parameters
divide_2 = DivideCurve(Curve=rotax.Geometry, Count=multiplication, Kinks=False)  # -> Points, Tangents, Parameters
divide_3 = DivideCurve(Curve=rotax_2.Geometry, Count=multiplication, Kinks=False)  # -> Points, Tangents, Parameters
divide_4 = DivideCurve(Curve=rotax_3.Geometry, Count=multiplication, Kinks=False)  # -> Points, Tangents, Parameters
divide_5 = DivideCurve(Curve=rotax_4.Geometry, Count=multiplication, Kinks=False)  # -> Points, Tangents, Parameters
divide_6 = DivideCurve(Curve=rotax_5.Geometry, Count=multiplication, Kinks=False)  # -> Points, Tangents, Parameters
divide_7 = DivideCurve(Curve=rotax_6.Geometry, Count=multiplication, Kinks=False)  # -> Points, Tangents, Parameters
divide_8 = DivideCurve(Curve=rotax_7.Geometry, Count=multiplication, Kinks=False)  # -> Points, Tangents, Parameters
divide_9 = DivideCurve(Curve=rotax_8.Geometry, Count=multiplication, Kinks=False)  # -> Points, Tangents, Parameters
ln_14 = Line(StartPoint=divide.Points, EndPoint=divide_2.Points)
ln_15 = Line(StartPoint=divide_2.Points, EndPoint=divide_3.Points)
ln_16 = Line(StartPoint=divide_3.Points, EndPoint=divide.Points)
ln_17 = Line(StartPoint=divide_3.Points, EndPoint=divide_4.Points)
ln_18 = Line(StartPoint=divide_2.Points, EndPoint=divide_4.Points)
ln_19 = Line(StartPoint=divide_6.Points, EndPoint=divide_5.Points)
ln_20 = Line(StartPoint=divide.Points, EndPoint=divide_5.Points)
ln_21 = Line(StartPoint=divide_5.Points, EndPoint=divide_3.Points)
ln_22 = Line(StartPoint=divide_7.Points, EndPoint=divide_5.Points)
ln_23 = Line(StartPoint=divide_6.Points, EndPoint=divide_7.Points)
ln_24 = Line(StartPoint=divide_7.Points, EndPoint=divide_8.Points)
ln_25 = Line(StartPoint=divide_8.Points, EndPoint=divide_6.Points)
ln_26 = Line(StartPoint=divide_8.Points, EndPoint=divide_9.Points)
ln_27 = Line(StartPoint=divide_7.Points, EndPoint=divide_9.Points)
merge_7 = Merge(
    Data1=ln_14,
    Data2=ln_15,
    Data3=ln_16,
    Data4=ln_17,
    Data5=ln_18,
    Data6=ln_23,
    Data7=ln_24,
    Data8=ln_25,
    Data9=ln_26,
    Data10=ln_27,
    Data11=ln_19,
    Data12=ln_20,
    Data13=ln_21,
    Data14=ln_22)
pline = PolyLine(Vertices=divide.Points, Closed=False)
pline_2 = PolyLine(Vertices=divide_6.Points, Closed=False)
pline_3 = PolyLine(Vertices=divide_2.Points, Closed=False)
pline_4 = PolyLine(Vertices=divide_3.Points, Closed=False)
pline_5 = PolyLine(Vertices=divide_7.Points, Closed=False)
pline_6 = PolyLine(Vertices=divide_8.Points, Closed=False)
pline_7 = PolyLine(Vertices=divide_4.Points, Closed=False)
pline_8 = PolyLine(Vertices=divide_5.Points, Closed=False)
pline_9 = PolyLine(Vertices=divide_9.Points, Closed=False)
explode = Explode(Curve=pline, Recursive=True)  # -> Segments, Vertices
explode_2 = Explode(Curve=pline_2, Recursive=True)  # -> Segments, Vertices
explode_3 = Explode(Curve=pline_3, Recursive=True)  # -> Segments, Vertices
explode_4 = Explode(Curve=pline_4, Recursive=True)  # -> Segments, Vertices
explode_5 = Explode(Curve=pline_5, Recursive=True)  # -> Segments, Vertices
explode_6 = Explode(Curve=pline_6, Recursive=True)  # -> Segments, Vertices
explode_7 = Explode(Curve=pline_7, Recursive=True)  # -> Segments, Vertices
explode_8 = Explode(Curve=pline_8, Recursive=True)  # -> Segments, Vertices
explode_9 = Explode(Curve=pline_9, Recursive=True)  # -> Segments, Vertices

panel_19 = Panel("support")
cluster = Cluster()  # -> G, geo_2
geo_3 = Geometry([cluster.G, cluster.geo_2])
preview_4 = CustomPreview(Geometry=geo_3, Shader=ColourSwatch(SwatchColor=RGB(219, 219, 219)))
rec_2pt_4 = Rectangle2Pt(Plane=PlaneXY(0, 0, 0), PointA="30.0,9.0,3.6", PointB="70.0,12.0,3.6", Radius=0)  # -> Rectangle, Length
height = Panel("7.0")
boxrec_2 = BoxRectangle(Rectangle=rec_2pt_4.Rectangle, Height=height)

panel_20 = Panel("Arquibancada")
python = PythonScript(start="4.00", end="96.00", tread="1.00", landing="0.40", steps="10", taper="0.00")  # -> out, a, b; inputs steps: Int32
# ---------- python: Python ----------
import rhinoscriptsyntax as rs
import Rhino.Geometry as geo
import scriptcontext as sc

cont = 0
cont2 = 0
cont3 = 0

line = []

while cont < steps:
    lineA = rs.AddLine([start + cont3, cont, cont2],
                       [end - cont3, cont, cont2])
    line.append(lineA)

    lineB = rs.AddLine([start + cont3, cont + 1, cont2],
                       [end - cont3,cont + 1,cont2])
    line.append(lineB)

    cont += tread
    cont2 += landing
    cont3 += taper

a = line



"""
lineA = rs.AddLine([0,0,0],[100,0,0])
lineB = rs.AddLine([0,1,0],[100,1,0])

lineC = rs.AddLine([0,1,0.3],[100,1,0.3])
lineD = rs.AddLine([0,2,0.3],[100,2,0.3])

a = lineA, lineB, lineC, lineD
"""
# ---------- end python ----------
line = Line(python.b)
line_2 = Line(python.a)
loft = Loft(Curves=line_2, Options={Adjust=False, Closed=False, LoftEnds=0, LoftSimp=0, LoftType=3, Rebuild=10, Refit=0.01})
preview_5 = CustomPreview(Geometry=[loft, boxrec_2], Shader=ColourSwatch(SwatchColor=RGB(255, 255, 255)))

intcrv_8 = Interpolate(Vertices=divide_8.Points, Degree=3, Periodic=False, KnotStyle=1)  # -> Curve, Length, Domain
intcrv_9 = Interpolate(Vertices=divide_9.Points, Degree=3, Periodic=False, KnotStyle=1)  # -> Curve, Length, Domain
intcrv_10 = Interpolate(Vertices=divide_9.Points, Degree=3, Periodic=False, KnotStyle=1)  # -> Curve, Length, Domain
intcrv_11 = Interpolate(Vertices=divide_7.Points, Degree=3, Periodic=False, KnotStyle=1)  # -> Curve, Length, Domain
intcrv_12 = Interpolate(Vertices=divide_7.Points, Degree=3, Periodic=False, KnotStyle=1)  # -> Curve, Length, Domain
intcrv_13 = Interpolate(Vertices=divide_5.Points, Degree=3, Periodic=False, KnotStyle=1)  # -> Curve, Length, Domain
intcrv_14 = Interpolate(Vertices=divide_5.Points, Degree=3, Periodic=False, KnotStyle=1)  # -> Curve, Length, Domain
intcrv_15 = Interpolate(Vertices=divide_3.Points, Degree=3, Periodic=False, KnotStyle=1)  # -> Curve, Length, Domain
intcrv_16 = Interpolate(Vertices=divide_3.Points, Degree=3, Periodic=False, KnotStyle=1)  # -> Curve, Length, Domain
intcrv_17 = Interpolate(Vertices=divide_4.Points, Degree=3, Periodic=False, KnotStyle=1)  # -> Curve, Length, Domain
intcrv_18 = Interpolate(Vertices=divide_4.Points, Degree=3, Periodic=False, KnotStyle=1)  # -> Curve, Length, Domain
intcrv_19 = Interpolate(Vertices=divide_2.Points, Degree=3, Periodic=False, KnotStyle=1)  # -> Curve, Length, Domain
loft_2 = Loft(
    Curves=[intcrv_8.Curve, intcrv_9.Curve],
    Options={Adjust=False, Closed=False, LoftEnds=0, LoftSimp=0, LoftType=0, Rebuild=10, Refit=0.01})
loft_3 = Loft(
    Curves=[intcrv_10.Curve, intcrv_11.Curve],
    Options={Adjust=False, Closed=False, LoftEnds=0, LoftSimp=0, LoftType=0, Rebuild=10, Refit=0.01})
loft_4 = Loft(
    Curves=[intcrv_12.Curve, intcrv_13.Curve],
    Options={Adjust=False, Closed=False, LoftEnds=0, LoftSimp=0, LoftType=0, Rebuild=10, Refit=0.01})
loft_5 = Loft(
    Curves=[intcrv_14.Curve, intcrv_15.Curve],
    Options={Adjust=False, Closed=False, LoftEnds=0, LoftSimp=0, LoftType=0, Rebuild=10, Refit=0.01})
loft_6 = Loft(
    Curves=[intcrv_16.Curve, intcrv_17.Curve],
    Options={Adjust=False, Closed=False, LoftEnds=0, LoftSimp=0, LoftType=0, Rebuild=10, Refit=0.01})
loft_7 = Loft(
    Curves=[intcrv_18.Curve, intcrv_19.Curve],
    Options={Adjust=False, Closed=False, LoftEnds=0, LoftSimp=0, LoftType=0, Rebuild=10, Refit=0.01})

panel_21 = Panel("Membrana translúcida")
merge_8 = Merge(Data1=loft_2, Data2=loft_3, Data3=loft_4, Data4=loft_5, Data5=loft_6, Data6=loft_7)
area = Area(Geometry=merge_8)  # -> Area, Centroid
loft_8 = Loft(
    Curves=[intcrv_10.Curve, intcrv_17.Curve],
    Options={Adjust=False, Closed=False, LoftEnds=0, LoftSimp=0, LoftType=0, Rebuild=10, Refit=0.01})
project = Project(Geometry=loft_8, Plane=PlaneXY(0, 0, 0))  # -> Geometry, Transform
preview_6 = CustomPreview(Geometry=merge_8, Shader=ColourSwatch(SwatchColor=RGBA(255, 255, 255, 206)))
ma = MassAddition(Input=area.Area)  # -> Result, PartialResults
info = Panel(ma.Result)

panel_22 = Panel("PAINEIS FOTOVOLTAICOS")
quads_2 = QuadPanels(Surface=loft_3, UDivisions=1, VDivisions=200)
quads_3 = QuadPanels(Surface=loft_4, UDivisions=1, VDivisions=200)
quads_4 = QuadPanels(Surface=loft_5, UDivisions=1, VDivisions=200)
quads_5 = QuadPanels(Surface=loft_6, UDivisions=1, VDivisions=200)
dispatch_2 = Dispatch(List=quads_2, DispatchPattern=[True, False])  # -> ListA, ListB
dispatch_3 = Dispatch(List=quads_3, DispatchPattern=[True, False])  # -> ListA, ListB
dispatch_4 = Dispatch(List=quads_4, DispatchPattern=[True, False])  # -> ListA, ListB
dispatch_5 = Dispatch(List=quads_5, DispatchPattern=[True, False])  # -> ListA, ListB
srf = Surface(dispatch_2.ListA)
srf_2 = Surface(dispatch_3.ListB)
srf_3 = Surface(dispatch_4.ListA)
srf_4 = Surface(dispatch_5.ListB)
srf_5 = Surface(dispatch_2.ListB)
srf_6 = Surface(dispatch_3.ListA)
srf_7 = Surface(dispatch_4.ListB)
srf_8 = Surface(dispatch_5.ListA)
merge_9 = Merge(Data1=srf_5, Data2=srf_6, Data3=srf_7, Data4=srf_8)
area_2 = Area(Geometry=merge_9)  # -> Area, Centroid
ma_2 = MassAddition(Input=area_2.Area)  # -> Result, PartialResults
info_2 = Panel(ma_2.Result)

# ----
# (1)	Veloc. Básica do vento (local)
# V0 = 30 m/s
# S1 = 1.0
# 
# S2 = b*Fr*(z/10)**p
# Cat. IV – Classe C
# Elevação(Z)-> pto. médio¹;	 b->0.84; Fr->ñ se aplica; 	P->0.134
# S2 = 0.82
# 
# S3 = 1.0 (fator estatístico)
# 
# 	Velocidade característica:
# Vk = V0 * S1 * S2 * S3
# 
# 	Pressão dinâmica do vento:
# q=0.613Vk**2
# 
# 	Força de arrasto (Fa):
# Fa = Ca * q * Ae
# ¹Ponto médio dado pelo modelo (varia durante a
#   otimização)
# *** O fator S1 pode assumir três valores diferentes,
#       a depender do tipo de terreno em que será construída
#       a edificação:
# *** O fator S2
#       - a categoria de rugosidade do terreno:
#       - a classe do edifício (determinado de acordo com
#        as dimensões):
# *** O fator S3 é um fator estatístico e considera o grau
#       de segurança requerido e a vida útil da edificação
# *** Fonte:
#       NBR 6123 - Forças devidas ao vento em edificações
panel_23 = Panel("ABSTRACT")

merge_10 = Merge(Data1=divide_3.Points, Data2=divide_4.Points, Data3=divide_5.Points, Data4=divide_7.Points, Data5=divide_9.Points)

mass_pv_kg_m² = Panel("15")
mass_membrane_kg_m² = Panel("7")
sobrecarga_kg_m² = Panel("30.0")

# ----
# Combinações de ações:
# 
# Combinação 01: 1.4*CP + 1.4*CA
# Combinação 02: 1.4*CP + 1.4*CA + 1.4*0.6*CV
# Combinação 03: 1.4*CP + 1.4*CV + 1.4*0.7*CA
# Combinação 04: 1.4*CP + 1.4*CV
# 
# A partir da determinação da combinação mais exigente, foram atribuídos os valores corrigidos para as entradas do Karamba:
# (1)	Carga permanente * 1.4
# (2)	Carga acidental * 1.4
# (3)	Carga de vento * 1.4 x 0.6
# *** As combinações foram calculadas sem o peso próprio,
#       já que o próprio Karamba faz esta conta.
# *** Neste caso, vou substituir o valor de 1.0 (negativo) pelo
#       valor 1.4 (negativo) no elemento de “carga de gravidade”
#       do próprio Karamba, responsável pelo calculo do peso
#       próprio.
# *** Fonte:
#       NBR 8681 - Ações e segurança nas estruturas - Proce-
#      -dimento
panel_24 = Panel("ABSTRACT")

multiplication_2 = Multiplication(A=ma_2.Result, B=mass_pv_kg_m²)
preview_7 = CustomPreview(Geometry=merge_9, Shader=ColourSwatch(SwatchColor=RGBA(158, 158, 158, 206)))

# ----
# Seção Tubular Circular (TC)
# 
#  0  >   D    --> dimensões externas (mm)
#  1  >   t     --> espessura da parede (mm)
#  2  >   m    --> massa por unidade de comp. (kg/m)
#  3  >   A    --> área da seção transversal (cm²)
#  4  >  Ix/Iy  --> momento de inércia (cm4)
#  5  > rx/ry  --> raio de giração (cm)
#  6  > Wx/Wy --> módulo de resistência elástico (cm³)
#  7  >  Zx/Zy --> módulo de resistência plástico (cm³)
#  8  >    J    --> const. torção (cm4)
#  9  >   Wt   --> módulo de resitência à torção (cm³)
#  10 >    U    --> área de superfície por unidade de comp. (m²/m)
# ** As bitolas são as frequentemente
#     produzidas e por isso adotadas como
#     preferenciais.
# *** Fonte:
#       http:// ww.vallourec.com/COUNTRIES/BRAZIL/PT/
#       Products-and-services/automotive-industrial-
#       tubes/Documents/Catalogo%20Estruturais.pdf
panel_25 = Panel("ABSTRACT")

vec2pt = Vector2Pt(PointA=pt_19, PointB=pt_20, Unitize=False)  # -> Vector, Length
vec2pt_2 = Vector2Pt(PointA=pt_11, PointB=pt_12, Unitize=False)  # -> Vector, Length
merge_11 = Merge(Data1=pt_19, Data2=pt_20)
merge_12 = Merge(Data1=pt_11, Data2=pt_12)
align = AlignPlane(Plane=pt_19, Direction=vec2pt.Vector)  # -> Plane, Angle
align_2 = AlignPlane(Plane=pt_11, Direction=vec2pt_2.Vector)  # -> Plane, Angle
pln = Plane(align.Plane)
pln_2 = Plane(align_2.Plane)

# ---- group: path of the .csv file
path = FilePath("C:\Users\Renato\OneDrive\github\generative_design_mecom\models_inputs\profiles2.csv")

# ----
# Selection of circular tubular section
python_2 = PythonScript(f=path, indexA=input17, indexB=input18, indexC=input19, indexD=input20)  # -> out, profileA, DiameterA, ThicknessA, profileB, DiameterB, ThicknessB, profileC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; inputs indexA: Int32, indexB: Int32, indexC: Int32, indexD: Int32
# ---------- python_2: Python ----------
import rhinoscriptsyntax as rs

lista = []               # U

f = open(f, 'r')         # Open file for reading

for line in f:
    lista_line = line.rstrip().split('\t')
    lista.append(lista_line)

print lista

W = []                     # lista de Módulo de Resistência Elástico
I = []                     # lista de Momento de Inércia --> Ix == Iy
Z = []                     # lista de Módulo de Resistência Plástico (cm³)

proA = lista[indexA]       # profile A ####### 

pA = proA[0].split(',')    # split strings
diameterA = pA[0] 
DiameterA = float(diameterA) / 10 
thicknessA = pA[1]
ThicknessA = float(thicknessA) / 10 
profileA = diameterA, thicknessA
W.append (pA[6])
I.append (pA[5])
Z.append (pA[7])

proB = lista[indexB]       # profile B ####### 

pB = proB[0].split(',')    # split strings
diameterB = pB[0]
DiameterB = float(diameterB) / 10
thicknessB = pB[1]  
ThicknessB = float(thicknessB) / 10 
profileB = diameterB, thicknessB
W.append (pB[6])
I.append (pB[5])
Z.append (pB[7])

proC = lista[indexC]       # profile C ####### 

pC = proC[0].split(',')    # split strings
diameterC = pC[0]
DiameterC = float(diameterC) / 10
thicknessC = pC[1]
ThicknessC = float(thicknessC) / 10 
profileC = diameterC, thicknessC
W.append (pC[6])
I.append (pC[5])
Z.append (pC[7])

proD = lista[indexD]       # profile D ####### 

pD = proD[0].split(',')    # split strings
diameterD = pD[0]
DiameterD = float(diameterD) / 10
thicknessD = pD[1]
ThicknessD = float(thicknessD) / 10 
profileD = diameterD, thicknessD
W.append (pD[6])
I.append (pD[5])
Z.append (pD[7])
# ---------- end python_2 ----------
profile_mm = Panel(python_2.profileA)
profile_mm_2 = Panel(python_2.profileB)
profile_mm_3 = Panel(python_2.profileC)
profile_mm_4 = Panel(python_2.profileD)

supp = SupportKaramba(PosInd=merge_12, PlaneOfReference=pln_2, menu=[buttons(on, on, on, off, off, off)])
supp_2 = SupportKaramba(PosInd=merge_11, PlaneOfReference=pln, menu=[buttons(on, on, on, off, off, off)])
panel_26 = Panel("Apoios")

# ---- group: Módulo de Resistência Elástico (cm3)
panel_27 = Panel(python_2.W)

# ---- group: Módulo de Resistência Plástico (cm³)
panel_28 = Panel(python_2.Z)

# ---- group: Momento de Inércia (cm4)
panel_29 = Panel(python_2.I)

# ----
merge_13 = Merge(Data1=explode.Segments, Data2=explode_2.Segments)
merge_14 = Merge(Data1=explode_7.Segments, Data2=explode_8.Segments, Data3=explode_9.Segments)
merge_15 = Merge(Data1=explode_3.Segments, Data2=explode_4.Segments, Data3=explode_5.Segments, Data4=explode_6.Segments)
entwine = Entwine(Branch00=merge_13, Branch01=merge_15, Branch02=merge_14, Branch03=merge_7, FlattenInputs=True)

# ----
# Valor de Χ em função do índice de esbeltez  λ0
# 
# ** fonte: NBR 8800
python_3 = PythonScript()  # -> out, a; disabled
# ---------- python_3: Python ----------
lista = {
         0.00: [1.000], 0.01: [1.000], 0.02: [1.000], 0.03: [1.000], 0.04: [0.999], 
         0.05: [0.999], 0.06: [0.998], 0.07: [0.998], 0.08: [0.997], 0.09: [0.997],
         0.10: [0.996], 0.11: [0.995], 0.02: [0.994], 0.13: [0.993], 0.14: [0.992], 
         0.15: [0.991], 0.16: [0.989], 0.17: [0.988], 0.18: [0.987], 0.19: [0.985],
         0.20: [0.983], 0.21: [0.982], 0.02: [0.980], 0.23: [0.978], 0.24: [0.976], 
         0.25: [0.974], 0.26: [0.972], 0.27: [0.970], 0.28: [0.968], 0.29: [0.965],
         0.30: [0.963], 0.31: [0.961], 0.32: [0.958], 0.33: [0.955], 0.34: [0.953], 
         0.35: [0.950], 0.36: [0.947], 0.37: [0.944], 0.38: [0.941], 0.39: [0.938],
         0.40: [0.935], 0.41: [0.932], 0.42: [0.929], 0.43: [0.926], 0.44: [0.922], 
         0.45: [0.919], 0.46: [0.915], 0.47: [0.912], 0.48: [0.908], 0.49: [0.904],
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         }

num = lista[0.26]
print num
# ---------- end python_3 ----------
python_4 = PythonScript()  # -> out, tabela; disabled
# ---------- python_4: Python ----------
tabela = {
         0.00: [1.000], 0.01: [1.000], 0.02: [1.000], 0.03: [1.000], 0.04: [0.999], 
         0.05: [0.999], 0.06: [0.998], 0.07: [0.998], 0.08: [0.997], 0.09: [0.997],
         0.10: [0.996], 0.11: [0.995], 0.02: [0.994], 0.13: [0.993], 0.14: [0.992], 
         0.15: [0.991], 0.16: [0.989], 0.17: [0.988], 0.18: [0.987], 0.19: [0.985],
         0.20: [0.983], 0.21: [0.982], 0.02: [0.980], 0.23: [0.978], 0.24: [0.976], 
         0.25: [0.974], 0.26: [0.972], 0.27: [0.970], 0.28: [0.968], 0.29: [0.965],
         0.30: [0.963], 0.31: [0.961], 0.32: [0.958], 0.33: [0.955], 0.34: [0.953], 
         0.35: [0.950], 0.36: [0.947], 0.37: [0.944], 0.38: [0.941], 0.39: [0.938],
         0.40: [0.935], 0.41: [0.932], 0.42: [0.929], 0.43: [0.926], 0.44: [0.922], 
         0.45: [0.919], 0.46: [0.915], 0.47: [0.912], 0.48: [0.908], 0.49: [0.904],
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         }

print (type(tabela))
# ---------- end python_4 ----------

panel_30 = Panel("A")
panel_31 = Panel("B")
panel_32 = Panel("C")
panel_33 = Panel("D")
cross_sections = CrossSectionsKaramba(
    ElementsIdentifiers=panel_30,
    Diameter_cm=python_2.DiameterA,
    WallThickness_cm=python_2.ThicknessA,
    mode="Circular Hollow")
cross_sections_2 = CrossSectionsKaramba(
    ElementsIdentifiers=panel_31,
    Diameter_cm=python_2.DiameterB,
    WallThickness_cm=python_2.ThicknessB,
    mode="Circular Hollow")
cross_sections_3 = CrossSectionsKaramba(
    ElementsIdentifiers=panel_32,
    Diameter_cm=python_2.DiameterC,
    WallThickness_cm=python_2.ThicknessC,
    mode="Circular Hollow")
cross_sections_4 = CrossSectionsKaramba(
    ElementsIdentifiers=panel_33,
    Diameter_cm=python_2.DiameterD,
    WallThickness_cm=python_2.ThicknessD,
    mode="Circular Hollow")

pipe = Pipe(Curve=merge_13, Radius="0.200", Caps=0)
pipe_2 = Pipe(Curve=merge_15, Radius="0.0603", Caps=0)
pipe_3 = Pipe(Curve=merge_14, Radius="0.0422", Caps=0)
pipe_4 = Pipe(Curve=merge_7, Radius="0.180", Caps=0)
geo_4 = Geometry([pipe, pipe_2, pipe_3, pipe_4])

panel_34 = Panel("Elementos")
panel_35 = Panel("D")
panel_36 = Panel("""A
B
C
D""")
panel_37 = Panel("A")
panel_38 = Panel("B")
panel_39 = Panel("C")
linetobeam = LineToBeamKaramba(Line=entwine, New=True, Remove=True, LimitDistance_m=0.005, BeamIdentifier=graft(panel_36))  # -> Points, flatten(Element), Info
modifyelem = ModifyElementKaramba(BeamIdentifier=panel_37, Alpha_deg="90", mode="Beam")
modifyelem_2 = ModifyElementKaramba(BeamIdentifier=panel_38, Alpha_deg="90", mode="Beam")
modifyelem_3 = ModifyElementKaramba(BeamIdentifier=panel_39, Alpha_deg="90", mode="Beam")
modifyelem_4 = ModifyElementKaramba(BeamIdentifier=panel_35, Bending=Toggle(True), mode="Beam")

panel_40 = Panel("""A
B
C
D""")
matselect = MaterialSelectionKaramba(ElementsIdentifiers=panel_40, menu=[dropdown(1), dropdown(54)])
panel_41 = Panel("Material")

# ----
# Coeficiente de flambagem por flexão de elementos isolados
# 
# a --> Kx/Ky = 0.5; valor teórico --> 0.65; valor recomendado
# b --> Kx/Ky = 0.7; valor teórico --> 0.80; valor recomendado
# c --> Kx/Ky = 1.0; valor teórico --> 1.20; valor recomendado
# d --> Kx/Ky = 1.0; valor teórico --> 1.00; valor recomendado
# e --> Kx/Ky = 2.0; valor teórico --> 2.10; valor recomendado
# f --> Kx/Ky = 2.0; valor teórico --> 2.00; valor recomendado
# 
# * condição:
#   a - 1ª e 2º extremidade: rotação e translação impedidas;
#   b - 1ª extremidade: rotação livre, translação impedida
#       2º extremidade: rotação e translação impedida;
#   c - 1ª extremidade: rotação impedida, translação livre
#       2º extremidade: rotação e translação impedida;
#   d - 1ª e 2ª extremidade: rotação livre, translação impedida,
#   e - 1ª extremidade: rotação e translação livre,
#       2º extremidade: rotação e translação impedida;
#   f - 1ª extremidade: rotação impedida, translação livre,
#       2º extremidade: rotação livre, translação impedida;
# 
# ** fonte: Tabela E.1 - NBR 8800
# Tração - Dimensionamento
# 
# Ntsd ≤ Ntrd
# 
# onde:
# Ntsd = força axial de tração solicitante de cálculo;
# 
# Ntrd = força axial de tração resistente de cálculo.
# 
# A força axial de tração resistente de cálculo deve ser o menor dos valores obtidos nas esquações abaixos:
# 
# Ntrd = Ag fy / γa1
# 
# Ntrd = Ae fu / γa2
# Compressão - Dimensionamento
# 
# Ncsd ≤ Ncrd
# 
# onde:
# Nc, sd = força axial de compressão solicitante de cálculo;
# Nc, rd = força axial de compressão resistente de cálculo;
# 
# A força axial resistente de cálculo é dada pela equação abaixo:
# 
# Ncrs = χ Q Ag fy / γa1
# 
# onde:
# 
# χ = fator de redução associado à resistência à compressão determinado:
# 
# λ ≤ 1.5 --> χ = 0.658 ** (λ**2)
# λ > 1.5 --> χ = 0.877 / (λ**2)
# 
# λ = √ (Q Ag fy) / Ne
# 
# *************
# Fator de redução para flambagem local -
# Elementos de seção tubular circular
# 
# Não é previsto utilização de seções com D/t > 0.45 E / fy (NBR 8800)
# 
# Q = 1.00, para D/t ≤ E/fy
# 
# Q = 0.038 E / fy(D/t) + 2/3, para 0.11E/fy < D/t ≤ 0.45 E/fy
# Momento fletor resistente de cálculo
# 
# para seções superiores com relação:
# D/t > 0.45 * E / fy
# 
# equação 01
# Mrd = Mp1/γa1 --> para λ <= λp
# 
# onde:
# Mpl - momento fletor de plastificação da seção transversal, igual ao produto do módulo de resistência plástico (Z) pela resistência ao escoamento do aço (fy). (NBR 8800, p. 147)
# 
# 
# equação 02
# Mrd = 1/γa1((0.021E / (D/t)) + fy) * w --> para λp < λ < λr
# 
# equação 03
# Mrd = (1 * 0.33E / γa1 * D/t) * W      --> para λ > λr
# 
# com:
# λ = D / t
# λp = 0.07 * (E / fy)
# λr = 0.31 * (E / fy)
# CRIAR penalidade para seções com D/t > 0.45 E / fy
# ** Reference NBR 8800
panel_42 = Panel("ABSTRACT")  # disabled

# ----
# * Resistência ao escoamento do aço 250 MPa;
# 
# ** Resistance (KN/mm²)
# * Módulo de elasticidade (KN/mm²)
# 
# ** E = 200 000 MPa
panel_43 = Panel("Condição de restrição")  # disabled

crosec = CrossSectionKaramba([cross_sections, cross_sections_2, cross_sections_3, cross_sections_4])

panel_44 = Panel("Etapa 02")  # disabled

support = SupportKaramba([supp_2, supp])
panel_45 = Panel("200")  # disabled
panel_46 = Panel("0.25")  # disabled
panel_47 = Panel("2.10")  # disabled
diameter = Merge(Data1=python_2.DiameterA, Data2=python_2.DiameterB, Data3=python_2.DiameterC, Data4=python_2.DiameterD)  # disabled
thickness = Merge(Data1=python_2.ThicknessA, Data2=python_2.ThicknessB, Data3=python_2.ThicknessC, Data4=python_2.ThicknessD)  # disabled
área_pv = Panel(ma_2.Result)  # disabled
merge_16 = Merge(Data1=loft_3, Data2=loft_4, Data3=loft_5, Data4=loft_6)  # disabled
# Calculate Nt,rd and Nc,rd
python_5 = PythonScript(diameterCm=diameter, thicknessCm=thickness, fy=panel_46, E=panel_45, I=python_2.I, K=panel_47)  # -> out, forceTraction, forceCompression; inputs diameterCm: list, thicknessCm: list, E: Int32, I: list
# ---------- python_5: Python ----------
import math

listDiameter = (diameterCm)
listThickness = (thicknessCm)
num = (len(listThickness))

cont = 0

momentInertia = I 

γa1 = 1.10

forceTraction = []
forceCompression = []

while cont < num:

    D = listDiameter[cont] * 10      # diameter (cm -> mm) ATENÇÃO (conferir se é em cm)
    t = listThickness[cont] * 10     # thickness (cm -> mm)
    
    Ag = math.pi * (D * t - t ** 2)  # profile area
    
    #traction

    Ntrd = (Ag * fy) / γa1           # força axial de tração resistente de cálculo
    forceTraction.append(Ntrd)
    print ('Nt,rd %s: %.2f KN' % (cont, Ntrd))

    #compression

    if D/t <= E/fy:
        Q = 1.00
    else:
        Q = (0.038 * E) / ((fy * (D / t)) + 2 / 3)                  # para 0.11E/fy < D/t ≤ 0.45 E/fy
                                                                    # ATENÇÃO Não é previsto utilização de seções com D/t > 0.45 E / fy (NBR 8800)

    Ne = (((math.pi)** 2) * (E * momentInertia[cont])) / (K) ** 2   # KL tabela E.1 NBR 8800
    cont += 1
    λ = math.sqrt(Q * Ag * fy) / Ne                                 # índice de esbeltez reduzido    
    if λ <= 1.5:
        χ = 0.658 ** (λ ** 2)                                       # (χ)fator de redução associado à resistência à compressão
    else:
        χ = 0.877 / (λ ** 2)
    Ncrs = (χ * Q * Ag * fy) / γa1                                  # força axial de compressão resistente de cálculo
    forceCompression.append(Ncrs)
    print ('Nc,rd %s: %.2f KN' % (cont, Ncrs))
    
#print λ
# ---------- end python_5 ----------
panel_48 = Panel("PV PERFORMANCE ANALYSIS")  # disabled
python_6 = PythonScript(diameterCm=diameter, thicknessCm=thickness, fy=panel_46, E=panel_45, W=python_2.W, Z=python_2.Z)  # -> out, listMrd; inputs diameterCm: list, thicknessCm: list, W: list, Z: list
# ---------- python_6: Python ----------
import math

listDiameter = (diameterCm)
listThickness = (thicknessCm)
num = (len(listThickness))

ResistanceElastic = W

γa1 = 1.10

cont = 0

listMrd = []

while cont < num:

    D = listDiameter[cont] * 10      # diameter (cm -> mm) ATENÇÃO (conferir se é em cm)
    t = listThickness[cont] * 10     # thickness (cm -> mm)
    
    Ag = math.pi * (D * t - t ** 2)  # profile area
    #print ('Area %.2f' % Ag)
    
    λ = D / t                        # parâmetro de esbeltez da seção transversal
    λp = 0.07 * (E / fy)             # parâmetro de esbeltez correspondente à plastificação
    λr = 0.31 * (E / fy)             # parâmetro de esbeltez correspondente ao início do escoamento
    #print ('P.E. seção trans: %s' %λ)
    #print ('P.E. plastiicação: %s' %λp)
    #print ('P.E. escoamento: %s' %λr)
    
    if λ <= λp:           # equação 67
        Mrd = ((Z[cont]) * fy) / γa1   # Mpl (Mom. Fletor de Plastificação)= Z * fy
        listMrd.append(Mrd)
    elif λp < λ < λr:     # equação 68
        Mrd = ((1/γa1) * ((0.021 * E) / (D / t)) + fy) * ResistanceElastic[cont]
        listMrd.append(Mrd)
    else:                 # equação 69
        Mrd = ((1 * 0.33 * E) / (γa1 * (D / t))) * ResistanceElastic[cont]
        listMrd.append(Mrd)
    cont += 1
    
    print ('Mrd %s: %.2f KNm' % (cont, Mrd))
# ---------- end python_6 ----------
panel_49 = Panel("Calculate Mrd")  # disabled

# ---- group: PVsurface normal direction check
panel_50 = Panel("0.5,0.5")  # disabled
evalsrf = EvaluateSurface(Surface=reparameterize(graft(merge_16)), Point=panel_50)  # -> Point, Normal, Frame; disabled
vdis = VectorDisplay(Anchor=evalsrf.Point, Vector=expr("x*10", evalsrf.Normal))  # disabled

# ----
panel_51 = Panel("https://energyplus.net/weather-download/south_america_wmo_region_3/BRA//BRA_MG_Ouro.Branco.868230_INMET/all")  # disabled
info_3 = Panel(python_6.out)  # disabled

# ---- group: extract surface from polysurface
srf_9 = Surface(flatten(merge_16))  # disabled

# ----
info_4 = Panel(python_5.out)  # disabled
ladybug = Ladybug_Ladybug()  # -> Vviiiiiiiiiizzz; disabled; plug-in component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
epw_stat = Ladybug_OpenEPWAndSTATWeatherFiles(weatherFileURL=panel_51)  # -> epwFile, statFile; disabled; plug-in component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
panel_52 = Panel("2385 - Centrosolar America VS-160C1")  # disabled
panel_53 = Panel("Search Msd maximum")  # disabled
path_2 = FilePath(epw_stat.epwFile)  # disabled
path_3 = FilePath("C:\Users\Renato\Desktop\CECModulesCompleta.csv")  # disabled
panel_54 = Panel("2")  # disabled
panel_55 = Panel("50")  # disabled
panel_56 = Panel("2385")  # disabled
# download the "California Energy Commission (CEC) Modules" .csv file from bottom of the following page:
# https://sam.nrel.gov/libraries
# 
# And add its file path to the "_modulesLibraryFile" input
importcecphotovoltaicsmodule = Ladybug_ImportCECPhotovoltaicsModule(modulesLibraryFile=path_3, moduleIndex=panel_56, newModuleMountType=panel_54, moduleActiveAreaPercent=panel_55)  # -> readMe, allModuleNames, port, moduleName, moduleMaterial, moduleMountType, moduleArea, modulePower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; disabled; plug-in component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
toggle = BooleanToggle(False)  # disabled
photovoltaicssurface = Ladybug_PhotovoltaicsSurface(
    epwFile=path_2,
    PVsurface=graft(srf_9),
    PVsurfacePercent=100,
    DCtoACderateFactor=0.85,
    PVmoduleSettings=importcecphotovoltaicsmodule.PVmoduleSettings,
    north=0,
    runIt=toggle)  # -> readMe, port, ACenergyPerHour, ACenergyPerYear, averageDailyACenergyPerYear, port_2, DCenergyPerHour, totalRadiationPerHour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; disabled; plug-in component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
punishment = Panel("100000")  # disabled
forcecompression = Number(python_5.forceCompression)  # disabled
forcetraction = Number(python_5.forceTraction)  # disabled
support_2 = Number("100")  # disabled
bang = ExplodeTree(Data=photovoltaicssurface.ACenergyPerYear)  # -> Branch0, Branch1, Branch2, Branch3; disabled
info_5 = Panel([bang.Branch0, bang.Branch1, bang.Branch2, bang.Branch3])  # disabled
addition_15 = Addition(A=bang.Branch0, B=bang.Branch1, C=bang.Branch2, D=bang.Branch3)  # disabled
panel_57 = Panel("Total Energy KWh/year")  # disabled
# AC energy Per Year (Generic Data)
# Total AC power output for a whole year. - In kWh.
info_6 = Panel(addition_15)  # disabled
aço = Panel("20.00")  # disabled
kwh = Panel("0.587")  # disabled
panel_58 = Panel("Fitness")  # disabled
galapagos = Galapagos(
    fitness=goal,
    gene=[barextrz, alturasup, eixo_x, eixo_x_2, barraextrem, bansup, barextrem, number_slider, ptmedb, ptmed, ângulo, ptmed_2, ptmedb_2, sistptmed, ângulo_2, barptmed, bansupptmed, index_d, index_b, index_a, index_c])

loft_9 = Loft(
    Curves=[pline_6, pline_9],
    Options={Adjust=False, Closed=False, LoftEnds=0, LoftSimp=0, LoftType=0, Rebuild=10, Refit=0.01})
panel_59 = Panel("DETERMINAÇÃO DAS CARGAS")
area_3 = Area(Geometry=loft_9)  # -> Area, Centroid
pdecon = Deconstruct(Point=area_3.Centroid)  # -> XComponent, YComponent, ZComponent
s1 = Panel("1.0")
s3 = Panel("1.0")
s2 = Panel("""categoria IV
classe C""")
v0 = Panel("30.0")
coeficiente_arrasto_ca = Panel("30.0")
área_ae = Panel(area_3.Area)
multiplication_3 = Multiplication(A=ma.Result, B=mass_membrane_kg_m²)
area_4 = Area(Geometry=project.Geometry)  # -> Area, Centroid
pt_21 = Point(merge_10)
p = Panel("0.134")
z = Panel(pdecon.ZComponent)
b = Panel("0.84")
multiplication_4 = Multiplication(A=area_4.Area, B=sobrecarga_kg_m²)
# (...) vencimento de grandes vãos e baixo peso da membrana: apresentam peso de duas ordens de grandeza menor do que o de estruturas em concreto armado e uma ordem de grandeza menor que estruturas convencionais de aço. Exemplo: uma cobertura para vãos livres da ordem de 30m apresenta densidade de carga estrutural de até 300N/m2, no caso das estruturas metálicas convencionais; com as tensoestruturas, vãos da ordem de 50m a 70m apresentam no máximo 60N/m2.
# Fonte: http://www.infohab.org.br/entac2014/2006/artigos/ENTAC2006_3132_3141.pdf
# 
# Destaca-se em primeiro lugar, a facilidade para cobrir grandes espaços, a um custo relativamente reduzido e, sobretudo, com grande rapidez de execução. A capacidade estrutural da membrana (e seu reduzido peso próprio de 1 a 5 Kg/m2), permitem vencer grandes vãos, a um custo mínimo de estrutura suporte.
# fonte: http://wwwo.metalica.com.br/tensoestrutura-comentarios-tecnicos-e-caracteristicas
# 
# 
# O baixo peso. Apresentam peso de duas ordens de grandeza menor do que o de estruturas em concreto armado e uma ordem de grandeza menor que estruturas convencionais de aço. Exemplo: uma cobertura para vãos livres da ordem de 30m pesa até 30kg/m2, no caso das estruturas metálicas convencionais; com as tensoestruturas vãos da ordem de 50m a 70m equivalem a no máximo 6kg/m2. Fonte:http://wwwo.metalica.com.br/tensoestrutura-cobertura-de-estruturas-de-membrana-tensionada
lng = ListLength(List=pt_21)
força_de_arrasto_fa = PythonScript(s1=s1, b=b, p=p, z=z, s3=s3, v0=v0, Ae=área_ae)  # -> out, a
# ---------- força_de_arrasto_fa: Python ----------
#determinar a velocidade característica do vento


s2 = b * (z / 10) ** p
#print ("S2 = %.2f" %s2)

vk = v0 * s1 * s2 * s3
print ("velocidade característica (Vk)= %.2f m/s" %vk)

#pressão dinâmica do vento

q = (0.613 * (vk) ** 2)/1000                       #divisão por 1000 --> N para KN
print ("pressão dinâmica do vento (q)= %.2f KN/m²" %q) 

# componente global da força Fa na direção do vento
Ca = 1.3 # provisório, entender como funciona Tabela

Fa = Ca * q * Ae
print ("força de arrasto (Fa) = %.2f KN" %Fa)

a = Fa
# ---------- end força_de_arrasto_fa ----------
info_7 = Panel(força_de_arrasto_fa.out)
num = Number(força_de_arrasto_fa.a)
combinações_de_ações = PythonScript(celulasPV=multiplication_2, membrane=multiplication_3, sobrecarga=multiplication_4, CV=num)  # -> out, Permanentes, Acidentais, Vento
# ---------- combinações_de_ações: Python ----------
#combinações de ações

"""
CP é a combinação de ações permanentes, neste caso:
peso próprio cobertura e peso próprio das placas PV;
CA é as ações acidentais, neste caso, sobrecarga e
CV é as combinações de vento.

#Quando consideramos as ações permanentes todas 
agrupadas as combinações passam a ser:
"""

fatorM = 0.0098 # fator de multiplicação

# somátoria das cargas ações permanentes (menos peso próprio)
CP = celulasPV + membrane
CA = sobrecarga

c1 = (1.4 * CP) + (1.4 * CA)
c11 = c1 * fatorM
print ("combinação 1 = %.2f + PP" %c11)

c2 = (1.4 * CP) + (1.4 * CA) + (1.4 * 0.6 * CV)
c21 = c2 * fatorM
print ("combinação 2 = %.2f + PP" %c21)

c3 = (1.4 * CP) + (1.4 * CV) + (0.70 * CA)
c31 = c3 * fatorM
print ("combinação 3 = %.2f + PP" %c31)

c4 = (1.4 * (CP * fatorM)) + (1.4 * CV)
print ("combinação 4 = %.2f + PP" %c4)

#OUTPUTS
#permanentes
Permanentes = - (CP * 1.4 * fatorM)

#acidentais
Acidentais = - (CA * 1.4 * fatorM)

#vento
Vento = - (1.4 * 0.6 * CV * fatorM)
# ---------- end combinações_de_ações ----------
info_8 = Panel(combinações_de_ações.out)
pt_22 = Point(flatten(pt_21))
pt_23 = Point([explode_6.Vertices, explode_9.Vertices])
carga_de_vento = Number(combinações_de_ações.Vento)
lng_2 = ListLength(List=pt_23)
carga_por_nó_vento = Division(A=carga_de_vento, B=lng_2)
num_2 = Number(carga_por_nó_vento)
pt_24 = Point(flatten(pt_23))
Y = UnitY(Factor=num_2)

carga_permanente = Number(combinações_de_ações.Permanentes)
carga_acidental = Number(combinações_de_ações.Acidentais)
addition_16 = Addition(A=carga_permanente, B=carga_acidental)
kn = Panel(carga_de_vento)
carga_por_nó_cp_ca = Division(A=addition_16, B=lng)
panel_60 = Panel(carga_por_nó_vento)  # "kN/m²"
num_3 = Number(carga_por_nó_cp_ca)
panel_61 = Panel(num_3)  # "kN/m²"

Z_9 = UnitZ(Factor=num_3)

panel_62 = Panel("Cargas")
loads = LoadsKaramba(ForceVector=Z_9, Local=True, PosInd=pt_22, LCase=0, mode="Point")
loads_2 = LoadsKaramba(ForceVector=Y, Local=True, PosInd=pt_24, LCase=0, mode="Point")
loads_3 = LoadsKaramba(Vector=Vector(0, 0, -1), LCase=0, mode="Gravity")

load = LoadKaramba(flatten([loads_3, loads, loads_2]))
assemble = AssembleModelKaramba(
    Elem=[linetobeam.Element, modifyelem_4, modifyelem_3, modifyelem, modifyelem_2],
    Support=support,
    Load=load,
    CrossSection=crosec,
    Material=matselect,
    LimitDistance_m=0.005)  # -> Model, Info, Mass_kg, CenterOfGravity
analyzethi = AnalyzeThIKaramba(Model=assemble.Model)  # -> CalculatedModel, MaximumDisplacement_m, ResultingForceOfGravity_kN, ElasticEnergy_kNm

panel_63 = Panel("A")
panel_64 = Panel("B")
panel_65 = Panel("C")
panel_66 = Panel("D")
b_res_force = BeamResultantForcesKaramba(
    AnalyzedModel=analyzethi.CalculatedModel,
    BeamIdentifiers=panel_63,
    LoadCase=-1,
    MaximumProbingDistance_m=-1,
    NumberOfProbingPointsPerElement=3)  # -> AnalyzedModel, NormalForce_kN, ResultantBendingMoment_kNm, ResultantShearForce_kN
b_res_force_2 = BeamResultantForcesKaramba(
    AnalyzedModel=analyzethi.CalculatedModel,
    BeamIdentifiers=panel_64,
    LoadCase=-1,
    MaximumProbingDistance_m=-1,
    NumberOfProbingPointsPerElement=3)  # -> AnalyzedModel, NormalForce_kN, ResultantBendingMoment_kNm, ResultantShearForce_kN
b_res_force_3 = BeamResultantForcesKaramba(
    AnalyzedModel=analyzethi.CalculatedModel,
    BeamIdentifiers=panel_65,
    LoadCase=-1,
    MaximumProbingDistance_m=-1,
    NumberOfProbingPointsPerElement=3)  # -> AnalyzedModel, NormalForce_kN, ResultantBendingMoment_kNm, ResultantShearForce_kN
b_res_force_4 = BeamResultantForcesKaramba(
    AnalyzedModel=analyzethi.CalculatedModel,
    BeamIdentifiers=panel_66,
    LoadCase=-1,
    MaximumProbingDistance_m=-1,
    NumberOfProbingPointsPerElement=3)  # -> AnalyzedModel, NormalForce_kN, ResultantBendingMoment_kNm, ResultantShearForce_kN

modelview = ModelViewKaramba(Model=analyzethi.CalculatedModel, LoadCaseFactorsForLinearSuperposition=1, IndexIncrementOfVisibleLoadcase=0)  # -> Model, DeformedMesh, DeformedAxes, DeformedModel
max_displacement_m = Panel(analyzethi.MaximumDisplacement_m)
model_mass_kg = Panel(assemble.Mass_kg)
beamview = BeamViewKaramba(Model=modelview.Model)  # -> Model, MeshesOfRenderedBeams, DeformedBeamAxes, LegendColors, LegendTags
legend = Legend(Colour=beamview.LegendColors, Tags=beamview.LegendTags, LegendType=1)
# Search Nt,sd and Nc,sd maximum
python_7 = PythonScript(normalForce=b_res_force.NormalForce_kN)  # -> out, traction, compression; inputs normalForce: list
# ---------- python_7: Python ----------
# ***** NORMAL FORCE *****
L = normalForce

listMax = map(abs, L)
listMax.sort()
forceMax = (listMax[-1])

traction = forceMax
compression = forceMax

print ('A --> Nt,sd: %0.2f KN'% traction)
print ('A --> Nc,sd: %0.2f KN'% compression)
# ---------- end python_7 ----------
python_8 = PythonScript(normalForce=b_res_force_2.NormalForce_kN)  # -> out, traction, compression; inputs normalForce: list; disabled
# ---------- python_8: Python ----------
# ***** NORMAL FORCE *****
L = normalForce

listMax = map(abs, L)
listMax.sort()
forceMax = (listMax[-1])

traction = forceMax
compression = forceMax

print ('B --> Nt,sd: %0.2f KN'% traction)
print ('B --> Nc,sd: %0.2f KN'% compression)
# ---------- end python_8 ----------
python_9 = PythonScript(normalForce=b_res_force_3.NormalForce_kN)  # -> out, traction, compression; inputs normalForce: list; disabled
# ---------- python_9: Python ----------
# ***** NORMAL FORCE *****
L = normalForce

listMax = map(abs, L)
listMax.sort()
forceMax = (listMax[-1])

traction = forceMax
compression = forceMax

print ('C --> Nt,sd: %0.2f KN'% traction)
print ('C --> Nc,sd: %0.2f KN'% compression)
# ---------- end python_9 ----------
python_10 = PythonScript(normalForce=b_res_force_4.NormalForce_kN)  # -> out, traction, compression; inputs normalForce: list; disabled
# ---------- python_10: Python ----------
# ***** NORMAL FORCE *****
L = normalForce

listMax = map(abs, L)
listMax.sort()
forceMax = (listMax[-1])

traction = forceMax
compression = forceMax

print ('D --> Nt,sd: %0.2f KN'% traction)
print ('D --> Nc,sd: %0.2f KN'% compression)
# ---------- end python_10 ----------
python_11 = PythonScript(bendingMoment=b_res_force.ResultantBendingMoment_kNm)  # -> out, maximumBendingMoment; inputs bendingMoment: list
# ---------- python_11: Python ----------
listBM = bendingMoment

listBM.sort()
maximumBendingMoment = listBM[-1]

print ('A --> Msd: %0.2f KNm'% maximumBendingMoment)
# ---------- end python_11 ----------
python_12 = PythonScript(bendingMoment=b_res_force_2.ResultantBendingMoment_kNm)  # -> out, maximumBendingMoment; inputs bendingMoment: list; disabled
# ---------- python_12: Python ----------
listBM = bendingMoment

listBM.sort()
maximumBendingMoment = listBM[-1]

print ('B --> Msd: %0.2f KNm'% maximumBendingMoment)
# ---------- end python_12 ----------
python_13 = PythonScript(bendingMoment=b_res_force_3.ResultantBendingMoment_kNm)  # -> out, maximumBendingMoment; inputs bendingMoment: list; disabled
# ---------- python_13: Python ----------
listBM = bendingMoment

listBM.sort()
maximumBendingMoment = listBM[-1]

print ('C --> Msd: %0.2f KNm'% maximumBendingMoment)
# ---------- end python_13 ----------
python_14 = PythonScript(bendingMoment=b_res_force_4.ResultantBendingMoment_kNm)  # -> out, maximumBendingMoment; inputs bendingMoment: list; disabled
# ---------- python_14: Python ----------
listBM = bendingMoment

listBM.sort()
maximumBendingMoment = listBM[-1]
maximumBendingMoment = listBM[-1]

print ('D --> Msd: %0.2f KNm'% maximumBendingMoment)
# ---------- end python_14 ----------
# Simplificação:
# Foi atribuido a maior solicitação, em valores absolutos, tanto para tração como para compressão. Isso para evitar "bug" em caso de situações que solicitarem apenas uma das forças para uma determinada seção.
info_9 = Panel([python_7.out, python_8.out, python_9.out, python_10.out])  # disabled
info_10 = Panel([python_11.out, python_12.out, python_13.out, python_14.out])  # disabled
bendingmoment = Merge(
    Data1=python_11.maximumBendingMoment,
    Data2=python_12.maximumBendingMoment,
    Data3=python_13.maximumBendingMoment,
    Data4=python_14.maximumBendingMoment)  # disabled
traction = Merge(Data1=python_7.traction, Data2=python_8.traction, Data3=python_9.traction, Data4=python_10.traction)  # disabled
compression = Merge(Data1=python_7.compression, Data2=python_8.compression, Data3=python_9.compression, Data4=python_10.compression)  # disabled
b_res_force_5 = BeamResultantForcesKaramba(AnalyzedModel=beamview.Model, LoadCase=-1, MaximumProbingDistance_m=-1, NumberOfProbingPointsPerElement=3)  # -> AnalyzedModel, NormalForce_kN, ResultantBendingMoment_kNm, ResultantShearForce_kN; disabled
python_15 = PythonScript(x=beamview.LegendTags)  # -> out, a; inputs x: list; disabled
# ---------- python_15: Python ----------
import re

a = []

x.pop(0)

for val in x:
    try:
        a.append( float(re.sub(r'[^\d.-e+]+', '', val)) )
    except ValueError:
        continue
# ---------- end python_15 ----------
abs = Absolute(Value=python_15.a)  # disabled
bnd = Bounds(Numbers=b_res_force_5.NormalForce_kN)  # disabled
bnd_2 = Bounds(Numbers=b_res_force_5.ResultantBendingMoment_kNm)  # disabled
bnd_3 = Bounds(Numbers=b_res_force_5.ResultantShearForce_kN)  # disabled
bnd_4 = Bounds(Numbers=abs)  # disabled
maximumdisplacement = Number(analyzethi.MaximumDisplacement_m)  # disabled
dedomain = DeconstructDomain(Domain=bnd)  # -> Start, End; disabled
dedomain_2 = DeconstructDomain(Domain=bnd_2)  # -> Start, End; disabled
dedomain_3 = DeconstructDomain(Domain=bnd_3)  # -> Start, End; disabled
dedomain_4 = DeconstructDomain(Domain=bnd_4)  # -> Start, End; disabled
mass = Number(assemble.Mass_kg)  # disabled
abs_2 = Absolute(Value=dedomain.Start)  # disabled

# ----
# Sd ≤ Rd
# 
# Sd = Sk * Yf -- Yf > 1
# Rd = Rk / Ym -- Ym > 1
# Structural analysis:
# 
# Nt,sd ≤ Nt,rd
# Nc,sd ≤ Nc,rd
# Msd ≤ Mrd
# Max. Displacement  ≤ ℓ/300
python_16 = PythonScript(
    support=support_2,
    maximumDisplacement=maximumdisplacement,
    traction=traction,
    forceTraction=forcetraction,
    compression=compression,
    forceCompression=forcecompression,
    flecha=bendingmoment,
    forceFlecha=python_6.listMrd,
    mass=mass,
    punishment=punishment)  # -> out, goal; inputs traction: list, forceTraction: list, compression: list, forceCompression: list, flecha: list, forceFlecha: list, punishment: Int32
# ---------- python_16: Python ----------
# Check Traction
Ntsd = traction        # list traction
Ntrd = forceTraction

num = (len(Ntsd))   # numero de valores
cont = 0

punish = []

while cont < num:
    if (Ntrd[cont]/1.1) > (Ntsd[cont]*1.1): #Rd minorado / Sd majorado
        print ('Traction %s is OK!' % cont)
    else:
        print ('Traction %s is NOT OK!' % cont)
        punish.append(punishment)
    cont += 1

# Check Compression
Ncsd = compression     # list compression
Ncrd = forceCompression

num2 = (len(Ncsd))
cont2 = 0

while cont2 < num2:
    if (Ncrd[cont2]/1.1) > (Ncsd[cont2]*1.1):
        print ('Compression %s is OK!' % cont2)
    else:
        print ('Compression %s is NOT OK!' % cont2)
        punish.append(punishment)
    cont2 += 1

# Check Flecha
Msd = flecha
Mrd = forceFlecha

num2 = (len(Msd))
cont2 = 0

while cont2 < num2:
    if (Mrd[cont2]/1.1) > (Msd[cont2]*1.1):
        print ('Bending Moment %s is OK!' % cont2)
    else:
        print ('Bending Moment %s is NOT OK!' % cont2)
        punish.append(punishment)
    cont2 += 1

# 2ª Parte
l = support                                   # *** FLECHA ***

if ((l / 300) > maximumDisplacement):
    print ('Flecha is OK!')
    disp = 0                                  # not punishment
else:
    print ('Fecha is NOT OK!')
    punish.append(mass * punishment)          # punishment


addition = sum(punish)                        # Somar os elementos da lista
goal = (mass + addition)                      # para otimização

print ('Total mass: %.2f kg' % mass)
print ('Mass to optimize: %.2f kg' % goal)

#print = (lenght(punish))
# ---------- end python_16 ----------

max_utilization_percentage = Panel(dedomain_4.End)  # disabled
max_compression_kn = Panel(abs_2)  # disabled
max_tension_kn = Panel(dedomain.End)  # disabled
max_moment_knm = Panel(dedomain_2.End)  # disabled
max_shear_kn = Panel(dedomain_3.End)  # disabled

panel_67 = Panel(python_16.goal)  # disabled

# ---- group: goal to optimize !
goal = Number(python_16.goal)  # disabled

# ----
mass_kg = Panel(python_16.goal)  # disabled
# - Peso total * valor de R$ 20,00
# - Energia/ano * média  kWh R$ 0,587
python_17 = PythonScript(x=mass_kg, z=aço, y=addition_15, u=kwh)  # -> out, goal; disabled
# ---------- python_17: Python ----------
"""
produto da multiplicação 
entre o peso total e o preço médio do aço (kg)
"""
A = x * z

"""
produto da multiplicação entre o potencial energético 
e o preço médio do kwh
"""
B = y * u

r = A / B
print ("goal = %.2f" % r)
goal = r
# ---------- end python_17 ----------
info_11 = Panel(python_16.out)  # disabled
info_12 = Panel(python_17.out)  # disabled

# ---- group: goal to optimize !
goal_2 = Number(python_17.goal)  # disabled

# ==== cluster Cluster
yz = YZPlane(Origin=Point(0, 0, 0))
abs = Absolute(Value="-0.20")
abs_2 = Absolute(Value="-0.2")
pt = ConstructPoint(XCoordinate="- 4.5", YCoordinate="-0.20", ZCoordinate=0)
pt_2 = ConstructPoint(XCoordinate="- 1.8", YCoordinate=abs, ZCoordinate=0)
pt_3 = ConstructPoint(XCoordinate=0, YCoordinate=abs_2, ZCoordinate="1.65")
pt_4 = ConstructPoint(XCoordinate=0, YCoordinate="-0.2", ZCoordinate="1.95")
rec_2pt = Rectangle2Pt(Plane=PlaneXY(0, 0, 0), PointA=pt, PointB=pt_2, Radius=0)  # -> Rectangle, Length
rec_2pt_2 = Rectangle2Pt(Plane=yz, PointA=pt_4, PointB=pt_3, Radius=0)  # -> Rectangle, Length
loft = Loft(
    Curves=[rec_2pt_2.Rectangle, rec_2pt.Rectangle],
    Options={Adjust=True, Closed=False, LoftEnds=0, LoftSimp=0, LoftType=5, Rebuild=10, Refit=0.01})
move = Move(Geometry=loft, Motion="0, 10, 0")  # -> Geometry, Transform
geo = Geometry([loft, move.Geometry])
mirror = Mirror(Geometry=geo, Plane=PlaneYZ(0, 0, 0))  # -> Geometry, Transform
geo_2 = ClusterOutput(geo)
move_2 = Move(Geometry=mirror.Geometry, Motion="100, 0, 0")  # -> Geometry, Transform
G = ClusterOutput(move_2.Geometry)
