# Grasshopper definition truss_one.ghx (Grasshopper 0.9.76)
# plug-ins: Karamba, Python Interpreter, LunchBox

# ---- group: get inputs from job results
python = PythonScript(jobName="_job name_", id="0")  # -> out, inputs
# ---------- python: Python ----------
path = ghenv.Component.OnPingDocument().FilePath
path = path.split("\\")
path = "\\".join(path[:-1] + [jobName, "results.tsv"])

with open(path, 'r') as f:
    data = f.readlines()

headers = data.pop(0).split('\t')

designs = {}
for d in data:
    line = d.split('\t')
    designs[ int(line[headers.index('id')]) ] = [x for i,x in enumerate(line) if "[in" in headers[i]]

inputs = designs[int(id)]
# ---------- end python ----------

# ---- group: get inputs from file
python_2 = PythonScript()  # -> out, path
# ---------- python_2: Python ----------
path = ghenv.Component.OnPingDocument().FilePath
path = path.split("\\")
path = "\\".join(path[:-1] + ["inputs.txt"])
# ---------- end python_2 ----------
file = ReadFile(File=python_2.path, PerLineParse=True)

# ----
data_in = Panel(file)
bang = ExplodeTree(Inputs=simplify(graft(file)))  # -> Branch0, Branch1, Branch2, Branch3, Branch4, Branch5, Branch6, Branch7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

# ---- group: unpack series
python_3 = PythonScript()  # -> out, a
# ---------- python_3: Python ----------
import json

a = json.loads(x)
# ---------- end python_3 ----------

# ----
addition = Addition(A=bang.Branch0, B=bang.Branch9)
addition_2 = Addition(A=bang.Branch1, B=bang.Branch10)
addition_3 = Addition(A=bang.Branch2, B=bang.Branch11)
addition_4 = Addition(A=bang.Branch3, B=bang.Branch12)
addition_5 = Addition(A=bang.Branch4, B=bang.Branch13)
addition_6 = Addition(A=bang.Branch5, B=bang.Branch14)
addition_7 = Addition(A=bang.Branch6, B=bang.Branch15)
addition_8 = Addition(A=bang.Branch7, B=bang.Branch16)
addition_9 = Addition(A=bang.Branch8, B=bang.Branch17)

# ---- group: Calcular relação que proteja o público de insolações intensas
division = Division(A=bang.Branch3, B=-3)

# ----
panel = Panel(division)
resistência_kn_mm² = Panel(".25")
peso_do_aço_m3 = Panel("7850")
pt = ConstructPoint(XCoordinate="0", YCoordinate=0, ZCoordinate=bang.Branch0)
pt_2 = ConstructPoint(XCoordinate="0", YCoordinate="10", ZCoordinate=bang.Branch1)
pt_3 = ConstructPoint(XCoordinate="0", YCoordinate="20", ZCoordinate=bang.Branch2)
pt_4 = ConstructPoint(XCoordinate="50", YCoordinate=panel, ZCoordinate=bang.Branch3)
pt_5 = ConstructPoint(XCoordinate="50", YCoordinate="10", ZCoordinate=bang.Branch4)
pt_6 = ConstructPoint(XCoordinate="50", YCoordinate="20", ZCoordinate=bang.Branch5)
pt_7 = ConstructPoint(XCoordinate="100", YCoordinate=0, ZCoordinate=bang.Branch6)
pt_8 = ConstructPoint(XCoordinate="100", YCoordinate="10", ZCoordinate=bang.Branch7)
pt_9 = ConstructPoint(XCoordinate="100", YCoordinate="20", ZCoordinate=bang.Branch8)
pt_10 = ConstructPoint(XCoordinate="0", YCoordinate=0, ZCoordinate=addition)
pt_11 = ConstructPoint(XCoordinate="0", YCoordinate="10", ZCoordinate=addition_2)
pt_12 = ConstructPoint(XCoordinate="0", YCoordinate="20", ZCoordinate=addition_3)
pt_13 = ConstructPoint(XCoordinate="50", YCoordinate=panel, ZCoordinate=addition_4)
pt_14 = ConstructPoint(XCoordinate="50", YCoordinate="10", ZCoordinate=addition_5)
pt_15 = ConstructPoint(XCoordinate="50", YCoordinate="20", ZCoordinate=addition_6)
pt_16 = ConstructPoint(XCoordinate="100", YCoordinate=0, ZCoordinate=addition_7)
pt_17 = ConstructPoint(XCoordinate="100", YCoordinate="10", ZCoordinate=addition_8)
pt_18 = ConstructPoint(XCoordinate="100", YCoordinate="20", ZCoordinate=addition_9)
# Catálogo Vallourec.As bitolas escolhidas são as mais frequentemente produzidas.
seção_d_t = Panel("""33.4,3.2
33.4,3.6
38.1,3.2
38.1,4.0
42.2,3.6
42.2,5.0
48.3,3.6
48.3,5.0
60.3,4.0
60.3,5.6
73.0,5.0
73.0,7.1
88.9,5.6
88.9,8.0
101.6,5.6
101.6,8.8
114.3,6.4
114.3,8.8
141.3,6.4
141.3,10.0
168.3,7.1
168.3,11.0
219.1,8.0
219.1,12.5
273.0,10.0
273.0,16.0
323.8,10.0
323.8,17.5
355.6,10.0
355.6,12.5""")
panel_2 = Panel(pt_14)
panel_3 = Panel(pt_11)
panel_4 = Panel(pt_17)
panel_5 = Panel(pt_15)
panel_6 = Panel(pt_12)
panel_7 = Panel(pt_18)
panel_8 = Panel(pt_4)
panel_9 = Panel(pt)
panel_10 = Panel(pt_7)
panel_11 = Panel(pt_5)
panel_12 = Panel(pt_6)
panel_13 = Panel(pt_2)
panel_14 = Panel(pt_3)
panel_15 = Panel(pt_8)
panel_16 = Panel(pt_9)

merge = Merge(Data1=pt_10, Data2=pt_13, Data3=pt_16)
item = ListItem(List=flatten(merge), Index=2, Wrap=True)
item_2 = ListItem(List=flatten(merge), Index=0, Wrap=True)
item_3 = ListItem(List=flatten(merge), Index=1, Wrap=True)

intcrv = Interpolate(Vertices=flatten([pt_2, pt_5, pt_8]), Degree=3, Periodic=False, KnotStyle=1)  # -> Curve, Length, Domain
intcrv_2 = Interpolate(Vertices=flatten([pt_3, pt_6, pt_9]), Degree=3, Periodic=False, KnotStyle=1)  # -> Curve, Length, Domain
intcrv_3 = Interpolate(Vertices=flatten([pt, pt_4, pt_7]), Degree=3, Periodic=False, KnotStyle=1)  # -> Curve, Length, Domain
intcrv_4 = Interpolate(Vertices=flatten([item, item_2, item_3]), Degree=3, Periodic=False, KnotStyle=1)  # -> Curve, Length, Domain
intcrv_5 = Interpolate(Vertices=flatten([pt_11, pt_14, pt_17]), Degree=3, Periodic=False, KnotStyle=1)  # -> Curve, Length, Domain
intcrv_6 = Interpolate(Vertices=flatten([pt_12, pt_15, pt_18]), Degree=3, Periodic=False, KnotStyle=1)  # -> Curve, Length, Domain
item_4 = ListItem(List=seção_d_t, Index=bang.Branch20, Wrap=True)
item_5 = ListItem(List=seção_d_t, Index=bang.Branch21, Wrap=True)
item_6 = ListItem(List=seção_d_t, Index=bang.Branch22, Wrap=True)
panel_17 = Panel(item_4)

# ---- group: Sobrecarga na treliça / Cobertura
loft = Loft(
    Curves=[intcrv_4.Curve, intcrv_5.Curve, intcrv_6.Curve],
    Options={Adjust=False, Closed=False, LoftEnds=0, LoftSimp=0, LoftType=0, Rebuild=10, Refit=0.01})
project = Project(Geometry=loft, Plane=PlaneXY(0, 0, 0))  # -> Geometry, Transform
area = Area(Geometry=project.Geometry)  # -> Area, Centroid
sobrecarga_por_m2_kg = Panel("30")
multiplication = Multiplication(A=area.Area, B=sobrecarga_por_m2_kg)

# ----
peso_próprio_da_telha_por_m2_kg = Panel("9")
area_2 = Area(Geometry=loft)  # -> Area, Centroid
split = TextSplit(Text=panel_17, Separators=",")
split_2 = TextSplit(Text=item_5, Separators=",")
split_3 = TextSplit(Text=item_6, Separators=",")
loft_2 = Loft(
    Curves=[intcrv_3.Curve, intcrv.Curve, intcrv_2.Curve],
    Options={Adjust=False, Closed=False, LoftEnds=0, LoftSimp=0, LoftType=0, Rebuild=10, Refit=0.01})
panel_18 = Panel(split)
multiplication_2 = Multiplication(A=area_2.Area, B=peso_próprio_da_telha_por_m2_kg)
item_7 = ListItem(List=panel_18, Index=0, Wrap=True)
item_8 = ListItem(List=panel_18, Index=1, Wrap=True)
item_9 = ListItem(List=split_2, Index=0, Wrap=True)
item_10 = ListItem(List=split_2, Index=1, Wrap=True)
item_11 = ListItem(List=split_3, Index=0, Wrap=True)
item_12 = ListItem(List=split_3, Index=1, Wrap=True)
supp = SupportKaramba(PosInd=flatten([pt_7, pt]), menu=[buttons(on, off, on, off, off, off)])
supp_2 = SupportKaramba(PosInd=flatten([pt_9, pt_3]), menu=[buttons(on, on, on, on, on, on)])
# Simplificação: aqui estamos considerando uma carga igualmente distribuída por todos os nós de apoio.
addition_10 = Addition(A=multiplication, B=multiplication_2)
diametro_mm = Panel(item_7)
parede_mm = Panel(item_8)
diametro_mm_2 = Panel(item_9)
parede_mm_2 = Panel(item_10)
diametro_mm_3 = Panel(item_11)
parede_mm_3 = Panel(item_12)
spacetruss_2 = SpaceTrussStructure2(SurfaceA=loft_2, SurfaceB=loft, UDivisions=bang.Branch18, VDivisions=bang.Branch19)  # -> LinesA, LinesB, Web, Nodes
disc = Discontinuity(Curve=spacetruss_2.LinesB, Level=1)  # -> flatten(Points), Parameters
division_2 = Division(A=diametro_mm, B=10)
division_3 = Division(A=parede_mm, B=10)
division_4 = Division(A=item_9, B=10)
division_5 = Division(A=item_10, B=10)
division_6 = Division(A=diametro_mm_3, B=10)
division_7 = Division(A=parede_mm_3, B=10)
merge_2 = Merge(Data1=supp, Data2=supp_2)
rdpoints = RemoveDuplicatePointsKaramba(Point=disc.Points, LimitDistance=0.005)  # -> OutPoint, Info, Indexes

# ---- group: Sobrecarga na treliça
lng = ListLength(List=rdpoints.OutPoint)
carga_por_nó = Division(A=addition_10, B=lng)
multiplication_3 = Multiplication(A=carga_por_nó, B=-0.0098)

# ----
diametro_cm = Panel(division_6)
parede_cm = Panel(division_7)
linhas_base = RemoveDuplicateLinesKaramba(Line=flatten(spacetruss_2.LinesA), LimitDistance=0.005)  # -> OutLine, Info, Indexes
linhas_topo = RemoveDuplicateLinesKaramba(Line=flatten(spacetruss_2.LinesB), LimitDistance=0.005)  # -> OutLine, Info, Indexes
treliça = RemoveDuplicateLinesKaramba(Line=flatten(spacetruss_2.Web), LimitDistance=0.005)  # -> OutLine, Info, Indexes
eval = Evaluate(F="(3.14159*x^2)/4", x=diametro_mm)
eval_2 = Evaluate(F="(3.14159*(x-(y*2))^2)/4", x=diametro_mm, y=parede_mm)
eval_3 = Evaluate(F="(3.14159*x^2)/4", x=item_9)
eval_4 = Evaluate(F="(3.14159*(x-(y*2))^2)/4", x=item_9, y=item_10)
eval_5 = Evaluate(F="(3.14159*x^2)/4", x=diametro_mm_3)
eval_6 = Evaluate(F="(3.14159*(x-(y*2))^2)/4", x=diametro_mm_3, y=parede_mm_3)
diametro_cm_2 = Panel(division_2)
parede_cm_2 = Panel(division_3)
Z = UnitZ(Factor=multiplication_3)
loads = LoadsKaramba(ForceVector=Z, Local=False, PosInd=rdpoints.OutPoint, LCase=0, mode="Point")
subtraction = Subtraction(A=eval, B=eval_2)
subtraction_2 = Subtraction(A=eval_3, B=eval_4)
subtraction_3 = Subtraction(A=eval_5, B=eval_6)
linetobeam = LineToBeamKaramba(Points=rdpoints.OutPoint, Line=linhas_base.OutLine, New=True, Remove=True, LimitDistance_m=0.005, BeamIdentifier="base")  # -> Points, Element, Info
linetobeam_2 = LineToBeamKaramba(Line=linhas_topo.OutLine, New=True, Remove=True, LimitDistance_m=0.005, BeamIdentifier="topo")  # -> Points, Element, Info
linetobeam_3 = LineToBeamKaramba(Line=treliça.OutLine, New=True, Remove=True, LimitDistance_m=0.005, BeamIdentifier="diagonais")  # -> Points, Element, Info
cross_sections = CrossSectionsKaramba(ElementsIdentifiers="base", Diameter_cm=diametro_cm_2, WallThickness_cm=parede_cm_2, mode="Circular Hollow")
cross_sections_2 = CrossSectionsKaramba(ElementsIdentifiers="topo", Diameter_cm=division_4, WallThickness_cm=division_5, mode="Circular Hollow")
cross_sections_3 = CrossSectionsKaramba(ElementsIdentifiers="diagonais", Diameter_cm=diametro_cm, WallThickness_cm=parede_cm, mode="Circular Hollow")
área_do_perfil_mm2 = Panel(subtraction_3)
área_do_perfil_mm2_2 = Panel(subtraction)
área_do_perfil_mm2_3 = Panel(subtraction_2)
loads_2 = LoadsKaramba(Vector=Vector(0, 0, -1), LCase=0, mode="Gravity")
matselect = MaterialSelectionKaramba(menu=[dropdown(1), dropdown(54)])
merge_3 = Merge(Data1=flatten(cross_sections), Data2=flatten(cross_sections_2), Data3=flatten(cross_sections_3))
merge_4 = Merge(Data1=linetobeam.Element, Data2=linetobeam_2.Element, Data3=linetobeam_3.Element)
merge_5 = Merge(Data1=loads_2, Data2=loads)
len = Length(Curve=linhas_base.OutLine)
len_2 = Length(Curve=linhas_topo.OutLine)
len_3 = Length(Curve=treliça.OutLine)
assemble = AssembleModelKaramba(
    Point=rdpoints.OutPoint,
    Elem=flatten(merge_4),
    Support=merge_2,
    Load=flatten(merge_5),
    CrossSection=merge_3,
    Material=matselect,
    LimitDistance_m=0.005)  # -> Model, Info, Mass_kg, CenterOfGravity
ma = MassAddition(Input=len)  # -> Result, PartialResults
division_8 = Division(A=área_do_perfil_mm2_2, B=1000000)
multiplication_4 = Multiplication(A=área_do_perfil_mm2_2, B=resistência_kn_mm²)
ma_2 = MassAddition(Input=len_2)  # -> Result, PartialResults
division_9 = Division(A=área_do_perfil_mm2_3, B=1000000)
multiplication_5 = Multiplication(A=área_do_perfil_mm2_3, B=resistência_kn_mm²)
ma_3 = MassAddition(Input=len_3)  # -> Result, PartialResults
division_10 = Division(A=área_do_perfil_mm2, B=1000000)
multiplication_6 = Multiplication(A=área_do_perfil_mm2, B=resistência_kn_mm²)
analyzethi = AnalyzeThIKaramba(Model=assemble.Model)  # -> CalculatedModel, MaximumDisplacement_m, ResultingForceOfGravity_kN, ElasticEnergy_kNm
multiplication_7 = Multiplication(A=ma.Result, B=division_8)
multiplication_8 = Multiplication(A=ma_2.Result, B=division_9)
multiplication_9 = Multiplication(A=ma_3.Result, B=division_10)
ladybug = Ladybug_Ladybug()  # -> Vviiiiiiiiiizzz; plug-in component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
modelview = ModelViewKaramba(Model=analyzethi.CalculatedModel, LoadCaseFactorsForLinearSuperposition=1, IndexIncrementOfVisibleLoadcase=0)  # -> Model, DeformedMesh, DeformedAxes, DeformedModel
b_res_force = BeamResultantForcesKaramba(
    AnalyzedModel=analyzethi.CalculatedModel,
    BeamIdentifiers="base",
    LoadCase=-1,
    MaximumProbingDistance_m=-1,
    NumberOfProbingPointsPerElement=3)  # -> AnalyzedModel, NormalForce_kN, ResultantBendingMoment_kNm, ResultantShearForce_kN
b_res_force_2 = BeamResultantForcesKaramba(
    AnalyzedModel=analyzethi.CalculatedModel,
    BeamIdentifiers="topo",
    LoadCase=-1,
    MaximumProbingDistance_m=-1,
    NumberOfProbingPointsPerElement=3)  # -> AnalyzedModel, NormalForce_kN, ResultantBendingMoment_kNm, ResultantShearForce_kN
b_res_force_3 = BeamResultantForcesKaramba(
    AnalyzedModel=analyzethi.CalculatedModel,
    BeamIdentifiers="diagonais",
    LoadCase=-1,
    MaximumProbingDistance_m=-1,
    NumberOfProbingPointsPerElement=3)  # -> AnalyzedModel, NormalForce_kN, ResultantBendingMoment_kNm, ResultantShearForce_kN
multiplication_10 = Multiplication(A=multiplication_7, B=peso_do_aço_m3)
multiplication_11 = Multiplication(A=multiplication_8, B=peso_do_aço_m3)
multiplication_12 = Multiplication(A=multiplication_9, B=peso_do_aço_m3)

rec_3pt = Rectangle3Pt(PointA="0.0, 0.0, 0.1", PointB="100.0, 0.0, 0.1", PointC="0.0, 20.0, 0.1")  # -> Rectangle, Length
rec_3pt_2 = Rectangle3Pt(PointA="-20.0, -20.0, 0.0", PointB="120.0, -20.0, 0.0", PointC="0.0, 40.0, 0.0")  # -> Rectangle, Length
srf = Surface(rec_3pt_2.Rectangle)
srf_2 = Surface(rec_3pt.Rectangle)

flecha_máxima_aceitável_l_x = Panel("300")
d_energy = DeformationEnergyKaramba(AnalyzedModel=modelview.Model)  # -> AnalyzedModel, AxialDeformationEnergies_kNm, BendingEnergies_kNm
bnd = Bounds(Numbers=b_res_force.NormalForce_kN)
bnd_2 = Bounds(Numbers=b_res_force_2.NormalForce_kN)
bnd_3 = Bounds(Numbers=b_res_force_3.NormalForce_kN)
geo = Geometry(loft)
vão_total = Subtraction(A="100", B="0")
dedomain = DeconstructDomain(Domain=bnd)  # -> Start, End
dedomain_2 = DeconstructDomain(Domain=bnd_2)  # -> Start, End
dedomain_3 = DeconstructDomain(Domain=bnd_3)  # -> Start, End
beamview = BeamViewKaramba(Model=d_energy.AnalyzedModel)  # -> Model, MeshesOfRenderedBeams, DeformedBeamAxes, LegendColors, LegendTags

# ---- group: teste
python_4 = PythonScript(x=beamview.LegendTags)  # -> out, a; inputs x: list
# ---------- python_4: Python ----------
import re

a = []

x.pop(0)

for val in x:
    try:
        a.append( float(re.sub(r'[^\d.-e+]+', '', val)) )
    except ValueError:
        continue
# ---------- end python_4 ----------
abs = Absolute(Value=python_4.a)
bnd_4 = Bounds(Numbers=abs)
dedomain_4 = DeconstructDomain(Domain=bnd_4)  # -> Start, End
percentual_de_utilização_máxima = Panel(dedomain_4.End)

# ----
abs_2 = Absolute(Value=dedomain.Start)
abs_3 = Absolute(Value=dedomain_2.Start)
abs_4 = Absolute(Value=dedomain_3.Start)
compressão_máxima_kn = Panel(abs_2)
tração_máxima_kn = Panel(dedomain.End)
compressão_máxima_kn_2 = Panel(abs_3)
tração_máxima_kn_2 = Panel(dedomain_2.End)
compressão_máxima_kn_3 = Panel(abs_4)
tração_máxima_kn_3 = Panel(dedomain_3.End)
division_11 = Division(A=vão_total, B=flecha_máxima_aceitável_l_x)
abs_5 = Absolute(Value=[compressão_máxima_kn_2, tração_máxima_kn_2])
abs_6 = Absolute(Value=[compressão_máxima_kn, tração_máxima_kn])
abs_7 = Absolute(Value=[compressão_máxima_kn_3, tração_máxima_kn_3])
sort = SortList(Keys=abs_5)  # -> Keys, ValuesA
sort_2 = SortList(Keys=abs_6)  # -> Keys, ValuesA
sort_3 = SortList(Keys=abs_7)  # -> Keys, ValuesA
addition_11 = Addition(A=multiplication_10, B=multiplication_11, C=multiplication_12)
rev = ReverseList(List=sort.Keys)
rev_2 = ReverseList(List=sort_2.Keys)
rev_3 = ReverseList(List=sort_3.Keys)
peso_da_estrutura_kg = Panel(addition_11)
item_13 = ListItem(List=rev_2, Index=0, Wrap=True)
item_14 = ListItem(List=rev, Index=0, Wrap=True)
item_15 = ListItem(List=rev_3, Index=0, Wrap=True)
flecha_máxima_aceitável_m = Panel(division_11)
flecha_máxima_m = Panel(analyzethi.MaximumDisplacement_m)
solicitação_máxima = Panel(item_13)
resistência_máxima_de_cada_peça = Panel(multiplication_4)
solicitação_máxima_2 = Panel(item_14)
resistência_máxima_de_cada_peça_2 = Panel(multiplication_5)
solicitação_máxima_3 = Panel(item_15)
resistência_máxima_de_cada_peça_3 = Panel(multiplication_6)
galapagos = Galapagos()

# ----
# Estes "coeficientes" são "multas" pela estrutura estar levando bomba no cálculo estrutural. Eles permitem que o Galapagos vá se aproximando das soluções ideais.
panel_19 = Panel("100000")

subtraction_4 = Subtraction(A=flecha_máxima_m, B=flecha_máxima_aceitável_m)
subtraction_5 = Subtraction(A=solicitação_máxima_2, B=resistência_máxima_de_cada_peça_2)
panel_20 = Panel(subtraction_5)
subtraction_6 = Subtraction(A=solicitação_máxima, B=resistência_máxima_de_cada_peça)
panel_21 = Panel(subtraction_6)
subtraction_7 = Subtraction(A=solicitação_máxima_3, B=resistência_máxima_de_cada_peça_3)
panel_22 = Panel(subtraction_7)
max = Maximum(A=subtraction_4, B=0)
max_2 = Maximum(A=subtraction_5, B=0)
max_3 = Maximum(A=subtraction_6, B=0)
max_4 = Maximum(A=subtraction_7, B=0)
multiplication_13 = Multiplication(A=max, B=panel_19)
multiplication_14 = Multiplication(A=max_2, B="10000")
multiplication_15 = Multiplication(A=max_3, B="10000")
multiplication_16 = Multiplication(A=max_4, B="10000")
addition_12 = Addition(A=multiplication_15, B=multiplication_14, C=multiplication_13, D=multiplication_16, E=peso_da_estrutura_kg)
parâmetro_a_otimizar = Panel(addition_12)
equals = Equality(FirstNumber=parâmetro_a_otimizar, SecondNumber=peso_da_estrutura_kg)  # -> Equality, Inequality
está_passando = Panel(equals.Equality)
num = Number(está_passando)

# ----
# Funções
# Objetivas
# Peso total da estrutura (kg)
# MINIMIZAR
panel_23 = Panel(assemble.Mass_kg)

panel_24 = Panel("""Condição estrutural:
0.0 = False
1.0 = True""")
restrição = Panel(num)

# ---- group: screenshot
python_5 = PythonScript()  # -> out, path
# ---------- python_5: Python ----------
path = ghenv.Component.OnPingDocument().FilePath
path = path.split("\\")
path = "\\".join(path[:-1] + ["gh.ping"])
# ---------- end python_5 ----------
file_2 = ReadFile(File=python_5.path, PerLineParse=True)
python_6 = PythonScript(id=file_2)  # -> out
# ---------- python_6: Python ----------
import pickle
import rhinoscriptsyntax as rs

localFolder = "\\".join(ghenv.Component.OnPingDocument().FilePath.split("\\")[:-1]) + "\\"

with open(localFolder + "meta.file", 'rb') as f:
    meta = pickle.load(f)

jobID = meta['jobID']
#    designID = meta['designID']

imageFolder = localFolder + str(jobID) + "\\images\\"
imageName = imageFolder + str(id) + ".png"
rs.Command("_-ViewCaptureToFile \n\"" + imageName + "\"\n _Enter")

outputFile = localFolder + "python.ping"
with open(outputFile, 'w') as f:
    f.write('ack')

print "complete"
# ---------- end python_6 ----------

# ----
# Análise da sombra
panel_25 = Panel("C:\Users\Renato\Dropbox\REANTO DOCS\ESTUDO\17_2\MECOM GRASSHOPPER\Simulação_ambiental\Carta_Psicomêtrica\BRA_MG_Ouro.Branco.868230_INMET.epw")
importlocation = Ladybug_ImportLocation(epwFile=panel_25)  # -> location; plug-in component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
horas = Series(Start="8", Step=1, Count="10")
mês = Panel("11")
dia = Panel("21")
pt_19 = Point(area.Centroid)
sunpath = Ladybug_SunPath(
    north="270",
    location=importlocation,
    hour=horas,
    day=dia,
    month=mês,
    timeStep=1,
    centerPt=pt_19,
    sunPathScale="0.30",
    dailyOrAnnualSunPath=True)  # -> readMe, sunVectors, sunAltitudes, sunAzimuths, port, sunSpheresMesh, sunPathCrvs, compassCrvs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; plug-in component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
preview = CustomPreview(Geometry=[srf, srf_2], Shader=ColourSwatch(SwatchColor=RGBA(255, 255, 255, 223)))
preview_2 = CustomPreview(Geometry=geo, Shader=ColourSwatch(SwatchColor=RGBA(255, 255, 255, 73)))
number_slider = Slider(0.001, range=0..0.001)
toggle = BooleanToggle(True)
toggle_2 = BooleanToggle(True)
sunlighthoursanalysis = Ladybug_SunlightHoursAnalysis(
    geometry=flatten(srf_2),
    context=flatten(geo),
    gridSize="1",
    disFromBase=number_slider,
    sunVectors=flatten(sunpath.sunVectors),
    timeStep=1,
    parallel=toggle,
    runIt=toggle_2)  # -> readMe, contextMesh, analysisMesh, testPts, testVec, port, sunlightHoursResult, sunlightHoursMesh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; plug-in component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

panel_26 = Panel(horas)
preview_3 = CustomPreview(
    Geometry=[sunpath.sunPathCrvs, sunpath.compassCrvs, sunpath.sunSpheresMesh],
    Shader=ColourSwatch(SwatchColor=RGB(105, 105, 105)))

lng_2 = ListLength(List=sunpath.sunVectors)
addition_13 = Addition(A=lng_2, B=1)
legendpar = Ladybug_LegendParameters(numSegments=addition_13)  # -> legendPar; plug-in component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

sunlighthoursanalysis_2 = Ladybug_SunlightHoursAnalysis(
    geometry=flatten(srf),
    context=flatten(geo),
    gridSize="1",
    disFromBase=number_slider,
    sunVectors=flatten(sunpath.sunVectors),
    timeStep=1,
    legendPar=flatten(legendpar),
    parallel=toggle,
    runIt=toggle_2)  # -> readMe, contextMesh, analysisMesh, testPts, testVec, port, sunlightHoursResult, sunlightHoursMesh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; plug-in component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

neg = Negative(Value=sunlighthoursanalysis.totalSunlightHours)
min = Minimum(A=neg, B=0)

# ----
# Média de horas de luz solar direta recebida
panel_27 = Panel("""Sombra 
MAXIMIZAR""")
panel_28 = Panel(sunlighthoursanalysis.totalSunlightHours)

merge_6 = Merge(Data1=flatten(assemble.Mass_kg), Data2=flatten(min), Data3=flatten(num))
data_out = Panel(merge_6)

# ---- group: write to output file
python_7 = PythonScript(data=merge_6)  # -> out; inputs data: list
# ---------- python_7: Python ----------
import pickle
import rhinoscriptsyntax as rs

localFolder = "\\".join(ghenv.Component.OnPingDocument().FilePath.split("\\")[:-1]) + "\\"

outputFile = localFolder + "outputs.txt"
with open(outputFile, 'w') as f:
    f.write('\n'.join([str(x) for x in data]))

print "complete"
# ---------- end python_7 ----------
