# Grasshopper definition truss_two.gh (Grasshopper 0.9.76)
# plug-ins: Karamba, Python Interpreter

# ----
# ** ponto médio de toda a estrutura
# ** ponto médio banzo superior
# ** altura banzo superior
# ** ponto médio da barra
# ** altura das extremidades da barra
# ** ângulo dos banzos inferiores
ptmed = Slider(8.29, range=5..12)
ptmed_2 = Slider(4.06, range=2..6)
panel = Panel("ESTRUTURA A")
ptmedb = Slider(2.33, range=1..5)
alturasup = Slider(0.7, range=0..1)
barextrz = Slider(4.73, range=2..10)
ângulo = Slider(10, range=10..20)

# ----
# ** comprimento das extremidades
panel_2 = Panel("Elementos B")
eixo_x = Slider(0.62, range=0..1.5)

# ----
# ** altura das extremidades
# ** ponto médio
panel_3 = Panel("""elemento C
 CENTRAL""")
bansupptmed = Slider(2.7, range=1..6)
barextrem = Slider(7.2, range=4..10)

# ----
# Transcrever para o arquivo 'Python' abaixo...
panel_4 = Panel("6.6, 0.0, 0.4")
srf4pt = _4PointSurface(CornerA="6.2, 0.0, 0", CornerB="6.6, 0.0, 0", CornerC=panel_4, CornerD="6.2, 0.0, 0.4")
xz = XZPlane(Origin=Point(0, 0, 0))
orient = Orient(Geometry=srf4pt, Source=PlaneXY(0, 0, 0), Target=xz)  # -> Geometry, Transform
vec = VectorXYZ(XComponent=0, YComponent=1, ZComponent=0.44)  # -> Vector, Length
geo = Geometry([srf4pt, orient.Geometry])
move = Move(Geometry=geo, Motion=vec.Vector)  # -> Geometry, Transform
arrlinear = LinearArray(Geometry=move.Geometry, Direction="0, 1.0, 0.40", Count=9)  # -> Geometry, Transform
rec_2pt = Rectangle2Pt(Plane=PlaneXY(0, 0, 0), PointA="0.0, 0.0, 0.0", PointB="0.60, 0.80, 0.0", Radius=0)  # -> Rectangle, Length
X = UnitX(Factor=Slider(15.1, range=0..100))
arrrec = RectangularArray(Geometry=arrlinear.Geometry, Cell=rec_2pt.Rectangle, XCount=Slider(21, range=0..1000), YCount="1")  # -> flatten(Geometry), Transform
move_2 = Move(Geometry=arrrec.Geometry, Motion=X)  # -> Geometry, Transform
move_3 = Move(Geometry=move_2.Geometry, Motion=X)  # -> Geometry, Transform
move_4 = Move(Geometry=move_3.Geometry, Motion=X)  # -> Geometry, Transform
move_5 = Move(Geometry=move_4.Geometry, Motion=X)  # -> Geometry, Transform
move_6 = Move(Geometry=move_5.Geometry, Motion=X)  # -> Geometry, Transform
preview = CustomPreview(
    Geometry=[arrrec.Geometry, move_2.Geometry, move_3.Geometry, move_4.Geometry, move_5.Geometry, move_6.Geometry],
    Shader=ColourSwatch(SwatchColor=RGBA(255, 255, 255, 107)))

# ----
# ** altura dos apoios A
# ** altura dos apoios B
panel_5 = Panel("Dimensão Geral")

# ----
# ** ponto médio de toda a estrutura
# ** ponto médio banzo superior
# ** altura banzo superior
# ** ponto médio da barra
# ** altura das extremidades da barra
# ** ângulo dos banzos inferiores
panel_6 = Panel("ESTRUTURA B")
ptmedb_2 = Slider(2.32, range=1..5)
bansup = Slider(0.45, range=0..1)
ângulo_2 = Slider(10, range=10..20)
sistptmed = Slider(8.98, range=5..12)
barptmed = Slider(3.97, range=2..6)
barraextrem = Slider(5.63, range=2..10)

# ----
# ** quantidades de diagonais
# *** este valor é multiplicado por 2
panel_7 = Panel("Diagonais")
number_slider = Slider(10, range=8..20)

# ----
# ** comprimento das extremidades
panel_8 = Panel("Elementos C")
eixo_x_2 = Slider(1.19, range=0..1.5)

rec_2pt_2 = Rectangle2Pt(Plane=PlaneXY(0, 0, 0), PointA="4.0, 0.0, 0.0", PointB="96.0, 10.0, 0.0", Radius=0)  # -> Rectangle, Length
Z = UnitZ(Factor=-1)
move_7 = Move(Geometry=rec_2pt_2.Rectangle, Motion=Z)  # -> Geometry, Transform
boxrec = BoxRectangle(Rectangle=move_7.Geometry, Height=Domain(0, 0.5))
espaço_de_projeto = Panel("438939648 x 10³³")
idade_da_terra = Panel("4,54 x 10**9")

panel_9 = Panel("Geometria")
neg = Negative(Value=eixo_x)
addition = Addition(A=eixo_x, B="100")
addition_2 = Addition(A=alturasup, B="1.80")
addition_3 = Addition(A=bansup, B="1.80")
addition_4 = Addition(A=eixo_x, B="100")
neg_2 = Negative(Value=eixo_x)
addition_5 = Addition(A=sistptmed, B=ptmedb_2)
addition_6 = Addition(A=ptmed, B=ptmedb)

# ----
# ** geometria barras inferiores
# ***estrutura A
panel_10 = Panel("BANZOS INFERIORES 1")
pt = ConstructPoint(XCoordinate=neg_2, YCoordinate=0, ZCoordinate=addition_2)
pt_2 = ConstructPoint(XCoordinate=addition, YCoordinate=0, ZCoordinate=addition_2)
ln = Line(StartPoint=pt, EndPoint=pt_2)
eval = EvaluateCurve(Curve=reparameterize(ln), Parameter=0.5)  # -> Point, Tangent, Angle
Z_2 = UnitZ(Factor=addition_6)
move_8 = Move(Geometry=eval.Point, Motion=Z_2)  # -> Geometry, Transform
intcrv = Interpolate(Vertices=[pt, move_8.Geometry, pt_2], Degree=3, Periodic=False, KnotStyle=1)  # -> Curve, Length, Domain
end = EndPoints(Curve=intcrv.Curve)  # -> Start, End
ln_2 = Line(StartPoint=end.Start, EndPoint=end.End)
neg_3 = Negative(Value=ângulo)
rotax = RotateAxis(Geometry=intcrv.Curve, Angle=degrees(ângulo), Axis=ln_2)  # -> Geometry, Transform
rotax_2 = RotateAxis(Geometry=intcrv.Curve, Angle=degrees(neg_3), Axis=ln_2)  # -> Geometry, Transform

# ----
# ** geometria barra
# *** estrutura A
expression = Expression(x=ângulo, y=barextrz, Expression="-((x*π/180)*y)")
panel_11 = Panel("BARRA 1")
addition_7 = Addition(A=eixo_x_2, B="100")
neg_4 = Negative(Value=eixo_x_2)
addition_8 = Addition(A="1.80", B=barextrz)
pt_3 = ConstructPoint(XCoordinate=neg_4, YCoordinate=expression, ZCoordinate=0)
pt_4 = ConstructPoint(XCoordinate=neg_4, YCoordinate=expression, ZCoordinate=addition_8)
pt_5 = ConstructPoint(XCoordinate=addition_7, YCoordinate=expression, ZCoordinate=addition_8)
pt_6 = ConstructPoint(XCoordinate=addition_7, YCoordinate=expression, ZCoordinate=0)
ln_3 = Line(StartPoint=pt_3, EndPoint=pt_6)
eval_2 = EvaluateCurve(Curve=reparameterize(ln_3), Parameter=0.5)  # -> Point, Tangent, Angle
addition_9 = Addition(A=addition_6, B=ptmed_2)
Z_3 = UnitZ(Factor=addition_9)
move_9 = Move(Geometry=eval_2.Point, Motion=Z_3)  # -> Geometry, Transform
merge = Merge(Data1=pt_4, Data2=move_9.Geometry, Data3=pt_5)
intcrv_2 = Interpolate(Vertices=merge, Degree=3, Periodic=False, KnotStyle=1)  # -> Curve, Length, Domain
end_2 = EndPoints(Curve=intcrv_2.Curve)  # -> Start, End
ln_4 = Line(StartPoint=end_2.Start, EndPoint=end_2.End)
rotax_3 = RotateAxis(Geometry=intcrv_2.Curve, Angle=degrees(ângulo), Axis=ln_4)  # -> Geometry, Transform

# ----
# ** geometria barra
# *** estrutura intermediária
panel_12 = Panel("BARRA 1/2")
neg_5 = Negative(Value=eixo_x_2)
division = Division(A="10", B=2)
addition_10 = Addition(A=eixo_x_2, B="100")
pt_7 = ConstructPoint(XCoordinate=neg_5, YCoordinate=division, ZCoordinate=0)
pt_8 = ConstructPoint(XCoordinate=neg_5, YCoordinate=division, ZCoordinate=barextrem)
pt_9 = ConstructPoint(XCoordinate=addition_10, YCoordinate=division, ZCoordinate=barextrem)
pt_10 = ConstructPoint(XCoordinate=addition_10, YCoordinate=division, ZCoordinate=0)
ln_5 = Line(StartPoint=pt_7, EndPoint=pt_10)
eval_3 = EvaluateCurve(Curve=reparameterize(ln_5), Parameter=0.5)  # -> Point, Tangent, Angle
addition_11 = Addition(A=sistptmed, B=bansupptmed)
Z_4 = UnitZ(Factor=addition_11)
move_10 = Move(Geometry=eval_3.Point, Motion=Z_4)  # -> Geometry, Transform
merge_2 = Merge(Data1=pt_8, Data2=move_10.Geometry, Data3=pt_9)
intcrv_3 = Interpolate(Vertices=merge_2, Degree=3, Periodic=False, KnotStyle=1)  # -> Curve, Length, Domain
end_3 = EndPoints(Curve=intcrv_3.Curve)  # -> Start, End
ln_6 = Line(StartPoint=end_3.Start, EndPoint=end_3.End)
rotax_4 = RotateAxis(Geometry=intcrv_3.Curve, Angle=degrees("0.0"), Axis=ln_6)  # -> Geometry, Transform

# ----
# ** geometria barra superior
# *** estrutura B
panel_13 = Panel("BANZO SUPERIOR 2")
pt_11 = ConstructPoint(XCoordinate=0, YCoordinate="10", ZCoordinate="1.80")
pt_12 = ConstructPoint(XCoordinate="100", YCoordinate="10", ZCoordinate="1.80")
ln_7 = Line(StartPoint=pt_11, EndPoint=pt_12)
eval_4 = EvaluateCurve(Curve=reparameterize(ln_7), Parameter=0.5)  # -> Point, Tangent, Angle
Z_5 = UnitZ(Factor=sistptmed)
move_11 = Move(Geometry=eval_4.Point, Motion=Z_5)  # -> Geometry, Transform
merge_3 = Merge(Data1=pt_11, Data2=move_11.Geometry, Data3=pt_12)
intcrv_4 = Interpolate(Vertices=merge_3, Degree=3, Periodic=False, KnotStyle=1)  # -> Curve, Length, Domain
end_4 = EndPoints(Curve=intcrv_4.Curve)  # -> Start, End
ln_8 = Line(StartPoint=end_4.Start, EndPoint=end_4.End)
rotax_5 = RotateAxis(Geometry=intcrv_4.Curve, Angle=degrees("0.0"), Axis=ln_8)  # -> Geometry, Transform

panel_14 = Panel("BANZOS INFERIORES 2")
pt_13 = ConstructPoint(XCoordinate=neg, YCoordinate="10", ZCoordinate=addition_3)
pt_14 = ConstructPoint(XCoordinate=addition_4, YCoordinate="10", ZCoordinate=addition_3)
ln_9 = Line(StartPoint=pt_13, EndPoint=pt_14)
eval_5 = EvaluateCurve(Curve=reparameterize(ln_9), Parameter=0.5)  # -> Point, Tangent, Angle
Z_6 = UnitZ(Factor=addition_5)
move_12 = Move(Geometry=eval_5.Point, Motion=Z_6)  # -> Geometry, Transform
merge_4 = Merge(Data1=pt_13, Data2=move_12.Geometry, Data3=pt_14)
intcrv_5 = Interpolate(Vertices=merge_4, Degree=3, Periodic=False, KnotStyle=1)  # -> Curve, Length, Domain
end_5 = EndPoints(Curve=intcrv_5.Curve)  # -> Start, End
ln_10 = Line(StartPoint=end_5.Start, EndPoint=end_5.End)
neg_6 = Negative(Value=ângulo_2)
rotax_6 = RotateAxis(Geometry=intcrv_5.Curve, Angle=degrees(ângulo_2), Axis=ln_10)  # -> Geometry, Transform
rotax_7 = RotateAxis(Geometry=intcrv_5.Curve, Angle=degrees(neg_6), Axis=ln_10)  # -> Geometry, Transform

expression_2 = Expression(x=ângulo_2, y=barraextrem, Expression=" (x*π/180) * y")
panel_15 = Panel("BARRA 2")
addition_12 = Addition(A=eixo_x_2, B="100")
neg_7 = Negative(Value=eixo_x_2)
addition_13 = Addition(A=expression_2, B="10")
pt_15 = ConstructPoint(XCoordinate=neg_7, YCoordinate=addition_13, ZCoordinate=0)
pt_16 = ConstructPoint(XCoordinate=neg_7, YCoordinate=addition_13, ZCoordinate=barraextrem)
pt_17 = ConstructPoint(XCoordinate=addition_12, YCoordinate=addition_13, ZCoordinate=barraextrem)
pt_18 = ConstructPoint(XCoordinate=addition_12, YCoordinate=addition_13, ZCoordinate=0)
ln_11 = Line(StartPoint=pt_15, EndPoint=pt_18)
eval_6 = EvaluateCurve(Curve=reparameterize(ln_11), Parameter=0.5)  # -> Point, Tangent, Angle
addition_14 = Addition(A=addition_5, B=barptmed)
Z_7 = UnitZ(Factor=addition_14)
move_13 = Move(Geometry=eval_6.Point, Motion=Z_7)  # -> Geometry, Transform
merge_5 = Merge(Data1=pt_16, Data2=move_13.Geometry, Data3=pt_17)
intcrv_6 = Interpolate(Vertices=merge_5, Degree=3, Periodic=False, KnotStyle=1)  # -> Curve, Length, Domain
end_6 = EndPoints(Curve=intcrv_6.Curve)  # -> Start, End
ln_12 = Line(StartPoint=end_6.Start, EndPoint=end_6.End)
rotax_8 = RotateAxis(Geometry=intcrv_6.Curve, Angle=degrees(neg_6), Axis=ln_12)  # -> Geometry, Transform

# ----
# ** geometria barra superior
# *** estrutura A
panel_16 = Panel("BANZO SUPERIOR 1")
pt_19 = ConstructPoint(XCoordinate=0, YCoordinate=0, ZCoordinate="1.80")
pt_20 = ConstructPoint(XCoordinate="100", YCoordinate=0, ZCoordinate="1.80")
ln_13 = Line(StartPoint=pt_19, EndPoint=pt_20)
eval_7 = EvaluateCurve(Curve=reparameterize(ln_13), Parameter=0.5)  # -> Point, Tangent, Angle
Z_8 = UnitZ(Factor=ptmed)
move_14 = Move(Geometry=eval_7.Point, Motion=Z_8)  # -> Geometry, Transform
merge_6 = Merge(Data1=pt_19, Data2=move_14.Geometry, Data3=pt_20)
intcrv_7 = Interpolate(Vertices=merge_6, Degree=3, Periodic=False, KnotStyle=1)  # -> Curve, Length, Domain
rotax_9 = RotateAxis(Geometry=intcrv_7.Curve, Angle="0.0", Axis=Line((0, 0, 0), (10, 0, 0)))  # -> Geometry, Transform

rec_2pt_3 = Rectangle2Pt(Plane=PlaneXY(0, 0, 0), PointA="30.0,9.0,3.6", PointB="70.0,12.0,3.6", Radius=0)  # -> Rectangle, Length
boxrec_2 = BoxRectangle(Rectangle=rec_2pt_3.Rectangle, Height=Slider(7, range=0..10))

recuo = Slider(0, range=0..1)
panel_17 = Panel("Arquibancada")
python = PythonScript(
    start=Slider(4, range=0..100),
    end=Slider(96, range=0..100),
    tread=Slider(1, range=0.18..1),
    landing=Slider(0.4, range=0.15..0.44),
    steps=Slider(10, range=5..15),
    taper=recuo)  # -> out, a, b; inputs steps: Int32
# ---------- python: Python ----------
import rhinoscriptsyntax as rs
import Rhino.Geometry as geo
import scriptcontext as sc

cont = 0
cont2 = 0
cont3 = 0

line = []

while cont < steps:
    lineA = rs.AddLine([start + cont3, cont, cont2],
                       [end - cont3, cont, cont2])
    line.append(lineA)

    lineB = rs.AddLine([start + cont3, cont + 1, cont2],
                       [end - cont3,cont + 1,cont2])
    line.append(lineB)

    cont += tread
    cont2 += landing
    cont3 += taper

a = line



"""
lineA = rs.AddLine([0,0,0],[100,0,0])
lineB = rs.AddLine([0,1,0],[100,1,0])

lineC = rs.AddLine([0,1,0.3],[100,1,0.3])
lineD = rs.AddLine([0,2,0.3],[100,2,0.3])

a = lineA, lineB, lineC, lineD
"""
# ---------- end python ----------
line = Line(python.a)
line_2 = Line(python.b)
loft = Loft(Curves=line, Options={Adjust=False, Closed=False, LoftEnds=0, LoftSimp=0, LoftType=3, Rebuild=10, Refit=0.01})
preview_2 = CustomPreview(Geometry=[loft, boxrec_2], Shader=ColourSwatch(SwatchColor=RGB(255, 255, 255)))

multiplication = Multiplication(A=number_slider, B=1)
divide = DivideCurve(Curve=rotax_9.Geometry, Count=multiplication, Kinks=False)  # -> Points, Tangents, Parameters
divide_2 = DivideCurve(Curve=rotax.Geometry, Count=multiplication, Kinks=False)  # -> Points, Tangents, Parameters
divide_3 = DivideCurve(Curve=rotax_2.Geometry, Count=multiplication, Kinks=False)  # -> Points, Tangents, Parameters
divide_4 = DivideCurve(Curve=rotax_3.Geometry, Count=multiplication, Kinks=False)  # -> Points, Tangents, Parameters
divide_5 = DivideCurve(Curve=rotax_4.Geometry, Count=multiplication, Kinks=False)  # -> Points, Tangents, Parameters
divide_6 = DivideCurve(Curve=rotax_5.Geometry, Count=multiplication, Kinks=False)  # -> Points, Tangents, Parameters
divide_7 = DivideCurve(Curve=rotax_6.Geometry, Count=multiplication, Kinks=False)  # -> Points, Tangents, Parameters
divide_8 = DivideCurve(Curve=rotax_7.Geometry, Count=multiplication, Kinks=False)  # -> Points, Tangents, Parameters
divide_9 = DivideCurve(Curve=rotax_8.Geometry, Count=multiplication, Kinks=False)  # -> Points, Tangents, Parameters
ln_14 = Line(StartPoint=divide.Points, EndPoint=divide_2.Points)
ln_15 = Line(StartPoint=divide_2.Points, EndPoint=divide_3.Points)
ln_16 = Line(StartPoint=divide_3.Points, EndPoint=divide.Points)
ln_17 = Line(StartPoint=divide_3.Points, EndPoint=divide_4.Points)
ln_18 = Line(StartPoint=divide_2.Points, EndPoint=divide_4.Points)
ln_19 = Line(StartPoint=divide_6.Points, EndPoint=divide_5.Points)
ln_20 = Line(StartPoint=divide.Points, EndPoint=divide_5.Points)
ln_21 = Line(StartPoint=divide_5.Points, EndPoint=divide_3.Points)
ln_22 = Line(StartPoint=divide_7.Points, EndPoint=divide_5.Points)
ln_23 = Line(StartPoint=divide_6.Points, EndPoint=divide_7.Points)
ln_24 = Line(StartPoint=divide_7.Points, EndPoint=divide_8.Points)
ln_25 = Line(StartPoint=divide_8.Points, EndPoint=divide_6.Points)
ln_26 = Line(StartPoint=divide_8.Points, EndPoint=divide_9.Points)
ln_27 = Line(StartPoint=divide_7.Points, EndPoint=divide_9.Points)
merge_7 = Merge(
    Data1=ln_14,
    Data2=ln_15,
    Data3=ln_16,
    Data4=ln_17,
    Data5=ln_18,
    Data6=ln_23,
    Data7=ln_24,
    Data8=ln_25,
    Data9=ln_26,
    Data10=ln_27,
    Data11=ln_19,
    Data12=ln_20,
    Data13=ln_21,
    Data14=ln_22)
pline = PolyLine(Vertices=divide.Points, Closed=False)
pline_2 = PolyLine(Vertices=divide_6.Points, Closed=False)
pline_3 = PolyLine(Vertices=divide_2.Points, Closed=False)
pline_4 = PolyLine(Vertices=divide_3.Points, Closed=False)
pline_5 = PolyLine(Vertices=divide_7.Points, Closed=False)
pline_6 = PolyLine(Vertices=divide_8.Points, Closed=False)
pline_7 = PolyLine(Vertices=divide_4.Points, Closed=False)
pline_8 = PolyLine(Vertices=divide_5.Points, Closed=False)
pline_9 = PolyLine(Vertices=divide_9.Points, Closed=False)
explode = Explode(Curve=pline, Recursive=True)  # -> Segments, Vertices
explode_2 = Explode(Curve=pline_2, Recursive=True)  # -> Segments, Vertices
explode_3 = Explode(Curve=pline_3, Recursive=True)  # -> Segments, Vertices
explode_4 = Explode(Curve=pline_4, Recursive=True)  # -> Segments, Vertices
explode_5 = Explode(Curve=pline_5, Recursive=True)  # -> Segments, Vertices
explode_6 = Explode(Curve=pline_6, Recursive=True)  # -> Segments, Vertices
explode_7 = Explode(Curve=pline_7, Recursive=True)  # -> Segments, Vertices
explode_8 = Explode(Curve=pline_8, Recursive=True)  # -> Segments, Vertices
explode_9 = Explode(Curve=pline_9, Recursive=True)  # -> Segments, Vertices

intcrv_8 = Interpolate(Vertices=divide_8.Points, Degree=3, Periodic=False, KnotStyle=1)  # -> Curve, Length, Domain
intcrv_9 = Interpolate(Vertices=divide_9.Points, Degree=3, Periodic=False, KnotStyle=1)  # -> Curve, Length, Domain
intcrv_10 = Interpolate(Vertices=divide_9.Points, Degree=3, Periodic=False, KnotStyle=1)  # -> Curve, Length, Domain
intcrv_11 = Interpolate(Vertices=divide_7.Points, Degree=3, Periodic=False, KnotStyle=1)  # -> Curve, Length, Domain
intcrv_12 = Interpolate(Vertices=divide_7.Points, Degree=3, Periodic=False, KnotStyle=1)  # -> Curve, Length, Domain
intcrv_13 = Interpolate(Vertices=divide_5.Points, Degree=3, Periodic=False, KnotStyle=1)  # -> Curve, Length, Domain
intcrv_14 = Interpolate(Vertices=divide_5.Points, Degree=3, Periodic=False, KnotStyle=1)  # -> Curve, Length, Domain
intcrv_15 = Interpolate(Vertices=divide_3.Points, Degree=3, Periodic=False, KnotStyle=1)  # -> Curve, Length, Domain
intcrv_16 = Interpolate(Vertices=divide_3.Points, Degree=3, Periodic=False, KnotStyle=1)  # -> Curve, Length, Domain
intcrv_17 = Interpolate(Vertices=divide_4.Points, Degree=3, Periodic=False, KnotStyle=1)  # -> Curve, Length, Domain
intcrv_18 = Interpolate(Vertices=divide_4.Points, Degree=3, Periodic=False, KnotStyle=1)  # -> Curve, Length, Domain
intcrv_19 = Interpolate(Vertices=divide_2.Points, Degree=3, Periodic=False, KnotStyle=1)  # -> Curve, Length, Domain
loft_2 = Loft(
    Curves=[intcrv_8.Curve, intcrv_9.Curve],
    Options={Adjust=False, Closed=False, LoftEnds=0, LoftSimp=0, LoftType=0, Rebuild=10, Refit=0.01})
loft_3 = Loft(
    Curves=[intcrv_10.Curve, intcrv_11.Curve],
    Options={Adjust=False, Closed=False, LoftEnds=0, LoftSimp=0, LoftType=0, Rebuild=10, Refit=0.01})
loft_4 = Loft(
    Curves=[intcrv_12.Curve, intcrv_13.Curve],
    Options={Adjust=False, Closed=False, LoftEnds=0, LoftSimp=0, LoftType=0, Rebuild=10, Refit=0.01})
loft_5 = Loft(
    Curves=[intcrv_14.Curve, intcrv_15.Curve],
    Options={Adjust=False, Closed=False, LoftEnds=0, LoftSimp=0, LoftType=0, Rebuild=10, Refit=0.01})
loft_6 = Loft(
    Curves=[intcrv_16.Curve, intcrv_17.Curve],
    Options={Adjust=False, Closed=False, LoftEnds=0, LoftSimp=0, LoftType=0, Rebuild=10, Refit=0.01})
loft_7 = Loft(
    Curves=[intcrv_18.Curve, intcrv_19.Curve],
    Options={Adjust=False, Closed=False, LoftEnds=0, LoftSimp=0, LoftType=0, Rebuild=10, Refit=0.01})

loft_8 = Loft(
    Curves=[intcrv_10.Curve, intcrv_17.Curve],
    Options={Adjust=False, Closed=False, LoftEnds=0, LoftSimp=0, LoftType=0, Rebuild=10, Refit=0.01})

panel_18 = Panel("Membrana translúcida")
merge_8 = Merge(Data1=loft_2, Data2=loft_3, Data3=loft_4, Data4=loft_5, Data5=loft_6, Data6=loft_7)
area = Area(Geometry=merge_8)  # -> Area, Centroid
project = Project(Geometry=loft_8, Plane=PlaneXY(0, 0, 0))  # -> Geometry, Transform
preview_3 = CustomPreview(Geometry=merge_8, Shader=ColourSwatch(SwatchColor=RGBA(255, 255, 255, 206)))
ma = MassAddition(Input=area.Area)  # -> Result, PartialResults

index_a = Slider(18, range=0..29)
index_b = Slider(6, range=0..29)
index_d = Slider(18, range=0..29)

# ----
# GUIA DE BOA PRÁTICA E ESTILO PYTHON
# 
# https://wiki.python.org.br/GuiaDeEstilo
# 
# comentários:
# - primeira letra deve ser maiúscula;
# - usar dois espaços do ponto final permitindo que o Emacs ajuste a linha de maneira consistente.
# - progradores de lingua não-inglesa devem escrever em inglês;
# - deve ser separado por uma linha em branco no topo e embaixo;
# - não faça comentários em coisas óbvias. Eles distraem mais do que ajudam.
# Seção Tubular Circular (TC)
# 
#  0  >   D    --> dimensões externas (mm)
#  1  >   t     --> espessura da parede (mm)
#  2  >   m    --> massa por unidade de comp. (kg/m)
#  3  >   A    --> área da seção transversal (cm²)
#  4  >  Ix/Iy  --> momento de inércia (cm4)
#  5  > rx/ry  --> raio de giração (cm)
#  6  > Wx/Wy --> módulo de resistência elástico (cm³)
#  7  >  Zx/Zy --> módulo de resistência plástico (cm³)
#  8  >    J    --> const. torção (cm4)
#  9  >   Wt   --> módulo de resitência à torção (cm³)
#  10 >    U    --> área de superfície por unidade de comp. (m²/m)
# ** As bitolas são as frequentemente
#     produzidas e por isso adotadas como
#     preferenciais.
# *** Fonte:
#       http:// ww.vallourec.com/COUNTRIES/BRAZIL/PT/
#       Products-and-services/automotive-industrial-
#       tubes/Documents/Catalogo%20Estruturais.pdf
panel_19 = Panel("ABSTRACT")

index_c = Slider(14, range=0..29)

panel_20 = Panel("0.0, -2.2, 0.0")  # disabled
panel_21 = Panel("100.0, -62.2, 0.0")  # disabled
panel_22 = Panel("Campo de futebol")  # disabled
rec_2pt_4 = Rectangle2Pt(Plane=PlaneXY(0, 0, 0), PointA=panel_20, PointB=panel_21, Radius=0)  # -> Rectangle, Length; disabled
football_field = Surface(rec_2pt_4.Rectangle)  # disabled
geo_2 = Geometry(rec_2pt_4.Rectangle)  # disabled

# ---- group: path of the .csv file
path = FilePath("C:\Users\Renato\Desktop\profiles2.csv")

# ----
# Selection of circular tubular section
python_2 = PythonScript(f=path, indexA=index_a, indexB=index_b, indexC=index_c, indexD=index_d)  # -> out, profileA, DiameterA, ThicknessA, profileB, DiameterB, ThicknessB, profileC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; inputs indexA: Int32, indexB: Int32, indexC: Int32, indexD: Int32
# ---------- python_2: Python ----------
import rhinoscriptsyntax as rs

lista = []               # U

f = open(f, 'r')         # Open file for reading

for line in f:
    lista_line = line.rstrip().split('\t')
    lista.append(lista_line)

print lista

W = []                     # lista de Módulo de Resistência Elástico
I = []                     # lista de Momento de Inércia --> Ix == Iy
Z = []                     # lista de Módulo de Resistência Plástico (cm³)

proA = lista[indexA]       # profile A ####### 

pA = proA[0].split(',')    # split strings
diameterA = pA[0] 
DiameterA = float(diameterA) / 10 
thicknessA = pA[1]
ThicknessA = float(thicknessA) / 10 
profileA = diameterA, thicknessA
W.append (pA[6])
I.append (pA[5])
Z.append (pA[7])

proB = lista[indexB]       # profile B ####### 

pB = proB[0].split(',')    # split strings
diameterB = pB[0]
DiameterB = float(diameterB) / 10
thicknessB = pB[1]  
ThicknessB = float(thicknessB) / 10 
profileB = diameterB, thicknessB
W.append (pB[6])
I.append (pB[5])
Z.append (pB[7])

proC = lista[indexC]       # profile C ####### 

pC = proC[0].split(',')    # split strings
diameterC = pC[0]
DiameterC = float(diameterC) / 10
thicknessC = pC[1]
ThicknessC = float(thicknessC) / 10 
profileC = diameterC, thicknessC
W.append (pC[6])
I.append (pC[5])
Z.append (pC[7])

proD = lista[indexD]       # profile D ####### 

pD = proD[0].split(',')    # split strings
diameterD = pD[0]
DiameterD = float(diameterD) / 10
thicknessD = pD[1]
ThicknessD = float(thicknessD) / 10 
profileD = diameterD, thicknessD
W.append (pD[6])
I.append (pD[5])
Z.append (pD[7])
# ---------- end python_2 ----------
merge_9 = Merge(Data1=divide_3.Points, Data2=divide_4.Points, Data3=divide_5.Points, Data4=divide_7.Points, Data5=divide_9.Points)

mass_kg_m² = Panel("0.7")
sobrecarga_kg_m² = Panel("30.0")

merge_10 = Merge(Data1=loft_3, Data2=loft_4, Data3=loft_5, Data4=loft_6)  # disabled

# ---- group: Problema no RUN ENERGY é aqui
# 1) input .epw file path
# 3) check the surface direction
# 2) input the surface
# 4) define the DC-to-AC derate factor
#       (use "0" for annualShading)
# 5) run!
brep = Brep(boxrec)  # disabled
move_15 = Move(Geometry=brep, Motion=Vector(0, 0, 10))  # -> Geometry, Transform; disabled
brep_2 = Brep(move_15.Geometry)  # disabled
roof = Brep(loft_8)  # disabled

# ----
profile_mm = Panel(python_2.profileA)
profile_mm_2 = Panel(python_2.profileB)
profile_mm_3 = Panel(python_2.profileD)
profile_mm_4 = Panel(python_2.profileC)

panel_23 = Panel("Etapa 03")

panel_24 = Panel("Etapa 02")

multiplication_2 = Multiplication(A=ma.Result, B=mass_kg_m²)
area_2 = Area(Geometry=project.Geometry)  # -> Area, Centroid
pt_21 = Point(merge_9)
multiplication_3 = Multiplication(A=area_2.Area, B=sobrecarga_kg_m²)
lng = ListLength(List=pt_21)
addition_15 = Addition(A=multiplication_2, B=multiplication_3)
carga_por_nó = Division(A=addition_15, B=lng)
multiplication_4 = Multiplication(A=carga_por_nó, B=-0.0098)
pt_22 = Point(flatten(pt_21))
num = Number(multiplication_4)
Z_9 = UnitZ(Factor=num)

# ---- group: Módulo de Resistência Elástico (cm3)
panel_25 = Panel(python_2.W)

# ---- group: Momento de Inércia (cm4)
panel_26 = Panel(python_2.I)

# ---- group: Módulo de Resistência Plástico (cm³)
panel_27 = Panel(python_2.Z)

# ----
# DEFINE TREE
# CHARACTERISTICS
treecanopytransmittance = Panel("0.5")  # disabled
# SELECT WEATHER FILE + RUN PERIOD
honeybee = Honeybee_Honeybee()  # -> Vviiiiiiiiiizzz; disabled; plug-in component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
evaluation_surface = Brep(loft)  # disabled

# ----
# DEFINE GROUND ZONE
brep_3 = Brep(boxrec)  # disabled
toggle = BooleanToggle(True)  # disabled
mass2zone = Honeybee_Masses2Zones(zoneMasses=flatten(brep_3), isConditioned=True, maxRoofAngle=30, createHBZones=toggle)  # -> readMe, HBZones; disabled; plug-in component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
soil_type = Panel("2")  # disabled
createepground = Honeybee_CreateEPGround(HBZones=mass2zone.HBZones, soilTypeOrMat=soil_type)  # -> HBGrndZones; disabled; plug-in component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

srf = Surface(rec_2pt_2.Rectangle)  # disabled
ladybug = Ladybug_Ladybug()  # -> Vviiiiiiiiiizzz; plug-in component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
brep_4 = Brep(srf)  # disabled

# ---- group: PVsurface normal direction check
panel_28 = Panel("0.5,0.5")  # disabled
evalsrf = EvaluateSurface(Surface=reparameterize(graft(merge_10)), Point=panel_28)  # -> Point, Normal, Frame; disabled
vdis = VectorDisplay(Anchor=evalsrf.Point, Vector=expr("x*10", evalsrf.Normal))  # disabled

# ---- group: extract surface from polysurface
srf_2 = Surface(flatten(merge_10))  # disabled

# ----
merge_11 = Merge(Data1=explode.Segments, Data2=explode_2.Segments)
merge_12 = Merge(Data1=explode_7.Segments, Data2=explode_8.Segments, Data3=explode_9.Segments)
merge_13 = Merge(Data1=explode_3.Segments, Data2=explode_4.Segments, Data3=explode_5.Segments, Data4=explode_6.Segments)
entwine = Entwine(Branch00=merge_11, Branch01=merge_13, Branch02=merge_12, Branch03=merge_7, FlattenInputs=True)

# ---- group: Factor in Tree for Energy Simulation
panel_29 = Panel("TreeTransP")  # disabled
constantschedule = Honeybee_ConstantSchedule(value=treecanopytransmittance, scheduleName=panel_29)  # -> readMe, schedule, weekSched, schedIDFText; disabled; plug-in component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
hb_epcontextsrf = HoneybeeEPContextSurfaces(shdSurfaces=flatten(brep_2), EPTransSchedule=constantschedule.schedule)  # -> HBContext; inputs shdSurfaces: list of Brep, justBoundingBox: Boolean; disabled
# ---------- hb_epcontextsrf: Python ----------
"""
prepare shading/context geometries

    Args:
        northVectorOrRotation: A vector that shows North or a number that shows
                               the rotation of the North from the Y axis
        bldgMasses: List of closed Breps as thermal zones.
    Returns:
        report: ...
        thermalZones: Thermal zone's geometries for visualiza
"""

ghenv.Component.Name = 'Honeybee EP context Surfaces'
ghenv.Component.NickName = 'HB_EPContextSrf'
ghenv.Component.Message = 'VER 0.0.62\nJUL_28_2017'
ghenv.Component.IconDisplayMode = ghenv.Component.IconDisplayMode.application
ghenv.Component.Category = "Honeybee"
ghenv.Component.SubCategory = "10 | Energy | Energy"
#compatibleHBVersion = VER 0.0.57\nNOV_04_2016
#compatibleLBVersion = VER 0.0.59\nFEB_01_2015
ghenv.Component.AdditionalHelpFromDocStrings = "2"

import rhinoscriptsyntax as rs
import Rhino as rc
import scriptcontext as sc
import os
import System
import Grasshopper.Kernel as gh
import uuid

tolerance = sc.doc.ModelAbsoluteTolerance
import math


def main(shdSurfaces, EPTransSchedule, meshingSettings, justBoundingBox):
    
    # import the classes
    if sc.sticky.has_key('honeybee_release'):

        try:
            if not sc.sticky['honeybee_release'].isCompatible(ghenv.Component): return -1
            if sc.sticky['honeybee_release'].isInputMissing(ghenv.Component): return -1
        except:
            warning = "You need a newer version of Honeybee to use this compoent." + \
            " Use updateHoneybee component to update userObjects.\n" + \
            "If you have already updated userObjects drag Honeybee_Honeybee component " + \
            "into canvas and try again."
            w = gh.GH_RuntimeMessageLevel.Warning
            ghenv.Component.AddRuntimeMessage(w, warning)
            return -1
        
        # don't customize this part
        hb_EPSrf = sc.sticky["honeybee_EPSurface"]
        hb_EPSHDSurface = sc.sticky["honeybee_EPShdSurface"]
        hb_RADMaterialAUX = sc.sticky["honeybee_RADMaterialAUX"]
        hb_EPObjectsAux = sc.sticky["honeybee_EPObjectsAUX"]()
        HBScheduleList = sc.sticky["honeybee_ScheduleLib"].keys()

        ########################################################################
        #----------------------------------------------------------------------#
        shdBreps = []
        # create bounding box of shading geometries
        if justBoundingBox:
            for brep in shdSurfaces:
                if brep.Faces.Count>1 or not brep.Faces[0].IsPlanar(sc.doc.ModelAbsoluteTolerance):
                    shdBreps.append(brep.GetBoundingBox(True).ToBrep())
                else:
                    shdBreps.append(brep)
        else:
            shdBreps = shdSurfaces
        
        shadingClasses = []
        shadingMeshPreview = []
        
        if meshingSettings == None:
            mp = rc.Geometry.MeshingParameters.Minimal
            mp.SimplePlanes = True
        else:
            mp = meshingSettings
        
        def getRadMaterialName(radMaterial):
            nameStr = radMaterial.split(" ")[2]
            name =  nameStr.split("\n")[0]
            return name
        
        for brepCount, brep in enumerate(shdBreps):
            if brep != None:
                isPlanar = True
                # check planarity
                for face in brep.Faces:
                    if not face.IsPlanar(tolerance):
                        isPlanar = False
                        break
                
                shadingBreps = []
                if not isPlanar:
                    meshArray = rc.Geometry.Mesh.CreateFromBrep(brep, mp)
                    for mesh in meshArray:
                        for meshFace in range(mesh.Faces.Count):
                            vertices = list(mesh.Faces.GetFaceVertices(meshFace))[1:]
                            vertices = vertices + [sc.doc.ModelAbsoluteTolerance]
                            # create the brep from mesh
                            shdBrep = rc.Geometry.Brep.CreateFromCornerPoints(*vertices)
                            shadingBreps.append(shdBrep)
                else:
                    for face in brep.Faces:
                        shadingBreps.append(face.DuplicateFace(False))
                
                for faceCount, shdBrep in enumerate(shadingBreps):
                        thisShading = hb_EPSHDSurface(shdBrep, 1000*brepCount + faceCount, 'shdSrf_' + `brepCount` + '_' + `faceCount` + "_" + str(uuid.uuid4()))
                        
                        # add transmittance schedule if any
                        if EPTransSchedule!=None:
                            schedule= EPTransSchedule.upper()
                            if schedule!=None and not schedule.lower().endswith(".csv") and schedule not in HBScheduleList:
                                msg = "Cannot find " + schedule + " in Honeybee schedule library."
                                print msg
                                ghenv.Component.AddRuntimeMessage(gh.GH_RuntimeMessageLevel.Warning, msg)
                                return -1
                            elif schedule!=None and schedule.lower().endswith(".csv"):
                                # check if csv file is existed
                                if not os.path.isfile(schedule):
                                    msg = "Cannot find the shchedule file: " + schedule
                                    print msg
                                    ghenv.Component.AddRuntimeMessage(gh.GH_RuntimeMessageLevel.Warning, msg)
                                    return -1
                            
                            thisShading.TransmittanceSCH = schedule
                        
                        # add the Rad Material if any
                        if RADMaterial!=None:
                            # if it is just the name of the material make sure it is already defined
                            if len(RADMaterial.split(" ")) == 1:
                                # if the material is not in the library add it to the library
                                if not hb_RADMaterialAUX.isMatrialExistInLibrary(RADMaterial):
                                    warningMsg = "Can't find " + RADMaterial + " in RAD Material Library.\n" + \
                                                "Add the material to the library and try again."
                                    ghenv.Component.AddRuntimeMessage(gh.GH_RuntimeMessageLevel.Warning, warningMsg)
                                    return
                                
                                try:
                                    thisShading.setRADMaterial(RADMaterial)
                                except Exception, e:
                                    print e
                                    warningMsg = "You are using an old version of Honeybee_Honeybee! Update your files and try again."
                                    print warningMsg
                                    ghenv.Component.AddRuntimeMessage(gh.GH_RuntimeMessageLevel.Warning, warningMsg)
                                    return
                                
                                addedToLib = True
                            else:
                                
                                # try to add the material to the library
                                addedToLib, thisShading.RadMaterial = hb_RADMaterialAUX.analyseRadMaterials(RADMaterial, True)
                                
                            if addedToLib==False:
                                warningMsg = "Failed to add " + RADMaterial + " to the Library."
                                ghenv.Component.AddRuntimeMessage(gh.GH_RuntimeMessageLevel.Warning, warningMsg)
                                return
                        
                        # add shading to the list
                        shadingClasses.append(thisShading)
                
        # add to the hive
        hb_hive = sc.sticky["honeybee_Hive"]()
        HBContext  = hb_hive.addToHoneybeeHive(shadingClasses, ghenv.Component)
        return HBContext
        ################################################################################################
    else:
        print "You should first let Honeybee to fly..."
        w = gh.GH_RuntimeMessageLevel.Warning
        ghenv.Component.AddRuntimeMessage(w, "You should first let Honeybee to fly...")
        return -1
        

if _shdSurfaces and _shdSurfaces[0]!=None:
    # add cleaning function
    result= main(_shdSurfaces, EPTransSchedule_, meshingSettings_, justBoundingBox_)
    
    if result != -1: HBContext = result
# ---------- end hb_epcontextsrf ----------

# ----
# criar suporte para os banzos superiores e inferiores
# 
# ????????????????????????????????????????????????????????????????????????????????????????????????
vec2pt = Vector2Pt(PointA=pt_19, PointB=pt_20, Unitize=False)  # -> Vector, Length
merge_14 = Merge(Data1=pt_19, Data2=pt_20)
align = AlignPlane(Plane=pt_19, Direction=vec2pt.Vector)  # -> Plane, Angle
pln = Plane(align.Plane)

vec2pt_2 = Vector2Pt(PointA=pt_11, PointB=pt_12, Unitize=False)  # -> Vector, Length
merge_15 = Merge(Data1=pt_11, Data2=pt_12)
align_2 = AlignPlane(Plane=pt_11, Direction=vec2pt_2.Vector)  # -> Plane, Angle
pln_2 = Plane(align_2.Plane)

panel_30 = Panel("B")
panel_31 = Panel("A")
panel_32 = Panel("D")
panel_33 = Panel("C")
cross_sections = CrossSectionsKaramba(
    ElementsIdentifiers=panel_31,
    Diameter_cm=python_2.DiameterA,
    WallThickness_cm=python_2.ThicknessA,
    mode="Circular Hollow")
cross_sections_2 = CrossSectionsKaramba(
    ElementsIdentifiers=panel_30,
    Diameter_cm=python_2.DiameterB,
    WallThickness_cm=python_2.ThicknessB,
    mode="Circular Hollow")
cross_sections_3 = CrossSectionsKaramba(
    ElementsIdentifiers=panel_33,
    Diameter_cm=python_2.DiameterC,
    WallThickness_cm=python_2.ThicknessC,
    mode="Circular Hollow")
cross_sections_4 = CrossSectionsKaramba(
    ElementsIdentifiers=panel_32,
    Diameter_cm=python_2.DiameterD,
    WallThickness_cm=python_2.ThicknessD,
    mode="Circular Hollow")

supp = SupportKaramba(PosInd=merge_15, PlaneOfReference=pln_2, menu=[buttons(on, on, on, off, off, off)])
supp_2 = SupportKaramba(PosInd=merge_14, PlaneOfReference=pln, menu=[buttons(on, on, on, off, off, off)])
panel_34 = Panel("Apoios")

crosec = CrossSectionKaramba([cross_sections, cross_sections_2, cross_sections_3, cross_sections_4])

# ----
# Valor de Χ em função do índice de esbeltez  λ0
# 
# ** fonte: NBR 8800
python_3 = PythonScript()  # -> out, a
# ---------- python_3: Python ----------
lista = {
         0.00: [1.000], 0.01: [1.000], 0.02: [1.000], 0.03: [1.000], 0.04: [0.999], 
         0.05: [0.999], 0.06: [0.998], 0.07: [0.998], 0.08: [0.997], 0.09: [0.997],
         0.10: [0.996], 0.11: [0.995], 0.02: [0.994], 0.13: [0.993], 0.14: [0.992], 
         0.15: [0.991], 0.16: [0.989], 0.17: [0.988], 0.18: [0.987], 0.19: [0.985],
         0.20: [0.983], 0.21: [0.982], 0.02: [0.980], 0.23: [0.978], 0.24: [0.976], 
         0.25: [0.974], 0.26: [0.972], 0.27: [0.970], 0.28: [0.968], 0.29: [0.965],
         0.30: [0.963], 0.31: [0.961], 0.32: [0.958], 0.33: [0.955], 0.34: [0.953], 
         0.35: [0.950], 0.36: [0.947], 0.37: [0.944], 0.38: [0.941], 0.39: [0.938],
         0.40: [0.935], 0.41: [0.932], 0.42: [0.929], 0.43: [0.926], 0.44: [0.922], 
         0.45: [0.919], 0.46: [0.915], 0.47: [0.912], 0.48: [0.908], 0.49: [0.904],
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         }

num = lista[0.26]
print num
# ---------- end python_3 ----------
python_4 = PythonScript()  # -> out, tabela
# ---------- python_4: Python ----------
tabela = {
         0.00: [1.000], 0.01: [1.000], 0.02: [1.000], 0.03: [1.000], 0.04: [0.999], 
         0.05: [0.999], 0.06: [0.998], 0.07: [0.998], 0.08: [0.997], 0.09: [0.997],
         0.10: [0.996], 0.11: [0.995], 0.02: [0.994], 0.13: [0.993], 0.14: [0.992], 
         0.15: [0.991], 0.16: [0.989], 0.17: [0.988], 0.18: [0.987], 0.19: [0.985],
         0.20: [0.983], 0.21: [0.982], 0.02: [0.980], 0.23: [0.978], 0.24: [0.976], 
         0.25: [0.974], 0.26: [0.972], 0.27: [0.970], 0.28: [0.968], 0.29: [0.965],
         0.30: [0.963], 0.31: [0.961], 0.32: [0.958], 0.33: [0.955], 0.34: [0.953], 
         0.35: [0.950], 0.36: [0.947], 0.37: [0.944], 0.38: [0.941], 0.39: [0.938],
         0.40: [0.935], 0.41: [0.932], 0.42: [0.929], 0.43: [0.926], 0.44: [0.922], 
         0.45: [0.919], 0.46: [0.915], 0.47: [0.912], 0.48: [0.908], 0.49: [0.904],
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         }

print (type(tabela))
# ---------- end python_4 ----------

data = Data(flatten(treecanopytransmittance))  # disabled
geo_3 = Geometry(flatten(brep_2))  # disabled
panel_35 = Panel("""OutputControl:Table:Style,Comma;
Output:Variable,*,Surface Outside Face Temperature, hourly;""")  # disabled
# 2
toggle_2 = BooleanToggle(True)  # disabled

panel_36 = Panel("Elementos")
panel_37 = Panel("D")
panel_38 = Panel("""A
B
C
D""")
panel_39 = Panel("A")
panel_40 = Panel("B")
panel_41 = Panel("C")
linetobeam = LineToBeamKaramba(Line=entwine, New=True, Remove=True, LimitDistance_m=0.005, BeamIdentifier=graft(panel_38))  # -> Points, flatten(Element), Info
modifyelem = ModifyElementKaramba(BeamIdentifier=panel_39, Alpha_deg="90", mode="Beam")
modifyelem_2 = ModifyElementKaramba(BeamIdentifier=panel_40, Alpha_deg="90", mode="Beam")
modifyelem_3 = ModifyElementKaramba(BeamIdentifier=panel_41, Alpha_deg="90", mode="Beam")
modifyelem_4 = ModifyElementKaramba(BeamIdentifier=panel_37, Bending=Toggle(True), mode="Beam")

panel_42 = Panel("""A
B
C
D""")
matselect = MaterialSelectionKaramba(ElementsIdentifiers=panel_42, menu=[dropdown(1), dropdown(54)])
panel_43 = Panel("Material")

panel_44 = Panel("Cargas")
loads = LoadsKaramba(ForceVector=Z_9, Local=True, PosInd=pt_22, LCase=0, mode="Point")
loads_2 = LoadsKaramba(Vector=Vector(0, 0, -1), LCase=0, mode="Gravity")

# ----
# * Resistência ao escoamento do aço 250 MPa;
# 
# ** Resistance (KN/mm²)
# * Módulo de elasticidade (KN/mm²)
# 
# ** E = 200 000 MPa
panel_45 = Panel("Etapa 01")

# ----
# Coeficiente de flambagem por flexão de elementos isolados
# 
# a --> Kx/Ky = 0.5; valor teórico --> 0.65; valor recomendado
# b --> Kx/Ky = 0.7; valor teórico --> 0.80; valor recomendado
# c --> Kx/Ky = 1.0; valor teórico --> 1.20; valor recomendado
# d --> Kx/Ky = 1.0; valor teórico --> 1.00; valor recomendado
# e --> Kx/Ky = 2.0; valor teórico --> 2.10; valor recomendado
# f --> Kx/Ky = 2.0; valor teórico --> 2.00; valor recomendado
# 
# * condição:
#   a - 1ª e 2º extremidade: rotação e translação impedidas;
#   b - 1ª extremidade: rotação livre, translação impedida
#       2º extremidade: rotação e translação impedida;
#   c - 1ª extremidade: rotação impedida, translação livre
#       2º extremidade: rotação e translação impedida;
#   d - 1ª e 2ª extremidade: rotação livre, translação impedida,
#   e - 1ª extremidade: rotação e translação livre,
#       2º extremidade: rotação e translação impedida;
#   f - 1ª extremidade: rotação impedida, translação livre,
#       2º extremidade: rotação livre, translação impedida;
# 
# ** fonte: Tabela E.1 - NBR 8800
# Tração - Dimensionamento
# 
# Ntsd ≤ Ntrd
# 
# onde:
# Ntsd = força axial de tração solicitante de cálculo;
# 
# Ntrd = força axial de tração resistente de cálculo.
# 
# A força axial de tração resistente de cálculo deve ser o menor dos valores obtidos nas esquações abaixos:
# 
# Ntrd = Ag fy / γa1
# 
# Ntrd = Ae fu / γa2
# Compressão - Dimensionamento
# 
# Ncsd ≤ Ncrd
# 
# onde:
# Nc, sd = força axial de compressão solicitante de cálculo;
# Nc, rd = força axial de compressão resistente de cálculo;
# 
# A força axial resistente de cálculo é dada pela equação abaixo:
# 
# Ncrs = χ Q Ag fy / γa1
# 
# onde:
# 
# χ = fator de redução associado à resistência à compressão determinado:
# 
# λ ≤ 1.5 --> χ = 0.658 ** (λ**2)
# λ > 1.5 --> χ = 0.877 / (λ**2)
# 
# λ = √ (Q Ag fy) / Ne
# 
# *************
# Fator de redução para flambagem local -
# Elementos de seção tubular circular
# 
# Não é previsto utilização de seções com D/t > 0.45 E / fy (NBR 8800)
# 
# Q = 1.00, para D/t ≤ E/fy
# 
# Q = 0.038 E / fy(D/t) + 2/3, para 0.11E/fy < D/t ≤ 0.45 E/fy
# Momento fletor resistente de cálculo
# 
# para seções superiores com relação:
# D/t > 0.45 * E / fy
# 
# equação 01
# Mrd = Mp1/γa1 --> para λ <= λp
# 
# onde:
# Mpl - momento fletor de plastificação da seção transversal, igual ao produto do módulo de resistência plástico (Z) pela resistência ao escoamento do aço (fy). (NBR 8800, p. 147)
# 
# 
# equação 02
# Mrd = 1/γa1((0.021E / (D/t)) + fy) * w --> para λp < λ < λr
# 
# equação 03
# Mrd = (1 * 0.33E / γa1 * D/t) * W      --> para λ > λr
# 
# com:
# λ = D / t
# λp = 0.07 * (E / fy)
# λr = 0.31 * (E / fy)
# CRIAR penalidade para seções com D/t > 0.45 E / fy
# ** Reference NBR 8800
panel_46 = Panel("ABSTRACT")

panel_47 = Panel("1")  # disabled
toggle_3 = BooleanToggle(True)  # disabled
# CALCULATE
# VIEW FACTORS
toggle_4 = BooleanToggle(True)  # disabled
indoorviewfactor = Honeybee_IndoorViewFactorCalculator(
    HBZones=flatten(createepground),
    gridSize=panel_47,
    distFromFloorOrSrf=flatten(brep_4),
    additionalShading=flatten(geo_3),
    addShdTransmiss=flatten(data),
    includeOutdoor=toggle_3,
    parallel=toggle_4,
    buildMesh=toggle_2,
    runIt=toggle_2)  # -> readMe, port, viewFactorMesh, viewFactorInfo, port_2, testPts, viewMeshFaces, zoneWireFrame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; disabled; plug-in component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

# ----
# 1
toggle_5 = BooleanToggle(False)  # disabled
panel_48 = Panel("270")  # disabled

panel_49 = Panel("PV performance analysis")  # disabled
panel_50 = Panel("0")  # disabled
dctoacderatefactor = Ladybug_DCToACDerateFactor(
    annualShading=panel_50,
    age=0,
    snow=0,
    wiring=2,
    soiling=2,
    mismatch=2,
    availability=3,
    connections=0.5,
    nameplateRating=1,
    lightInducedDegradation=1.5)  # -> readMe, totalLosses, DCtoACderateFactor; disabled; plug-in component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
panel_51 = Panel("c:/ladybug")  # disabled
ladybug_2 = Ladybug_Ladybug(defaultFolder=panel_51)  # -> Vviiiiiiiiiizzz; disabled; plug-in component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
panel_52 = Panel(dctoacderatefactor.DCtoACderateFactor)  # disabled
panel_53 = Panel("https://energyplus.net/weather-download/south_america_wmo_region_3/BRA//BRA_MG_Ouro.Branco.868230_INMET/all")  # disabled
epw_stat = Ladybug_OpenEPWAndSTATWeatherFiles(weatherFileURL=panel_53)  # -> epwFile, statFile; disabled; plug-in component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
toggle_6 = BooleanToggle(True)  # disabled
photovoltaicssurface = Ladybug_PhotovoltaicsSurface(
    epwFile=epw_stat.epwFile,
    PVsurface=graft(srf_2),
    PVsurfacePercent=100,
    DCtoACderateFactor=dctoacderatefactor.DCtoACderateFactor,
    PVmoduleSettings=["close roof mount", "c-Si", 1, 90, 15, -0.5, -2.98, -0.0471, 1],
    north=panel_48,
    runIt=toggle_6)  # -> readMe, port, ACenergyPerHour, ACenergyPerYear, averageDailyACenergyPerYear, port_2, DCenergyPerHour, totalRadiationPerHour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; disabled; plug-in component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
toggle_7 = BooleanToggle(True)  # disabled
r_kwh = Panel("0.36")  # disabled
photovoltaicsperformancemetrics = Ladybug_PhotovoltaicsPerformanceMetrics(
    PVsurface=graft(srf_2),
    PVsurfacePercent="100",
    PVmoduleSettings=["close roof mount", "c-Si", 1, 90, 15, -0.5, -2.98, -0.0471, 1],
    ACenergyPerHour=photovoltaicssurface.ACenergyPerHour,
    totalRadiationPerHour=photovoltaicssurface.totalRadiationPerHour,
    cellTemperaturePerHour=photovoltaicssurface.cellTemperaturePerHour,
    energyCostPerKWh=r_kwh,
    embodiedEnergyPerM2="4410",
    embodiedCO2PerM2="225",
    gridEfficiency=29,
    optimal=False,
    runIt=toggle_7)  # -> readMe, optimalSystemSize, port, CUFperYear, basicPRperYear, temperatureCorrectedPRperMonth, temperatureCorrectedPRperYear, port_2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; disabled; plug-in component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

importstat = Ladybug_ImportStat(statFile=epw_stat.statFile)  # -> readMe, ashraeClimateZone, koppenClimateZone, port, heatingDesignTemp, coolingDesignTemp, port_2, extremeHotWeek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; disabled; plug-in component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

support = SupportKaramba([supp_2, supp])
load = LoadKaramba(flatten([loads_2, loads]))
assemble = AssembleModelKaramba(
    Elem=[linetobeam.Element, modifyelem_4, modifyelem_3, modifyelem, modifyelem_2],
    Support=support,
    Load=load,
    CrossSection=crosec,
    Material=matselect,
    LimitDistance_m=0.005)  # -> Model, Info, Mass_kg, CenterOfGravity
analyzethi = AnalyzeThIKaramba(Model=assemble.Model)  # -> CalculatedModel, MaximumDisplacement_m, ResultingForceOfGravity_kN, ElasticEnergy_kNm
modelview = ModelViewKaramba(Model=analyzethi.CalculatedModel, LoadCaseFactorsForLinearSuperposition=1, IndexIncrementOfVisibleLoadcase=0)  # -> Model, DeformedMesh, DeformedAxes, DeformedModel
beamview = BeamViewKaramba(Model=modelview.Model)  # -> Model, MeshesOfRenderedBeams, DeformedBeamAxes, LegendColors, LegendTags

# ----
# RUN ENERGY SIM
exporttoopenstudio = Honeybee_ExportToOpenStudio(
    north=panel_48,
    epwWeatherFile=epw_stat.epwFile,
    analysisPeriod=importstat.extremeHotWeek,
    HBZones=flatten(createepground),
    HBContext=flatten(hb_epcontextsrf),
    simulationOutputs=flatten(panel_35),
    writeOSM=toggle_5,
    runSimulation=toggle_5)  # -> readMe, osmFileAddress, idfFileAddress, resultFileAddress, eioFileAddress, rddFileAddress, htmlReport, studyFolder, model; disabled; plug-in component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
readepsrfresult = Honeybee_ReadEPSurfaceResult(resultFileAddress=exporttoopenstudio.resultFileAddress)  # -> surfaceIndoorTemp, surfaceOutdoorTemp, surfaceEnergyFlow, opaqueEnergyFlow, glazEnergyFlow, windowTotalSolarEnergy, windowBeamEnergy, windowDiffEnergy, windowTransmissivity, otherSurfaceData; disabled; plug-in component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

diameter = Merge(Data1=python_2.DiameterA, Data2=python_2.DiameterB, Data3=python_2.DiameterC, Data4=python_2.DiameterD)
thickness = Merge(Data1=python_2.ThicknessA, Data2=python_2.ThicknessB, Data3=python_2.ThicknessC, Data4=python_2.ThicknessD)
# Calculate Nt,rd and Nc,rd
python_5 = PythonScript(diameterCm=diameter, thicknessCm=thickness, fy="0.25", E="200", I=python_2.I, K="2.10")  # -> out, forceTraction, forceCompression; inputs diameterCm: list, thicknessCm: list, E: Int32, I: list
# ---------- python_5: Python ----------
import math

listDiameter = (diameterCm)
listThickness = (thicknessCm)
num = (len(listThickness))

cont = 0

momentInertia = I 

γa1 = 1.10

forceTraction = []
forceCompression = []

while cont < num:

    D = listDiameter[cont] * 10      # diameter (cm -> mm) ATENÇÃO (conferir se é em cm)
    t = listThickness[cont] * 10     # thickness (cm -> mm)
    
    Ag = math.pi * (D * t - t ** 2)  # profile area
    
    #traction

    Ntrd = (Ag * fy) / γa1           # força axial de tração resistente de cálculo
    forceTraction.append(Ntrd)
    print ('Nt,rd %s: %.2f KN' % (cont, Ntrd))

    #compression

    if D/t <= E/fy:
        Q = 1.00
    else:
        Q = (0.038 * E) / ((fy * (D / t)) + 2 / 3)                  # para 0.11E/fy < D/t ≤ 0.45 E/fy
                                                                    # ATENÇÃO Não é previsto utilização de seções com D/t > 0.45 E / fy (NBR 8800)

    Ne = (((math.pi)** 2) * (E * momentInertia[cont])) / (K) ** 2   # KL tabela E.1 NBR 8800
    cont += 1
    λ = math.sqrt(Q * Ag * fy) / Ne                                 # índice de esbeltez reduzido    
    if λ <= 1.5:
        χ = 0.658 ** (λ ** 2)                                       # (χ)fator de redução associado à resistência à compressão
    else:
        χ = 0.877 / (λ ** 2)
    Ncrs = (χ * Q * Ag * fy) / γa1                                  # força axial de compressão resistente de cálculo
    forceCompression.append(Ncrs)
    print ('Nc,rd %s: %.2f KN' % (cont, Ncrs))
    
#print λ
# ---------- end python_5 ----------
python_6 = PythonScript(diameterCm=diameter, thicknessCm=thickness, fy="0.25", E="200", W=python_2.W, Z=python_2.Z)  # -> out, listMrd; inputs diameterCm: list, thicknessCm: list, W: list, Z: list
# ---------- python_6: Python ----------
import math

listDiameter = (diameterCm)
listThickness = (thicknessCm)
num = (len(listThickness))

ResistanceElastic = W

γa1 = 1.10

cont = 0

listMrd = []

while cont < num:

    D = listDiameter[cont] * 10      # diameter (cm -> mm) ATENÇÃO (conferir se é em cm)
    t = listThickness[cont] * 10     # thickness (cm -> mm)
    
    Ag = math.pi * (D * t - t ** 2)  # profile area
    #print ('Area %.2f' % Ag)
    
    λ = D / t                        # parâmetro de esbeltez da seção transversal
    λp = 0.07 * (E / fy)             # parâmetro de esbeltez correspondente à plastificação
    λr = 0.31 * (E / fy)             # parâmetro de esbeltez correspondente ao início do escoamento
    #print ('P.E. seção trans: %s' %λ)
    #print ('P.E. plastiicação: %s' %λp)
    #print ('P.E. escoamento: %s' %λr)
    
    if λ <= λp:           # equação 67
        Mrd = ((Z[cont]) * fy) / γa1   # Mpl (Mom. Fletor de Plastificação)= Z * fy
        listMrd.append(Mrd)
    elif λp < λ < λr:     # equação 68
        Mrd = ((1/γa1) * ((0.021 * E) / (D / t)) + fy) * ResistanceElastic[cont]
        listMrd.append(Mrd)
    else:                 # equação 69
        Mrd = ((1 * 0.33 * E) / (γa1 * (D / t))) * ResistanceElastic[cont]
        listMrd.append(Mrd)
    cont += 1
    
    print ('Mrd %s: %.2f KNm' % (cont, Mrd))
# ---------- end python_6 ----------
panel_54 = Panel("Calculate Mrd")

panel_55 = Panel("A")
panel_56 = Panel("B")
panel_57 = Panel("C")
panel_58 = Panel("D")
b_res_force = BeamResultantForcesKaramba(
    AnalyzedModel=analyzethi.CalculatedModel,
    BeamIdentifiers=panel_55,
    LoadCase=-1,
    MaximumProbingDistance_m=-1,
    NumberOfProbingPointsPerElement=3)  # -> AnalyzedModel, NormalForce_kN, ResultantBendingMoment_kNm, ResultantShearForce_kN
b_res_force_2 = BeamResultantForcesKaramba(
    AnalyzedModel=analyzethi.CalculatedModel,
    BeamIdentifiers=panel_56,
    LoadCase=-1,
    MaximumProbingDistance_m=-1,
    NumberOfProbingPointsPerElement=3)  # -> AnalyzedModel, NormalForce_kN, ResultantBendingMoment_kNm, ResultantShearForce_kN
b_res_force_3 = BeamResultantForcesKaramba(
    AnalyzedModel=analyzethi.CalculatedModel,
    BeamIdentifiers=panel_57,
    LoadCase=-1,
    MaximumProbingDistance_m=-1,
    NumberOfProbingPointsPerElement=3)  # -> AnalyzedModel, NormalForce_kN, ResultantBendingMoment_kNm, ResultantShearForce_kN
b_res_force_4 = BeamResultantForcesKaramba(
    AnalyzedModel=analyzethi.CalculatedModel,
    BeamIdentifiers=panel_58,
    LoadCase=-1,
    MaximumProbingDistance_m=-1,
    NumberOfProbingPointsPerElement=3)  # -> AnalyzedModel, NormalForce_kN, ResultantBendingMoment_kNm, ResultantShearForce_kN

max_displacement_m = Panel(analyzethi.MaximumDisplacement_m)
model_mass_kg = Panel(assemble.Mass_kg)
info = Panel(python_6.out)
info_2 = Panel(python_5.out)
legend = Legend(Colour=beamview.LegendColors, Tags=beamview.LegendTags, LegendType=1)
# Search Nt,sd and Nc,sd maximum
python_7 = PythonScript(normalForce=b_res_force.NormalForce_kN)  # -> out, traction, compression; inputs normalForce: list
# ---------- python_7: Python ----------
# ***** NORMAL FORCE *****
L = normalForce

listMax = map(abs, L)
listMax.sort()
forceMax = (listMax[-1])

traction = forceMax
compression = forceMax

print ('A --> Max Mt,sd: %0.2f KNm'% traction)
print ('A --> Max Mc,sd: %0.2f KNm'% compression)
# ---------- end python_7 ----------
python_8 = PythonScript(normalForce=b_res_force_2.NormalForce_kN)  # -> out, traction, compression; inputs normalForce: list
# ---------- python_8: Python ----------
# ***** NORMAL FORCE *****
L = normalForce

listMax = map(abs, L)
listMax.sort()
forceMax = (listMax[-1])

traction = forceMax
compression = forceMax

print ('B --> Max Mt,sd: %0.2f KNm'% traction)
print ('B --> Max Mc,sd: %0.2f KNm'% compression)
# ---------- end python_8 ----------
python_9 = PythonScript(normalForce=b_res_force_3.NormalForce_kN)  # -> out, traction, compression; inputs normalForce: list
# ---------- python_9: Python ----------
# ***** NORMAL FORCE *****
L = normalForce

listMax = map(abs, L)
listMax.sort()
forceMax = (listMax[-1])

traction = forceMax
compression = forceMax

print ('C --> Max Mt,sd: %0.2f KNm'% traction)
print ('C --> Max Mc,sd: %0.2f KNm'% compression)
# ---------- end python_9 ----------
python_10 = PythonScript(normalForce=b_res_force_4.NormalForce_kN)  # -> out, traction, compression; inputs normalForce: list
# ---------- python_10: Python ----------
# ***** NORMAL FORCE *****
L = normalForce

listMax = map(abs, L)
listMax.sort()
forceMax = (listMax[-1])

traction = forceMax
compression = forceMax

print ('D --> Max Mt,sd: %0.2f KNm'% traction)
print ('D --> Max Mc,sd: %0.2f KNm'% compression)
# ---------- end python_10 ----------
python_11 = PythonScript(bendingMoment=b_res_force.ResultantBendingMoment_kNm)  # -> out, maximumBendingMoment; inputs bendingMoment: list
# ---------- python_11: Python ----------
listBM = bendingMoment

listBM.sort()
maximumBendingMoment = listBM[-1]

print ('A --> Max Msd: %0.2f KNm'% maximumBendingMoment)
# ---------- end python_11 ----------
python_12 = PythonScript(bendingMoment=b_res_force_2.ResultantBendingMoment_kNm)  # -> out, maximumBendingMoment; inputs bendingMoment: list
# ---------- python_12: Python ----------
listBM = bendingMoment

listBM.sort()
maximumBendingMoment = listBM[-1]

print ('B --> Max Msd: %0.2f KNm'% maximumBendingMoment)
# ---------- end python_12 ----------
python_13 = PythonScript(bendingMoment=b_res_force_3.ResultantBendingMoment_kNm)  # -> out, maximumBendingMoment; inputs bendingMoment: list
# ---------- python_13: Python ----------
listBM = bendingMoment

listBM.sort()
maximumBendingMoment = listBM[-1]

print ('C --> Max Msd: %0.2f KNm'% maximumBendingMoment)
# ---------- end python_13 ----------
python_14 = PythonScript(bendingMoment=b_res_force_4.ResultantBendingMoment_kNm)  # -> out, maximumBendingMoment; inputs bendingMoment: list
# ---------- python_14: Python ----------
listBM = bendingMoment

listBM.sort()
maximumBendingMoment = listBM[-1]
maximumBendingMoment = listBM[-1]

print ('D --> Max Msd: %0.2f KNm'% maximumBendingMoment)
# ---------- end python_14 ----------
panel_59 = Panel("Search Msd maximum")
# 3
toggle_8 = BooleanToggle(True)  # disabled

# ----
# RUN MICROCLIMATE MAP
outdoorcomfrecipe = Honeybee_OutdoorComfortAnalysisRecipe(
    viewFactorMesh=indoorviewfactor.viewFactorMesh,
    viewFactorInfo=indoorviewfactor.viewFactorInfo,
    epwFile=epw_stat.epwFile,
    srfOutdoorTemp=readepsrfresult.surfaceOutdoorTemp)  # -> comfRecipe; disabled; plug-in component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
microclimatemap = Honeybee_MicroclimateMapAnalysis(comfAnalysisRecipe=outdoorcomfrecipe, analysisPeriodOrHOY=importstat.extremeHotWeek, parallel=toggle_8, runIt=toggle_8)  # -> readMe, port, radTempMtx, airTempMtx, operativeTempMtx, adaptComfMtx, degFromTargetMtx, port_2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; disabled; plug-in component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

# ----
# Simplificação:
# Foi atribuido a maior solicitação, em valores absolutos, tanto para tração como para compressão. Isso para evitar "bug" em caso de situações que solicitarem apenas uma das forças para uma determinada seção.
info_3 = Panel([python_7.out, python_8.out, python_9.out, python_10.out])
panel_60 = Panel(photovoltaicsperformancemetrics.temperatureCorrectedPRperYear)  # disabled
info_4 = Panel([python_11.out, python_12.out, python_13.out, python_14.out])

# ----
# Scroll Through the Hours of the Simulation
# VISUALIZE MICROCLIMATE MAP
number_slider_2 = Slider(24, range=1..24)  # disabled
visualizemicroclimate = Honeybee_VisualizeMicroclimateMap(comfResultsMtx=microclimatemap.operativeTempMtx, viewFactorMesh=flatten(indoorviewfactor.viewFactorMesh))  # -> readMe, port, resultMesh, legend, legendBasePt, port_2, resultValues, resultColors; disabled; plug-in component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

bendingmoment = Merge(
    Data1=python_11.maximumBendingMoment,
    Data2=python_12.maximumBendingMoment,
    Data3=python_13.maximumBendingMoment,
    Data4=python_14.maximumBendingMoment)
bang = ExplodeTree(Data=photovoltaicsperformancemetrics.energyValue)  # -> Branch0, Branch1, Branch2, Branch3; disabled
info_5 = Panel([bang.Branch0, bang.Branch1, bang.Branch2, bang.Branch3])  # disabled
traction = Merge(Data1=python_7.traction, Data2=python_8.traction, Data3=python_9.traction, Data4=python_10.traction)
compression = Merge(Data1=python_7.compression, Data2=python_8.compression, Data3=python_9.compression, Data4=python_10.compression)
addition_16 = Addition(A=bang.Branch0, B=bang.Branch1, C=bang.Branch2, D=bang.Branch3)  # disabled
b_res_force_5 = BeamResultantForcesKaramba(AnalyzedModel=beamview.Model, LoadCase=-1, MaximumProbingDistance_m=-1, NumberOfProbingPointsPerElement=3)  # -> AnalyzedModel, NormalForce_kN, ResultantBendingMoment_kNm, ResultantShearForce_kN
python_15 = PythonScript(x=beamview.LegendTags)  # -> out, a; inputs x: list
# ---------- python_15: Python ----------
import re

a = []

x.pop(0)

for val in x:
    try:
        a.append( float(re.sub(r'[^\d.-e+]+', '', val)) )
    except ValueError:
        continue
# ---------- end python_15 ----------
panel_61 = Panel("Total Energy Value")  # disabled
# Total Energy value for the whole year in currency unit (real - R$)
info_6 = Panel(addition_16)  # disabled
punishment = Slider(100000, range=1000..100000)
abs = Absolute(Value=python_15.a)
bnd = Bounds(Numbers=b_res_force_5.NormalForce_kN)
bnd_2 = Bounds(Numbers=b_res_force_5.ResultantBendingMoment_kNm)
bnd_3 = Bounds(Numbers=b_res_force_5.ResultantShearForce_kN)
bnd_4 = Bounds(Numbers=abs)
maximumdisplacement = Number(analyzethi.MaximumDisplacement_m)
forcecompression = Number(python_5.forceCompression)
dedomain = DeconstructDomain(Domain=bnd)  # -> Start, End
dedomain_2 = DeconstructDomain(Domain=bnd_2)  # -> Start, End
dedomain_3 = DeconstructDomain(Domain=bnd_3)  # -> Start, End
dedomain_4 = DeconstructDomain(Domain=bnd_4)  # -> Start, End
forcetraction = Number(python_5.forceTraction)
support_2 = Number("100")
mass = Number(assemble.Mass_kg)
abs_2 = Absolute(Value=dedomain.Start)
ma_2 = MassAddition(Input=visualizemicroclimate.resultValues)  # -> Result, PartialResults; disabled
division_2 = Division(A=ma_2.Result, B=920)  # disabled
panel_62 = Panel("18.88")  # disabled
# Structural analysis:
# 
# Nt,sd ≤ Nt,rd
# Nc,sd ≤ Nc,rd
# Msd ≤ Mrd
# Max. Displacement  ≤ ℓ/300
python_16 = PythonScript(
    support=support_2,
    maximumDisplacement=maximumdisplacement,
    traction=traction,
    forceTraction=forcetraction,
    compression=compression,
    forceCompression=forcecompression,
    flecha=bendingmoment,
    forceFlecha=python_6.listMrd,
    mass=mass,
    punishment=punishment)  # -> out, goal; inputs traction: list, forceTraction: list, compression: list, forceCompression: list, flecha: list, forceFlecha: list, punishment: Int32
# ---------- python_16: Python ----------
# Check Traction
Ntsd = traction        # list traction
Ntrd = forceTraction

num = (len(Ntsd))   # numero de valores
cont = 0
gTraction = []

while cont < num:
    if Ntrd[cont] > Ntsd[cont]:
        print ('Traction %s is OK!' % cont)
    else:
        print ('Traction %s is NOT OK!' % cont)
        gTraction.append(Ntsd[cont] * punishment)
    cont += 1

# Check Compression
Ncsd = compression     # list compression
Ncrd = forceCompression

num2 = (len(Ncsd))
cont2 = 0
gCompression = []

while cont2 < num2:
    if Ncrd[cont2] > Ncsd[cont2]:
        print ('Compression %s is OK!' % cont2)
    else:
        print ('Compression %s is NOT OK!' % cont2)
        gCompression.append(Ncsd[cont2] * punishment)
    cont2 += 1

# Check Flecha
Msd = flecha
Mrd = forceFlecha

num2 = (len(Msd))
cont2 = 0
gFlecha = []

while cont2 < num2:
    if Mrd[cont2] > Msd[cont2]:
        print ('Bending Moment %s is OK!' % cont2)
    else:
        print ('Bending Moment %s is NOT OK!' % cont2)
        gFlecha.append(Msd[cont2] * punishment)
    cont2 += 1

# 2ª Parte
l = support                                   # *** FLECHA ***

if ((l / 300) > maximumDisplacement):
    print ('Flecha is OK!')
    disp = 0                                  # not punishment
else:
    print ('Fecha is NOT OK!')
    disp = (l + punishment + 100)             # punishment


addition = sum(gTraction) + sum(gCompression) + sum(gFlecha) # Somar os elementos da lista
goal = (mass + addition + disp)               # para otimização

print ('Total mass: %.2f kg' % mass)
print ('Mass to optimize: %.2f kg' % goal)
# ---------- end python_16 ----------
panel_63 = Panel(division_2)  # disabled

max_utilization_percentage = Panel(dedomain_4.End)
max_compression_kn = Panel(abs_2)
max_tension_kn = Panel(dedomain.End)
max_moment_knm = Panel(dedomain_2.End)
max_shear_kn = Panel(dedomain_3.End)

galapagos = Galapagos(
    fitness=goal,
    gene=[barextrz, alturasup, eixo_x, eixo_x_2, barraextrem, bansup, barextrem, number_slider, ptmedb, ptmed, ângulo, ptmed_2, ptmedb_2, sistptmed, ângulo_2, barptmed, bansupptmed, index_d, index_b, index_a, index_c])

# ---- group: goal to optimize !
goal = Number(python_16.goal)

# ----
# https://github.com/mostaphaRoudsari/ladybug/issues/150
# 
# http://www.grasshopper3d.com/group/ladybug/forum/topics/ladybug-photovoltaics-components-released?commentId=2985220%3AComment%3A1397873&groupId=2985220%3AGroup%3A658987
python_17 = PythonScript(x=addition_16, y=goal, tarifaDoAco=panel_62)  # -> out, tempoParaPagar; disabled
# ---------- python_17: Python ----------
# recebe total de energia (em valores R$)
energyValue = x
# recebe peso total da estrutura (kg)
peso = y

# Descontar o valor total de energia?
energyValueDesc = energyValue #* 0.30 #qual será o desconto??

# multiplicar o peso (kg) pelo custo do aço (R$)
valorEstrutura = peso * tarifaDoAco

#Sistema compensatório

energyMes = energyValueDesc / 12

tempoParaPagar = valorEstrutura / energyMes
print tempoParaPagar
# ---------- end python_17 ----------
# Dois objetivos:
# 
# Minimizar - Massa total da estrutura.
# 
# Maximizar - Potencial energético PV.
# 
# A = - B + C;
# 
# onde B é valor total, em reais, do aço e C é o potecial energético anula, em reais, da cobertura.
# 
# A é a quantidade de meses para se pagar a estrutura.
num_2 = Number(python_17.tempoParaPagar)  # disabled
panel_64 = Panel("2ª etapa")  # disabled
panel_65 = Panel("Fitness")  # disabled
em_mês = Panel(num_2)  # disabled
panel_66 = Panel("Fitness")
info_7 = Panel(python_16.out)
