# Grasshopper definition trelica_espacial_simples.gh (Grasshopper 0.9.76)
# plug-ins: Karamba, LunchBox

# ---- group: Linhas que geram as 3 seções da superfície inferior da treliça espacial
number_slider = Slider(21.4, range=0..25)
number_slider_2 = Slider(3.3, range=2.5..10)
number_slider_3 = Slider(25, range=2.5..25)
number_slider_4 = Slider(5.5, range=0..10)
number_slider_5 = Slider(2.9, range=0..10)
number_slider_6 = Slider(0, range=0..10)
number_slider_7 = Slider(2.6, range=2.5..10)
number_slider_8 = Slider(3.1, range=0..10)
number_slider_9 = Slider(0, range=0..10)

# ---- group: Linhas que geram as 3 seções da superfície superior da treliça espacial (espessura da treliça em cada ponto)
number_slider_10 = Slider(1.2, range=0.5..3)
number_slider_11 = Slider(1.6, range=0.5..3)
number_slider_12 = Slider(1.2, range=0.5..3)

# ---- group: Número de Módulos
number_slider_13 = Slider(5, range=5..10)
number_slider_14 = Slider(30, range=30..50)

# ---- group: Calcular relação que proteja o público de insolações intensas
division = Division(A=number_slider_3, B=-3)

# ----
addition = Addition(A=number_slider_7, B=number_slider_12)
addition_2 = Addition(A=number_slider_8, B=number_slider_12)
addition_3 = Addition(A=number_slider_9, B=number_slider_12)
addition_4 = Addition(A=number_slider_3, B=number_slider_11)
addition_5 = Addition(A=number_slider, B=number_slider_11)
addition_6 = Addition(A=number_slider_4, B=number_slider_11)
addition_7 = Addition(A=number_slider_2, B=number_slider_10)
addition_8 = Addition(A=number_slider_5, B=number_slider_10)
addition_9 = Addition(A=number_slider_6, B=number_slider_10)
panel = Panel(division)
# 1
C = ConstructPoint(XCoordinate="0", YCoordinate=0, ZCoordinate=number_slider_7)
B = ConstructPoint(XCoordinate="0", YCoordinate="10", ZCoordinate=number_slider_8)
A = ConstructPoint(XCoordinate="0", YCoordinate="20", ZCoordinate=number_slider_9)
# 2
construct_point = ConstructPoint(XCoordinate="50", YCoordinate=panel, ZCoordinate=number_slider_3)
B_2 = ConstructPoint(XCoordinate="50", YCoordinate="10", ZCoordinate=number_slider)
A_2 = ConstructPoint(XCoordinate="50", YCoordinate="20", ZCoordinate=number_slider_4)
# 3
C_2 = ConstructPoint(XCoordinate="100", YCoordinate=0, ZCoordinate=number_slider_2)
B_3 = ConstructPoint(XCoordinate="100", YCoordinate="10", ZCoordinate=number_slider_5)
A_3 = ConstructPoint(XCoordinate="100", YCoordinate="20", ZCoordinate=number_slider_6)
# 1
C_3 = ConstructPoint(XCoordinate="0", YCoordinate=0, ZCoordinate=addition)
B_4 = ConstructPoint(XCoordinate="0", YCoordinate="10", ZCoordinate=addition_2)
A_4 = ConstructPoint(XCoordinate="0", YCoordinate="20", ZCoordinate=addition_3)
# 2
construct_point_2 = ConstructPoint(XCoordinate="50", YCoordinate=panel, ZCoordinate=addition_4)
B_5 = ConstructPoint(XCoordinate="50", YCoordinate="10", ZCoordinate=addition_5)
A_5 = ConstructPoint(XCoordinate="50", YCoordinate="20", ZCoordinate=addition_6)
# 3
C_4 = ConstructPoint(XCoordinate="100", YCoordinate=0, ZCoordinate=addition_7)
B_6 = ConstructPoint(XCoordinate="100", YCoordinate="10", ZCoordinate=addition_8)
A_6 = ConstructPoint(XCoordinate="100", YCoordinate="20", ZCoordinate=addition_9)
intcrv = Interpolate(Vertices=[C, construct_point, C_2], Degree=3, Periodic=False, KnotStyle=1)  # -> Curve, Length, Domain
intcrv_2 = Interpolate(Vertices=[B, B_2, B_3], Degree=3, Periodic=False, KnotStyle=1)  # -> Curve, Length, Domain
intcrv_3 = Interpolate(Vertices=[A, A_2, A_3], Degree=3, Periodic=False, KnotStyle=1)  # -> Curve, Length, Domain
intcrv_4 = Interpolate(Vertices=[C_3, construct_point_2, C_4], Degree=3, Periodic=False, KnotStyle=1)  # -> Curve, Length, Domain
intcrv_5 = Interpolate(Vertices=[B_4, B_5, B_6], Degree=3, Periodic=False, KnotStyle=1)  # -> Curve, Length, Domain
intcrv_6 = Interpolate(Vertices=[A_4, A_5, A_6], Degree=3, Periodic=False, KnotStyle=1)  # -> Curve, Length, Domain

# ----
# Cobertura
loft = Loft(
    Curves=[intcrv_4.Curve, intcrv_5.Curve, intcrv_6.Curve],
    Options={Adjust=False, Closed=False, LoftEnds=0, LoftSimp=0, LoftType=0, Rebuild=10, Refit=0.01})
project = Project(Geometry=loft, Plane=PlaneXY(0, 0, 0))  # -> Geometry, Transform
sobrecarga_por_m2_kg = Panel("30")
area = Area(Geometry=project.Geometry)  # -> Area, Centroid
multiplication = Multiplication(A=area.Area, B=sobrecarga_por_m2_kg)

loft_2 = Loft(
    Curves=[intcrv.Curve, intcrv_2.Curve, intcrv_3.Curve],
    Options={Adjust=False, Closed=False, LoftEnds=0, LoftSimp=0, LoftType=0, Rebuild=10, Refit=0.01})
supp = SupportKaramba(PosInd=[C_2, C], menu=[buttons(on, off, on, off, off, off)])
supp_2 = SupportKaramba(PosInd=[A_3, A], menu=[buttons(on, on, on, on, on, on)])
spacetruss_2 = SpaceTrussStructure2(SurfaceA=loft_2, SurfaceB=loft, UDivisions=number_slider_13, VDivisions=number_slider_14)  # -> LinesA, LinesB, Web, Nodes

preview = CustomPreview(Geometry=[spacetruss_2.LinesA, spacetruss_2.LinesB], Shader=ColourSwatch(SwatchColor=RGB(3, 3, 3)))

disc = Discontinuity(Curve=spacetruss_2.LinesB, Level=1)  # -> flatten(Points), Parameters
rdlines = RemoveDuplicateLinesKaramba(Line=flatten([spacetruss_2.LinesA, spacetruss_2.LinesB, spacetruss_2.Web]), LimitDistance=0.005)  # -> OutLine, Info, Indexes
rdpoints = RemoveDuplicatePointsKaramba(Point=disc.Points, LimitDistance=0.005)  # -> OutPoint, Info, Indexes

# ----
# Sobrecarga na treliça
# Simplificação: aqui estamos considerando uma carga igualmente distribuída por todos os nós de apoio.
peso_próprio_da_telha_por_m2_kg = Panel("9")
area_2 = Area(Geometry=loft)  # -> Area, Centroid
multiplication_2 = Multiplication(A=area_2.Area, B=peso_próprio_da_telha_por_m2_kg)
addition_10 = Addition(A=multiplication, B=multiplication_2)
lng = ListLength(List=rdpoints.OutPoint)
carga_por_nó = Division(A=addition_10, B=lng)
multiplication_3 = Multiplication(A=carga_por_nó, B=-0.0098)

# ----
# Perfil usado
parede_cm = Slider(3, range=1..4, expression="x*.4")
diâmetro = Slider(3, range=1..5, expression="x*5")

linetobeam = LineToBeamKaramba(Points=rdpoints.OutPoint, Line=rdlines.OutLine, New=True, Remove=True, LimitDistance_m=0.005)  # -> Points, Element, Info
Z = UnitZ(Factor=multiplication_3)
eval = Evaluate(F="3.14159*(x*10/2)^2", x=diâmetro)
eval_2 = Evaluate(F="π*((10*x/2)-y*10)^2", x=diâmetro, y=parede_cm)
loads = LoadsKaramba(ForceVector=Z, Local=False, PosInd=rdpoints.OutPoint, LCase=0, mode="Point")
subtraction = Subtraction(A=eval, B=eval_2)
matselect = MaterialSelectionKaramba(menu=[dropdown(1), dropdown(54)])
cross_sections = CrossSectionsKaramba(Diameter_cm=diâmetro, WallThickness_cm=parede_cm, mode="Circular Hollow")
área_do_perfil_mm2 = Panel(subtraction)
resistência_kn_mm² = Panel(".25")
loads_2 = LoadsKaramba(Vector=Vector(0, 0, -1), LCase=0, mode="Gravity")
multiplication_4 = Multiplication(A=simplify(área_do_perfil_mm2), B=resistência_kn_mm²)
len = Length(Curve=rdlines.OutLine)
assemble = AssembleModelKaramba(
    Point=rdpoints.OutPoint,
    Elem=flatten(linetobeam.Element),
    Support=[supp_2, supp],
    Load=flatten([loads, loads_2]),
    CrossSection=cross_sections,
    Material=matselect,
    LimitDistance_m=0.005)  # -> Model, Info, Mass_kg, CenterOfGravity
peso_do_aço_m3 = Panel("7850")
ma = MassAddition(Input=len)  # -> Result, PartialResults
division_2 = Division(A=área_do_perfil_mm2, B=1000000)
panel_2 = Panel("""255
255
255
175
0
0
0""")
analyzethi = AnalyzeThIKaramba(Model=assemble.Model)  # -> CalculatedModel, MaximumDisplacement_m, ResultingForceOfGravity_kN, ElasticEnergy_kNm
multiplication_5 = Multiplication(A=ma.Result, B=division_2)
panel_3 = Panel("""0
0
255
255
255
0
0""")
multiplication_6 = Multiplication(A=multiplication_5, B=peso_do_aço_m3)
rgb = ColourRGB(Alpha=255, Red=panel_2, Green=panel_3, Blue=reverse(0))
b_res_force = BeamResultantForcesKaramba(AnalyzedModel=analyzethi.CalculatedModel, LoadCase=-1, MaximumProbingDistance_m=-1, NumberOfProbingPointsPerElement=3)  # -> AnalyzedModel, NormalForce_kN, ResultantBendingMoment_kNm, ResultantShearForce_kN
modelview = ModelViewKaramba(
    Model=analyzethi.CalculatedModel,
    LoadCaseFactorsForLinearSuperposition=1,
    IndexIncrementOfVisibleLoadcase=0,
    ListOfColorsForColoringPlots=reverse(rgb))  # -> Model, DeformedMesh, DeformedAxes, DeformedModel
sort = SortList(Keys=b_res_force.NormalForce_kN)  # -> Keys, ValuesA
d_energy = DeformationEnergyKaramba(AnalyzedModel=modelview.Model)  # -> AnalyzedModel, AxialDeformationEnergies_kNm, BendingEnergies_kNm
flecha_máxima_aceitável_l_x = Panel("300")
vão_total = Subtraction(A="100", B="0")
rev = ReverseList(List=sort.Keys)

# ---- group: Teste Extração Dados
panel_4 = Panel("""Nós
barras 01
barras 02
Máxima Compressão
Máxima Tração""")
excelwrite = ExcelWriteLEGACY(
    WriteToggle=Toggle(True),
    WriteHeading=Toggle(True),
    ClearSheet=Toggle(True),
    Worksheet="1",
    ColumnStart="1",
    RowStart="1",
    ColumnHeadings=panel_4,
    Column1=linetobeam.Points,
    Column2=spacetruss_2.LinesA,
    Column3=spacetruss_2.LinesB,
    Column4=sort.Keys,
    Column5=rev)

# ----
beamview = BeamViewKaramba(Model=d_energy.AnalyzedModel)  # -> Model, MeshesOfRenderedBeams, DeformedBeamAxes, LegendColors, LegendTags
cargas_máximas_tração = Panel(rev)
cargas_máximas_compressão = Panel(sort.Keys)
division_3 = Division(A=vão_total, B=flecha_máxima_aceitável_l_x)
legend = Legend(Colour=beamview.LegendColors, Tags=beamview.LegendTags, LegendType=1)
abs = Absolute(Value=[cargas_máximas_tração, cargas_máximas_compressão])
sort_2 = SortList(Keys=abs)  # -> Keys, ValuesA
rev_2 = ReverseList(List=sort_2.Keys)
peso_da_estrutura_kg = Panel(multiplication_6)
item = ListItem(List=rev_2, Index=0, Wrap=True)
solicitação_máxima = Panel(item)
resistência_máxima_de_cada_peça = Panel(multiplication_4)
flecha_máxima_aceitável_m = Panel(division_3)
flecha_máxima_m = Panel(analyzethi.MaximumDisplacement_m)
galapagos = Galapagos(
    fitness=addition_11,
    gene=[number_slider_10, number_slider_11, number_slider_12, number_slider_13, number_slider_14, number_slider_5, number_slider_2, number_slider_4, number_slider, number_slider_3, number_slider_8, number_slider_7])

# ----
# Estes "coeficientes" são "multas" pela estrutura estar levando bomba no cálculo estrutural. Eles permitem que o Galapagos vá se aproximando das soluções ideais.
panel_5 = Panel("100000")

subtraction_2 = Subtraction(A=solicitação_máxima, B=resistência_máxima_de_cada_peça)
subtraction_3 = Subtraction(A=flecha_máxima_m, B=flecha_máxima_aceitável_m)
max = Maximum(A=subtraction_2, B=0)
max_2 = Maximum(A=subtraction_3, B=0)
multiplication_7 = Multiplication(A=max_2, B=panel_5)
multiplication_8 = Multiplication(A=max, B="10000")
addition_11 = Addition(A=multiplication_7, B=multiplication_8, C=peso_da_estrutura_kg)
parâmetro_a_otimizar = Panel(addition_11)
equals = Equality(FirstNumber=parâmetro_a_otimizar, SecondNumber=peso_da_estrutura_kg)  # -> Equality, Inequality
está_passando = Panel(equals.Equality)
