# Grasshopper definition trelica_espacial_simples_R01.gh (Grasshopper 0.9.76)
# plug-ins: Karamba, Python Interpreter, LunchBox

# ---- group: Linhas que geram as 3 seções da superfície inferior da treliça espacial
number_slider = Slider(11.6, range=0..25)
number_slider_2 = Slider(2.5, range=2.5..10)
number_slider_3 = Slider(11.2, range=2.5..25)
number_slider_4 = Slider(7.5, range=0..10)
number_slider_5 = Slider(0.8, range=0..10)
number_slider_6 = Slider(0, range=0..10)
number_slider_7 = Slider(2.5, range=2.5..10)
number_slider_8 = Slider(0.8, range=0..10)
number_slider_9 = Slider(0, range=0..10)

# ---- group: Linhas que geram as 3 seções da superfície superior da treliça espacial (espessura da treliça em cada ponto)
number_slider_10 = Slider(0.4, range=0.2..3)
number_slider_11 = Slider(0.2, range=0.2..3)
number_slider_12 = Slider(0.4, range=0.2..3)

# ---- group: Número de Módulos
number_slider_13 = Slider(5, range=5..10)
number_slider_14 = Slider(30, range=30..50)

# ----
addition = Addition(A=number_slider, B=number_slider_11)
addition_2 = Addition(A=number_slider_3, B=number_slider_11)
addition_3 = Addition(A=number_slider_4, B=number_slider_11)
addition_4 = Addition(A=number_slider_5, B=number_slider_10)
addition_5 = Addition(A=number_slider_2, B=number_slider_10)
addition_6 = Addition(A=number_slider_6, B=number_slider_10)

# ---- group: Calcular relação que proteja o público de insolações intensas
division = Division(A=number_slider_3, B=-3)

# ----
addition_7 = Addition(A=number_slider_8, B=number_slider_12)
addition_8 = Addition(A=number_slider_7, B=number_slider_12)
addition_9 = Addition(A=number_slider_9, B=number_slider_12)
panel = Panel(division)
resistência_kn_mm² = Panel(".25")
peso_do_aço_m3 = Panel("7850")
pt = ConstructPoint(XCoordinate="50", YCoordinate="10", ZCoordinate=number_slider)
pt_2 = ConstructPoint(XCoordinate="50", YCoordinate=panel, ZCoordinate=number_slider_3)
pt_3 = ConstructPoint(XCoordinate="50", YCoordinate="20", ZCoordinate=number_slider_4)
pt_4 = ConstructPoint(XCoordinate="50", YCoordinate="10", ZCoordinate=addition)
pt_5 = ConstructPoint(XCoordinate="50", YCoordinate=panel, ZCoordinate=addition_2)
pt_6 = ConstructPoint(XCoordinate="50", YCoordinate="20", ZCoordinate=addition_3)
pt_7 = ConstructPoint(XCoordinate="0", YCoordinate=0, ZCoordinate=number_slider_7)
pt_8 = ConstructPoint(XCoordinate="0", YCoordinate="10", ZCoordinate=number_slider_8)
pt_9 = ConstructPoint(XCoordinate="0", YCoordinate="20", ZCoordinate=number_slider_9)
pt_10 = ConstructPoint(XCoordinate="100", YCoordinate=0, ZCoordinate=number_slider_2)
pt_11 = ConstructPoint(XCoordinate="100", YCoordinate="10", ZCoordinate=number_slider_5)
pt_12 = ConstructPoint(XCoordinate="100", YCoordinate="20", ZCoordinate=number_slider_6)
pt_13 = ConstructPoint(XCoordinate="0", YCoordinate=0, ZCoordinate=addition_8)
pt_14 = ConstructPoint(XCoordinate="0", YCoordinate="10", ZCoordinate=addition_7)
pt_15 = ConstructPoint(XCoordinate="0", YCoordinate="20", ZCoordinate=addition_9)
pt_16 = ConstructPoint(XCoordinate="100", YCoordinate=0, ZCoordinate=addition_5)
pt_17 = ConstructPoint(XCoordinate="100", YCoordinate="10", ZCoordinate=addition_4)
pt_18 = ConstructPoint(XCoordinate="100", YCoordinate="20", ZCoordinate=addition_6)
intcrv = Interpolate(Vertices=[pt_9, pt_3, pt_12], Degree=3, Periodic=False, KnotStyle=1)  # -> Curve, Length, Domain
intcrv_2 = Interpolate(Vertices=[pt_7, pt_2, pt_10], Degree=3, Periodic=False, KnotStyle=1)  # -> Curve, Length, Domain
intcrv_3 = Interpolate(Vertices=[pt_13, pt_5, pt_16], Degree=3, Periodic=False, KnotStyle=1)  # -> Curve, Length, Domain
intcrv_4 = Interpolate(Vertices=[pt_8, pt, pt_11], Degree=3, Periodic=False, KnotStyle=1)  # -> Curve, Length, Domain
intcrv_5 = Interpolate(Vertices=[pt_14, pt_4, pt_17], Degree=3, Periodic=False, KnotStyle=1)  # -> Curve, Length, Domain
intcrv_6 = Interpolate(Vertices=[pt_15, pt_6, pt_18], Degree=3, Periodic=False, KnotStyle=1)  # -> Curve, Length, Domain
loft = Loft(
    Curves=[intcrv_2.Curve, intcrv_4.Curve, intcrv.Curve],
    Options={Adjust=False, Closed=False, LoftEnds=0, LoftSimp=0, LoftType=0, Rebuild=10, Refit=0.01})

# ---- group: Sobrecarga na treliça / Cobertura
loft_2 = Loft(
    Curves=[intcrv_3.Curve, intcrv_5.Curve, intcrv_6.Curve],
    Options={Adjust=False, Closed=False, LoftEnds=0, LoftSimp=0, LoftType=0, Rebuild=10, Refit=0.01})
project = Project(Geometry=loft_2, Plane=PlaneXY(0, 0, 0))  # -> Geometry, Transform
area = Area(Geometry=project.Geometry)  # -> Area, Centroid
sobrecarga_por_m2_kg = Panel("30")
multiplication = Multiplication(A=area.Area, B=sobrecarga_por_m2_kg)

# ----
peso_próprio_da_telha_por_m2_kg = Panel("9")

# ---- group: Perfil usado
parede_cm = Slider(2, range=1..4, expression="x*.2")
diâmetro = Slider(3, range=1..5, expression="x*5")

parede_cm_2 = Slider(3, range=1..4, expression="x*.2")
diâmetro_2 = Slider(4, range=1..5, expression="x*5")

parede_cm_3 = Slider(1, range=1..4, expression="x*.2")
diâmetro_3 = Slider(3, range=1..5, expression="x*5")

# ----
area_2 = Area(Geometry=loft_2)  # -> Area, Centroid
supp = SupportKaramba(PosInd=[pt_12, pt_9], menu=[buttons(on, on, on, on, on, on)])
supp_2 = SupportKaramba(PosInd=[pt_10, pt_7], menu=[buttons(on, off, on, off, off, off)])
multiplication_2 = Multiplication(A=area_2.Area, B=peso_próprio_da_telha_por_m2_kg)
spacetruss_2 = SpaceTrussStructure2(SurfaceA=loft, SurfaceB=loft_2, UDivisions=number_slider_13, VDivisions=number_slider_14)  # -> LinesA, LinesB, Web, Nodes
disc = Discontinuity(Curve=spacetruss_2.LinesB, Level=1)  # -> flatten(Points), Parameters
# Simplificação: aqui estamos considerando uma carga igualmente distribuída por todos os nós de apoio.
addition_10 = Addition(A=multiplication, B=multiplication_2)
rdpoints = RemoveDuplicatePointsKaramba(Point=disc.Points, LimitDistance=0.005)  # -> OutPoint, Info, Indexes

# ---- group: Sobrecarga na treliça
lng = ListLength(List=rdpoints.OutPoint)
carga_por_nó = Division(A=addition_10, B=lng)
multiplication_3 = Multiplication(A=carga_por_nó, B=-0.0098)

# ----
eval = Evaluate(F="π*((10*x/2)-y*10)^2", x=diâmetro_2, y=parede_cm_2)
eval_2 = Evaluate(F="3.14159*(x*10/2)^2", x=diâmetro_2)
eval_3 = Evaluate(F="π*((10*x/2)-y*10)^2", x=diâmetro_3, y=parede_cm_3)
eval_4 = Evaluate(F="3.14159*(x*10/2)^2", x=diâmetro_3)
eval_5 = Evaluate(F="π*((10*x/2)-y*10)^2", x=diâmetro, y=parede_cm)
eval_6 = Evaluate(F="3.14159*(x*10/2)^2", x=diâmetro)
linhas_base = RemoveDuplicateLinesKaramba(Line=flatten(spacetruss_2.LinesA), LimitDistance=0.005)  # -> OutLine, Info, Indexes
linhas_topo = RemoveDuplicateLinesKaramba(Line=flatten(spacetruss_2.LinesB), LimitDistance=0.005)  # -> OutLine, Info, Indexes
treliça = RemoveDuplicateLinesKaramba(Line=flatten(spacetruss_2.Web), LimitDistance=0.005)  # -> OutLine, Info, Indexes
subtraction = Subtraction(A=eval_2, B=eval)
subtraction_2 = Subtraction(A=eval_4, B=eval_3)
Z = UnitZ(Factor=multiplication_3)
subtraction_3 = Subtraction(A=eval_6, B=eval_5)
cross_sections = CrossSectionsKaramba(ElementsIdentifiers="base", Diameter_cm=diâmetro_2, WallThickness_cm=parede_cm_2, mode="Circular Hollow")
cross_sections_2 = CrossSectionsKaramba(ElementsIdentifiers="topo", Diameter_cm=diâmetro_3, WallThickness_cm=parede_cm_3, mode="Circular Hollow")
cross_sections_3 = CrossSectionsKaramba(ElementsIdentifiers="diagonais", Diameter_cm=diâmetro, WallThickness_cm=parede_cm, mode="Circular Hollow")
loads = LoadsKaramba(ForceVector=Z, Local=False, PosInd=rdpoints.OutPoint, LCase=0, mode="Point")
linetobeam = LineToBeamKaramba(Points=rdpoints.OutPoint, Line=linhas_base.OutLine, New=True, Remove=True, LimitDistance_m=0.005, BeamIdentifier="base")  # -> Points, Element, Info
linetobeam_2 = LineToBeamKaramba(Line=linhas_topo.OutLine, New=True, Remove=True, LimitDistance_m=0.005, BeamIdentifier="topo")  # -> Points, Element, Info
linetobeam_3 = LineToBeamKaramba(Line=treliça.OutLine, New=True, Remove=True, LimitDistance_m=0.005, BeamIdentifier="diagonais")  # -> Points, Element, Info
área_do_perfil_mm2 = Panel(subtraction_2)
área_do_perfil_mm2_2 = Panel(subtraction)
matselect = MaterialSelectionKaramba(menu=[dropdown(1), dropdown(54)])
área_do_perfil_mm2_3 = Panel(subtraction_3)
loads_2 = LoadsKaramba(Vector=Vector(0, 0, -1), LCase=0, mode="Gravity")
len = Length(Curve=linhas_base.OutLine)
len_2 = Length(Curve=linhas_topo.OutLine)
len_3 = Length(Curve=treliça.OutLine)
multiplication_4 = Multiplication(A=área_do_perfil_mm2_2, B=resistência_kn_mm²)
assemble = AssembleModelKaramba(
    Point=rdpoints.OutPoint,
    Elem=flatten([linetobeam.Element, linetobeam_2.Element, linetobeam_3.Element]),
    Support=[supp, supp_2],
    Load=flatten([loads, loads_2]),
    CrossSection=[cross_sections, cross_sections_2, cross_sections_3],
    Material=matselect,
    LimitDistance_m=0.005)  # -> Model, Info, Mass_kg, CenterOfGravity
ma = MassAddition(Input=len)  # -> Result, PartialResults
multiplication_5 = Multiplication(A=área_do_perfil_mm2, B=resistência_kn_mm²)
ma_2 = MassAddition(Input=len_2)  # -> Result, PartialResults
division_2 = Division(A=área_do_perfil_mm2_2, B=1000000)
division_3 = Division(A=área_do_perfil_mm2, B=1000000)
multiplication_6 = Multiplication(A=área_do_perfil_mm2_3, B=resistência_kn_mm²)
ma_3 = MassAddition(Input=len_3)  # -> Result, PartialResults
panel_2 = Panel("""255
255
255
175
0
0
0""")
division_4 = Division(A=área_do_perfil_mm2_3, B=1000000)
multiplication_7 = Multiplication(A=ma.Result, B=division_2)
multiplication_8 = Multiplication(A=ma_2.Result, B=division_3)
panel_3 = Panel("""0
0
255
255
255
0
0""")
analyzethi = AnalyzeThIKaramba(Model=assemble.Model)  # -> CalculatedModel, MaximumDisplacement_m, ResultingForceOfGravity_kN, ElasticEnergy_kNm
multiplication_9 = Multiplication(A=ma_3.Result, B=division_4)
rgb = ColourRGB(Alpha=255, Red=panel_2, Green=panel_3, Blue=reverse(0))
multiplication_10 = Multiplication(A=multiplication_7, B=peso_do_aço_m3)
multiplication_11 = Multiplication(A=multiplication_8, B=peso_do_aço_m3)
multiplication_12 = Multiplication(A=multiplication_9, B=peso_do_aço_m3)
modelview = ModelViewKaramba(
    Model=analyzethi.CalculatedModel,
    LoadCaseFactorsForLinearSuperposition=1,
    IndexIncrementOfVisibleLoadcase=0,
    ListOfColorsForColoringPlots=reverse(rgb))  # -> Model, DeformedMesh, DeformedAxes, DeformedModel
b_res_force = BeamResultantForcesKaramba(
    AnalyzedModel=analyzethi.CalculatedModel,
    BeamIdentifiers="diagonais",
    LoadCase=-1,
    MaximumProbingDistance_m=-1,
    NumberOfProbingPointsPerElement=3)  # -> AnalyzedModel, NormalForce_kN, ResultantBendingMoment_kNm, ResultantShearForce_kN
b_res_force_2 = BeamResultantForcesKaramba(
    AnalyzedModel=analyzethi.CalculatedModel,
    BeamIdentifiers="topo",
    LoadCase=-1,
    MaximumProbingDistance_m=-1,
    NumberOfProbingPointsPerElement=3)  # -> AnalyzedModel, NormalForce_kN, ResultantBendingMoment_kNm, ResultantShearForce_kN
b_res_force_3 = BeamResultantForcesKaramba(
    AnalyzedModel=analyzethi.CalculatedModel,
    BeamIdentifiers="base",
    LoadCase=-1,
    MaximumProbingDistance_m=-1,
    NumberOfProbingPointsPerElement=3)  # -> AnalyzedModel, NormalForce_kN, ResultantBendingMoment_kNm, ResultantShearForce_kN
d_energy = DeformationEnergyKaramba(AnalyzedModel=modelview.Model)  # -> AnalyzedModel, AxialDeformationEnergies_kNm, BendingEnergies_kNm
flecha_máxima_aceitável_l_x = Panel("300")
sort = SortList(Keys=b_res_force.NormalForce_kN)  # -> Keys, ValuesA
sort_2 = SortList(Keys=b_res_force_2.NormalForce_kN)  # -> Keys, ValuesA
sort_3 = SortList(Keys=b_res_force_3.NormalForce_kN)  # -> Keys, ValuesA
vão_total = Subtraction(A="100", B="0")
beamview = BeamViewKaramba(Model=d_energy.AnalyzedModel)  # -> Model, MeshesOfRenderedBeams, DeformedBeamAxes, LegendColors, LegendTags
rev = ReverseList(List=sort.Keys)
rev_2 = ReverseList(List=sort_2.Keys)
rev_3 = ReverseList(List=sort_3.Keys)
cargas_máximas_tração = Panel(rev)
cargas_máximas_compressão = Panel(sort.Keys)
cargas_máximas_tração_2 = Panel(rev_2)
cargas_máximas_compressão_2 = Panel(sort_2.Keys)
cargas_máximas_tração_3 = Panel(rev_3)
cargas_máximas_compressão_3 = Panel(sort_3.Keys)
division_5 = Division(A=vão_total, B=flecha_máxima_aceitável_l_x)
legend = Legend(Colour=beamview.LegendColors, Tags=beamview.LegendTags, LegendType=1)
abs = Absolute(Value=[cargas_máximas_tração, cargas_máximas_compressão])
abs_2 = Absolute(Value=[cargas_máximas_tração_2, cargas_máximas_compressão_2])
abs_3 = Absolute(Value=[cargas_máximas_tração_3, cargas_máximas_compressão_3])
sort_4 = SortList(Keys=abs)  # -> Keys, ValuesA
sort_5 = SortList(Keys=abs_2)  # -> Keys, ValuesA
sort_6 = SortList(Keys=abs_3)  # -> Keys, ValuesA
addition_11 = Addition(A=multiplication_10, B=multiplication_11, C=multiplication_12)
rev_4 = ReverseList(List=sort_4.Keys)
rev_5 = ReverseList(List=sort_5.Keys)
rev_6 = ReverseList(List=sort_6.Keys)
peso_da_estrutura_kg = Panel(addition_11)
item = ListItem(List=rev_4, Index=0, Wrap=True)
item_2 = ListItem(List=rev_6, Index=0, Wrap=True)
item_3 = ListItem(List=rev_5, Index=0, Wrap=True)
flecha_máxima_aceitável_m = Panel(division_5)
flecha_máxima_m = Panel(analyzethi.MaximumDisplacement_m)
solicitação_máxima = Panel(item)
resistência_máxima_de_cada_peça = Panel(multiplication_6)
solicitação_máxima_2 = Panel(item_3)
resistência_máxima_de_cada_peça_2 = Panel(multiplication_5)
solicitação_máxima_3 = Panel(item_2)
resistência_máxima_de_cada_peça_3 = Panel(multiplication_4)
galapagos = Galapagos(
    fitness=addition_12,
    gene=[number_slider_10, number_slider_11, number_slider_12, number_slider_13, number_slider_14, number_slider_5, number_slider_2, number_slider_4, number_slider, number_slider_3, number_slider_8, number_slider_7, parede_cm_2, parede_cm_3, parede_cm])

# ----
# Estes "coeficientes" são "multas" pela estrutura estar levando bomba no cálculo estrutural. Eles permitem que o Galapagos vá se aproximando das soluções ideais.
panel_4 = Panel("10000")

subtraction_4 = Subtraction(A=flecha_máxima_m, B=flecha_máxima_aceitável_m)
subtraction_5 = Subtraction(A=solicitação_máxima_2, B=resistência_máxima_de_cada_peça_2)
panel_5 = Panel(subtraction_5)
subtraction_6 = Subtraction(A=solicitação_máxima, B=resistência_máxima_de_cada_peça)
panel_6 = Panel(subtraction_6)
subtraction_7 = Subtraction(A=solicitação_máxima_3, B=resistência_máxima_de_cada_peça_3)
panel_7 = Panel(subtraction_7)
max = Maximum(A=subtraction_4, B=0)
max_2 = Maximum(A=subtraction_6, B=0)
max_3 = Maximum(A=subtraction_5, B=0)
max_4 = Maximum(A=subtraction_7, B=0)
multiplication_13 = Multiplication(A=max, B="100000")
multiplication_14 = Multiplication(A=max_2, B=panel_4)
multiplication_15 = Multiplication(A=max_3, B=panel_4)
multiplication_16 = Multiplication(A=max_4, B=panel_4)
addition_12 = Addition(A=multiplication_16, B=multiplication_15, C=multiplication_13, D=multiplication_14, E=peso_da_estrutura_kg)
parâmetro_a_otimizar = Panel(addition_12)
equals = Equality(FirstNumber=parâmetro_a_otimizar, SecondNumber=peso_da_estrutura_kg)  # -> Equality, Inequality
está_passando = Panel(equals.Equality)
captureview = Ladybug_CaptureView(
    fileName=addition_11,
    folder="C:\Users\Renato\Desktop\TreEspSim",
    imageWidth="600",
    imageHeight="600",
    capture=Toggle(False))  # -> imagePath; plug-in component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
panel_8 = Panel(captureview)
concat = Concatenate(FragmentA=multiplication_5, FragmentB=",", FragmentC=item_3)
concat_2 = Concatenate(FragmentA=multiplication_4, FragmentB=",", FragmentC=item_2)
panel_9 = Panel("base")
panel_10 = Panel("topo")
panel_11 = Panel("diagonal")
concat_3 = Concatenate(FragmentA=multiplication_6, FragmentB=",", FragmentC=item)
concat_4 = Concatenate(FragmentA=division_5, FragmentB=",", FragmentC=analyzethi.MaximumDisplacement_m)
concat_5 = Concatenate(FragmentA=diâmetro_2, FragmentB=",", FragmentC=parede_cm_2, FragmentD=",", FragmentE=subtraction)
concat_6 = Concatenate(FragmentA=diâmetro_3, FragmentB=",", FragmentC=parede_cm_3, FragmentD=",", FragmentE=subtraction_2)
panel_12 = Panel("perfil usado DIAGONAL")
concat_7 = Concatenate(FragmentA=diâmetro, FragmentB=",", FragmentC=parede_cm, FragmentD=",", FragmentE=subtraction_3)
panel_13 = Panel("fecha")
panel_14 = Panel("perfil BASE")
panel_15 = Panel("perfil TOPO")
resistência_solicitação = Panel(concat_2)
resistência_solicitação_2 = Panel(concat)
resistência_solicitação_3 = Panel(concat_3)
diâmetro_parede_cm_área = Panel(concat_5)
diâmetro_parede_cm_área_2 = Panel(concat_6)
diâmetro_parede_cm_área_3 = Panel(concat_7)
está_passando_2 = Panel(está_passando)
peso_da_estrutura = Panel(peso_da_estrutura_kg)
máxima_existente = Panel(concat_4)
peso_topo = Panel(multiplication_11)
peso_diagonal = Panel(multiplication_12)
peso_base = Panel(multiplication_10)
concat_8 = Concatenate(
    FragmentA=concat_5,
    FragmentB=",",
    FragmentC=concat_2,
    FragmentD=",",
    FragmentE=concat_6,
    FragmentF=",",
    FragmentG=concat,
    FragmentH=",",
    FragmentI=concat_7,
    FragmentJ=",",
    FragmentK=concat_3,
    FragmentL=",",
    FragmentM=concat_4,
    FragmentN=",",
    FragmentO=addition_11,
    FragmentP=",",
    FragmentQ=equals.Equality,
    FragmentR=",",
    FragmentS=captureview)
rec = DataRecorder(concat_8, DataLimit=-10, RecordData=True)
panel_16 = Panel(rec)
