# Grasshopper definition trelica_espacial_simples_R01_b.gh (Grasshopper 0.9.76)
# plug-ins: Karamba, Python Interpreter, LunchBox

# ---- group: Linhas que geram as 3 seções da superfície inferior da treliça espacial
number_slider = Slider(2.5, range=2.5..10)
number_slider_2 = Slider(0.8, range=0..10)
number_slider_3 = Slider(0, range=0..10)
number_slider_4 = Slider(11.2, range=2.5..25)
number_slider_5 = Slider(11.6, range=0..25)
number_slider_6 = Slider(7.5, range=0..10)
number_slider_7 = Slider(2.5, range=2.5..10)
number_slider_8 = Slider(0.8, range=0..10)
number_slider_9 = Slider(0, range=0..10)

# ---- group: Número de Módulos
number_slider_10 = Slider(5, range=5..10)
number_slider_11 = Slider(30, range=30..50)

# ---- group: Linhas que geram as 3 seções da superfície superior da treliça espacial (espessura da treliça em cada ponto)
number_slider_12 = Slider(0.4, range=0.2..3)
number_slider_13 = Slider(0.2, range=0.2..3)
number_slider_14 = Slider(0.4, range=0.2..3)

# ----
number_slider_15 = Slider(0.4, range=0.2..3)
number_slider_16 = Slider(0.4, range=0.2..3)

number_slider_17 = Slider(0.4, range=0.2..3)
number_slider_18 = Slider(0.4, range=0.2..3)

number_slider_19 = Slider(0.4, range=0.2..3)
number_slider_20 = Slider(0.4, range=0.2..3)

addition = Addition(A=number_slider, B=number_slider_12)
addition_2 = Addition(A=number_slider_2, B=number_slider_12)
addition_3 = Addition(A=number_slider_3, B=number_slider_12)
addition_4 = Addition(A=number_slider_4, B=number_slider_13)
addition_5 = Addition(A=number_slider_5, B=number_slider_13)
addition_6 = Addition(A=number_slider_6, B=number_slider_13)
addition_7 = Addition(A=number_slider_7, B=number_slider_14)
addition_8 = Addition(A=number_slider_8, B=number_slider_14)
addition_9 = Addition(A=number_slider_9, B=number_slider_14)

# ---- group: Calcular relação que proteja o público de insolações intensas
division = Division(A=number_slider_4, B=-3)

# ----
panel = Panel(division)

# ---- group: Posso pegar da tabela tambem?
resistência_kn_mm² = Panel(".25")

# ----
peso_do_aço_m3 = Panel("7850")
pt = ConstructPoint(XCoordinate="0", YCoordinate=0, ZCoordinate=number_slider)
pt_2 = ConstructPoint(XCoordinate="0", YCoordinate="10", ZCoordinate=number_slider_2)
pt_3 = ConstructPoint(XCoordinate="0", YCoordinate="20", ZCoordinate=number_slider_3)
pt_4 = ConstructPoint(XCoordinate="50", YCoordinate=panel, ZCoordinate=number_slider_4)
pt_5 = ConstructPoint(XCoordinate="50", YCoordinate="10", ZCoordinate=number_slider_5)
pt_6 = ConstructPoint(XCoordinate="50", YCoordinate="20", ZCoordinate=number_slider_6)
pt_7 = ConstructPoint(XCoordinate="100", YCoordinate=0, ZCoordinate=number_slider_7)
pt_8 = ConstructPoint(XCoordinate="100", YCoordinate="10", ZCoordinate=number_slider_8)
pt_9 = ConstructPoint(XCoordinate="100", YCoordinate="20", ZCoordinate=number_slider_9)
pt_10 = ConstructPoint(XCoordinate="0", YCoordinate=0, ZCoordinate=addition)
pt_11 = ConstructPoint(XCoordinate="0", YCoordinate="10", ZCoordinate=addition_2)
pt_12 = ConstructPoint(XCoordinate="0", YCoordinate="20", ZCoordinate=addition_3)
pt_13 = ConstructPoint(XCoordinate="50", YCoordinate=panel, ZCoordinate=addition_4)
pt_14 = ConstructPoint(XCoordinate="50", YCoordinate="10", ZCoordinate=addition_5)
pt_15 = ConstructPoint(XCoordinate="50", YCoordinate="20", ZCoordinate=addition_6)
pt_16 = ConstructPoint(XCoordinate="100", YCoordinate=0, ZCoordinate=addition_7)
pt_17 = ConstructPoint(XCoordinate="100", YCoordinate="10", ZCoordinate=addition_8)
pt_18 = ConstructPoint(XCoordinate="100", YCoordinate="20", ZCoordinate=addition_9)
# Catálogo Vallourec.As bitolas escolhidas são as mais frequentemente produzidas.
seção_d_t = Panel("""33.4,3.2
33.4,3.6
38.1,3.2
38.1,4.0
42.2,3.6
42.2,5.0
48.3,3.6
48.3,5.0
60.3,4.0
60.3,5.6
73.0,5.0
73.0,7.1
88.9,5.6
88.9,8.0
101.6,5.6
101.6,8.8
114.3,6.4
114.3,8.8
141.3,6.4
141.3,10.0
168.3,7.1
168.3,11.0
219.1,8.0
219.1,12.5
273.0,10.0
273.0,16.0
323.8,10.0
323.8,17.5
355.6,10.0
355.6,12.5""")
intcrv = Interpolate(Vertices=[pt, pt_4, pt_7], Degree=3, Periodic=False, KnotStyle=1)  # -> Curve, Length, Domain
intcrv_2 = Interpolate(Vertices=[pt_2, pt_5, pt_8], Degree=3, Periodic=False, KnotStyle=1)  # -> Curve, Length, Domain
intcrv_3 = Interpolate(Vertices=[pt_3, pt_6, pt_9], Degree=3, Periodic=False, KnotStyle=1)  # -> Curve, Length, Domain
intcrv_4 = Interpolate(Vertices=[pt_10, pt_13, pt_16], Degree=3, Periodic=False, KnotStyle=1)  # -> Curve, Length, Domain
intcrv_5 = Interpolate(Vertices=[pt_11, pt_14, pt_17], Degree=3, Periodic=False, KnotStyle=1)  # -> Curve, Length, Domain
intcrv_6 = Interpolate(Vertices=[pt_12, pt_15, pt_18], Degree=3, Periodic=False, KnotStyle=1)  # -> Curve, Length, Domain
number_slider_21 = Slider(15, range=0..29)
number_slider_22 = Slider(18, range=0..29)
number_slider_23 = Slider(22, range=0..29)
item = ListItem(List=seção_d_t, Index=number_slider_23, Wrap=True)
item_2 = ListItem(List=seção_d_t, Index=number_slider_21, Wrap=True)
item_3 = ListItem(List=seção_d_t, Index=number_slider_22, Wrap=True)
panel_2 = Panel(item)
split = TextSplit(Text=panel_2, Separators=",")
split_2 = TextSplit(Text=item_2, Separators=",")
split_3 = TextSplit(Text=item_3, Separators=",")
loft = Loft(
    Curves=[intcrv.Curve, intcrv_2.Curve, intcrv_3.Curve],
    Options={Adjust=False, Closed=False, LoftEnds=0, LoftSimp=0, LoftType=0, Rebuild=10, Refit=0.01})

# ---- group: Sobrecarga na treliça / Cobertura
loft_2 = Loft(
    Curves=[intcrv_4.Curve, intcrv_5.Curve, intcrv_6.Curve],
    Options={Adjust=False, Closed=False, LoftEnds=0, LoftSimp=0, LoftType=0, Rebuild=10, Refit=0.01})
project = Project(Geometry=loft_2, Plane=PlaneXY(0, 0, 0))  # -> Geometry, Transform
area = Area(Geometry=project.Geometry)  # -> Area, Centroid
sobrecarga_por_m2_kg = Panel("30")
multiplication = Multiplication(A=area.Area, B=sobrecarga_por_m2_kg)

# ----
peso_próprio_da_telha_por_m2_kg = Panel("9")
panel_3 = Panel(split)
area_2 = Area(Geometry=loft_2)  # -> Area, Centroid
item_4 = ListItem(List=panel_3, Index=0, Wrap=True)
item_5 = ListItem(List=panel_3, Index=1, Wrap=True)
item_6 = ListItem(List=split_2, Index=0, Wrap=True)
item_7 = ListItem(List=split_2, Index=1, Wrap=True)
item_8 = ListItem(List=split_3, Index=0, Wrap=True)
item_9 = ListItem(List=split_3, Index=1, Wrap=True)
supp = SupportKaramba(PosInd=[pt_7, pt], menu=[buttons(on, off, on, off, off, off)])
supp_2 = SupportKaramba(PosInd=[pt_9, pt_3], menu=[buttons(on, on, on, on, on, on)])
multiplication_2 = Multiplication(A=area_2.Area, B=peso_próprio_da_telha_por_m2_kg)
diametro_mm = Panel(item_4)
parede_mm = Panel(item_5)
diametro_mm_2 = Panel(item_6)
parede_mm_2 = Panel(item_7)
diametro_mm_3 = Panel(item_8)
parede_mm_3 = Panel(item_9)
spacetruss_2 = SpaceTrussStructure2(SurfaceA=loft, SurfaceB=loft_2, UDivisions=number_slider_10, VDivisions=number_slider_11)  # -> LinesA, LinesB, Web, Nodes
disc = Discontinuity(Curve=spacetruss_2.LinesB, Level=1)  # -> flatten(Points), Parameters
# Simplificação: aqui estamos considerando uma carga igualmente distribuída por todos os nós de apoio.
addition_10 = Addition(A=multiplication, B=multiplication_2)
division_2 = Division(A=diametro_mm, B=10)
division_3 = Division(A=parede_mm, B=10)
division_4 = Division(A=item_6, B=10)
division_5 = Division(A=item_7, B=10)
division_6 = Division(A=diametro_mm_3, B=10)
division_7 = Division(A=parede_mm_3, B=10)
merge = Merge(Data1=supp, Data2=supp_2)
rdpoints = RemoveDuplicatePointsKaramba(Point=disc.Points, LimitDistance=0.005)  # -> OutPoint, Info, Indexes

# ---- group: Sobrecarga na treliça
lng = ListLength(List=rdpoints.OutPoint)
carga_por_nó = Division(A=addition_10, B=lng)
multiplication_3 = Multiplication(A=carga_por_nó, B=-0.0098)

# ----
diametro_cm = Panel(division_6)
parede_cm = Panel(division_7)
linhas_base = RemoveDuplicateLinesKaramba(Line=flatten(spacetruss_2.LinesA), LimitDistance=0.005)  # -> OutLine, Info, Indexes
linhas_topo = RemoveDuplicateLinesKaramba(Line=flatten(spacetruss_2.LinesB), LimitDistance=0.005)  # -> OutLine, Info, Indexes
treliça = RemoveDuplicateLinesKaramba(Line=flatten(spacetruss_2.Web), LimitDistance=0.005)  # -> OutLine, Info, Indexes
eval = Evaluate(F="(3.14159*x^2)/4", x=diametro_mm)
eval_2 = Evaluate(F="(3.14159*(x-(y*2))^2)/4", x=diametro_mm, y=parede_mm)
eval_3 = Evaluate(F="(3.14159*x^2)/4", x=item_6)
eval_4 = Evaluate(F="(3.14159*(x-(y*2))^2)/4", x=item_6, y=item_7)
eval_5 = Evaluate(F="(3.14159*x^2)/4", x=diametro_mm_3)
eval_6 = Evaluate(F="(3.14159*(x-(y*2))^2)/4", x=diametro_mm_3, y=parede_mm_3)
diametro_cm_2 = Panel(division_2)
parede_cm_2 = Panel(division_3)
Z = UnitZ(Factor=multiplication_3)
loads = LoadsKaramba(ForceVector=Z, Local=False, PosInd=rdpoints.OutPoint, LCase=0, mode="Point")
subtraction = Subtraction(A=eval, B=eval_2)
subtraction_2 = Subtraction(A=eval_3, B=eval_4)
subtraction_3 = Subtraction(A=eval_5, B=eval_6)
linetobeam = LineToBeamKaramba(Points=rdpoints.OutPoint, Line=linhas_base.OutLine, New=True, Remove=True, LimitDistance_m=0.005, BeamIdentifier="base")  # -> Points, Element, Info
linetobeam_2 = LineToBeamKaramba(Line=linhas_topo.OutLine, New=True, Remove=True, LimitDistance_m=0.005, BeamIdentifier="topo")  # -> Points, Element, Info
linetobeam_3 = LineToBeamKaramba(Line=treliça.OutLine, New=True, Remove=True, LimitDistance_m=0.005, BeamIdentifier="diagonais")  # -> Points, Element, Info
cross_sections = CrossSectionsKaramba(ElementsIdentifiers="base", Diameter_cm=diametro_cm_2, WallThickness_cm=parede_cm_2, mode="Circular Hollow")
cross_sections_2 = CrossSectionsKaramba(ElementsIdentifiers="topo", Diameter_cm=division_4, WallThickness_cm=division_5, mode="Circular Hollow")
cross_sections_3 = CrossSectionsKaramba(ElementsIdentifiers="diagonais", Diameter_cm=diametro_cm, WallThickness_cm=parede_cm, mode="Circular Hollow")
área_do_perfil_mm2 = Panel(subtraction_3)
área_do_perfil_mm2_2 = Panel(subtraction)
área_do_perfil_mm2_3 = Panel(subtraction_2)
loads_2 = LoadsKaramba(Vector=Vector(0, 0, -1), LCase=0, mode="Gravity")
matselect = MaterialSelectionKaramba(menu=[dropdown(1), dropdown(54)])
merge_2 = Merge(Data1=cross_sections, Data2=cross_sections_2, Data3=cross_sections_3)
merge_3 = Merge(Data1=linetobeam.Element, Data2=linetobeam_2.Element, Data3=linetobeam_3.Element)
merge_4 = Merge(Data1=loads_2, Data2=loads)
len = Length(Curve=linhas_base.OutLine)
len_2 = Length(Curve=linhas_topo.OutLine)
len_3 = Length(Curve=treliça.OutLine)
assemble = AssembleModelKaramba(
    Point=rdpoints.OutPoint,
    Elem=flatten(merge_3),
    Support=merge,
    Load=flatten(merge_4),
    CrossSection=merge_2,
    Material=matselect,
    LimitDistance_m=0.005)  # -> Model, Info, Mass_kg, CenterOfGravity
panel_4 = Panel("""255
255
255
175
0
0
0""")
ma = MassAddition(Input=len)  # -> Result, PartialResults
division_8 = Division(A=área_do_perfil_mm2_2, B=1000000)
multiplication_4 = Multiplication(A=área_do_perfil_mm2_2, B=resistência_kn_mm²)
ma_2 = MassAddition(Input=len_2)  # -> Result, PartialResults
division_9 = Division(A=área_do_perfil_mm2_3, B=1000000)
multiplication_5 = Multiplication(A=área_do_perfil_mm2_3, B=resistência_kn_mm²)
ma_3 = MassAddition(Input=len_3)  # -> Result, PartialResults
division_10 = Division(A=área_do_perfil_mm2, B=1000000)
multiplication_6 = Multiplication(A=área_do_perfil_mm2, B=resistência_kn_mm²)
panel_5 = Panel("""0
0
255
255
255
0
0""")
analyzethi = AnalyzeThIKaramba(Model=assemble.Model)  # -> CalculatedModel, MaximumDisplacement_m, ResultingForceOfGravity_kN, ElasticEnergy_kNm
rgb = ColourRGB(Alpha=255, Red=panel_4, Green=panel_5, Blue=reverse(0))
multiplication_7 = Multiplication(A=ma.Result, B=division_8)
multiplication_8 = Multiplication(A=ma_2.Result, B=division_9)
multiplication_9 = Multiplication(A=ma_3.Result, B=division_10)
modelview = ModelViewKaramba(
    Model=analyzethi.CalculatedModel,
    LoadCaseFactorsForLinearSuperposition=1,
    IndexIncrementOfVisibleLoadcase=0,
    ListOfColorsForColoringPlots=reverse(rgb))  # -> Model, DeformedMesh, DeformedAxes, DeformedModel
b_res_force = BeamResultantForcesKaramba(
    AnalyzedModel=analyzethi.CalculatedModel,
    BeamIdentifiers="base",
    LoadCase=-1,
    MaximumProbingDistance_m=-1,
    NumberOfProbingPointsPerElement=3)  # -> AnalyzedModel, NormalForce_kN, ResultantBendingMoment_kNm, ResultantShearForce_kN
b_res_force_2 = BeamResultantForcesKaramba(
    AnalyzedModel=analyzethi.CalculatedModel,
    BeamIdentifiers="topo",
    LoadCase=-1,
    MaximumProbingDistance_m=-1,
    NumberOfProbingPointsPerElement=3)  # -> AnalyzedModel, NormalForce_kN, ResultantBendingMoment_kNm, ResultantShearForce_kN
b_res_force_3 = BeamResultantForcesKaramba(
    AnalyzedModel=analyzethi.CalculatedModel,
    BeamIdentifiers="diagonais",
    LoadCase=-1,
    MaximumProbingDistance_m=-1,
    NumberOfProbingPointsPerElement=3)  # -> AnalyzedModel, NormalForce_kN, ResultantBendingMoment_kNm, ResultantShearForce_kN
multiplication_10 = Multiplication(A=multiplication_7, B=peso_do_aço_m3)
multiplication_11 = Multiplication(A=multiplication_8, B=peso_do_aço_m3)
multiplication_12 = Multiplication(A=multiplication_9, B=peso_do_aço_m3)
flecha_máxima_aceitável_l_x = Panel("300")
d_energy = DeformationEnergyKaramba(AnalyzedModel=modelview.Model)  # -> AnalyzedModel, AxialDeformationEnergies_kNm, BendingEnergies_kNm
sort = SortList(Keys=b_res_force.NormalForce_kN)  # -> Keys, ValuesA
sort_2 = SortList(Keys=b_res_force_2.NormalForce_kN)  # -> Keys, ValuesA
sort_3 = SortList(Keys=b_res_force_3.NormalForce_kN)  # -> Keys, ValuesA
vão_total = Subtraction(A="100", B="0")
beamview = BeamViewKaramba(Model=d_energy.AnalyzedModel)  # -> Model, MeshesOfRenderedBeams, DeformedBeamAxes, LegendColors, LegendTags

# ---- group: teste
python = PythonScript(x=beamview.LegendTags)  # -> out, a; inputs x: list
# ---------- python: Python ----------
import re

a = []

x.pop(0)

for val in x:
    try:
        a.append( float(re.sub(r'[^\d.-e+]+', '', val)) )
    except ValueError:
        continue
# ---------- end python ----------
bnd = Bounds(Numbers=b_res_force.NormalForce_kN)
abs = Absolute(Value=python.a)
dedomain = DeconstructDomain(Domain=bnd)  # -> Start, End
bnd_2 = Bounds(Numbers=abs)
abs_2 = Absolute(Value=dedomain.Start)
dedomain_2 = DeconstructDomain(Domain=bnd_2)  # -> Start, End
panel_6 = Panel(abs_2)
panel_7 = Panel(dedomain.End)
percentual_de_utilização_máxima = Panel(dedomain_2.End)

# ----
rev = ReverseList(List=sort.Keys)
rev_2 = ReverseList(List=sort_2.Keys)
rev_3 = ReverseList(List=sort_3.Keys)
cargas_máximas_tração = Panel(rev)
cargas_máximas_compressão = Panel(sort.Keys)
cargas_máximas_tração_2 = Panel(rev_2)
cargas_máximas_compressão_2 = Panel(sort_2.Keys)
cargas_máximas_tração_3 = Panel(rev_3)
cargas_máximas_compressão_3 = Panel(sort_3.Keys)
division_11 = Division(A=vão_total, B=flecha_máxima_aceitável_l_x)
legend = Legend(Colour=beamview.LegendColors, Tags=beamview.LegendTags, LegendType=101)
abs_3 = Absolute(Value=[cargas_máximas_tração, cargas_máximas_compressão])
abs_4 = Absolute(Value=[cargas_máximas_tração_2, cargas_máximas_compressão_2])
abs_5 = Absolute(Value=[cargas_máximas_tração_3, cargas_máximas_compressão_3])
sort_4 = SortList(Keys=abs_3)  # -> Keys, ValuesA
sort_5 = SortList(Keys=abs_4)  # -> Keys, ValuesA
sort_6 = SortList(Keys=abs_5)  # -> Keys, ValuesA
addition_11 = Addition(A=multiplication_10, B=multiplication_11, C=multiplication_12)
rev_4 = ReverseList(List=sort_4.Keys)
rev_5 = ReverseList(List=sort_5.Keys)
rev_6 = ReverseList(List=sort_6.Keys)
peso_da_estrutura_kg = Panel(addition_11)
item_10 = ListItem(List=rev_4, Index=0, Wrap=True)
item_11 = ListItem(List=rev_5, Index=0, Wrap=True)
item_12 = ListItem(List=rev_6, Index=0, Wrap=True)
flecha_máxima_aceitável_m = Panel(division_11)
flecha_máxima_m = Panel(analyzethi.MaximumDisplacement_m)
resistência_máxima_de_cada_peça = Panel(multiplication_4)
solicitação_máxima = Panel(item_10)
resistência_máxima_de_cada_peça_2 = Panel(multiplication_5)
solicitação_máxima_2 = Panel(item_11)
resistência_máxima_de_cada_peça_3 = Panel(multiplication_6)
solicitação_máxima_3 = Panel(item_12)
galapagos = Galapagos(
    fitness=addition_12,
    gene=[number_slider_14, number_slider_13, number_slider_12, number_slider_10, number_slider_11, number_slider_8, number_slider_7, number_slider_6, number_slider_5, number_slider_4, number_slider_2, number_slider, number_slider_23, number_slider_21, number_slider_22])

# ----
# Estes "coeficientes" são "multas" pela estrutura estar levando bomba no cálculo estrutural. Eles permitem que o Galapagos vá se aproximando das soluções ideais.
panel_8 = Panel("100000")

subtraction_4 = Subtraction(A=flecha_máxima_m, B=flecha_máxima_aceitável_m)
subtraction_5 = Subtraction(A=solicitação_máxima, B=resistência_máxima_de_cada_peça)
panel_9 = Panel(subtraction_5)
subtraction_6 = Subtraction(A=solicitação_máxima_2, B=resistência_máxima_de_cada_peça_2)
panel_10 = Panel(subtraction_6)
subtraction_7 = Subtraction(A=solicitação_máxima_3, B=resistência_máxima_de_cada_peça_3)
panel_11 = Panel(subtraction_7)
max = Maximum(A=subtraction_4, B=0)
max_2 = Maximum(A=subtraction_5, B=0)
max_3 = Maximum(A=subtraction_6, B=0)
max_4 = Maximum(A=subtraction_7, B=0)
multiplication_13 = Multiplication(A=max, B=panel_8)
multiplication_14 = Multiplication(A=max_2, B="10000")
multiplication_15 = Multiplication(A=max_3, B="10000")
multiplication_16 = Multiplication(A=max_4, B="10000")
addition_12 = Addition(A=multiplication_14, B=multiplication_15, C=multiplication_13, D=multiplication_16, E=peso_da_estrutura_kg)
parâmetro_a_otimizar = Panel(addition_12)
equals = Equality(FirstNumber=parâmetro_a_otimizar, SecondNumber=peso_da_estrutura_kg)  # -> Equality, Inequality
está_passando = Panel(equals.Equality)
panel_12 = Panel("C:\Users\Renato\Desktop\TreEspSim")  # disabled
toggle = BooleanToggle(True)  # disabled
panel_13 = Panel("600")  # disabled
captureview = Ladybug_CaptureView(fileName=addition_11, folder=panel_12, imageWidth=panel_13, imageHeight=panel_13, capture=toggle)  # -> imagePath; disabled; plug-in component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
panel_14 = Panel(",")  # disabled
panel_15 = Panel(",")  # disabled
panel_16 = Panel(",")  # disabled
panel_17 = Panel(",")  # disabled
panel_18 = Panel(",")  # disabled
panel_19 = Panel(",")  # disabled
panel_20 = Panel(",")  # disabled
panel_21 = Panel(captureview)  # disabled
concat = Concatenate(FragmentA=multiplication_5, FragmentB=panel_15, FragmentC=item_11)  # disabled
concat_2 = Concatenate(FragmentA=multiplication_4, FragmentB=panel_14, FragmentC=item_10)  # disabled
panel_22 = Panel("base")  # disabled
panel_23 = Panel("topo")  # disabled
panel_24 = Panel("diagonal")  # disabled
concat_3 = Concatenate(FragmentA=multiplication_6, FragmentB=panel_16, FragmentC=item_12)  # disabled
concat_4 = Concatenate(FragmentA=division_11, FragmentB=panel_17, FragmentC=analyzethi.MaximumDisplacement_m)  # disabled
concat_5 = Concatenate(FragmentB=panel_18, FragmentD=panel_18)  # disabled
concat_6 = Concatenate(FragmentB=panel_19, FragmentD=panel_19)  # disabled
panel_25 = Panel("perfil usado DIAGONAL")  # disabled
concat_7 = Concatenate(FragmentB=panel_20, FragmentD=panel_20)  # disabled
panel_26 = Panel("fecha")  # disabled
panel_27 = Panel("perfil BASE")  # disabled
panel_28 = Panel("perfil TOPO")  # disabled
resistência_solicitação = Panel(concat_2)  # disabled
resistência_solicitação_2 = Panel(concat)  # disabled
resistência_solicitação_3 = Panel(concat_3)  # disabled
diâmetro_parede_cm_área = Panel(concat_5)  # disabled
diâmetro_parede_cm_área_2 = Panel(concat_6)  # disabled
diâmetro_parede_cm_área_3 = Panel(concat_7)  # disabled
está_passando_2 = Panel(está_passando)  # disabled
peso_da_estrutura = Panel(peso_da_estrutura_kg)  # disabled
máxima_existente = Panel(concat_4)  # disabled
peso_topo = Panel(multiplication_11)  # disabled
peso_diagonal = Panel(multiplication_12)  # disabled
peso_base = Panel(multiplication_10)  # disabled
panel_29 = Panel(",")  # disabled
concat_8 = Concatenate(
    FragmentA=concat_5,
    FragmentB=panel_29,
    FragmentC=concat_2,
    FragmentD=panel_29,
    FragmentE=concat_6,
    FragmentF=panel_29,
    FragmentG=concat,
    FragmentH=panel_29,
    FragmentI=concat_7,
    FragmentJ=panel_29,
    FragmentK=concat_3,
    FragmentL=panel_29,
    FragmentM=concat_4,
    FragmentN=panel_29,
    FragmentO=addition_11,
    FragmentP=panel_29,
    FragmentQ=equals.Equality,
    FragmentR=panel_29,
    FragmentS=captureview)  # disabled
rec = DataRecorder(concat_8, DataLimit=-10, RecordData=True)  # disabled
panel_30 = Panel(rec)  # disabled
