# Grasshopper definition trelica_espacial_simples_R01_b_02_multi.gh (Grasshopper 0.9.76)
# plug-ins: Karamba, Python Interpreter, LunchBox

# ---- group: Linhas que geram as 3 seções da superfície inferior da treliça espacial
number_slider = Slider(2.5, range=2.5..10)
number_slider_2 = Slider(1, range=0..10)
number_slider_3 = Slider(0.1, range=0..10)
number_slider_4 = Slider(10.5, range=2.5..25)
number_slider_5 = Slider(11.7, range=0..25)
number_slider_6 = Slider(7.9, range=0..10)
number_slider_7 = Slider(2.5, range=2.5..10)
number_slider_8 = Slider(1.1, range=0..10)
number_slider_9 = Slider(0, range=0..10)

# ---- group: Número de Módulos
number_slider_10 = Slider(5, range=5..10)
number_slider_11 = Slider(30, range=30..50)

# ---- group: Linhas que geram as 3 seções da superfície superior da treliça espacial (espessura da treliça em cada ponto)
number_slider_12 = Slider(0.4, range=0.2..3)
number_slider_13 = Slider(0.3, range=0.2..3)
number_slider_14 = Slider(0.2, range=0.2..3)
number_slider_15 = Slider(0.2, range=0.2..3)
number_slider_16 = Slider(0.2, range=0.2..3)
number_slider_17 = Slider(0.2, range=0.2..3)
number_slider_18 = Slider(0.4, range=0.2..3)
number_slider_19 = Slider(0.3, range=0.2..3)
number_slider_20 = Slider(0.3, range=0.2..3)

# ----
# C) instructions for PV performance analysis
# ---------------------------------------
# 
# 
# You can either use the results from unshaded or shaded analysis. In this example we will use the one from shaded analysis.
# 
# 1) Input the surface to "Photovoltaics performance metrics" component.
# 
# 2) Input the "ACenergyPerHour" output from "Photovoltaics Surface" to "_ACenergyPerHour" input of "Photovoltaics performance metrics" component.
# 
# Input the "totalRadiationPerHour" output from "Photovoltaics Surface" to "_totalRadiationPerHour" input of "Photovoltaics performance metrics" component.
# 
# Input the "cellTemperaturePerHour" output from "Photovoltaics Surface" to "_cellTemperaturePerHour" input of "Photovoltaics performance metrics" component.
# 
# 3) Run the "Photovoltaics performance metrics" component.
panel = Panel("c:/ladybug")
dctoacderatefactor = Ladybug_DCToACDerateFactor(
    annualShading=0,
    age=0,
    snow=0,
    wiring=2,
    soiling=2,
    mismatch=2,
    availability=3,
    connections=0.5,
    nameplateRating=1,
    lightInducedDegradation=1.5)  # -> readMe, totalLosses, DCtoACderateFactor; plug-in component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
panel_2 = Panel("https://energyplus.net/weather-download/europe_wmo_region_6/NOR//NOR_Oslo.Fornebu.014880_IWEC/all")
ladybug = Ladybug_Ladybug(defaultFolder=panel)  # -> Vviiiiiiiiiizzz; plug-in component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
epw_stat = Ladybug_OpenEPWAndSTATWeatherFiles(weatherFileURL=panel_2)  # -> epwFile, statFile; plug-in component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
addition = Addition(A=number_slider, B=number_slider_12)
addition_2 = Addition(A=number_slider_2, B=number_slider_13)
addition_3 = Addition(A=number_slider_3, B=number_slider_14)
addition_4 = Addition(A=number_slider_4, B=number_slider_15)
addition_5 = Addition(A=number_slider_5, B=number_slider_16)
addition_6 = Addition(A=number_slider_6, B=number_slider_17)
addition_7 = Addition(A=number_slider_7, B=number_slider_18)
addition_8 = Addition(A=number_slider_8, B=number_slider_19)
addition_9 = Addition(A=number_slider_9, B=number_slider_20)

# ---- group: Calcular relação que proteja o público de insolações intensas
division = Division(A=number_slider_4, B=-3)

# ----
panel_3 = Panel(dctoacderatefactor.DCtoACderateFactor)
panel_4 = Panel(division)
resistência_kn_mm² = Panel(".25")
peso_do_aço_m3 = Panel("7850")
pt = ConstructPoint(XCoordinate="0", YCoordinate=0, ZCoordinate=number_slider)
pt_2 = ConstructPoint(XCoordinate="0", YCoordinate="10", ZCoordinate=number_slider_2)
pt_3 = ConstructPoint(XCoordinate="0", YCoordinate="20", ZCoordinate=number_slider_3)
pt_4 = ConstructPoint(XCoordinate="50", YCoordinate=panel_4, ZCoordinate=number_slider_4)
pt_5 = ConstructPoint(XCoordinate="50", YCoordinate="10", ZCoordinate=number_slider_5)
pt_6 = ConstructPoint(XCoordinate="50", YCoordinate="20", ZCoordinate=number_slider_6)
pt_7 = ConstructPoint(XCoordinate="100", YCoordinate=0, ZCoordinate=number_slider_7)
pt_8 = ConstructPoint(XCoordinate="100", YCoordinate="10", ZCoordinate=number_slider_8)
pt_9 = ConstructPoint(XCoordinate="100", YCoordinate="20", ZCoordinate=number_slider_9)
pt_10 = ConstructPoint(XCoordinate="0", YCoordinate=0, ZCoordinate=addition)
pt_11 = ConstructPoint(XCoordinate="0", YCoordinate="10", ZCoordinate=addition_2)
pt_12 = ConstructPoint(XCoordinate="0", YCoordinate="20", ZCoordinate=addition_3)
pt_13 = ConstructPoint(XCoordinate="50", YCoordinate=panel_4, ZCoordinate=addition_4)
pt_14 = ConstructPoint(XCoordinate="50", YCoordinate="10", ZCoordinate=addition_5)
pt_15 = ConstructPoint(XCoordinate="50", YCoordinate="20", ZCoordinate=addition_6)
pt_16 = ConstructPoint(XCoordinate="100", YCoordinate=0, ZCoordinate=addition_7)
pt_17 = ConstructPoint(XCoordinate="100", YCoordinate="10", ZCoordinate=addition_8)
pt_18 = ConstructPoint(XCoordinate="100", YCoordinate="20", ZCoordinate=addition_9)
# Catálogo Vallourec.As bitolas escolhidas são as mais frequentemente produzidas.
seção_d_t = Panel("""33.4,3.2
33.4,3.6
38.1,3.2
38.1,4.0
42.2,3.6
42.2,5.0
48.3,3.6
48.3,5.0
60.3,4.0
60.3,5.6
73.0,5.0
73.0,7.1
88.9,5.6
88.9,8.0
101.6,5.6
101.6,8.8
114.3,6.4
114.3,8.8
141.3,6.4
141.3,10.0
168.3,7.1
168.3,11.0
219.1,8.0
219.1,12.5
273.0,10.0
273.0,16.0
323.8,10.0
323.8,17.5
355.6,10.0
355.6,12.5""")
intcrv = Interpolate(Vertices=[pt, pt_4, pt_7], Degree=3, Periodic=False, KnotStyle=1)  # -> Curve, Length, Domain
intcrv_2 = Interpolate(Vertices=[pt_2, pt_5, pt_8], Degree=3, Periodic=False, KnotStyle=1)  # -> Curve, Length, Domain
intcrv_3 = Interpolate(Vertices=[pt_3, pt_6, pt_9], Degree=3, Periodic=False, KnotStyle=1)  # -> Curve, Length, Domain
intcrv_4 = Interpolate(Vertices=[pt_10, pt_13, pt_16], Degree=3, Periodic=False, KnotStyle=1)  # -> Curve, Length, Domain
intcrv_5 = Interpolate(Vertices=[pt_11, pt_14, pt_17], Degree=3, Periodic=False, KnotStyle=1)  # -> Curve, Length, Domain
intcrv_6 = Interpolate(Vertices=[pt_12, pt_15, pt_18], Degree=3, Periodic=False, KnotStyle=1)  # -> Curve, Length, Domain

number_slider_21 = Slider(20, range=0..29)
number_slider_22 = Slider(12, range=0..29)
number_slider_23 = Slider(16, range=0..29)

item = ListItem(List=seção_d_t, Index=number_slider_21, Wrap=True)
item_2 = ListItem(List=seção_d_t, Index=number_slider_22, Wrap=True)
item_3 = ListItem(List=seção_d_t, Index=number_slider_23, Wrap=True)
panel_5 = Panel(item)

# ---- group: Sobrecarga na treliça / Cobertura
loft = Loft(
    Curves=[intcrv_4.Curve, intcrv_5.Curve, intcrv_6.Curve],
    Options={Adjust=False, Closed=False, LoftEnds=0, LoftSimp=0, LoftType=0, Rebuild=10, Refit=0.01})
project = Project(Geometry=loft, Plane=PlaneXY(0, 0, 0))  # -> Geometry, Transform
area = Area(Geometry=project.Geometry)  # -> Area, Centroid
sobrecarga_por_m2_kg = Panel("30")
multiplication = Multiplication(A=area.Area, B=sobrecarga_por_m2_kg)

# ---- group: superfície
srf = Surface(loft)
quads = QuadPanels(Surface=srf, UDivisions=2, VDivisions=8)
debrep = DeconstructBrep(Brep=quads)  # -> Faces, Edges, Vertices

# ---- group: PVsurface normal direction check
evalsrf = EvaluateSurface(Surface=reparameterize(debrep.Faces), Point="0.5,0.5")  # -> Point, Normal, Frame
vdis = VectorDisplay(Anchor=evalsrf.Point, Vector=expr("x*-10", evalsrf.Normal))

# ----
num = Number(flatten(debrep.Faces))
viewer = ParamViewer(num)
photovoltaicssurface = Ladybug_PhotovoltaicsSurface(
    epwFile=epw_stat.epwFile,
    PVsurface=flatten(debrep.Faces),
    PVsurfacePercent=100,
    DCtoACderateFactor=dctoacderatefactor.DCtoACderateFactor,
    PVmoduleSettings=["close roof mount", "c-Si", 1, 90, 15, -0.5, -2.98, -0.0471, 1],
    north=0,
    runIt=Toggle(True))  # -> readMe, port, ACenergyPerHour, ACenergyPerYear, averageDailyACenergyPerYear, port_2, DCenergyPerHour, totalRadiationPerHour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; plug-in component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
peso_próprio_da_telha_por_m2_kg = Panel("9")
area_2 = Area(Geometry=loft)  # -> Area, Centroid
split = TextSplit(Text=panel_5, Separators=",")
split_2 = TextSplit(Text=item_2, Separators=",")
split_3 = TextSplit(Text=item_3, Separators=",")
loft_2 = Loft(
    Curves=[intcrv.Curve, intcrv_2.Curve, intcrv_3.Curve],
    Options={Adjust=False, Closed=False, LoftEnds=0, LoftSimp=0, LoftType=0, Rebuild=10, Refit=0.01})
panel_6 = Panel(split)
multiplication_2 = Multiplication(A=area_2.Area, B=peso_próprio_da_telha_por_m2_kg)
item_4 = ListItem(List=panel_6, Index=0, Wrap=True)
item_5 = ListItem(List=panel_6, Index=1, Wrap=True)
item_6 = ListItem(List=split_2, Index=0, Wrap=True)
item_7 = ListItem(List=split_2, Index=1, Wrap=True)
item_8 = ListItem(List=split_3, Index=0, Wrap=True)
item_9 = ListItem(List=split_3, Index=1, Wrap=True)
# Simplificação: aqui estamos considerando uma carga igualmente distribuída por todos os nós de apoio.
addition_10 = Addition(A=multiplication, B=multiplication_2)
supp = SupportKaramba(PosInd=[pt_7, pt], menu=[buttons(on, off, on, off, off, off)])
supp_2 = SupportKaramba(PosInd=[pt_9, pt_3], menu=[buttons(on, on, on, on, on, on)])
diametro_mm = Panel(item_4)
parede_mm = Panel(item_5)
diametro_mm_2 = Panel(item_6)
parede_mm_2 = Panel(item_7)
diametro_mm_3 = Panel(item_8)
parede_mm_3 = Panel(item_9)
spacetruss_2 = SpaceTrussStructure2(SurfaceA=loft_2, SurfaceB=loft, UDivisions=number_slider_10, VDivisions=number_slider_11)  # -> LinesA, LinesB, Web, Nodes
disc = Discontinuity(Curve=spacetruss_2.LinesB, Level=1)  # -> flatten(Points), Parameters
division_2 = Division(A=diametro_mm, B=10)
division_3 = Division(A=parede_mm, B=10)
division_4 = Division(A=item_6, B=10)
division_5 = Division(A=item_7, B=10)
division_6 = Division(A=diametro_mm_3, B=10)
division_7 = Division(A=parede_mm_3, B=10)
merge = Merge(Data1=supp, Data2=supp_2)
rdpoints = RemoveDuplicatePointsKaramba(Point=disc.Points, LimitDistance=0.005)  # -> OutPoint, Info, Indexes

# ---- group: Sobrecarga na treliça
lng = ListLength(List=rdpoints.OutPoint)
carga_por_nó = Division(A=addition_10, B=lng)
multiplication_3 = Multiplication(A=carga_por_nó, B=-0.0098)

# ----
diametro_cm = Panel(division_6)
parede_cm = Panel(division_7)
linhas_base = RemoveDuplicateLinesKaramba(Line=flatten(spacetruss_2.LinesA), LimitDistance=0.005)  # -> OutLine, Info, Indexes
linhas_topo = RemoveDuplicateLinesKaramba(Line=flatten(spacetruss_2.LinesB), LimitDistance=0.005)  # -> OutLine, Info, Indexes
treliça = RemoveDuplicateLinesKaramba(Line=flatten(spacetruss_2.Web), LimitDistance=0.005)  # -> OutLine, Info, Indexes
eval = Evaluate(F="(3.14159*x^2)/4", x=diametro_mm)
eval_2 = Evaluate(F="(3.14159*(x-(y*2))^2)/4", x=diametro_mm, y=parede_mm)
eval_3 = Evaluate(F="(3.14159*x^2)/4", x=item_6)
eval_4 = Evaluate(F="(3.14159*(x-(y*2))^2)/4", x=item_6, y=item_7)
eval_5 = Evaluate(F="(3.14159*x^2)/4", x=diametro_mm_3)
eval_6 = Evaluate(F="(3.14159*(x-(y*2))^2)/4", x=diametro_mm_3, y=parede_mm_3)
diametro_cm_2 = Panel(division_2)
parede_cm_2 = Panel(division_3)
Z = UnitZ(Factor=multiplication_3)
loads = LoadsKaramba(ForceVector=Z, Local=False, PosInd=rdpoints.OutPoint, LCase=0, mode="Point")
subtraction = Subtraction(A=eval, B=eval_2)
subtraction_2 = Subtraction(A=eval_3, B=eval_4)
subtraction_3 = Subtraction(A=eval_5, B=eval_6)
linetobeam = LineToBeamKaramba(Points=rdpoints.OutPoint, Line=linhas_base.OutLine, New=True, Remove=True, LimitDistance_m=0.005, BeamIdentifier="base")  # -> Points, Element, Info
linetobeam_2 = LineToBeamKaramba(Line=linhas_topo.OutLine, New=True, Remove=True, LimitDistance_m=0.005, BeamIdentifier="topo")  # -> Points, Element, Info
linetobeam_3 = LineToBeamKaramba(Line=treliça.OutLine, New=True, Remove=True, LimitDistance_m=0.005, BeamIdentifier="diagonais")  # -> Points, Element, Info
cross_sections = CrossSectionsKaramba(ElementsIdentifiers="base", Diameter_cm=diametro_cm_2, WallThickness_cm=parede_cm_2, mode="Circular Hollow")
cross_sections_2 = CrossSectionsKaramba(ElementsIdentifiers="topo", Diameter_cm=division_4, WallThickness_cm=division_5, mode="Circular Hollow")
cross_sections_3 = CrossSectionsKaramba(ElementsIdentifiers="diagonais", Diameter_cm=diametro_cm, WallThickness_cm=parede_cm, mode="Circular Hollow")
área_do_perfil_mm2 = Panel(subtraction_3)
área_do_perfil_mm2_2 = Panel(subtraction)
área_do_perfil_mm2_3 = Panel(subtraction_2)
loads_2 = LoadsKaramba(Vector=Vector(0, 0, -1), LCase=0, mode="Gravity")
matselect = MaterialSelectionKaramba(menu=[dropdown(1), dropdown(54)])
merge_2 = Merge(Data1=cross_sections, Data2=cross_sections_2, Data3=cross_sections_3)
merge_3 = Merge(Data1=linetobeam.Element, Data2=linetobeam_2.Element, Data3=linetobeam_3.Element)
merge_4 = Merge(Data1=loads_2, Data2=loads)
len = Length(Curve=linhas_base.OutLine)
len_2 = Length(Curve=linhas_topo.OutLine)
len_3 = Length(Curve=treliça.OutLine)
assemble = AssembleModelKaramba(
    Point=rdpoints.OutPoint,
    Elem=flatten(merge_3),
    Support=merge,
    Load=flatten(merge_4),
    CrossSection=merge_2,
    Material=matselect,
    LimitDistance_m=0.005)  # -> Model, Info, Mass_kg, CenterOfGravity

end = EndPoints(Curve=linhas_topo.OutLine)  # -> Start, End
pt_19 = Point(spacetruss_2.Nodes)
del = DelaunayMesh(Points=pt_19, Plane=PlaneXY(0, 0, 0))

ma = MassAddition(Input=len)  # -> Result, PartialResults
division_8 = Division(A=área_do_perfil_mm2_2, B=1000000)
multiplication_4 = Multiplication(A=área_do_perfil_mm2_2, B=resistência_kn_mm²)
ma_2 = MassAddition(Input=len_2)  # -> Result, PartialResults
division_9 = Division(A=área_do_perfil_mm2_3, B=1000000)
multiplication_5 = Multiplication(A=área_do_perfil_mm2_3, B=resistência_kn_mm²)
ma_3 = MassAddition(Input=len_3)  # -> Result, PartialResults
division_10 = Division(A=área_do_perfil_mm2, B=1000000)
multiplication_6 = Multiplication(A=área_do_perfil_mm2, B=resistência_kn_mm²)
analyzethi = AnalyzeThIKaramba(Model=assemble.Model)  # -> CalculatedModel, MaximumDisplacement_m, ResultingForceOfGravity_kN, ElasticEnergy_kNm
multiplication_7 = Multiplication(A=ma.Result, B=division_8)
multiplication_8 = Multiplication(A=ma_2.Result, B=division_9)
multiplication_9 = Multiplication(A=ma_3.Result, B=division_10)
ladybug_2 = Ladybug_Ladybug()  # -> Vviiiiiiiiiizzz; plug-in component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
modelview = ModelViewKaramba(Model=analyzethi.CalculatedModel, LoadCaseFactorsForLinearSuperposition=1, IndexIncrementOfVisibleLoadcase=0)  # -> Model, DeformedMesh, DeformedAxes, DeformedModel
b_res_force = BeamResultantForcesKaramba(
    AnalyzedModel=analyzethi.CalculatedModel,
    BeamIdentifiers="base",
    LoadCase=-1,
    MaximumProbingDistance_m=-1,
    NumberOfProbingPointsPerElement=3)  # -> AnalyzedModel, NormalForce_kN, ResultantBendingMoment_kNm, ResultantShearForce_kN
b_res_force_2 = BeamResultantForcesKaramba(
    AnalyzedModel=analyzethi.CalculatedModel,
    BeamIdentifiers="topo",
    LoadCase=-1,
    MaximumProbingDistance_m=-1,
    NumberOfProbingPointsPerElement=3)  # -> AnalyzedModel, NormalForce_kN, ResultantBendingMoment_kNm, ResultantShearForce_kN
b_res_force_3 = BeamResultantForcesKaramba(
    AnalyzedModel=analyzethi.CalculatedModel,
    BeamIdentifiers="diagonais",
    LoadCase=-1,
    MaximumProbingDistance_m=-1,
    NumberOfProbingPointsPerElement=3)  # -> AnalyzedModel, NormalForce_kN, ResultantBendingMoment_kNm, ResultantShearForce_kN
multiplication_10 = Multiplication(A=multiplication_7, B=peso_do_aço_m3)
multiplication_11 = Multiplication(A=multiplication_8, B=peso_do_aço_m3)
multiplication_12 = Multiplication(A=multiplication_9, B=peso_do_aço_m3)

rec_3pt = Rectangle3Pt(PointA="0.0, 0.0, 0.1", PointB="100.0, 0.0, 0.1", PointC="0.0, 20.0, 0.1")  # -> Rectangle, Length
rec_3pt_2 = Rectangle3Pt(PointA="-20.0, -20.0, 0.0", PointB="120.0, -20.0, 0.0", PointC="0.0, 40.0, 0.0")  # -> Rectangle, Length
srf_2 = Surface(rec_3pt_2.Rectangle)
srf_3 = Surface(rec_3pt.Rectangle)

srf_4 = Surface(rec_3pt_2.Rectangle)
sunpathshading = Ladybug_SunpathShading(
    epwFile=epw_stat.epwFile,
    analysisGeometry=flatten(debrep.Faces),
    context=srf_4,
    coniferousAllyearIndex=0.3,
    deciduousInleafIndex=0.23,
    deciduousLeaflessIndex=0.64,
    ACenergyPerHour=flatten(photovoltaicssurface.ACenergyPerHour),
    north=0,
    outputGeometryIndex=0,
    scale=1,
    hoursPositionScale=1,
    precision="20",
    bakeIt=False,
    runIt=Toggle(False))  # -> readMe, skyExposureFactor, beamIndexPerHour, shadedSolarRadiationPerHour, port, Sep21toMar21Shading, Mar21toSep21Shading, annualShading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; plug-in component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
tag = TextTag(Location=sunpathshading.hoursPositions, Text=sunpathshading.hours)
tag_2 = TextTag(Location=sunpathshading.quadrantCentroids, Text=sunpathshading.quadrantShadingPercents)
geo = Geometry(sunpathshading.sunWindowCrvs)
mesh = Mesh([sunpathshading.sunWindowMesh, sunpathshading.legend])
panel_7 = Panel(sunpathshading.annualShading)
dctoacderatefactor_2 = Ladybug_DCToACDerateFactor(
    annualShading=sunpathshading.annualShading,
    age=0,
    snow=0,
    wiring=2,
    soiling=2,
    mismatch=2,
    availability=3,
    connections=0.5,
    nameplateRating=1,
    lightInducedDegradation=1.5)  # -> readMe, totalLosses, DCtoACderateFactor; plug-in component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
panel_8 = Panel(dctoacderatefactor_2.DCtoACderateFactor)
photovoltaicssurface_2 = Ladybug_PhotovoltaicsSurface(
    epwFile=epw_stat.epwFile,
    PVsurface=flatten(debrep.Faces),
    PVsurfacePercent=100,
    DCtoACderateFactor=dctoacderatefactor_2.DCtoACderateFactor,
    PVmoduleSettings=["close roof mount", "c-Si", 1, 90, 15, -0.5, -2.98, -0.0471, 1],
    north=0,
    runIt=Toggle(False))  # -> readMe, port, ACenergyPerHour, ACenergyPerYear, averageDailyACenergyPerYear, port_2, DCenergyPerHour, totalRadiationPerHour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; plug-in component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
bnd = Bounds(Numbers=b_res_force.NormalForce_kN)
bnd_2 = Bounds(Numbers=b_res_force_2.NormalForce_kN)
bnd_3 = Bounds(Numbers=b_res_force_3.NormalForce_kN)
flecha_máxima_aceitável_l_x = Panel("300")
d_energy = DeformationEnergyKaramba(AnalyzedModel=modelview.Model)  # -> AnalyzedModel, AxialDeformationEnergies_kNm, BendingEnergies_kNm
dedomain = DeconstructDomain(Domain=bnd)  # -> Start, End
dedomain_2 = DeconstructDomain(Domain=bnd_2)  # -> Start, End
dedomain_3 = DeconstructDomain(Domain=bnd_3)  # -> Start, End
abs = Absolute(Value=dedomain.Start)
abs_2 = Absolute(Value=dedomain_2.Start)
geo_2 = Geometry(loft)
vão_total = Subtraction(A="100", B="0")
abs_3 = Absolute(Value=dedomain_3.Start)
beamview = BeamViewKaramba(Model=d_energy.AnalyzedModel)  # -> Model, MeshesOfRenderedBeams, DeformedBeamAxes, LegendColors, LegendTags

# ---- group: teste
python = PythonScript(x=beamview.LegendTags)  # -> out, a; inputs x: list
# ---------- python: Python ----------
import re

a = []

x.pop(0)

for val in x:
    try:
        a.append( float(re.sub(r'[^\d.-e+]+', '', val)) )
    except ValueError:
        continue
# ---------- end python ----------
abs_4 = Absolute(Value=python.a)
bnd_4 = Bounds(Numbers=abs_4)
dedomain_4 = DeconstructDomain(Domain=bnd_4)  # -> Start, End
percentual_de_utilização_máxima = Panel(dedomain_4.End)

# ----
compressão_máxima_kn = Panel(abs)
tração_máxima_kn = Panel(dedomain.End)
compressão_máxima_kn_2 = Panel(abs_3)
tração_máxima_kn_2 = Panel(dedomain_3.End)
compressão_máxima_kn_3 = Panel(abs_2)
tração_máxima_kn_3 = Panel(dedomain_2.End)
division_11 = Division(A=vão_total, B=flecha_máxima_aceitável_l_x)
abs_5 = Absolute(Value=[compressão_máxima_kn_3, tração_máxima_kn_3])
abs_6 = Absolute(Value=[compressão_máxima_kn, tração_máxima_kn])
abs_7 = Absolute(Value=[compressão_máxima_kn_2, tração_máxima_kn_2])
r_kwh = Panel("0.494")
sort = SortList(Keys=abs_5)  # -> Keys, ValuesA
sort_2 = SortList(Keys=abs_6)  # -> Keys, ValuesA
sort_3 = SortList(Keys=abs_7)  # -> Keys, ValuesA
addition_11 = Addition(A=multiplication_10, B=multiplication_11, C=multiplication_12)
photovoltaicsperformancemetrics = Ladybug_PhotovoltaicsPerformanceMetrics(
    PVsurface=flatten(debrep.Faces),
    PVsurfacePercent="100",
    PVmoduleSettings=["close roof mount", "c-Si", 1, 90, 15, -0.5, -2.98, -0.0471, 1],
    ACenergyPerHour=photovoltaicssurface_2.ACenergyPerHour,
    totalRadiationPerHour=photovoltaicssurface_2.totalRadiationPerHour,
    cellTemperaturePerHour=photovoltaicssurface_2.cellTemperaturePerHour,
    energyCostPerKWh=r_kwh,
    embodiedEnergyPerM2="4410",
    embodiedCO2PerM2="225",
    gridEfficiency=29,
    optimal=False,
    runIt=Toggle(False))  # -> readMe, optimalSystemSize, port, CUFperYear, basicPRperYear, temperatureCorrectedPRperMonth, temperatureCorrectedPRperYear, port_2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; plug-in component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
rev = ReverseList(List=sort.Keys)
rev_2 = ReverseList(List=sort_2.Keys)
rev_3 = ReverseList(List=sort_3.Keys)
peso_da_estrutura_kg = Panel(addition_11)
item_10 = ListItem(List=rev_2, Index=0, Wrap=True)
item_11 = ListItem(List=rev, Index=0, Wrap=True)
item_12 = ListItem(List=rev_3, Index=0, Wrap=True)
flecha_máxima_aceitável_m = Panel(division_11)
flecha_máxima_m = Panel(analyzethi.MaximumDisplacement_m)
solicitação_máxima_perfis_base = Panel(item_10)
resistência_máxima_de_cada_peça = Panel(multiplication_4)
solicitação_máxima_perfis_topo = Panel(item_11)
resistência_máxima_de_cada_peça_2 = Panel(multiplication_5)
solicitação_máxima_perfis_diagonal = Panel(item_12)
resistência_máxima_de_cada_peça_3 = Panel(multiplication_6)
galapagos = Galapagos(
    fitness=addition_12,
    gene=[number_slider_18, number_slider_15, number_slider_12, number_slider_10, number_slider_11, number_slider_8, number_slider_7, number_slider_6, number_slider_5, number_slider_4, number_slider_2, number_slider, number_slider_21, number_slider_22, number_slider_23, number_slider_13, number_slider_14, number_slider_16, number_slider_17, number_slider_19, number_slider_20, number_slider_3, number_slider_9])
valor_energético_total_ano = Panel(photovoltaicsperformancemetrics.energyValue)
proporção_produção_energia_anual_real_e = Panel(photovoltaicsperformancemetrics.temperatureCorrectedPRperYear)  # "proporção produção energia anual real e teoricamente possível"

# ----
# Estes "coeficientes" são "multas" pela estrutura estar levando bomba no cálculo estrutural. Eles permitem que o Galapagos vá se aproximando das soluções ideais.
panel_9 = Panel("100000")

subtraction_4 = Subtraction(A=flecha_máxima_m, B=flecha_máxima_aceitável_m)
panel_10 = Panel(photovoltaicsperformancemetrics.temperatureCorrectedPRperMonth)
subtraction_5 = Subtraction(A=solicitação_máxima_perfis_topo, B=resistência_máxima_de_cada_peça_2)
panel_11 = Panel(subtraction_5)
subtraction_6 = Subtraction(A=solicitação_máxima_perfis_base, B=resistência_máxima_de_cada_peça)
panel_12 = Panel(subtraction_6)
subtraction_7 = Subtraction(A=solicitação_máxima_perfis_diagonal, B=resistência_máxima_de_cada_peça_3)
panel_13 = Panel(subtraction_7)
max = Maximum(A=subtraction_4, B=0)
max_2 = Maximum(A=subtraction_5, B=0)
max_3 = Maximum(A=subtraction_6, B=0)
max_4 = Maximum(A=subtraction_7, B=0)
multiplication_13 = Multiplication(A=max, B=panel_9)
multiplication_14 = Multiplication(A=max_2, B="10000")
multiplication_15 = Multiplication(A=max_3, B="10000")
multiplication_16 = Multiplication(A=max_4, B="10000")
addition_12 = Addition(A=multiplication_15, B=multiplication_14, C=multiplication_13, D=multiplication_16, E=peso_da_estrutura_kg)
parâmetro_a_otimizar = Panel(addition_12)
equals = Equality(FirstNumber=parâmetro_a_otimizar, SecondNumber=peso_da_estrutura_kg)  # -> Equality, Inequality
está_passando = Panel(equals.Equality)

# ----
# Análise da sombra
panel_14 = Panel("C:\Users\Renato\Dropbox\REANTO DOCS\ESTUDO\17_2\MECOM GRASSHOPPER\Simulação_ambiental\Carta_Psicomêtrica\BRA_MG_Ouro.Branco.868230_INMET.epw")
importlocation = Ladybug_ImportLocation(epwFile=panel_14)  # -> location; plug-in component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
horas = Series(Start="8", Step=1, Count="10")
mês = Panel("11")
dia = Panel("21")
pt_20 = Point(area.Centroid)
sunpath = Ladybug_SunPath(
    north="270",
    location=importlocation,
    hour=horas,
    day=dia,
    month=mês,
    timeStep=1,
    centerPt=pt_20,
    sunPathScale="0.30",
    dailyOrAnnualSunPath=True)  # -> readMe, sunVectors, sunAltitudes, sunAzimuths, port, sunSpheresMesh, sunPathCrvs, compassCrvs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; plug-in component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
preview = CustomPreview(Geometry=[srf_2, srf_3], Shader=ColourSwatch(SwatchColor=RGBA(255, 255, 255, 223)))
preview_2 = CustomPreview(Geometry=geo_2, Shader=ColourSwatch(SwatchColor=RGBA(255, 255, 255, 73)))
number_slider_24 = Slider(0.001, range=0..0.001)
toggle = BooleanToggle(False)
toggle_2 = BooleanToggle(False)
sunlighthoursanalysis = Ladybug_SunlightHoursAnalysis(
    geometry=flatten(srf_3),
    context=flatten(geo_2),
    gridSize="1",
    disFromBase=number_slider_24,
    sunVectors=flatten(sunpath.sunVectors),
    timeStep=1,
    parallel=toggle,
    runIt=toggle_2)  # -> readMe, contextMesh, analysisMesh, testPts, testVec, port, sunlightHoursResult, sunlightHoursMesh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; plug-in component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

panel_15 = Panel(horas)
preview_3 = CustomPreview(
    Geometry=[sunpath.sunPathCrvs, sunpath.compassCrvs, sunpath.sunSpheresMesh],
    Shader=ColourSwatch(SwatchColor=RGB(105, 105, 105)))

lng_2 = ListLength(List=sunpath.sunVectors)
addition_13 = Addition(A=lng_2, B=1)
legendpar = Ladybug_LegendParameters(numSegments=addition_13)  # -> legendPar; plug-in component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

sunlighthoursanalysis_2 = Ladybug_SunlightHoursAnalysis(
    geometry=flatten(srf_2),
    context=flatten(geo_2),
    gridSize="1",
    disFromBase=number_slider_24,
    sunVectors=flatten(sunpath.sunVectors),
    timeStep=1,
    legendPar=flatten(legendpar),
    parallel=toggle,
    runIt=toggle_2)  # -> readMe, contextMesh, analysisMesh, testPts, testVec, port, sunlightHoursResult, sunlightHoursMesh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; plug-in component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

# ----
# Funções Objetivas
# Média de horas de luz solar direta recebida
# Peso total da estrutura (kg)
minimizar = Panel(addition_12)
panel_16 = Panel("Condição estrutural")
restrição = Panel(está_passando)
minimizar_2 = Panel(sunlighthoursanalysis.totalSunlightHours)
