# Grasshopper definition cobertura.gh (Grasshopper 0.9.76)

number_slider = Slider(15, range=0..100)
ponto_perpendicular = Slider(18.875, range=0..50)
ângulo = Slider(20, range=0..100)
number_slider_2 = Slider(15, range=0..100)
number_slider_3 = Slider(80, range=0..100)
ponto_na_linha = Slider(0.5, range=0..1)
ponto_perpendicular_2 = Slider(27.674, range=0..35)
ponto_na_linha_2 = Slider(0.5, range=0..1)
ponto_perpendicular_3 = Slider(22.35, range=0..35)
ponto_perpendicular_4 = Slider(16.68, range=0..50)
ângulo_2 = Slider(20, range=0..100)
pt = ConstructPoint(XCoordinate=0, YCoordinate=number_slider_2, ZCoordinate=0)
pt_2 = ConstructPoint(XCoordinate=number_slider_3, YCoordinate=number_slider, ZCoordinate=Slider(0, range=0..100))
pt_3 = ConstructPoint(XCoordinate=0, YCoordinate=number_slider_2, ZCoordinate=0)
pt_4 = ConstructPoint(XCoordinate=number_slider_3, YCoordinate=number_slider, ZCoordinate=Slider(0, range=0..100))
pt_5 = ConstructPoint(XCoordinate=0, YCoordinate=0, ZCoordinate=0)
pt_6 = ConstructPoint(XCoordinate=Slider(80, range=0..100), YCoordinate=0, ZCoordinate=Slider(0, range=0..100))
pt_7 = ConstructPoint(XCoordinate=0, YCoordinate=0, ZCoordinate=0)
pt_8 = ConstructPoint(XCoordinate=Slider(80, range=0..100), YCoordinate=0, ZCoordinate=Slider(0, range=0..100))
ln = Line(StartPoint=pt, EndPoint=pt_2)
ln_2 = Line(StartPoint=pt_3, EndPoint=pt_4)
ln_3 = Line(StartPoint=pt_5, EndPoint=pt_6)
ln_4 = Line(StartPoint=pt_7, EndPoint=pt_8)
eval = EvaluateCurve(Curve=reparameterize(ln), Parameter=ponto_na_linha)  # -> Point, Tangent, Angle
eval_2 = EvaluateCurve(Curve=reparameterize(ln_2), Parameter=Slider(0.5, range=0..1))  # -> Point, Tangent, Angle
eval_3 = EvaluateCurve(Curve=reparameterize(ln_3), Parameter=ponto_na_linha_2)  # -> Point, Tangent, Angle
eval_4 = EvaluateCurve(Curve=reparameterize(ln_4), Parameter=Slider(0.5, range=0..1))  # -> Point, Tangent, Angle
pdecon = Deconstruct(Point=eval.Tangent)  # -> XComponent, YComponent, ZComponent
pdecon_2 = Deconstruct(Point=eval_2.Tangent)  # -> XComponent, YComponent, ZComponent
pdecon_3 = Deconstruct(Point=eval_3.Tangent)  # -> XComponent, YComponent, ZComponent
pdecon_4 = Deconstruct(Point=eval_4.Tangent)  # -> XComponent, YComponent, ZComponent
multiplication = Multiplication(A=pdecon.XComponent, B=-1)
multiplication_2 = Multiplication(A=pdecon_2.XComponent, B=-1)
multiplication_3 = Multiplication(A=pdecon_3.XComponent, B=-1)
multiplication_4 = Multiplication(A=pdecon_4.XComponent, B=-1)
pt_9 = ConstructPoint(XCoordinate=pdecon.ZComponent, YCoordinate=pdecon.YComponent, ZCoordinate=multiplication)
pt_10 = ConstructPoint(XCoordinate=pdecon_2.ZComponent, YCoordinate=pdecon_2.YComponent, ZCoordinate=multiplication_2)
pt_11 = ConstructPoint(XCoordinate=pdecon_3.ZComponent, YCoordinate=pdecon_3.YComponent, ZCoordinate=multiplication_3)
pt_12 = ConstructPoint(XCoordinate=pdecon_4.ZComponent, YCoordinate=pdecon_4.YComponent, ZCoordinate=multiplication_4)
multiplication_5 = Multiplication(A=pt_9, B=ponto_perpendicular_2)
multiplication_6 = Multiplication(A=pt_10, B=ponto_perpendicular)
multiplication_7 = Multiplication(A=pt_11, B=ponto_perpendicular_3)
multiplication_8 = Multiplication(A=pt_12, B=ponto_perpendicular_4)
neg = Negative(Value=multiplication_5)
neg_2 = Negative(Value=multiplication_6)
neg_3 = Negative(Value=multiplication_7)
neg_4 = Negative(Value=multiplication_8)
addition = Addition(A=neg, B=eval.Point)
addition_2 = Addition(A=neg_2, B=eval_2.Point)
addition_3 = Addition(A=neg_3, B=eval_3.Point)
addition_4 = Addition(A=neg_4, B=eval_4.Point)
merge = Merge(Data1=pt, Data2=addition, Data3=pt_2)
merge_2 = Merge(Data1=pt_3, Data2=addition_2, Data3=pt_4)
merge_3 = Merge(Data1=pt_5, Data2=addition_3, Data3=pt_6)
merge_4 = Merge(Data1=pt_7, Data2=addition_4, Data3=pt_8)
intcrv = Interpolate(Vertices=merge, Degree=3, Periodic=False, KnotStyle=1)  # -> Curve, Length, Domain
intcrv_2 = Interpolate(Vertices=merge_2, Degree=3, Periodic=False, KnotStyle=1)  # -> Curve, Length, Domain
intcrv_3 = Interpolate(Vertices=merge_3, Degree=3, Periodic=False, KnotStyle=1)  # -> Curve, Length, Domain
intcrv_4 = Interpolate(Vertices=merge_4, Degree=3, Periodic=False, KnotStyle=1)  # -> Curve, Length, Domain
end = EndPoints(Curve=intcrv.Curve)  # -> Start, End
end_2 = EndPoints(Curve=intcrv_3.Curve)  # -> Start, End
ln_5 = Line(StartPoint=end.Start, EndPoint=end.End)
ln_6 = Line(StartPoint=end_2.Start, EndPoint=end_2.End)
number_slider_4 = Slider(20, range=0..100)
number_slider_5 = Slider(20, range=0..100)
neg_5 = Negative(Value=ângulo)
neg_6 = Negative(Value=ângulo_2)
rotax = RotateAxis(Geometry=intcrv_2.Curve, Angle=degrees(ângulo), Axis=ln_5)  # -> Geometry, Transform
rotax_2 = RotateAxis(Geometry=intcrv_2.Curve, Angle=degrees(neg_5), Axis=ln_5)  # -> Geometry, Transform
rotax_3 = RotateAxis(Geometry=intcrv_4.Curve, Angle=degrees(ângulo_2), Axis=ln_6)  # -> Geometry, Transform
rotax_4 = RotateAxis(Geometry=intcrv_4.Curve, Angle=degrees(neg_6), Axis=ln_6)  # -> Geometry, Transform
crv = Curve(intcrv.Curve)
number_slider_6 = Slider(0.388, range=0..1)
crv_2 = Curve(intcrv_3.Curve)
divide = DivideCurve(Curve=rotax.Geometry, Count=number_slider_4, Kinks=False)  # -> Points, Tangents, Parameters
divide_2 = DivideCurve(Curve=crv, Count=number_slider_4, Kinks=False)  # -> Points, Tangents, Parameters
divide_3 = DivideCurve(Curve=rotax_2.Geometry, Count=number_slider_4, Kinks=False)  # -> Points, Tangents, Parameters
divide_4 = DivideCurve(Curve=rotax_3.Geometry, Count=number_slider_5, Kinks=False)  # -> Points, Tangents, Parameters
divide_5 = DivideCurve(Curve=crv_2, Count=number_slider_5, Kinks=False)  # -> Points, Tangents, Parameters
divide_6 = DivideCurve(Curve=rotax_4.Geometry, Count=number_slider_5, Kinks=False)  # -> Points, Tangents, Parameters
pipe = Pipe(Curve=rotax_3.Geometry, Radius=number_slider_6, Caps=0)
pipe_2 = Pipe(Curve=crv_2, Radius=number_slider_6, Caps=0)
pipe_3 = Pipe(Curve=rotax_4.Geometry, Radius=number_slider_6, Caps=0)
ln_7 = Line(StartPoint=divide.Points, EndPoint=divide_2.Points)
ln_8 = Line(StartPoint=divide_2.Points, EndPoint=divide_3.Points)
ln_9 = Line(StartPoint=divide.Points, EndPoint=divide_3.Points)
ln_10 = Line(StartPoint=divide_4.Points, EndPoint=divide_5.Points)
ln_11 = Line(StartPoint=divide_5.Points, EndPoint=divide_6.Points)
ln_12 = Line(StartPoint=divide_4.Points, EndPoint=divide_6.Points)
line = Line(flatten([ln_10, ln_11, ln_12]))
line_2 = Line(flatten([ln_7, ln_8, ln_9]))
cull_i = CullIndex(List=line, Indices=Slider(0, range=0..100), Wrap=True)
cull_i_2 = CullIndex(List=line_2, Indices=Slider(0, range=0..100), Wrap=True)
arrpolar = PolarArray(Geometry=rotax_4.Geometry, Plane=PlaneXY(0, 0, 0), Count=10, Angle=6.283185307)  # -> Geometry, Transform
number_slider_7 = Slider(20, range=0..100)
item = ListItem(List=arrpolar.Geometry, Index=Slider(1, range=0..1), Wrap=True)
crv_3 = Curve(rotax_3.Geometry)
divide_7 = DivideCurve(Curve=crv_3, Count=number_slider_7, Kinks=False)  # -> Points, Tangents, Parameters
divide_8 = DivideCurve(Curve=item, Count=number_slider_7, Kinks=False)  # -> Points, Tangents, Parameters
merge_5 = Merge(Data1=rotax_3.Geometry, Data2=item)  # -> flatten(Result)
ln_13 = Line(StartPoint=divide_7.Points, EndPoint=divide_8.Points)
curvepoint = PointOnCurve(ln_13, parameter=0.5)
pt_13 = ConstructPoint(XCoordinate=Slider(1, range=0..1), YCoordinate=0, ZCoordinate=Slider(0.9, range=0..10))
move = Move(Geometry=curvepoint, Motion=pt_13)  # -> Geometry, Transform
arc = Arc3Pt(PointA=divide_7.Points, PointB=move.Geometry, PointC=divide_8.Points)  # -> Arc, Plane, Radius
number_slider_8 = Slider(0.1, range=0..1)
number_slider_9 = Slider(0.2, range=0..1)
loft = Loft(Curves=arc.Arc, Options={Adjust=False, Closed=False, LoftEnds=0, LoftSimp=0, LoftType=0, Rebuild=10, Refit=0.01})
ln_14 = Line(StartPoint=move.Geometry, EndPoint=curvepoint)
ln_15 = Line(StartPoint=divide_7.Points, EndPoint=move.Geometry)
ln_16 = Line(StartPoint=divide_8.Points, EndPoint=move.Geometry)
pipe_4 = Pipe(Curve=ln_15, Radius=number_slider_9, Caps=0)
pipe_5 = Pipe(Curve=ln_16, Radius=number_slider_9, Caps=0)
pipe_6 = Pipe(Curve=ln_14, Radius=number_slider_8, Caps=0)
pipe_7 = Pipe(Curve=ln_13, Radius=number_slider_8, Caps=0)
merge_6 = Merge(Data1=pipe_4, Data2=pipe_5, Data3=pipe_6, Data4=pipe_7)
merge_7 = Merge(Data2=pipe, Data3=pipe_2, Data4=pipe_3, Data6=loft, Data7=merge_6)
