# Grasshopper definition cobertura2.gh (Grasshopper 0.9.76)
# plug-ins: Karamba

panel = Panel("DIMENSÃO MODELO")
panel_2 = Panel("LARGURA")
eixo_z = Slider(1.8, range=1.8..2.2)
panel_3 = Panel("COMPRIMENTO")
panel_4 = Panel("ALTURA APOIOS 01")
panel_5 = Panel("ALTURA APOIOS 02")
altura = Slider(1.8, range=1.8..2.2)

# ----
# Altura Banzo Superior 1
# Altura Banzo Superior 2
panel_6 = Panel("BANZO SUPERIORES")
panel_7 = Panel("Extremidade Banzos Superiores")
eixo_x = Slider(2.5, range=0..2.5)
eixo_z_2 = Slider(1.58, range=0..4)
ponto_perpendicular = Slider(1, range=1..5)
eixo_z_3 = Slider(2.63, range=0..3)
ponto_perpendicular_2 = Slider(13.763, range=0..35)

panel_8 = Panel("BARRAS")
panel_9 = Panel("Extremidade Barras")
eixo_x_2 = Slider(3, range=0..3)
panel_10 = Panel("Altura Barra 02")
eixo_z_4 = Slider(6.18, range=0..10)
ponto_perpendicular_3 = Slider(-3, range=-3..10)
ponto_perpendicular_4 = Slider(-1.5, range=-1.5..6)
panel_11 = Panel("Altura Barra 01")
eixo_z_5 = Slider(7.47, range=1..10)

# ----
# Ângulo Banzos Inferiores 1
# Altura Banzos Inferior 1
# Ângulo Banzos Inferiores 2
# Altura Banzos Inferior 2
ponto_perpendicular_5 = Slider(10, range=10..30)
ângulo = Slider(20, range=10..30)
panel_12 = Panel("BANZO INFERIORES")
ângulo_2 = Slider(20, range=10..30)
ponto_perpendicular_6 = Slider(11.2, range=0..35)

ponto_perpendicular_7 = Slider(0.19, range=-5..12)
eixo_z_6 = Slider(8.53, range=4..15)
panel_13 = Panel("Altura Barra 1/2")
ponto_perpendicular_8 = Slider(7.08, range=0..10)

panel_14 = Panel("DIVISÕES DIAGONAIS")
panel_15 = Panel("Quantidades diagonais")
number_slider = Slider(10, range=5..15)

pt = ConstructPoint(XCoordinate=0, YCoordinate="10", ZCoordinate=altura)
pt_2 = ConstructPoint(XCoordinate="100", YCoordinate="10", ZCoordinate=altura)

panel_16 = Panel("BANZOS INFERIORES 2")
ln = Line(StartPoint=pt, EndPoint=pt_2)
eval = EvaluateCurve(Curve=reparameterize(ln), Parameter=0.5)  # -> Point, Tangent, Angle
pdecon = Deconstruct(Point=eval.Tangent)  # -> XComponent, YComponent, ZComponent
multiplication = Multiplication(A=pdecon.XComponent, B=-1)
pt_3 = ConstructPoint(XCoordinate=pdecon.ZComponent, YCoordinate=pdecon.YComponent, ZCoordinate=multiplication)
multiplication_2 = Multiplication(A=pt_3, B=ponto_perpendicular_6)
neg = Negative(Value=multiplication_2)
addition = Addition(A=neg, B=eval.Point)
merge = Merge(Data1=pt, Data2=addition, Data3=pt_2)
intcrv = Interpolate(Vertices=merge, Degree=3, Periodic=False, KnotStyle=1)  # -> Curve, Length, Domain
end = EndPoints(Curve=intcrv.Curve)  # -> Start, End
ln_2 = Line(StartPoint=end.Start, EndPoint=end.End)
neg_2 = Negative(Value=ângulo)

pt_4 = ConstructPoint(XCoordinate=0, YCoordinate=0, ZCoordinate=eixo_z)
pt_5 = ConstructPoint(XCoordinate="100", YCoordinate=0, ZCoordinate=eixo_z)

panel_17 = Panel("BANZOS INFERIORES 1")
ln_3 = Line(StartPoint=pt_4, EndPoint=pt_5)
eval_2 = EvaluateCurve(Curve=reparameterize(ln_3), Parameter=0.5)  # -> Point, Tangent, Angle
pdecon_2 = Deconstruct(Point=eval_2.Tangent)  # -> XComponent, YComponent, ZComponent
multiplication_3 = Multiplication(A=pdecon_2.XComponent, B=-1)
pt_6 = ConstructPoint(XCoordinate=pdecon_2.ZComponent, YCoordinate=pdecon_2.YComponent, ZCoordinate=multiplication_3)
multiplication_4 = Multiplication(A=pt_6, B=ponto_perpendicular_5)
neg_3 = Negative(Value=multiplication_4)
addition_2 = Addition(A=neg_3, B=eval_2.Point)
merge_2 = Merge(Data1=pt_4, Data2=addition_2, Data3=pt_5)
intcrv_2 = Interpolate(Vertices=merge_2, Degree=3, Periodic=False, KnotStyle=1)  # -> Curve, Length, Domain
end_2 = EndPoints(Curve=intcrv_2.Curve)  # -> Start, End
ln_4 = Line(StartPoint=end_2.Start, EndPoint=end_2.End)
neg_4 = Negative(Value=ângulo_2)

rotax = RotateAxis(Geometry=intcrv_2.Curve, Angle=degrees(ângulo_2), Axis=ln_4)  # -> Geometry, Transform
rotax_2 = RotateAxis(Geometry=intcrv_2.Curve, Angle=degrees(neg_4), Axis=ln_4)  # -> Geometry, Transform

rotax_3 = RotateAxis(Geometry=intcrv.Curve, Angle=degrees(ângulo), Axis=ln_2)  # -> Geometry, Transform
rotax_4 = RotateAxis(Geometry=intcrv.Curve, Angle=degrees(neg_2), Axis=ln_2)  # -> Geometry, Transform

panel_18 = Panel("Diagonais")
panel_19 = Panel("01")

panel_20 = Panel("02")

panel_21 = Panel("03")

multiplication_5 = Multiplication(A=number_slider, B=2)
divide = DivideCurve(Curve=rotax.Geometry, Count=multiplication_5, Kinks=False)  # -> Points, Tangents, Parameters
divide_2 = DivideCurve(Curve=rotax_2.Geometry, Count=multiplication_5, Kinks=False)  # -> Points, Tangents, Parameters
divide_3 = DivideCurve(Curve=rotax_3.Geometry, Count=multiplication_5, Kinks=False)  # -> Points, Tangents, Parameters
divide_4 = DivideCurve(Curve=rotax_4.Geometry, Count=multiplication_5, Kinks=False)  # -> Points, Tangents, Parameters
ln_5 = Line(StartPoint=divide.Points, EndPoint=divide_2.Points)
ln_6 = Line(StartPoint=divide_3.Points, EndPoint=divide_4.Points)

# ----
# Catálogo Vallourec.As bitolas escolhidas são as mais frequentemente produzidas.
seção_d_t = Panel("""33.4,3.2
33.4,3.6
38.1,3.2
38.1,4.0
42.2,3.6
42.2,5.0
48.3,3.6
48.3,5.0
60.3,4.0
60.3,5.6
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""")

pline = PolyLine(Vertices=divide.Points, Closed=False)
pline_2 = PolyLine(Vertices=divide_2.Points, Closed=False)
pline_3 = PolyLine(Vertices=divide_3.Points, Closed=False)
pline_4 = PolyLine(Vertices=divide_4.Points, Closed=False)
explode = Explode(Curve=pline, Recursive=True)  # -> Segments, Vertices
explode_2 = Explode(Curve=pline_2, Recursive=True)  # -> Segments, Vertices
explode_3 = Explode(Curve=pline_3, Recursive=True)  # -> Segments, Vertices
explode_4 = Explode(Curve=pline_4, Recursive=True)  # -> Segments, Vertices
flatten = FlattenTree(Tree=explode.Segments, Path="0")
flatten_2 = FlattenTree(Tree=explode_2.Segments, Path="1")
flatten_3 = FlattenTree(Tree=explode_3.Segments, Path="2")
flatten_4 = FlattenTree(Tree=explode_4.Segments, Path="3")
merge_3 = Merge(Data1=flatten, Data2=flatten_2, Data3=flatten_3, Data4=flatten_4)

item = ListItem(List=seção_d_t, Index=Slider(15, range=0..29), Wrap=True)
split = TextSplit(Text=item, Separators=",")
item_2 = ListItem(List=split, Index=0, Wrap=True)
item_3 = ListItem(List=split, Index=1, Wrap=True)
division = Division(A=item_2, B=10)
division_2 = Division(A=item_3, B=10)

item_4 = ListItem(List=seção_d_t, Index=Slider(20, range=0..34), Wrap=True)
split_2 = TextSplit(Text=item_4, Separators=",")
item_5 = ListItem(List=split_2, Index=0, Wrap=True)
item_6 = ListItem(List=split_2, Index=1, Wrap=True)
division_3 = Division(A=item_5, B=10)
division_4 = Division(A=item_6, B=10)

item_7 = ListItem(List=seção_d_t, Index=Slider(16, range=0..34), Wrap=True)
split_3 = TextSplit(Text=item_7, Separators=",")
item_8 = ListItem(List=split_3, Index=0, Wrap=True)
item_9 = ListItem(List=split_3, Index=1, Wrap=True)
division_5 = Division(A=item_8, B=10)
division_6 = Division(A=item_9, B=10)

item_10 = ListItem(List=seção_d_t, Index=Slider(20, range=0..34), Wrap=True)
split_4 = TextSplit(Text=item_10, Separators=",")
item_11 = ListItem(List=split_4, Index=0, Wrap=True)
item_12 = ListItem(List=split_4, Index=1, Wrap=True)
division_7 = Division(A=item_11, B=10)
division_8 = Division(A=item_12, B=10)

rdlines = RemoveDuplicateLinesKaramba(Line=flatten(merge_3), LimitDistance=0.005)  # -> OutLine, Info, Indexes
llinter = LineLineIntersectionKaramba(Line=rdlines.OutLine, LengthTolerance=0.01)  # -> IntersectionPoints, flatten(LineSubSegements)
merge_4 = Merge(Data1=pt_4, Data2=pt_5, Data3=pt, Data4=pt_2)
Z = UnitZ(Factor="-0.9")
linetobeam = LineToBeamKaramba(Line=flatten(llinter.LineSubSegements), New=True, Remove=True, LimitDistance_m=0.005, BeamIdentifier="banzoinferior")  # -> Points, flatten(Element), Info
supp = SupportKaramba(PosInd=merge_4, menu=[buttons(on, on, on, on, on, on)])
loads = LoadsKaramba(Vector=Vector(0, 0, -1), LCase=0, mode="Gravity")
matselect = MaterialSelectionKaramba(menu=[dropdown(1), dropdown(3)])

# ----
# Catálogo Vallourec.As bitolas escolhidas são as mais frequentemente produzidas.
seção_d_t_2 = Panel("""33.4,3.2
33.4,3.6
38.1,3.2
38.1,4.0
42.2,3.6
42.2,5.0
48.3,3.6
48.3,5.0
60.3,4.0
60.3,5.6
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""")

panel_22 = Panel("Escolha do Perfil")

item_13 = ListItem(List=seção_d_t_2, Index=Slider(19, range=0..29), Wrap=True)
split_5 = TextSplit(Text=item_13, Separators=",")
item_14 = ListItem(List=split_5, Index=0, Wrap=True)
item_15 = ListItem(List=split_5, Index=1, Wrap=True)
division_9 = Division(A=item_14, B=10)
division_10 = Division(A=item_15, B=10)

item_16 = ListItem(List=seção_d_t_2, Index=Slider(34, range=0..34), Wrap=True)
split_6 = TextSplit(Text=item_16, Separators=",")
item_17 = ListItem(List=split_6, Index=0, Wrap=True)
item_18 = ListItem(List=split_6, Index=1, Wrap=True)
division_11 = Division(A=item_17, B=10)
division_12 = Division(A=item_18, B=10)

item_19 = ListItem(List=seção_d_t_2, Index=Slider(34, range=0..34), Wrap=True)
split_7 = TextSplit(Text=item_19, Separators=",")
item_20 = ListItem(List=split_7, Index=0, Wrap=True)
item_21 = ListItem(List=split_7, Index=1, Wrap=True)
division_13 = Division(A=item_20, B=10)
division_14 = Division(A=item_21, B=10)

item_22 = ListItem(List=seção_d_t_2, Index=Slider(20, range=0..34), Wrap=True)
split_8 = TextSplit(Text=item_22, Separators=",")
item_23 = ListItem(List=split_8, Index=0, Wrap=True)
item_24 = ListItem(List=split_8, Index=1, Wrap=True)
division_15 = Division(A=item_23, B=10)
division_16 = Division(A=item_24, B=10)

cross_sections = CrossSectionsKaramba(ElementsIdentifiers="diagonal", Diameter_cm=division_9, WallThickness_cm=division_10, mode="Circular Hollow")
cross_sections_2 = CrossSectionsKaramba(ElementsIdentifiers="banzosuperior", Diameter_cm=division_11, WallThickness_cm=division_12, mode="Circular Hollow")
cross_sections_3 = CrossSectionsKaramba(ElementsIdentifiers="banzoinferior", Diameter_cm=division_13, WallThickness_cm=division_14, mode="Circular Hollow")
cross_sections_4 = CrossSectionsKaramba(ElementsIdentifiers="barra", Diameter_cm=division_15, WallThickness_cm=division_16, mode="Circular Hollow")

merge_5 = Merge(Data1=cross_sections, Data2=cross_sections_2, Data3=cross_sections_3, Data4=cross_sections_4)

panel_23 = Panel("BANZO SUPERIOR 1")
addition_3 = Addition(A=eixo_x, B="100")
neg_5 = Negative(Value=eixo_x)
addition_4 = Addition(A=eixo_z_2, B=eixo_z)
addition_5 = Addition(A=ponto_perpendicular, B=ponto_perpendicular_5)

pt_7 = ConstructPoint(XCoordinate=neg_5, YCoordinate=0, ZCoordinate=addition_4)
pt_8 = ConstructPoint(XCoordinate=addition_3, YCoordinate=0, ZCoordinate=addition_4)

ln_7 = Line(StartPoint=pt_7, EndPoint=pt_8)
eval_3 = EvaluateCurve(Curve=reparameterize(ln_7), Parameter=0.5)  # -> Point, Tangent, Angle
pdecon_3 = Deconstruct(Point=eval_3.Tangent)  # -> XComponent, YComponent, ZComponent
multiplication_6 = Multiplication(A=pdecon_3.XComponent, B=-1)
pt_9 = ConstructPoint(XCoordinate=pdecon_3.ZComponent, YCoordinate=pdecon_3.YComponent, ZCoordinate=multiplication_6)
multiplication_7 = Multiplication(A=pt_9, B=addition_5)
neg_6 = Negative(Value=multiplication_7)
addition_6 = Addition(A=neg_6, B=eval_3.Point)
merge_6 = Merge(Data1=pt_7, Data2=addition_6, Data3=pt_8)
intcrv_3 = Interpolate(Vertices=merge_6, Degree=3, Periodic=False, KnotStyle=1)  # -> Curve, Length, Domain
end_3 = EndPoints(Curve=intcrv_3.Curve)  # -> Start, End
ln_8 = Line(StartPoint=end_3.Start, EndPoint=end_3.End)
rotax_5 = RotateAxis(Geometry=intcrv_3.Curve, Angle=degrees("0.0"), Axis=ln_8)  # -> Geometry, Transform

divide_5 = DivideCurve(Curve=rotax_5.Geometry, Count=multiplication_5, Kinks=False)  # -> Points, Tangents, Parameters
ln_9 = Line(StartPoint=divide_5.Points, EndPoint=divide.Points)
ln_10 = Line(StartPoint=divide_2.Points, EndPoint=divide_5.Points)
pline_5 = PolyLine(Vertices=divide_5.Points, Closed=False)
explode_5 = Explode(Curve=pline_5, Recursive=True)  # -> Segments, Vertices
flatten_5 = FlattenTree(Tree=explode_5.Segments, Path="5")

panel_24 = Panel("BARRA 1")
expression = Expression(x=ângulo_2, y=eixo_z_5, Expression="-((x*π/180)*y)")
addition_7 = Addition(A=eixo_x_2, B="100")
neg_7 = Negative(Value=eixo_x_2)
addition_8 = Addition(A=eixo_z, B=eixo_z_5)
addition_9 = Addition(A=ponto_perpendicular_5, B=ponto_perpendicular_4)

pt_10 = ConstructPoint(XCoordinate=neg_7, YCoordinate=expression, ZCoordinate=addition_8)
pt_11 = ConstructPoint(XCoordinate=addition_7, YCoordinate=expression, ZCoordinate=addition_8)

ln_11 = Line(StartPoint=pt_10, EndPoint=pt_11)
eval_4 = EvaluateCurve(Curve=reparameterize(ln_11), Parameter=0.5)  # -> Point, Tangent, Angle
pdecon_4 = Deconstruct(Point=eval_4.Tangent)  # -> XComponent, YComponent, ZComponent
multiplication_8 = Multiplication(A=pdecon_4.XComponent, B=-1)
pt_12 = ConstructPoint(XCoordinate=pdecon_4.ZComponent, YCoordinate=pdecon_4.YComponent, ZCoordinate=multiplication_8)
multiplication_9 = Multiplication(A=pt_12, B=addition_9)
neg_8 = Negative(Value=multiplication_9)
addition_10 = Addition(A=neg_8, B=eval_4.Point)
merge_7 = Merge(Data1=pt_10, Data2=addition_10, Data3=pt_11)
intcrv_4 = Interpolate(Vertices=merge_7, Degree=3, Periodic=False, KnotStyle=1)  # -> Curve, Length, Domain
end_4 = EndPoints(Curve=intcrv_4.Curve)  # -> Start, End
ln_12 = Line(StartPoint=end_4.Start, EndPoint=end_4.End)
rotax_6 = RotateAxis(Geometry=intcrv_4.Curve, Angle=degrees(ângulo_2), Axis=ln_12)  # -> Geometry, Transform

multiplication_10 = Multiplication(A=number_slider, B="2")
divide_6 = DivideCurve(Curve=rotax_5.Geometry, Count=multiplication_10, Kinks=False)  # -> Points, Tangents, Parameters
divide_7 = DivideCurve(Curve=rotax.Geometry, Count=multiplication_10, Kinks=False)  # -> Points, Tangents, Parameters
divide_8 = DivideCurve(Curve=rotax_2.Geometry, Count=multiplication_10, Kinks=False)  # -> Points, Tangents, Parameters
divide_9 = DivideCurve(Curve=rotax_6.Geometry, Count=multiplication_10, Kinks=False)  # -> Points, Tangents, Parameters
pt_13 = Point(divide_7.Points)
pt_14 = Point(divide_8.Points)
pline_6 = PolyLine(Vertices=divide_6.Points, Closed=False)
short = ShortestList(ListA=pt_13, ListB=pt_14, TrimMode=2)  # -> ListA, ListB
pline_7 = PolyLine(Vertices=divide_9.Points, Closed=False)
explode_6 = Explode(Curve=pline_6, Recursive=True)  # -> Segments, Vertices
explode_7 = Explode(Curve=pline_7, Recursive=True)  # -> Segments, Vertices
eval_5 = EvaluateCurve(Curve=reparameterize(explode_6.Segments), Parameter=0.5)  # -> Point, Tangent, Angle
eval_6 = EvaluateCurve(Curve=reparameterize(explode_7.Segments), Parameter=0.5)  # -> Point, Tangent, Angle
cull_i = CullIndex(List=pt_13, Indices=[0, -1], Wrap=True)
cull_i_2 = CullIndex(List=pt_14, Indices=[0, -1], Wrap=True)
pt_15 = Point(eval_5.Point)
pt_16 = Point(cull_i)
pt_17 = Point(cull_i_2)
pt_18 = Point(eval_6.Point)

divide_10 = DivideCurve(Curve=rotax_6.Geometry, Count=multiplication_5, Kinks=False)  # -> Points, Tangents, Parameters
ln_13 = Line(StartPoint=divide_5.Points, EndPoint=divide_10.Points)
ln_14 = Line(StartPoint=divide.Points, EndPoint=divide_10.Points)

ln_15 = Line(StartPoint=pt_15, EndPoint=pt_13)
ln_16 = Line(StartPoint=pt_15, EndPoint=pt_14)
ln_17 = Line(StartPoint=pt_15, EndPoint=pt_16)
ln_18 = Line(StartPoint=pt_15, EndPoint=pt_17)
ln_19 = Line(StartPoint=short.ListA, EndPoint=short.ListB)
ln_20 = Line(StartPoint=pt_18, EndPoint=pt_16)
ln_21 = Line(StartPoint=pt_18, EndPoint=pt_13)
ln_22 = Line(StartPoint=pt_18, EndPoint=pt_15)

pline_8 = PolyLine(Vertices=divide_10.Points, Closed=False)
explode_8 = Explode(Curve=pline_8, Recursive=True)  # -> Segments, Vertices
flatten_6 = FlattenTree(Tree=explode_8.Segments, Path="7")

panel_25 = Panel("BARRA 1/2")
division_17 = Division(A="10", B=2)
neg_9 = Negative(Value=eixo_x_2)
addition_11 = Addition(A=eixo_x_2, B="100")
addition_12 = Addition(A=ponto_perpendicular_7, B=ponto_perpendicular_8)

pt_19 = ConstructPoint(XCoordinate=neg_9, YCoordinate=division_17, ZCoordinate=eixo_z_6)
pt_20 = ConstructPoint(XCoordinate=addition_11, YCoordinate=division_17, ZCoordinate=eixo_z_6)

ln_23 = Line(StartPoint=pt_19, EndPoint=pt_20)
eval_7 = EvaluateCurve(Curve=reparameterize(ln_23), Parameter=0.5)  # -> Point, Tangent, Angle
pdecon_5 = Deconstruct(Point=eval_7.Tangent)  # -> XComponent, YComponent, ZComponent
multiplication_11 = Multiplication(A=pdecon_5.XComponent, B=-1)
pt_21 = ConstructPoint(XCoordinate=pdecon_5.ZComponent, YCoordinate=pdecon_5.YComponent, ZCoordinate=multiplication_11)
multiplication_12 = Multiplication(A=pt_21, B=addition_12)
neg_10 = Negative(Value=multiplication_12)
addition_13 = Addition(A=neg_10, B=eval_7.Point)
merge_8 = Merge(Data1=pt_19, Data2=addition_13, Data3=pt_20)
intcrv_5 = Interpolate(Vertices=merge_8, Degree=3, Periodic=False, KnotStyle=1)  # -> Curve, Length, Domain
end_5 = EndPoints(Curve=intcrv_5.Curve)  # -> Start, End
ln_24 = Line(StartPoint=end_5.Start, EndPoint=end_5.End)
rotax_7 = RotateAxis(Geometry=intcrv_5.Curve, Angle=degrees("0.0"), Axis=ln_24)  # -> Geometry, Transform

multiplication_13 = Multiplication(A=number_slider, B="2")
divide_11 = DivideCurve(Curve=rotax_7.Geometry, Count=multiplication_13, Kinks=False)  # -> Points, Tangents, Parameters
pline_9 = PolyLine(Vertices=divide_11.Points, Closed=False)
explode_9 = Explode(Curve=pline_9, Recursive=True)  # -> Segments, Vertices
eval_8 = EvaluateCurve(Curve=reparameterize(explode_9.Segments), Parameter=0.5)  # -> Point, Tangent, Angle
pt_22 = Point(eval_8.Point)

divide_12 = DivideCurve(Curve=rotax_7.Geometry, Count=multiplication_5, Kinks=False)  # -> Points, Tangents, Parameters
ln_25 = Line(StartPoint=divide_5.Points, EndPoint=divide_12.Points)
ln_26 = Line(StartPoint=divide_12.Points, EndPoint=divide_2.Points)
ln_27 = Line(StartPoint=divide_3.Points, EndPoint=divide_12.Points)
pline_10 = PolyLine(Vertices=divide_12.Points, Closed=False)
explode_10 = Explode(Curve=pline_10, Recursive=True)  # -> Segments, Vertices
flatten_7 = FlattenTree(Tree=explode_10.Segments, Path="8")

panel_26 = Panel("BANZO SUPERIOR 2")
neg_11 = Negative(Value=eixo_x)
addition_14 = Addition(A=eixo_z_3, B=altura)
addition_15 = Addition(A=eixo_x, B="100")

pt_23 = ConstructPoint(XCoordinate=neg_11, YCoordinate="10", ZCoordinate=addition_14)
pt_24 = ConstructPoint(XCoordinate=addition_15, YCoordinate="10", ZCoordinate=addition_14)

ln_28 = Line(StartPoint=pt_23, EndPoint=pt_24)
eval_9 = EvaluateCurve(Curve=reparameterize(ln_28), Parameter=0.5)  # -> Point, Tangent, Angle
pdecon_6 = Deconstruct(Point=eval_9.Tangent)  # -> XComponent, YComponent, ZComponent
multiplication_14 = Multiplication(A=pdecon_6.XComponent, B=-1)
pt_25 = ConstructPoint(XCoordinate=pdecon_6.ZComponent, YCoordinate=pdecon_6.YComponent, ZCoordinate=multiplication_14)
multiplication_15 = Multiplication(A=pt_25, B=ponto_perpendicular_2)
neg_12 = Negative(Value=multiplication_15)
addition_16 = Addition(A=neg_12, B=eval_9.Point)
merge_9 = Merge(Data1=pt_23, Data2=addition_16, Data3=pt_24)
intcrv_6 = Interpolate(Vertices=merge_9, Degree=3, Periodic=False, KnotStyle=1)  # -> Curve, Length, Domain
end_6 = EndPoints(Curve=intcrv_6.Curve)  # -> Start, End
ln_29 = Line(StartPoint=end_6.Start, EndPoint=end_6.End)
rotax_8 = RotateAxis(Geometry=intcrv_6.Curve, Angle=degrees("0.0"), Axis=ln_29)  # -> Geometry, Transform

divide_13 = DivideCurve(Curve=rotax_8.Geometry, Count=multiplication_5, Kinks=False)  # -> Points, Tangents, Parameters
ln_30 = Line(StartPoint=divide_13.Points, EndPoint=divide_12.Points)
ln_31 = Line(StartPoint=divide_13.Points, EndPoint=divide_3.Points)
ln_32 = Line(StartPoint=divide_4.Points, EndPoint=divide_13.Points)
pline_11 = PolyLine(Vertices=divide_13.Points, Closed=False)
explode_11 = Explode(Curve=pline_11, Recursive=True)  # -> Segments, Vertices
flatten_8 = FlattenTree(Tree=explode_11.Segments, Path="6")
merge_10 = Merge(Data1=flatten_5, Data2=flatten_8)
rdlines_2 = RemoveDuplicateLinesKaramba(Line=flatten(merge_10), LimitDistance=0.005)  # -> OutLine, Info, Indexes
llinter_2 = LineLineIntersectionKaramba(Line=rdlines_2.OutLine, LengthTolerance=0.01)  # -> IntersectionPoints, flatten(LineSubSegements)
linetobeam_2 = LineToBeamKaramba(Line=llinter_2.LineSubSegements, New=True, Remove=True, LimitDistance_m=0.005, BeamIdentifier="banzosuperior")  # -> Points, Element, Info

panel_27 = Panel("BARRA 2")
expression_2 = Expression(x=ângulo, y=eixo_z_4, Expression=" (x*π/180) * y")
addition_17 = Addition(A=eixo_x_2, B="100")
neg_13 = Negative(Value=eixo_x_2)
addition_18 = Addition(A=expression_2, B="10")
addition_19 = Addition(A=ponto_perpendicular_6, B=ponto_perpendicular_3)

pt_26 = ConstructPoint(XCoordinate=neg_13, YCoordinate=addition_18, ZCoordinate=eixo_z_4)
pt_27 = ConstructPoint(XCoordinate=addition_17, YCoordinate=addition_18, ZCoordinate=eixo_z_4)

ln_33 = Line(StartPoint=pt_26, EndPoint=pt_27)
eval_10 = EvaluateCurve(Curve=reparameterize(ln_33), Parameter=0.5)  # -> Point, Tangent, Angle
pdecon_7 = Deconstruct(Point=eval_10.Tangent)  # -> XComponent, YComponent, ZComponent
multiplication_16 = Multiplication(A=pdecon_7.XComponent, B=-1)
pt_28 = ConstructPoint(XCoordinate=pdecon_7.ZComponent, YCoordinate=pdecon_7.YComponent, ZCoordinate=multiplication_16)
multiplication_17 = Multiplication(A=pt_28, B=addition_19)
neg_14 = Negative(Value=multiplication_17)
addition_20 = Addition(A=neg_14, B=eval_10.Point)
merge_11 = Merge(Data1=pt_26, Data2=addition_20, Data3=pt_27)
intcrv_7 = Interpolate(Vertices=merge_11, Degree=3, Periodic=False, KnotStyle=1)  # -> Curve, Length, Domain
end_7 = EndPoints(Curve=intcrv_7.Curve)  # -> Start, End
ln_34 = Line(StartPoint=end_7.Start, EndPoint=end_7.End)
rotax_9 = RotateAxis(Geometry=intcrv_7.Curve, Angle=degrees(neg_2), Axis=ln_34)  # -> Geometry, Transform

multiplication_18 = Multiplication(A=number_slider, B="2")
divide_14 = DivideCurve(Curve=rotax_8.Geometry, Count=multiplication_18, Kinks=False)  # -> Points, Tangents, Parameters
divide_15 = DivideCurve(Curve=rotax_3.Geometry, Count=multiplication_18, Kinks=False)  # -> Points, Tangents, Parameters
divide_16 = DivideCurve(Curve=rotax_4.Geometry, Count=multiplication_18, Kinks=False)  # -> Points, Tangents, Parameters
divide_17 = DivideCurve(Curve=rotax_9.Geometry, Count=multiplication_18, Kinks=False)  # -> Points, Tangents, Parameters
pt_29 = Point(divide_15.Points)
pt_30 = Point(divide_16.Points)
pline_12 = PolyLine(Vertices=divide_14.Points, Closed=False)
short_2 = ShortestList(ListA=pt_29, ListB=pt_30, TrimMode=2)  # -> ListA, ListB
pline_13 = PolyLine(Vertices=divide_17.Points, Closed=False)
explode_12 = Explode(Curve=pline_12, Recursive=True)  # -> Segments, Vertices
explode_13 = Explode(Curve=pline_13, Recursive=True)  # -> Segments, Vertices
eval_11 = EvaluateCurve(Curve=reparameterize(explode_12.Segments), Parameter=0.5)  # -> Point, Tangent, Angle
eval_12 = EvaluateCurve(Curve=reparameterize(explode_13.Segments), Parameter=0.5)  # -> Point, Tangent, Angle
cull_i_3 = CullIndex(List=pt_29, Indices=[0, -1], Wrap=True)
cull_i_4 = CullIndex(List=pt_30, Indices=[0, -1], Wrap=True)
pt_31 = Point(eval_11.Point)
pt_32 = Point(eval_12.Point)

divide_18 = DivideCurve(Curve=rotax_9.Geometry, Count=multiplication_5, Kinks=False)  # -> Points, Tangents, Parameters
ln_35 = Line(StartPoint=divide_13.Points, EndPoint=divide_18.Points)
ln_36 = Line(StartPoint=divide_4.Points, EndPoint=divide_18.Points)

ln_37 = Line(StartPoint=pt_14, EndPoint=pt_22)
ln_38 = Line(StartPoint=cull_i_2, EndPoint=pt_22)
ln_39 = Line(StartPoint=pt_22, EndPoint=cull_i_3)
ln_40 = Line(StartPoint=pt_22, EndPoint=pt_29)

ln_41 = Line(StartPoint=pt_31, EndPoint=pt_29)
ln_42 = Line(StartPoint=pt_31, EndPoint=cull_i_3)
ln_43 = Line(StartPoint=pt_31, EndPoint=pt_30)
ln_44 = Line(StartPoint=pt_31, EndPoint=cull_i_4)
ln_45 = Line(StartPoint=short_2.ListA, EndPoint=short_2.ListB)
ln_46 = Line(StartPoint=pt_32, EndPoint=pt_30)
ln_47 = Line(StartPoint=pt_32, EndPoint=cull_i_4)
ln_48 = Line(StartPoint=pt_32, EndPoint=pt_31)

merge_12 = Merge(
    Data1=ln_9,
    Data2=ln_5,
    Data3=ln_10,
    Data4=ln_13,
    Data5=ln_14,
    Data6=ln_31,
    Data7=ln_6,
    Data8=ln_32,
    Data9=ln_35,
    Data10=ln_36,
    Data11=ln_30,
    Data12=ln_25,
    Data13=ln_26,
    Data14=ln_27)
pline_14 = PolyLine(Vertices=divide_18.Points, Closed=False)
explode_14 = Explode(Curve=pline_14, Recursive=True)  # -> Segments, Vertices
flatten_9 = FlattenTree(Tree=merge_12, Path="10")
flatten_10 = FlattenTree(Tree=explode_14.Segments, Path="9")
merge_13 = Merge(Data1=flatten_6, Data2=flatten_7, Data3=flatten_10)
rdlines_3 = RemoveDuplicateLinesKaramba(Line=flatten(merge_13), LimitDistance=0.005)  # -> OutLine, Info, Indexes
rdlines_4 = RemoveDuplicateLinesKaramba(Line=flatten(flatten_9), LimitDistance=0.005)  # -> OutLine, Info, Indexes
merge_14 = Merge(Data1=divide_5.Points, Data2=divide_10.Points, Data3=divide_12.Points, Data4=divide_13.Points, Data5=divide_18.Points)
llinter_3 = LineLineIntersectionKaramba(Line=rdlines_3.OutLine, LengthTolerance=0.01)  # -> IntersectionPoints, flatten(LineSubSegements)
llinter_4 = LineLineIntersectionKaramba(Line=rdlines_4.OutLine, LengthTolerance=0.01)  # -> IntersectionPoints, flatten(LineSubSegements)
linetobeam_3 = LineToBeamKaramba(Line=flatten(llinter_3.LineSubSegements), New=True, Remove=True, LimitDistance_m=0.005, BeamIdentifier="barra")  # -> Points, Element, Info
loads_2 = LoadsKaramba(ForceVector=Z, Local=False, PosInd=merge_14, LCase=0, mode="Point")
linetobeam_4 = LineToBeamKaramba(Line=llinter_4.LineSubSegements, New=True, Remove=True, LimitDistance_m=0.005, BeamIdentifier="diagonal")  # -> Points, Element, Info
panel_28 = Panel(linetobeam_4.Element)
merge_15 = Merge(Data1=linetobeam_4.Element, Data2=linetobeam_2.Element, Data3=linetobeam.Element, Data4=linetobeam_3.Element)
merge_16 = Merge(Data1=loads, Data2=loads_2)
assemble = AssembleModelKaramba(
    Elem=flatten(merge_15),
    Support=flatten(supp),
    Load=flatten(merge_16),
    CrossSection=flatten(merge_5),
    Material=flatten(matselect),
    LimitDistance_m=0.005)  # -> flatten(Model), Info, Mass_kg, CenterOfGravity
peso = Panel(assemble.Mass_kg)
analyzethi = AnalyzeThIKaramba(Model=assemble.Model)  # -> CalculatedModel, MaximumDisplacement_m, ResultingForceOfGravity_kN, ElasticEnergy_kNm
emodes = EigenModesKaramba(Model=analyzethi.CalculatedModel, FromIndex=1, NumberOfModes=1, MaximumNumberOfIterations=300, Epsilon=1e-07)  # -> ModelWithEigenModesAsLoadCaseResults, Eigenvalues
panel_29 = Panel(analyzethi.CalculatedModel)
modelview = ModelViewKaramba(Model=analyzethi.CalculatedModel, LoadCaseFactorsForLinearSuperposition=1, IndexIncrementOfVisibleLoadcase=0)  # -> Model, DeformedMesh, DeformedAxes, DeformedModel
panel_30 = Panel(emodes.ModelWithEigenModesAsLoadCaseResults)
beamview = BeamViewKaramba(Model=modelview.Model)  # -> Model, MeshesOfRenderedBeams, DeformedBeamAxes, LegendColors, LegendTags

# ----
# Tentativa de corrigir os "Modos de corpos rígidos".
# O problema é que, desta maneira, o programa não identifica os perfis separadamente (barras, banzos, etc) e assim mesmo não aparece as barras no calculo.
pline_15 = PolyLine(Vertices=divide_6.Points, Closed=False)
pline_16 = PolyLine(Vertices=divide_14.Points, Closed=False)
pline_17 = PolyLine(Vertices=divide_17.Points, Closed=False)
pline_18 = PolyLine(Vertices=divide_9.Points, Closed=False)
pline_19 = PolyLine(Vertices=divide_11.Points, Closed=False)
pline_20 = PolyLine(Vertices=divide_7.Points, Closed=False)
pline_21 = PolyLine(Vertices=divide_8.Points, Closed=False)
pline_22 = PolyLine(Vertices=divide_15.Points, Closed=False)
pline_23 = PolyLine(Vertices=divide_16.Points, Closed=False)
explode_15 = Explode(Curve=pline_20, Recursive=True)  # -> Segments, Vertices
explode_16 = Explode(Curve=pline_21, Recursive=True)  # -> Segments, Vertices
explode_17 = Explode(Curve=pline_22, Recursive=True)  # -> Segments, Vertices
explode_18 = Explode(Curve=pline_23, Recursive=True)  # -> Segments, Vertices
explode_19 = Explode(Curve=pline_15, Recursive=True)  # -> Segments, Vertices
explode_20 = Explode(Curve=pline_16, Recursive=True)  # -> Segments, Vertices
explode_21 = Explode(Curve=pline_17, Recursive=True)  # -> Segments, Vertices
explode_22 = Explode(Curve=pline_18, Recursive=True)  # -> Segments, Vertices
explode_23 = Explode(Curve=pline_19, Recursive=True)  # -> Segments, Vertices
merge_17 = Merge(
    Data1=ln_15,
    Data2=ln_16,
    Data3=ln_17,
    Data4=ln_18,
    Data5=ln_19,
    Data6=ln_20,
    Data7=ln_21,
    Data8=ln_22,
    Data9=ln_41,
    Data10=ln_42,
    Data11=ln_43,
    Data12=ln_44,
    Data13=ln_45,
    Data14=ln_46,
    Data15=ln_47,
    Data16=ln_48)
merge_18 = Merge(Data1=ln_37, Data2=ln_38, Data3=ln_39, Data4=ln_40)
merge_19 = Merge(Data1=explode_15.Segments, Data2=explode_16.Segments, Data3=explode_17.Segments, Data4=explode_18.Segments)
merge_20 = Merge(Data1=explode_19.Segments, Data2=explode_20.Segments)
merge_21 = Merge(Data1=explode_22.Segments, Data2=explode_23.Segments, Data3=explode_21.Segments)
flatten_11 = FlattenTree(Tree=flatten(merge_20), Path="1")
flatten_12 = FlattenTree(Tree=merge_17, Path="3")
flatten_13 = FlattenTree(Tree=merge_18, Path="4")
flatten_14 = FlattenTree(Tree=merge_21, Path="2")
flatten_15 = FlattenTree(Tree=flatten(merge_19), Path="0")
rdlines_5 = RemoveDuplicateLinesKaramba(Line=flatten(flatten_12), LimitDistance=0.005)  # -> OutLine, Info, Indexes
rdlines_6 = RemoveDuplicateLinesKaramba(Line=flatten(flatten_15), LimitDistance=0.005)  # -> OutLine, Info, Indexes
rdlines_7 = RemoveDuplicateLinesKaramba(Line=flatten(flatten_11), LimitDistance=0.005)  # -> OutLine, Info, Indexes
rdlines_8 = RemoveDuplicateLinesKaramba(Line=flatten(flatten_14), LimitDistance=0.005)  # -> OutLine, Info, Indexes
rdlines_9 = RemoveDuplicateLinesKaramba(Line=flatten(flatten_13), LimitDistance=0.005)  # -> OutLine, Info, Indexes
llinter_5 = LineLineIntersectionKaramba(Line=rdlines_5.OutLine, LengthTolerance=0.01)  # -> IntersectionPoints, flatten(LineSubSegements)
llinter_6 = LineLineIntersectionKaramba(Line=rdlines_9.OutLine, LengthTolerance=0.01)  # -> IntersectionPoints, flatten(LineSubSegements)
llinter_7 = LineLineIntersectionKaramba(Line=rdlines_6.OutLine, LengthTolerance=0.01)  # -> IntersectionPoints, flatten(LineSubSegements)
llinter_8 = LineLineIntersectionKaramba(Line=rdlines_7.OutLine, LengthTolerance=0.01)  # -> IntersectionPoints, flatten(LineSubSegements)
llinter_9 = LineLineIntersectionKaramba(Line=rdlines_8.OutLine, LengthTolerance=0.01)  # -> IntersectionPoints, flatten(LineSubSegements)
merge_22 = Merge(Data1=pt_4, Data2=pt_5)
merge_23 = Merge(Data3=pt, Data4=pt_2)
linetobeam_5 = LineToBeamKaramba(Line=llinter_5.LineSubSegements, New=True, Remove=True, LimitDistance_m=0.005, BeamIdentifier="diagonaltrel")  # -> Points, flatten(Element), Info
linetobeam_6 = LineToBeamKaramba(Line=llinter_7.LineSubSegements, New=True, Remove=True, LimitDistance_m=0.005, BeamIdentifier="banzoinf")  # -> Points, flatten(Element), Info
linetobeam_7 = LineToBeamKaramba(Line=llinter_8.LineSubSegements, New=True, Remove=True, LimitDistance_m=0.005, BeamIdentifier="banzosup")  # -> Points, flatten(Element), Info
linetobeam_8 = LineToBeamKaramba(Line=llinter_9.LineSubSegements, New=True, Remove=True, LimitDistance_m=0.005, BeamIdentifier="barras")  # -> Points, flatten(Element), Info
linetobeam_9 = LineToBeamKaramba(Line=llinter_6.LineSubSegements, New=True, Remove=True, LimitDistance_m=0.005, BeamIdentifier="diagonalcentro")  # -> Points, flatten(Element), Info
supp_2 = SupportKaramba(PosInd=merge_22, menu=[buttons(on, on, on, off, on, off)])
supp_3 = SupportKaramba(PosInd=merge_23, menu=[buttons(on, on, on, on, on, on)])
merge_24 = Merge(Data1=supp_2, Data2=supp_3)
merge_25 = Merge(
    Data1=linetobeam_6.Element,
    Data2=linetobeam_7.Element,
    Data3=linetobeam_8.Element,
    Data4=linetobeam_5.Element,
    Data5=linetobeam_9.Element)
assemble_2 = AssembleModelKaramba(Elem=flatten(merge_25), LimitDistance_m=Slider(0.1, range=0..20))  # -> Model, Info, Mass_kg, CenterOfGravity
conparts = ConnectedPartsKaramba(Model=assemble_2.Model)  # -> ConnectedLines, ConnectedMeshes
matselect_2 = MaterialSelectionKaramba(menu=[dropdown(1), dropdown(3)])
branch = TreeBranch(Tree=simplify(conparts.ConnectedLines), Path="0", MaintainPaths=True)
loads_3 = LoadsKaramba(Vector=Vector(0, 0, -1), LCase=0, mode="Gravity")
linetobeam_10 = LineToBeamKaramba(Line=branch, New=True, Remove=True, LimitDistance_m=0.005)  # -> Points, Element, Info

item_25 = ListItem(List=seção_d_t, Index=Slider(19, range=0..29), Wrap=True)
split_9 = TextSplit(Text=item_25, Separators=",")
item_26 = ListItem(List=split_9, Index=0, Wrap=True)
item_27 = ListItem(List=split_9, Index=1, Wrap=True)
division_18 = Division(A=item_26, B=10)
division_19 = Division(A=item_27, B=10)

cross_sections_5 = CrossSectionsKaramba(ElementsIdentifiers="diagonaltrel", Diameter_cm=division_18, WallThickness_cm=division_19, mode="Circular Hollow")
cross_sections_6 = CrossSectionsKaramba(ElementsIdentifiers="banzoinf", Diameter_cm=division_3, WallThickness_cm=division_4, mode="Circular Hollow")
cross_sections_7 = CrossSectionsKaramba(ElementsIdentifiers="banzosup", Diameter_cm=division_5, WallThickness_cm=division_6, mode="Circular Hollow")
cross_sections_8 = CrossSectionsKaramba(ElementsIdentifiers="barras", Diameter_cm=division_7, WallThickness_cm=division_8, mode="Circular Hollow")

cross_sections_9 = CrossSectionsKaramba(ElementsIdentifiers="diagonalcentro", Diameter_cm=division_18, WallThickness_cm=division_19, mode="Circular Hollow")
merge_26 = Merge(Data1=cross_sections_5, Data2=cross_sections_9, Data3=cross_sections_6, Data4=cross_sections_7, Data5=cross_sections_8)
assemble_3 = AssembleModelKaramba(
    Elem=flatten(linetobeam_10.Element),
    Support=flatten(merge_24),
    Load=flatten(loads_3),
    CrossSection=flatten(merge_26),
    Material=flatten(matselect_2),
    LimitDistance_m=0.005)  # -> Model, Info, Mass_kg, CenterOfGravity
analyzethi_2 = AnalyzeThIKaramba(Model=assemble_3.Model)  # -> CalculatedModel, MaximumDisplacement_m, ResultingForceOfGravity_kN, ElasticEnergy_kNm
emodes_2 = EigenModesKaramba(Model=assemble_3.Model, FromIndex=1, NumberOfModes=1, MaximumNumberOfIterations=300, Epsilon=1e-07)  # -> ModelWithEigenModesAsLoadCaseResults, Eigenvalues
modelview_2 = ModelViewKaramba(Model=analyzethi_2.CalculatedModel, LoadCaseFactorsForLinearSuperposition=1, IndexIncrementOfVisibleLoadcase=0)  # -> Model, DeformedMesh, DeformedAxes, DeformedModel
beamview_2 = BeamViewKaramba(Model=modelview_2.Model)  # -> Model, MeshesOfRenderedBeams, DeformedBeamAxes, LegendColors, LegendTags
