# Grasshopper definition cobertura3.2.gh (Grasshopper 0.9.76)
# plug-ins: Karamba, Python Interpreter

# UNIVERSIDADE FEDERAL DE OURO PRETO
# _____________________
# 
# Mestrado Profissional em Construção Metálica
# 
# Departamento de Engenharia Civil
panel = Panel("Genoma")

# ----
# Altura Banzo Superior 1
# Altura Banzo Superior 2
panel_2 = Panel("Banzos Superiores")
eixo_x = Slider(0, range=0..1.5)
panel_3 = Panel("Extremidade Banzos Superiores")

panel_4 = Panel("Barras")
panel_5 = Panel("Extremidade Barras")
eixo_x_2 = Slider(1.44, range=0..2.5)
panel_6 = Panel("Altura Barra 02")
panel_7 = Panel("Altura Barra 01")

# ----
# Ângulo Banzos Inferiores 1
# Altura Banzos Inferior 1
# Ângulo Banzos Inferiores 2
# Altura Banzos Inferior 2
panel_8 = Panel("Banzos Inferiores")

# ----
# Catálogo Vallourec.As bitolas escolhidas são as mais frequentemente produzidas.
seção_d_t = Panel("""33.4,3.2
33.4,3.6
38.1,3.2
38.1,4.0
42.2,3.6
42.2,5.0
48.3,3.6
48.3,5.0
60.3,4.0
60.3,5.6
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""")

panel_9 = Panel("Altura Barra 1/2")

panel_10 = Panel("Escolha dos Perfis")

panel_11 = Panel("Divisão Diagonais")
panel_12 = Panel("""Quantidades diagonais
(valor * 2)""")

panel_13 = Panel("Dimensão Modelo")
panel_14 = Panel("LARGURA")
panel_15 = Panel("COMPRIMENTO")
panel_16 = Panel("ALTURA APOIOS 01")
panel_17 = Panel("ALTURA APOIOS 02")

sistptmedio = Slider(12, range=5..12)
banzsup = Slider(1, range=0..1)
panel_18 = Panel("Altura ponto médio")
bansupptmed = Slider(3, range=1..3)
barptmed = Slider(2, range=2..6)
# Quero apenas subir as extremidades da barra
ângulo = Slider(20, range=5..20)
barextrz = Slider(5, range=2..5)
sistptmed = Slider(12, range=5..12)
bansup = Slider(3, range=0..3)
bansupptmed_2 = Slider(2, range=1..6)
barptmed_2 = Slider(6, range=2..6)
barraextrem = Slider(4.65, range=2..10)
ângulo_2 = Slider(20, range=5..20)
bansupptmed_3 = Slider(6, range=1..6)
barextrem = Slider(4, range=4..10)
panel_20 = Panel("BANZO SUPERIOR 1")
panel_21 = Panel("BANZOS INFERIORES 1")
panel_22 = Panel("BARRA 1")
panel_23 = Panel("BARRA 1/2")
panel_24 = Panel("BANZO SUPERIOR 2")
expression = Expression(x=ângulo, y=barextrz, Expression="-((x*π/180)*y)")
panel_25 = Panel("BANZOS INFERIORES 2")
panel_26 = Panel("BARRA 2")
expression_2 = Expression(x=ângulo_2, y=barraextrem, Expression=" (x*π/180) * y")
neg = Negative(Value=eixo_x)
addition = Addition(A=bansup, B="1.80")
addition_2 = Addition(A=eixo_x_2, B="100")
division = Division(A="10", B=2)
neg_2 = Negative(Value=eixo_x_2)
addition_3 = Addition(A=eixo_x_2, B="100")
neg_3 = Negative(Value=eixo_x_2)
addition_4 = Addition(A=eixo_x, B="100")
neg_4 = Negative(Value=eixo_x_2)
addition_5 = Addition(A="1.80", B=barextrz)
addition_6 = Addition(A=eixo_x, B="100")
addition_7 = Addition(A=expression_2, B="10")
neg_5 = Negative(Value=eixo_x)
addition_8 = Addition(A=banzsup, B="1.80")
addition_9 = Addition(A=eixo_x_2, B="100")

pt = ConstructPoint(XCoordinate=neg_3, YCoordinate=division, ZCoordinate=0)
pt_2 = ConstructPoint(XCoordinate=addition_9, YCoordinate=division, ZCoordinate=0)

pt_3 = ConstructPoint(XCoordinate=neg_2, YCoordinate=addition_7, ZCoordinate=0)
pt_4 = ConstructPoint(XCoordinate=addition_2, YCoordinate=addition_7, ZCoordinate=0)

pt_5 = ConstructPoint(XCoordinate=0, YCoordinate=0, ZCoordinate="1.80")
pt_6 = ConstructPoint(XCoordinate="100", YCoordinate=0, ZCoordinate="1.80")
pt_7 = ConstructPoint(XCoordinate=neg_4, YCoordinate=expression, ZCoordinate=addition_5)
pt_8 = ConstructPoint(XCoordinate=addition_3, YCoordinate=expression, ZCoordinate=addition_5)
pt_9 = ConstructPoint(XCoordinate=neg_3, YCoordinate=division, ZCoordinate=barextrem)
pt_10 = ConstructPoint(XCoordinate=addition_9, YCoordinate=division, ZCoordinate=barextrem)
pt_11 = ConstructPoint(XCoordinate=neg, YCoordinate="10", ZCoordinate=addition)
pt_12 = ConstructPoint(XCoordinate=addition_6, YCoordinate="10", ZCoordinate=addition)
pt_13 = ConstructPoint(XCoordinate=0, YCoordinate="10", ZCoordinate="1.80")
pt_14 = ConstructPoint(XCoordinate="100", YCoordinate="10", ZCoordinate="1.80")
pt_15 = ConstructPoint(XCoordinate=neg_2, YCoordinate=addition_7, ZCoordinate=barraextrem)
pt_16 = ConstructPoint(XCoordinate=addition_2, YCoordinate=addition_7, ZCoordinate=barraextrem)

pt_17 = ConstructPoint(XCoordinate=neg_4, YCoordinate=expression, ZCoordinate=0)
pt_18 = ConstructPoint(XCoordinate=addition_3, YCoordinate=expression, ZCoordinate=0)

pt_19 = ConstructPoint(XCoordinate=neg_5, YCoordinate=0, ZCoordinate=addition_8)
pt_20 = ConstructPoint(XCoordinate=addition_4, YCoordinate=0, ZCoordinate=addition_8)
ln = Line(StartPoint=pt, EndPoint=pt_2)
ln_2 = Line(StartPoint=pt_17, EndPoint=pt_18)
ln_3 = Line(StartPoint=pt_11, EndPoint=pt_12)
ln_4 = Line(StartPoint=pt_13, EndPoint=pt_14)
ln_5 = Line(StartPoint=pt_3, EndPoint=pt_4)
eval = EvaluateCurve(Curve=reparameterize(ln), Parameter=0.5)  # -> Point, Tangent, Angle
eval_2 = EvaluateCurve(Curve=reparameterize(ln_2), Parameter=0.5)  # -> Point, Tangent, Angle
eval_3 = EvaluateCurve(Curve=reparameterize(ln_3), Parameter=0.5)  # -> Point, Tangent, Angle
eval_4 = EvaluateCurve(Curve=reparameterize(ln_4), Parameter=0.5)  # -> Point, Tangent, Angle
eval_5 = EvaluateCurve(Curve=reparameterize(ln_5), Parameter=0.5)  # -> Point, Tangent, Angle
ln_6 = Line(StartPoint=pt_19, EndPoint=pt_20)
ln_7 = Line(StartPoint=pt_5, EndPoint=pt_6)
addition_10 = Addition(A=sistptmed, B=bansupptmed_2)
addition_11 = Addition(A=sistptmed, B=bansupptmed_3)
eval_6 = EvaluateCurve(Curve=reparameterize(ln_6), Parameter=0.5)  # -> Point, Tangent, Angle
addition_12 = Addition(A=sistptmed, B=barptmed_2)
eval_7 = EvaluateCurve(Curve=reparameterize(ln_7), Parameter=0.5)  # -> Point, Tangent, Angle
Z = UnitZ(Factor=addition_11)
Z_2 = UnitZ(Factor=addition_10)
Z_3 = UnitZ(Factor=sistptmed)
Z_4 = UnitZ(Factor=addition_12)
move = Move(Geometry=eval.Point, Motion=Z)  # -> Geometry, Transform
addition_13 = Addition(A=sistptmedio, B=bansupptmed)
addition_14 = Addition(A=sistptmedio, B=barptmed)
move_2 = Move(Geometry=eval_5.Point, Motion=Z_4)  # -> Geometry, Transform
move_3 = Move(Geometry=eval_4.Point, Motion=Z_3)  # -> Geometry, Transform
move_4 = Move(Geometry=eval_3.Point, Motion=Z_2)  # -> Geometry, Transform
Z_5 = UnitZ(Factor=addition_13)
merge = Merge(Data1=pt_9, Data2=move.Geometry, Data3=pt_10)
Z_6 = UnitZ(Factor=sistptmedio)
Z_7 = UnitZ(Factor=addition_14)
merge_2 = Merge(Data1=pt_15, Data2=move_2.Geometry, Data3=pt_16)
move_5 = Move(Geometry=eval_6.Point, Motion=Z_5)  # -> Geometry, Transform
merge_3 = Merge(Data1=pt_13, Data2=move_3.Geometry, Data3=pt_14)
merge_4 = Merge(Data1=pt_11, Data2=move_4.Geometry, Data3=pt_12)
move_6 = Move(Geometry=eval_7.Point, Motion=Z_6)  # -> Geometry, Transform
move_7 = Move(Geometry=eval_2.Point, Motion=Z_7)  # -> Geometry, Transform
intcrv = Interpolate(Vertices=merge, Degree=3, Periodic=False, KnotStyle=1)  # -> Curve, Length, Domain
merge_5 = Merge(Data1=pt_19, Data2=move_5.Geometry, Data3=pt_20)
intcrv_2 = Interpolate(Vertices=merge_2, Degree=3, Periodic=False, KnotStyle=1)  # -> Curve, Length, Domain
merge_6 = Merge(Data1=pt_7, Data2=move_7.Geometry, Data3=pt_8)
intcrv_3 = Interpolate(Vertices=merge_3, Degree=3, Periodic=False, KnotStyle=1)  # -> Curve, Length, Domain
intcrv_4 = Interpolate(Vertices=merge_4, Degree=3, Periodic=False, KnotStyle=1)  # -> Curve, Length, Domain
intcrv_5 = Interpolate(Vertices=merge_5, Degree=3, Periodic=False, KnotStyle=1)  # -> Curve, Length, Domain
intcrv_6 = Interpolate(Vertices=[pt_5, move_6.Geometry, pt_6], Degree=3, Periodic=False, KnotStyle=1)  # -> Curve, Length, Domain
end = EndPoints(Curve=intcrv.Curve)  # -> Start, End
intcrv_7 = Interpolate(Vertices=merge_6, Degree=3, Periodic=False, KnotStyle=1)  # -> Curve, Length, Domain
end_2 = EndPoints(Curve=intcrv_2.Curve)  # -> Start, End
end_3 = EndPoints(Curve=intcrv_3.Curve)  # -> Start, End
end_4 = EndPoints(Curve=intcrv_4.Curve)  # -> Start, End
end_5 = EndPoints(Curve=intcrv_6.Curve)  # -> Start, End
ln_8 = Line(StartPoint=end.Start, EndPoint=end.End)
end_6 = EndPoints(Curve=intcrv_7.Curve)  # -> Start, End
ln_9 = Line(StartPoint=end_2.Start, EndPoint=end_2.End)
ln_10 = Line(StartPoint=end_5.Start, EndPoint=end_5.End)
ln_11 = Line(StartPoint=end_3.Start, EndPoint=end_3.End)
ln_12 = Line(StartPoint=end_4.Start, EndPoint=end_4.End)
ln_13 = Line(StartPoint=end_6.Start, EndPoint=end_6.End)
neg_6 = Negative(Value=ângulo)
neg_7 = Negative(Value=ângulo_2)
rotax = RotateAxis(Geometry=intcrv.Curve, Angle=degrees("0.0"), Axis=ln_8)  # -> Geometry, Transform
rotax_2 = RotateAxis(Geometry=intcrv_6.Curve, Angle=degrees(ângulo), Axis=ln_10)  # -> Geometry, Transform
rotax_3 = RotateAxis(Geometry=intcrv_6.Curve, Angle=degrees(neg_6), Axis=ln_10)  # -> Geometry, Transform
rotax_4 = RotateAxis(Geometry=intcrv_5.Curve, Angle="0.0", Axis=Line((0, 0, 0), (10, 0, 0)))  # -> Geometry, Transform
rotax_5 = RotateAxis(Geometry=intcrv_3.Curve, Angle=degrees(ângulo_2), Axis=ln_11)  # -> Geometry, Transform
rotax_6 = RotateAxis(Geometry=intcrv_3.Curve, Angle=degrees(neg_7), Axis=ln_11)  # -> Geometry, Transform
rotax_7 = RotateAxis(Geometry=intcrv_4.Curve, Angle=degrees("0.0"), Axis=ln_12)  # -> Geometry, Transform
rotax_8 = RotateAxis(Geometry=intcrv_7.Curve, Angle=degrees(ângulo), Axis=ln_13)  # -> Geometry, Transform
rotax_9 = RotateAxis(Geometry=intcrv_2.Curve, Angle=degrees(neg_7), Axis=ln_9)  # -> Geometry, Transform

multiplication = Multiplication(A=Slider(15, range=5..15), B=2)

divide = DivideCurve(Curve=rotax_4.Geometry, Count=multiplication, Kinks=False)  # -> Points, Tangents, Parameters
divide_2 = DivideCurve(Curve=rotax_2.Geometry, Count=multiplication, Kinks=False)  # -> Points, Tangents, Parameters
divide_3 = DivideCurve(Curve=rotax_3.Geometry, Count=multiplication, Kinks=False)  # -> Points, Tangents, Parameters
divide_4 = DivideCurve(Curve=rotax_8.Geometry, Count=multiplication, Kinks=False)  # -> Points, Tangents, Parameters
divide_5 = DivideCurve(Curve=rotax.Geometry, Count=multiplication, Kinks=False)  # -> Points, Tangents, Parameters
divide_6 = DivideCurve(Curve=rotax_7.Geometry, Count=multiplication, Kinks=False)  # -> Points, Tangents, Parameters
divide_7 = DivideCurve(Curve=rotax_5.Geometry, Count=multiplication, Kinks=False)  # -> Points, Tangents, Parameters
divide_8 = DivideCurve(Curve=rotax_6.Geometry, Count=multiplication, Kinks=False)  # -> Points, Tangents, Parameters
divide_9 = DivideCurve(Curve=rotax_9.Geometry, Count=multiplication, Kinks=False)  # -> Points, Tangents, Parameters

ln_14 = Line(StartPoint=divide.Points, EndPoint=divide_2.Points)
ln_15 = Line(StartPoint=divide_2.Points, EndPoint=divide_3.Points)
ln_16 = Line(StartPoint=divide_3.Points, EndPoint=divide.Points)
ln_17 = Line(StartPoint=divide.Points, EndPoint=divide_4.Points)
ln_18 = Line(StartPoint=divide_2.Points, EndPoint=divide_4.Points)
ln_19 = Line(StartPoint=divide_6.Points, EndPoint=divide_5.Points)
ln_20 = Line(StartPoint=divide.Points, EndPoint=divide_5.Points)
ln_21 = Line(StartPoint=divide_5.Points, EndPoint=divide_3.Points)
ln_22 = Line(StartPoint=divide_7.Points, EndPoint=divide_5.Points)
ln_23 = Line(StartPoint=divide_6.Points, EndPoint=divide_7.Points)
ln_24 = Line(StartPoint=divide_7.Points, EndPoint=divide_8.Points)
ln_25 = Line(StartPoint=divide_8.Points, EndPoint=divide_6.Points)
ln_26 = Line(StartPoint=divide_6.Points, EndPoint=divide_9.Points)
ln_27 = Line(StartPoint=divide_8.Points, EndPoint=divide_9.Points)

merge_7 = Merge(Data1=divide.Points, Data2=divide_4.Points, Data3=divide_5.Points, Data4=divide_6.Points, Data5=divide_9.Points)
pt_21 = Point(merge_7)
del = DelaunayMesh(Points=pt_21, Plane=PlaneXY(0, 0, 0))
preview = CustomPreview(Geometry=del, Shader=ColourSwatch(SwatchColor=RGBA(255, 255, 255, 206)))

panel_27 = Panel("Membranas Translúcidas")

peso_próprio_da_membrana_por_m2_kg = Panel("0.7")
area = Area(Geometry=del)  # -> Area, Centroid
project = Project(Geometry=del, Plane=PlaneXY(0, 0, 0))  # -> Geometry, Transform
sobrecarga_por_m2_kg = Panel("30")
area_2 = Area(Geometry=project.Geometry)  # -> Area, Centroid
merge_8 = Merge(Data1=divide.Points, Data2=divide_4.Points, Data3=divide_5.Points, Data4=divide_6.Points, Data5=divide_9.Points)
multiplication_2 = Multiplication(A=area.Area, B=peso_próprio_da_membrana_por_m2_kg)
multiplication_3 = Multiplication(A=area_2.Area, B=sobrecarga_por_m2_kg)
addition_15 = Addition(A=multiplication_2, B=multiplication_3)
lng = ListLength(List=merge_8)
carga_por_nó = Division(A=addition_15, B=lng)
multiplication_4 = Multiplication(A=carga_por_nó, B=-0.0098)

item = ListItem(List=seção_d_t, Index=Slider(11, range=0..29), Wrap=True)
split = TextSplit(Text=item, Separators=",")
item_2 = ListItem(List=split, Index=0, Wrap=True)
item_3 = ListItem(List=split, Index=1, Wrap=True)
division_2 = Division(A=item_2, B=10)
division_3 = Division(A=item_3, B=10)

item_4 = ListItem(List=seção_d_t, Index=Slider(0, range=0..34), Wrap=True)
split_2 = TextSplit(Text=item_4, Separators=",")
item_5 = ListItem(List=split_2, Index=0, Wrap=True)
item_6 = ListItem(List=split_2, Index=1, Wrap=True)
division_4 = Division(A=item_5, B=10)
division_5 = Division(A=item_6, B=10)

item_7 = ListItem(List=seção_d_t, Index=Slider(34, range=0..34), Wrap=True)
split_3 = TextSplit(Text=item_7, Separators=",")
item_8 = ListItem(List=split_3, Index=0, Wrap=True)
item_9 = ListItem(List=split_3, Index=1, Wrap=True)
division_6 = Division(A=item_8, B=10)
division_7 = Division(A=item_9, B=10)

item_10 = ListItem(List=seção_d_t, Index=Slider(9, range=0..34), Wrap=True)
split_4 = TextSplit(Text=item_10, Separators=",")
item_11 = ListItem(List=split_4, Index=0, Wrap=True)
item_12 = ListItem(List=split_4, Index=1, Wrap=True)
division_8 = Division(A=item_11, B=10)
division_9 = Division(A=item_12, B=10)

pline = PolyLine(Vertices=divide.Points, Closed=False)
pline_2 = PolyLine(Vertices=divide_6.Points, Closed=False)
explode = Explode(Curve=pline, Recursive=True)  # -> Segments, Vertices
explode_2 = Explode(Curve=pline_2, Recursive=True)  # -> Segments, Vertices
flatten = FlattenTree(Tree=explode.Segments, Path="5")
flatten_2 = FlattenTree(Tree=explode_2.Segments, Path="6")
merge_9 = Merge(Data1=flatten, Data2=flatten_2)

merge_10 = Merge(
    Data1=ln_14,
    Data2=ln_15,
    Data3=ln_16,
    Data4=ln_17,
    Data5=ln_18,
    Data6=ln_23,
    Data7=ln_24,
    Data8=ln_25,
    Data9=ln_26,
    Data10=ln_27,
    Data11=ln_19,
    Data12=ln_20,
    Data13=ln_21,
    Data14=ln_22)
flatten_3 = FlattenTree(Tree=merge_10, Path="10")

pline_3 = PolyLine(Vertices=divide_2.Points, Closed=False)
pline_4 = PolyLine(Vertices=divide_3.Points, Closed=False)
pline_5 = PolyLine(Vertices=divide_7.Points, Closed=False)
pline_6 = PolyLine(Vertices=divide_8.Points, Closed=False)
explode_3 = Explode(Curve=pline_3, Recursive=True)  # -> Segments, Vertices
explode_4 = Explode(Curve=pline_4, Recursive=True)  # -> Segments, Vertices
explode_5 = Explode(Curve=pline_5, Recursive=True)  # -> Segments, Vertices
explode_6 = Explode(Curve=pline_6, Recursive=True)  # -> Segments, Vertices
flatten_4 = FlattenTree(Tree=explode_3.Segments, Path="0")
flatten_5 = FlattenTree(Tree=explode_4.Segments, Path="1")
flatten_6 = FlattenTree(Tree=explode_5.Segments, Path="2")
flatten_7 = FlattenTree(Tree=explode_6.Segments, Path="3")
merge_11 = Merge(Data1=flatten_4, Data2=flatten_5, Data3=flatten_6, Data4=flatten_7)

pline_7 = PolyLine(Vertices=divide_4.Points, Closed=False)
pline_8 = PolyLine(Vertices=divide_5.Points, Closed=False)
pline_9 = PolyLine(Vertices=divide_9.Points, Closed=False)
explode_7 = Explode(Curve=pline_7, Recursive=True)  # -> Segments, Vertices
explode_8 = Explode(Curve=pline_8, Recursive=True)  # -> Segments, Vertices
explode_9 = Explode(Curve=pline_9, Recursive=True)  # -> Segments, Vertices
flatten_8 = FlattenTree(Tree=explode_7.Segments, Path="7")
flatten_9 = FlattenTree(Tree=explode_8.Segments, Path="8")
flatten_10 = FlattenTree(Tree=explode_9.Segments, Path="9")
merge_12 = Merge(Data1=flatten_8, Data2=flatten_9, Data3=flatten_10)

peso_do_aço_m3 = Panel("7850")

rdlines = RemoveDuplicateLinesKaramba(Line=flatten(merge_9), LimitDistance=0.005)  # -> OutLine, Info, Indexes
llinter = LineLineIntersectionKaramba(Line=rdlines.OutLine, LengthTolerance=0.01)  # -> IntersectionPoints, flatten(LineSubSegements)
linetobeam = LineToBeamKaramba(Line=llinter.LineSubSegements, New=True, Remove=True, LimitDistance_m=0.005, BeamIdentifier="banzosuperior")  # -> Points, Element, Info

len = Length(Curve=rdlines.OutLine)
ma = MassAddition(Input=len)  # -> Result, PartialResults

rdlines_2 = RemoveDuplicateLinesKaramba(Line=flatten(merge_11), LimitDistance=0.005)  # -> OutLine, Info, Indexes
llinter_2 = LineLineIntersectionKaramba(Line=rdlines_2.OutLine, LengthTolerance=0.01)  # -> IntersectionPoints, flatten(LineSubSegements)
linetobeam_2 = LineToBeamKaramba(Line=flatten(llinter_2.LineSubSegements), New=True, Remove=True, LimitDistance_m=0.005, BeamIdentifier="banzoinferior")  # -> Points, flatten(Element), Info

len_2 = Length(Curve=rdlines_2.OutLine)
ma_2 = MassAddition(Input=len_2)  # -> Result, PartialResults

rdlines_3 = RemoveDuplicateLinesKaramba(Line=flatten(merge_12), LimitDistance=0.005)  # -> OutLine, Info, Indexes
llinter_3 = LineLineIntersectionKaramba(Line=rdlines_3.OutLine, LengthTolerance=0.01)  # -> IntersectionPoints, flatten(LineSubSegements)
linetobeam_3 = LineToBeamKaramba(Line=flatten(llinter_3.LineSubSegements), New=True, Remove=True, LimitDistance_m=0.005, BeamIdentifier="barra")  # -> Points, Element, Info

len_3 = Length(Curve=rdlines_3.OutLine)
ma_3 = MassAddition(Input=len_3)  # -> Result, PartialResults

rdlines_4 = RemoveDuplicateLinesKaramba(Line=flatten(flatten_3), LimitDistance=0.005)  # -> OutLine, Info, Indexes
llinter_4 = LineLineIntersectionKaramba(Line=rdlines_4.OutLine, LengthTolerance=0.01)  # -> IntersectionPoints, flatten(LineSubSegements)
linetobeam_4 = LineToBeamKaramba(Line=llinter_4.LineSubSegements, New=True, Remove=True, LimitDistance_m=0.005, BeamIdentifier="diagonal")  # -> Points, Element, Info

len_4 = Length(Curve=rdlines_4.OutLine)
ma_4 = MassAddition(Input=len_4)  # -> Result, PartialResults

parede_mm = Panel(item_9)
parede_mm_2 = Panel(item_6)
diametro_mm = Panel(item_8)
parede_mm_3 = Panel(item_12)
parede_mm_4 = Panel(item_3)
diametro_mm_2 = Panel(item_5)
diametro_mm_3 = Panel(division_8)
diametro_mm_4 = Panel(item_2)

# ----
# Estes "coeficientes" são "multas" pela estrutura estar levando bomba no cálculo estrutural. Eles permitem que o Galapagos vá se aproximando das soluções ideais.
panel_28 = Panel("100000")

merge_13 = Merge(Data1=divide.Points, Data2=divide_4.Points, Data3=divide_5.Points, Data4=divide_6.Points, Data5=divide_9.Points)
matselect = MaterialSelectionKaramba(menu=[dropdown(1), dropdown(54)])
merge_14 = Merge(Data1=pt_5, Data2=pt_6, Data3=pt_13, Data4=pt_14)
supp = SupportKaramba(PosInd=merge_14, menu=[buttons(on, on, on, on, on, on)])
merge_15 = Merge(Data1=linetobeam_4.Element, Data2=linetobeam.Element, Data3=linetobeam_2.Element, Data4=linetobeam_3.Element)
range = Range(Domain=Domain(0, 1), Steps=10)
gradient = Gradient(LowerLimit=0, UpperLimit=1, Parameter=range, stops=[0: RGB(0, 128, 0), 0.5: RGB(255, 255, 0), 1: RGB(255, 0, 0)])

Z_8 = UnitZ(Factor=multiplication_4)
loads = LoadsKaramba(ForceVector=Z_8, Local=False, PosInd=merge_13, LCase=0, mode="Point")
loads_2 = LoadsKaramba(Vector=Vector(0, 0, -1), LCase=0, mode="Gravity")

panel_29 = Panel("Escolha do Perfil")
resistência_kn_mm² = Panel("0.25")
eval_8 = Evaluate(F="(3.14159*x^2)/4", x=diametro_mm_4)
eval_9 = Evaluate(F="(3.14159*x^2)/4", x=diametro_mm_2)
eval_10 = Evaluate(F="(3.14159*x^2)/4", x=diametro_mm)
eval_11 = Evaluate(F="(3.14159*x^2)/4", x=diametro_mm_3)
eval_12 = Evaluate(F="(3.14159*(x-(y*2))^2)/4", x=diametro_mm_4, y=parede_mm_4)
eval_13 = Evaluate(F="(3.14159*(x-(y*2))^2)/4", x=diametro_mm_2, y=parede_mm_2)
eval_14 = Evaluate(F="(3.14159*(x-(y*2))^2)/4", x=diametro_mm, y=parede_mm)
eval_15 = Evaluate(F="(3.14159*(x-(y*2))^2)/4", x=diametro_mm_3, y=parede_mm_3)
subtraction = Subtraction(A=eval_8, B=eval_12)
subtraction_2 = Subtraction(A=eval_9, B=eval_13)
subtraction_3 = Subtraction(A=eval_10, B=eval_14)
subtraction_4 = Subtraction(A=eval_11, B=eval_15)

division_10 = Division(A=subtraction_2, B=1000000)

cross_sections = CrossSectionsKaramba(ElementsIdentifiers="diagonal", Diameter_cm=division_2, WallThickness_cm=division_3, mode="Circular Hollow")
cross_sections_2 = CrossSectionsKaramba(ElementsIdentifiers="banzosuperior", Diameter_cm=division_4, WallThickness_cm=division_5, mode="Circular Hollow")
cross_sections_3 = CrossSectionsKaramba(ElementsIdentifiers="banzoinferior", Diameter_cm=division_6, WallThickness_cm=division_7, mode="Circular Hollow")
cross_sections_4 = CrossSectionsKaramba(ElementsIdentifiers="barra", Diameter_cm=division_8, WallThickness_cm=division_9, mode="Circular Hollow")

multiplication_5 = Multiplication(A=ma.Result, B=division_10)
multiplication_6 = Multiplication(A=multiplication_5, B=peso_do_aço_m3)
panel_30 = Panel(multiplication_6)

área_do_perfil_mm2 = Panel(subtraction_2)
área_do_perfil_mm2_2 = Panel(subtraction_3)
área_do_perfil_mm2_3 = Panel(subtraction_4)
área_do_perfil_mm2_4 = Panel(subtraction)

division_11 = Division(A=área_do_perfil_mm2_4, B=1000000)
division_12 = Division(A=área_do_perfil_mm2_2, B=1000000)
division_13 = Division(A=área_do_perfil_mm2_3, B=1000000)
multiplication_7 = Multiplication(A=ma_4.Result, B=division_11)
multiplication_8 = Multiplication(A=ma_2.Result, B=division_12)
multiplication_9 = Multiplication(A=ma_3.Result, B=division_13)
multiplication_10 = Multiplication(A=multiplication_7, B=peso_do_aço_m3)
multiplication_11 = Multiplication(A=multiplication_8, B=peso_do_aço_m3)
multiplication_12 = Multiplication(A=multiplication_9, B=peso_do_aço_m3)

merge_16 = Merge(Data1=cross_sections, Data2=cross_sections_2, Data3=cross_sections_3, Data4=cross_sections_4)
multiplication_13 = Multiplication(A=área_do_perfil_mm2_4, B=resistência_kn_mm²)
multiplication_14 = Multiplication(A=área_do_perfil_mm2, B=resistência_kn_mm²)
multiplication_15 = Multiplication(A=área_do_perfil_mm2_2, B=resistência_kn_mm²)
multiplication_16 = Multiplication(A=área_do_perfil_mm2_3, B=resistência_kn_mm²)

panel_31 = Panel(multiplication_10)
panel_32 = Panel(multiplication_12)
panel_33 = Panel(multiplication_11)
ma_5 = MassAddition(Input=[panel_31, panel_30, panel_33, panel_32])  # -> Result, PartialResults
panel_34 = Panel(ma_5.Result)

merge_17 = Merge(Data1=loads_2, Data2=loads)

assemble = AssembleModelKaramba(
    Elem=flatten(merge_15),
    Support=flatten(supp),
    Load=flatten(merge_17),
    CrossSection=flatten(merge_16),
    Material=flatten(matselect),
    LimitDistance_m=0.005)  # -> flatten(Model), Info, Mass_kg, CenterOfGravity
model_mass_kg = Panel(assemble.Mass_kg)

analyzethi = AnalyzeThIKaramba(Model=assemble.Model)  # -> CalculatedModel, MaximumDisplacement_m, ResultingForceOfGravity_kN, ElasticEnergy_kNm
max_displacement_m = Panel(analyzethi.MaximumDisplacement_m)

b_res_force = BeamResultantForcesKaramba(
    AnalyzedModel=analyzethi.CalculatedModel,
    BeamIdentifiers="banzoinferior",
    LoadCase=-1,
    MaximumProbingDistance_m=-1,
    NumberOfProbingPointsPerElement=3)  # -> AnalyzedModel, NormalForce_kN, ResultantBendingMoment_kNm, ResultantShearForce_kN

b_res_force_2 = BeamResultantForcesKaramba(
    AnalyzedModel=analyzethi.CalculatedModel,
    BeamIdentifiers="barra",
    LoadCase=-1,
    MaximumProbingDistance_m=-1,
    NumberOfProbingPointsPerElement=3)  # -> AnalyzedModel, NormalForce_kN, ResultantBendingMoment_kNm, ResultantShearForce_kN

b_res_force_3 = BeamResultantForcesKaramba(
    AnalyzedModel=analyzethi.CalculatedModel,
    BeamIdentifiers="banzosuperior",
    LoadCase=-1,
    MaximumProbingDistance_m=-1,
    NumberOfProbingPointsPerElement=3)  # -> AnalyzedModel, NormalForce_kN, ResultantBendingMoment_kNm, ResultantShearForce_kN

b_res_force_4 = BeamResultantForcesKaramba(
    AnalyzedModel=analyzethi.CalculatedModel,
    BeamIdentifiers="diagonal",
    LoadCase=-1,
    MaximumProbingDistance_m=-1,
    NumberOfProbingPointsPerElement=3)  # -> AnalyzedModel, NormalForce_kN, ResultantBendingMoment_kNm, ResultantShearForce_kN

modelview = ModelViewKaramba(
    Model=analyzethi.CalculatedModel,
    LoadCaseFactorsForLinearSuperposition=1,
    IndexIncrementOfVisibleLoadcase=0,
    ListOfColorsForColoringPlots=gradient)  # -> Model, DeformedMesh, DeformedAxes, DeformedModel
beamview = BeamViewKaramba(Model=modelview.Model)  # -> Model, MeshesOfRenderedBeams, DeformedBeamAxes, LegendColors, LegendTags
b_res_force_5 = BeamResultantForcesKaramba(AnalyzedModel=beamview.Model, LoadCase=-1, MaximumProbingDistance_m=-1, NumberOfProbingPointsPerElement=3)  # -> AnalyzedModel, NormalForce_kN, ResultantBendingMoment_kNm, ResultantShearForce_kN
python = PythonScript(x=beamview.LegendTags)  # -> out, a; inputs x: list
# ---------- python: Python ----------
import re

a = []

x.pop(0)

for val in x:
    try:
        a.append( float(re.sub(r'[^\d.-e+]+', '', val)) )
    except ValueError:
        continue
# ---------- end python ----------
abs = Absolute(Value=python.a)
bnd = Bounds(Numbers=b_res_force_5.NormalForce_kN)
bnd_2 = Bounds(Numbers=b_res_force_5.ResultantBendingMoment_kNm)
bnd_3 = Bounds(Numbers=b_res_force_5.ResultantShearForce_kN)
bnd_4 = Bounds(Numbers=abs)
dedomain = DeconstructDomain(Domain=bnd)  # -> Start, End
dedomain_2 = DeconstructDomain(Domain=bnd_2)  # -> Start, End
dedomain_3 = DeconstructDomain(Domain=bnd_3)  # -> Start, End
dedomain_4 = DeconstructDomain(Domain=bnd_4)  # -> Start, End
abs_2 = Absolute(Value=dedomain.Start)

flecha_máxima_aceitável_l_x = Panel("300")
vão_total = Panel("100")
division_14 = Division(A=vão_total, B=flecha_máxima_aceitável_l_x)
flecha_máxima_aceitável_m = Panel(division_14)
flecha_máxima_m = Panel(analyzethi.MaximumDisplacement_m)

max_utilization_percentage = Panel(dedomain_4.End)
max_compression_kn = Panel(abs_2)
max_tension_kn = Panel(dedomain.End)
max_moment_knm = Panel(dedomain_2.End)
max_shear_kn = Panel(dedomain_3.End)

bnd_5 = Bounds(Numbers=b_res_force_4.NormalForce_kN)
bnd_6 = Bounds(Numbers=b_res_force_3.NormalForce_kN)
bnd_7 = Bounds(Numbers=b_res_force.NormalForce_kN)
bnd_8 = Bounds(Numbers=b_res_force_2.NormalForce_kN)
dedomain_5 = DeconstructDomain(Domain=bnd_5)  # -> Start, End
dedomain_6 = DeconstructDomain(Domain=bnd_6)  # -> Start, End
dedomain_7 = DeconstructDomain(Domain=bnd_7)  # -> Start, End
dedomain_8 = DeconstructDomain(Domain=bnd_8)  # -> Start, End
abs_3 = Absolute(Value=dedomain_5.Start)
abs_4 = Absolute(Value=dedomain_6.Start)
abs_5 = Absolute(Value=dedomain_7.Start)
abs_6 = Absolute(Value=dedomain_8.Start)

tração_máxima_kn = Panel(dedomain_6.End)
# Banzo Sup.
compressão_máxima_kn = Panel(abs_4)

# ----
# Barras
compressão_máxima_kn_2 = Panel(abs_6)
tração_máxima_kn_2 = Panel(dedomain_8.End)

# ----
# Diagonais
compressão_máxima_kn_3 = Panel(abs_3)
tração_máxima_kn_3 = Panel(dedomain_5.End)

# ----
# Banzo Inf.
compressão_máxima_kn_4 = Panel(abs_5)
tração_máxima_kn_4 = Panel(dedomain_7.End)

abs_7 = Absolute(Value=[compressão_máxima_kn_3, tração_máxima_kn_3])
abs_8 = Absolute(Value=[compressão_máxima_kn, tração_máxima_kn])
abs_9 = Absolute(Value=[compressão_máxima_kn_4, tração_máxima_kn_4])
abs_10 = Absolute(Value=[compressão_máxima_kn_2, tração_máxima_kn_2])
sort = SortList(Keys=abs_7)  # -> Keys, ValuesA
sort_2 = SortList(Keys=abs_8)  # -> Keys, ValuesA
sort_3 = SortList(Keys=abs_9)  # -> Keys, ValuesA
sort_4 = SortList(Keys=abs_10)  # -> Keys, ValuesA
rev = ReverseList(List=sort.Keys)
rev_2 = ReverseList(List=sort_2.Keys)
rev_3 = ReverseList(List=sort_3.Keys)
rev_4 = ReverseList(List=sort_4.Keys)
item_13 = ListItem(List=rev, Index=0, Wrap=True)
item_14 = ListItem(List=rev_2, Index=0, Wrap=True)
item_15 = ListItem(List=rev_3, Index=0, Wrap=True)
item_16 = ListItem(List=rev_4, Index=0, Wrap=True)

solicitação_máxima = Panel(item_13)
resistência_máxima_de_cada_peça = Panel(multiplication_13)

solicitação_máxima_2 = Panel(item_15)
resistência_máxima_de_cada_peça_2 = Panel(multiplication_15)

resistência_máxima_de_cada_peça_3 = Panel(multiplication_16)
solicitação_máxima_3 = Panel(item_16)

solicitação_máxima_4 = Panel(item_14)
resistência_máxima_de_cada_peça_4 = Panel(multiplication_14)

model_mass_kg_2 = Panel(assemble.Mass_kg)
subtraction_5 = Subtraction(A=flecha_máxima_m, B=flecha_máxima_aceitável_m)
subtraction_6 = Subtraction(A=solicitação_máxima, B=resistência_máxima_de_cada_peça)
subtraction_7 = Subtraction(A=solicitação_máxima_4, B=resistência_máxima_de_cada_peça_4)
subtraction_8 = Subtraction(A=solicitação_máxima_2, B=resistência_máxima_de_cada_peça_2)
subtraction_9 = Subtraction(A=solicitação_máxima_3, B=resistência_máxima_de_cada_peça_3)
max = Maximum(A=subtraction_5, B=0)
max_2 = Maximum(A=subtraction_6, B=0)
max_3 = Maximum(A=subtraction_7, B=0)
max_4 = Maximum(A=subtraction_8, B=0)
max_5 = Maximum(A=subtraction_9, B=0)
multiplication_17 = Multiplication(A=max, B=panel_28)
multiplication_18 = Multiplication(A=max_2, B=panel_28)
multiplication_19 = Multiplication(A=max_3, B=panel_28)
multiplication_20 = Multiplication(A=max_4, B=panel_28)
multiplication_21 = Multiplication(A=max_5, B=panel_28)
addition_16 = Addition(
    A=multiplication_17,
    B=multiplication_18,
    C=multiplication_19,
    D=multiplication_20,
    E=multiplication_21,
    F=model_mass_kg_2)
parâmetro_a_otimizar = Panel(addition_16)
equals = Equality(FirstNumber=parâmetro_a_otimizar, SecondNumber=model_mass_kg_2)  # -> Equality, Inequality
está_passando = Panel(equals.Equality)

panel_35 = Panel(model_mass_kg_2)
