# Grasshopper definition cobertura3.gh (Grasshopper 0.9.76)
# plug-ins: Karamba, Python Interpreter

panel = Panel("Genome")

# ----
# Altura Banzo Superior 1
# Altura Banzo Superior 2
panel_2 = Panel("Banzos Superiores")
eixo_x = Slider(1.07, range=0..2.5)
panel_3 = Panel("Extremidade Banzos Superiores")
eixo_z = Slider(1.5, range=0..4)
ponto_perpendicular = Slider(3, range=1..6)
eixo_z_2 = Slider(1.5, range=0..3)
ponto_perpendicular_2 = Slider(3, range=1..6)

panel_4 = Panel("Barras")
panel_5 = Panel("Extremidade Barras")
eixo_x_2 = Slider(3, range=0..3)
eixo_z_3 = Slider(1.91, range=0..10)
panel_6 = Panel("Altura Barra 02")
ponto_perpendicular_3 = Slider(3.7, range=-3..6)
ponto_perpendicular_4 = Slider(3.12, range=0..6)
eixo_z_4 = Slider(3, range=3..10)
panel_7 = Panel("Altura Barra 01")

# ----
# Ângulo Banzos Inferiores 1
# Altura Banzos Inferior 1
# Ângulo Banzos Inferiores 2
# Altura Banzos Inferior 2
panel_8 = Panel("Banzos Inferiores")
ângulo = Slider(17.56, range=10..30)
ponto_perpendicular_5 = Slider(14.6, range=10..30)
ângulo_2 = Slider(13.98, range=10..30)
ponto_perpendicular_6 = Slider(15.12, range=0..35)

# ----
# Catálogo Vallourec.As bitolas escolhidas são as mais frequentemente produzidas.
seção_d_t = Panel("""33.4,3.2
33.4,3.6
38.1,3.2
38.1,4.0
42.2,3.6
42.2,5.0
48.3,3.6
48.3,5.0
60.3,4.0
60.3,5.6
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""")

# ----
# UNIVERSIDADE FEDERAL DE OURO PRETO
# _____________________
# 
# Mestrado Profissional em Construção Metálica
# 
# Departamento de Engenharia Civil
ponto_perpendicular_7 = Slider(8, range=3..8)
eixo_z_5 = Slider(8, range=4..10)
ponto_perpendicular_8 = Slider(8, range=0..10)
panel_9 = Panel("Altura Barra 1/2")

panel_10 = Panel("Escolha dos Perfis")

panel_11 = Panel("Quantidades diagonais")
panel_12 = Panel("Divisão Diagonais")

panel_13 = Panel("Dimensão Modelo")
panel_14 = Panel("LARGURA")
panel_15 = Panel("COMPRIMENTO")
panel_16 = Panel("ALTURA APOIOS 01")
eixo_z_6 = Slider(1.8, range=1.8..2.2)
panel_17 = Panel("ALTURA APOIOS 02")
altura = Slider(1.8, range=1.8..2.2)

pt = ConstructPoint(XCoordinate=0, YCoordinate=0, ZCoordinate=eixo_z_6)
pt_2 = ConstructPoint(XCoordinate="100", YCoordinate=0, ZCoordinate=eixo_z_6)

panel_18 = Panel("BANZOS INFERIORES 1")
ln = Line(StartPoint=pt, EndPoint=pt_2)
eval = EvaluateCurve(Curve=reparameterize(ln), Parameter=0.5)  # -> Point, Tangent, Angle
pdecon = Deconstruct(Point=eval.Tangent)  # -> XComponent, YComponent, ZComponent
multiplication = Multiplication(A=pdecon.XComponent, B=-1)
pt_3 = ConstructPoint(XCoordinate=pdecon.ZComponent, YCoordinate=pdecon.YComponent, ZCoordinate=multiplication)
multiplication_2 = Multiplication(A=pt_3, B=ponto_perpendicular_5)
neg = Negative(Value=multiplication_2)
addition = Addition(A=neg, B=eval.Point)
merge = Merge(Data1=pt, Data2=addition, Data3=pt_2)
intcrv = Interpolate(Vertices=merge, Degree=3, Periodic=False, KnotStyle=1)  # -> Curve, Length, Domain
end = EndPoints(Curve=intcrv.Curve)  # -> Start, End
ln_2 = Line(StartPoint=end.Start, EndPoint=end.End)
neg_2 = Negative(Value=ângulo)

pt_4 = ConstructPoint(XCoordinate=0, YCoordinate="10", ZCoordinate=altura)
pt_5 = ConstructPoint(XCoordinate="100", YCoordinate="10", ZCoordinate=altura)

panel_19 = Panel("BANZOS INFERIORES 2")
ln_3 = Line(StartPoint=pt_4, EndPoint=pt_5)
eval_2 = EvaluateCurve(Curve=reparameterize(ln_3), Parameter=0.5)  # -> Point, Tangent, Angle
pdecon_2 = Deconstruct(Point=eval_2.Tangent)  # -> XComponent, YComponent, ZComponent
multiplication_3 = Multiplication(A=pdecon_2.XComponent, B=-1)
pt_6 = ConstructPoint(XCoordinate=pdecon_2.ZComponent, YCoordinate=pdecon_2.YComponent, ZCoordinate=multiplication_3)
multiplication_4 = Multiplication(A=pt_6, B=ponto_perpendicular_6)
neg_3 = Negative(Value=multiplication_4)
addition_2 = Addition(A=neg_3, B=eval_2.Point)
merge_2 = Merge(Data1=pt_4, Data2=addition_2, Data3=pt_5)
intcrv_2 = Interpolate(Vertices=merge_2, Degree=3, Periodic=False, KnotStyle=1)  # -> Curve, Length, Domain
end_2 = EndPoints(Curve=intcrv_2.Curve)  # -> Start, End
ln_4 = Line(StartPoint=end_2.Start, EndPoint=end_2.End)
neg_4 = Negative(Value=ângulo_2)

addition_3 = Addition(A=ponto_perpendicular_6, B=ponto_perpendicular_2)

rotax = RotateAxis(Geometry=intcrv.Curve, Angle=degrees(ângulo), Axis=ln_2)  # -> Geometry, Transform
rotax_2 = RotateAxis(Geometry=intcrv.Curve, Angle=degrees(neg_2), Axis=ln_2)  # -> Geometry, Transform

rotax_3 = RotateAxis(Geometry=intcrv_2.Curve, Angle=degrees(ângulo_2), Axis=ln_4)  # -> Geometry, Transform
rotax_4 = RotateAxis(Geometry=intcrv_2.Curve, Angle=degrees(neg_4), Axis=ln_4)  # -> Geometry, Transform

banzo_inf = CustomPreview(
    Geometry=[rotax.Geometry, rotax_2.Geometry, rotax_3.Geometry, rotax_4.Geometry],
    Shader=ColourSwatch(SwatchColor=RGBA(98, 145, 4, 220)))

multiplication_5 = Multiplication(A=Slider(10, range=5..15), B=2)

resistência_kn_mm² = Panel("0.25")
peso_do_aço_m3 = Panel("7850")

panel_20 = Panel("Membranas Translúcidas")

peso_próprio_da_membrana_por_m2_kg = Panel("0.7")
sobrecarga_por_m2_kg = Panel("30")

item = ListItem(List=seção_d_t, Index=Slider(19, range=0..29), Wrap=True)
split = TextSplit(Text=item, Separators=",")
item_2 = ListItem(List=split, Index=0, Wrap=True)
item_3 = ListItem(List=split, Index=1, Wrap=True)
division = Division(A=item_2, B=10)
division_2 = Division(A=item_3, B=10)

parede_mm = Panel(item_3)
diametro_mm = Panel(item_2)
eval_3 = Evaluate(F="(3.14159*x^2)/4", x=diametro_mm)
eval_4 = Evaluate(F="(3.14159*(x-(y*2))^2)/4", x=diametro_mm, y=parede_mm)
subtraction = Subtraction(A=eval_3, B=eval_4)
área_do_perfil_mm2 = Panel(subtraction)

item_4 = ListItem(List=seção_d_t, Index=Slider(34, range=0..34), Wrap=True)
split_2 = TextSplit(Text=item_4, Separators=",")
item_5 = ListItem(List=split_2, Index=0, Wrap=True)
item_6 = ListItem(List=split_2, Index=1, Wrap=True)
division_3 = Division(A=item_5, B=10)
division_4 = Division(A=item_6, B=10)

item_7 = ListItem(List=seção_d_t, Index=Slider(34, range=0..34), Wrap=True)
split_3 = TextSplit(Text=item_7, Separators=",")
item_8 = ListItem(List=split_3, Index=0, Wrap=True)
item_9 = ListItem(List=split_3, Index=1, Wrap=True)
division_5 = Division(A=item_8, B=10)
division_6 = Division(A=item_9, B=10)

item_10 = ListItem(List=seção_d_t, Index=Slider(20, range=0..34), Wrap=True)
split_4 = TextSplit(Text=item_10, Separators=",")
item_11 = ListItem(List=split_4, Index=0, Wrap=True)
item_12 = ListItem(List=split_4, Index=1, Wrap=True)
division_7 = Division(A=item_11, B=10)
division_8 = Division(A=item_12, B=10)

division_9 = Division(A=área_do_perfil_mm2, B=1000000)
multiplication_6 = Multiplication(A=área_do_perfil_mm2, B=resistência_kn_mm²)
resistência_máxima_de_cada_peça = Panel(multiplication_6)

parede_mm_2 = Panel(item_9)
parede_mm_3 = Panel(item_6)
diametro_mm_2 = Panel(item_8)
parede_mm_4 = Panel(item_12)
parede_mm_5 = Panel(item_3)
diametro_mm_3 = Panel(item_5)
diametro_mm_4 = Panel(division_7)
diametro_mm_5 = Panel(item_2)

# ----
# Estes "coeficientes" são "multas" pela estrutura estar levando bomba no cálculo estrutural. Eles permitem que o Galapagos vá se aproximando das soluções ideais.
panel_21 = Panel("10000")

panel_22 = Panel("BANZO SUPERIOR 1")
addition_4 = Addition(A=eixo_x, B="100")
neg_5 = Negative(Value=eixo_x)
addition_5 = Addition(A=eixo_z, B=eixo_z_6)
addition_6 = Addition(A=ponto_perpendicular, B=ponto_perpendicular_5)

pt_7 = ConstructPoint(XCoordinate=neg_5, YCoordinate=0, ZCoordinate=addition_5)
pt_8 = ConstructPoint(XCoordinate=addition_4, YCoordinate=0, ZCoordinate=addition_5)

ln_5 = Line(StartPoint=pt_7, EndPoint=pt_8)
eval_5 = EvaluateCurve(Curve=reparameterize(ln_5), Parameter=0.5)  # -> Point, Tangent, Angle
pdecon_3 = Deconstruct(Point=eval_5.Tangent)  # -> XComponent, YComponent, ZComponent
multiplication_7 = Multiplication(A=pdecon_3.XComponent, B=-1)
pt_9 = ConstructPoint(XCoordinate=pdecon_3.ZComponent, YCoordinate=pdecon_3.YComponent, ZCoordinate=multiplication_7)
multiplication_8 = Multiplication(A=pt_9, B=addition_6)
neg_6 = Negative(Value=multiplication_8)
addition_7 = Addition(A=neg_6, B=eval_5.Point)
merge_3 = Merge(Data1=pt_7, Data2=addition_7, Data3=pt_8)
intcrv_3 = Interpolate(Vertices=merge_3, Degree=3, Periodic=False, KnotStyle=1)  # -> Curve, Length, Domain
end_3 = EndPoints(Curve=intcrv_3.Curve)  # -> Start, End
ln_6 = Line(StartPoint=end_3.Start, EndPoint=end_3.End)
rotax_5 = RotateAxis(Geometry=intcrv_3.Curve, Angle=degrees("0.0"), Axis=ln_6)  # -> Geometry, Transform

panel_23 = Panel("BARRA 1")
expression = Expression(x=ângulo, y=eixo_z_4, Expression="-((x*π/180)*y)")
addition_8 = Addition(A=eixo_x_2, B="100")
neg_7 = Negative(Value=eixo_x_2)
addition_9 = Addition(A=eixo_z_6, B=eixo_z_4)
addition_10 = Addition(A=ponto_perpendicular_5, B=ponto_perpendicular_4)

pt_10 = ConstructPoint(XCoordinate=neg_7, YCoordinate=expression, ZCoordinate=addition_9)
pt_11 = ConstructPoint(XCoordinate=addition_8, YCoordinate=expression, ZCoordinate=addition_9)

ln_7 = Line(StartPoint=pt_10, EndPoint=pt_11)
eval_6 = EvaluateCurve(Curve=reparameterize(ln_7), Parameter=0.5)  # -> Point, Tangent, Angle
pdecon_4 = Deconstruct(Point=eval_6.Tangent)  # -> XComponent, YComponent, ZComponent
multiplication_9 = Multiplication(A=pdecon_4.XComponent, B=-1)
pt_12 = ConstructPoint(XCoordinate=pdecon_4.ZComponent, YCoordinate=pdecon_4.YComponent, ZCoordinate=multiplication_9)
multiplication_10 = Multiplication(A=pt_12, B=addition_10)
neg_8 = Negative(Value=multiplication_10)
addition_11 = Addition(A=neg_8, B=eval_6.Point)
merge_4 = Merge(Data1=pt_10, Data2=addition_11, Data3=pt_11)
intcrv_4 = Interpolate(Vertices=merge_4, Degree=3, Periodic=False, KnotStyle=1)  # -> Curve, Length, Domain
end_4 = EndPoints(Curve=intcrv_4.Curve)  # -> Start, End
ln_8 = Line(StartPoint=end_4.Start, EndPoint=end_4.End)
rotax_6 = RotateAxis(Geometry=intcrv_4.Curve, Angle=degrees(ângulo), Axis=ln_8)  # -> Geometry, Transform

panel_24 = Panel("BARRA 1/2")
division_10 = Division(A="10", B=2)
neg_9 = Negative(Value=eixo_x_2)
addition_12 = Addition(A=eixo_x_2, B="100")
addition_13 = Addition(A=ponto_perpendicular_7, B=ponto_perpendicular_8)

pt_13 = ConstructPoint(XCoordinate=neg_9, YCoordinate=division_10, ZCoordinate=eixo_z_5)
pt_14 = ConstructPoint(XCoordinate=addition_12, YCoordinate=division_10, ZCoordinate=eixo_z_5)

ln_9 = Line(StartPoint=pt_13, EndPoint=pt_14)
eval_7 = EvaluateCurve(Curve=reparameterize(ln_9), Parameter=0.5)  # -> Point, Tangent, Angle
pdecon_5 = Deconstruct(Point=eval_7.Tangent)  # -> XComponent, YComponent, ZComponent
multiplication_11 = Multiplication(A=pdecon_5.XComponent, B=-1)
pt_15 = ConstructPoint(XCoordinate=pdecon_5.ZComponent, YCoordinate=pdecon_5.YComponent, ZCoordinate=multiplication_11)
multiplication_12 = Multiplication(A=pt_15, B=addition_13)
neg_10 = Negative(Value=multiplication_12)
addition_14 = Addition(A=neg_10, B=eval_7.Point)
merge_5 = Merge(Data1=pt_13, Data2=addition_14, Data3=pt_14)
intcrv_5 = Interpolate(Vertices=merge_5, Degree=3, Periodic=False, KnotStyle=1)  # -> Curve, Length, Domain
end_5 = EndPoints(Curve=intcrv_5.Curve)  # -> Start, End
ln_10 = Line(StartPoint=end_5.Start, EndPoint=end_5.End)
rotax_7 = RotateAxis(Geometry=intcrv_5.Curve, Angle=degrees("0.0"), Axis=ln_10)  # -> Geometry, Transform

panel_25 = Panel("BANZO SUPERIOR 2")
neg_11 = Negative(Value=eixo_x)
addition_15 = Addition(A=eixo_z_2, B=altura)
addition_16 = Addition(A=eixo_x, B="100")

pt_16 = ConstructPoint(XCoordinate=neg_11, YCoordinate="10", ZCoordinate=addition_15)
pt_17 = ConstructPoint(XCoordinate=addition_16, YCoordinate="10", ZCoordinate=addition_15)

ln_11 = Line(StartPoint=pt_16, EndPoint=pt_17)
eval_8 = EvaluateCurve(Curve=reparameterize(ln_11), Parameter=0.5)  # -> Point, Tangent, Angle
pdecon_6 = Deconstruct(Point=eval_8.Tangent)  # -> XComponent, YComponent, ZComponent
multiplication_13 = Multiplication(A=pdecon_6.XComponent, B=-1)
pt_18 = ConstructPoint(XCoordinate=pdecon_6.ZComponent, YCoordinate=pdecon_6.YComponent, ZCoordinate=multiplication_13)
multiplication_14 = Multiplication(A=pt_18, B=addition_3)
neg_12 = Negative(Value=multiplication_14)
addition_17 = Addition(A=neg_12, B=eval_8.Point)
merge_6 = Merge(Data1=pt_16, Data2=addition_17, Data3=pt_17)
intcrv_6 = Interpolate(Vertices=merge_6, Degree=3, Periodic=False, KnotStyle=1)  # -> Curve, Length, Domain
end_6 = EndPoints(Curve=intcrv_6.Curve)  # -> Start, End
ln_12 = Line(StartPoint=end_6.Start, EndPoint=end_6.End)
rotax_8 = RotateAxis(Geometry=intcrv_6.Curve, Angle=degrees("0.0"), Axis=ln_12)  # -> Geometry, Transform

banzo_sup = CustomPreview(Geometry=[rotax_5.Geometry, rotax_8.Geometry], Shader=ColourSwatch(SwatchColor=RGBA(7, 114, 222, 220)))

panel_26 = Panel("BARRA 2")
expression_2 = Expression(x=ângulo_2, y=eixo_z_3, Expression=" (x*π/180) * y")
addition_18 = Addition(A=eixo_x_2, B="100")
neg_13 = Negative(Value=eixo_x_2)
addition_19 = Addition(A=expression_2, B="10")
addition_20 = Addition(A=ponto_perpendicular_6, B=ponto_perpendicular_3)

pt_19 = ConstructPoint(XCoordinate=neg_13, YCoordinate=addition_19, ZCoordinate=eixo_z_3)
pt_20 = ConstructPoint(XCoordinate=addition_18, YCoordinate=addition_19, ZCoordinate=eixo_z_3)

ln_13 = Line(StartPoint=pt_19, EndPoint=pt_20)
eval_9 = EvaluateCurve(Curve=reparameterize(ln_13), Parameter=0.5)  # -> Point, Tangent, Angle
pdecon_7 = Deconstruct(Point=eval_9.Tangent)  # -> XComponent, YComponent, ZComponent
multiplication_15 = Multiplication(A=pdecon_7.XComponent, B=-1)
pt_21 = ConstructPoint(XCoordinate=pdecon_7.ZComponent, YCoordinate=pdecon_7.YComponent, ZCoordinate=multiplication_15)
multiplication_16 = Multiplication(A=pt_21, B=addition_20)
neg_14 = Negative(Value=multiplication_16)
addition_21 = Addition(A=neg_14, B=eval_9.Point)
merge_7 = Merge(Data1=pt_19, Data2=addition_21, Data3=pt_20)
intcrv_7 = Interpolate(Vertices=merge_7, Degree=3, Periodic=False, KnotStyle=1)  # -> Curve, Length, Domain
end_7 = EndPoints(Curve=intcrv_7.Curve)  # -> Start, End
ln_14 = Line(StartPoint=end_7.Start, EndPoint=end_7.End)
rotax_9 = RotateAxis(Geometry=intcrv_7.Curve, Angle=degrees(neg_4), Axis=ln_14)  # -> Geometry, Transform

barra = CustomPreview(Geometry=[rotax_6.Geometry, rotax_7.Geometry, rotax_9.Geometry], Shader=ColourSwatch(SwatchColor=RGB(227, 117, 14)))

divide = DivideCurve(Curve=rotax_5.Geometry, Count=multiplication_5, Kinks=False)  # -> Points, Tangents, Parameters
divide_2 = DivideCurve(Curve=rotax.Geometry, Count=multiplication_5, Kinks=False)  # -> Points, Tangents, Parameters
divide_3 = DivideCurve(Curve=rotax_2.Geometry, Count=multiplication_5, Kinks=False)  # -> Points, Tangents, Parameters
divide_4 = DivideCurve(Curve=rotax_6.Geometry, Count=multiplication_5, Kinks=False)  # -> Points, Tangents, Parameters
divide_5 = DivideCurve(Curve=rotax_7.Geometry, Count=multiplication_5, Kinks=False)  # -> Points, Tangents, Parameters
divide_6 = DivideCurve(Curve=rotax_8.Geometry, Count=multiplication_5, Kinks=False)  # -> Points, Tangents, Parameters
divide_7 = DivideCurve(Curve=rotax_3.Geometry, Count=multiplication_5, Kinks=False)  # -> Points, Tangents, Parameters
divide_8 = DivideCurve(Curve=rotax_4.Geometry, Count=multiplication_5, Kinks=False)  # -> Points, Tangents, Parameters
divide_9 = DivideCurve(Curve=rotax_9.Geometry, Count=multiplication_5, Kinks=False)  # -> Points, Tangents, Parameters

ln_15 = Line(StartPoint=divide.Points, EndPoint=divide_2.Points)
ln_16 = Line(StartPoint=divide_2.Points, EndPoint=divide_3.Points)
ln_17 = Line(StartPoint=divide_3.Points, EndPoint=divide.Points)
ln_18 = Line(StartPoint=divide.Points, EndPoint=divide_4.Points)
ln_19 = Line(StartPoint=divide_2.Points, EndPoint=divide_4.Points)
ln_20 = Line(StartPoint=divide_6.Points, EndPoint=divide_5.Points)
ln_21 = Line(StartPoint=divide.Points, EndPoint=divide_5.Points)
ln_22 = Line(StartPoint=divide_5.Points, EndPoint=divide_3.Points)
ln_23 = Line(StartPoint=divide_7.Points, EndPoint=divide_5.Points)
ln_24 = Line(StartPoint=divide_6.Points, EndPoint=divide_7.Points)
ln_25 = Line(StartPoint=divide_7.Points, EndPoint=divide_8.Points)
ln_26 = Line(StartPoint=divide_8.Points, EndPoint=divide_6.Points)
ln_27 = Line(StartPoint=divide_6.Points, EndPoint=divide_9.Points)
ln_28 = Line(StartPoint=divide_8.Points, EndPoint=divide_9.Points)

merge_8 = Merge(Data1=divide.Points, Data2=divide_4.Points, Data3=divide_5.Points, Data4=divide_6.Points, Data5=divide_9.Points)
pt_22 = Point(merge_8)
del = DelaunayMesh(Points=pt_22, Plane=PlaneXY(0, 0, 0))
preview = CustomPreview(Geometry=del, Shader=ColourSwatch(SwatchColor=RGBA(255, 255, 255, 206)))

area = Area(Geometry=del)  # -> Area, Centroid
project = Project(Geometry=del, Plane=PlaneXY(0, 0, 0))  # -> Geometry, Transform
area_2 = Area(Geometry=project.Geometry)  # -> Area, Centroid
merge_9 = Merge(Data1=divide.Points, Data2=divide_4.Points, Data3=divide_5.Points, Data4=divide_6.Points, Data5=divide_9.Points)
multiplication_17 = Multiplication(A=area.Area, B=peso_próprio_da_membrana_por_m2_kg)
multiplication_18 = Multiplication(A=area_2.Area, B=sobrecarga_por_m2_kg)
addition_22 = Addition(A=multiplication_17, B=multiplication_18)
lng = ListLength(List=merge_9)
carga_por_nó = Division(A=addition_22, B=lng)
# por que dividir por esse valor?
multiplication_19 = Multiplication(A=carga_por_nó, B=-0.0098)

pline = PolyLine(Vertices=divide.Points, Closed=False)
pline_2 = PolyLine(Vertices=divide_6.Points, Closed=False)
explode = Explode(Curve=pline, Recursive=True)  # -> Segments, Vertices
explode_2 = Explode(Curve=pline_2, Recursive=True)  # -> Segments, Vertices
flatten = FlattenTree(Tree=explode.Segments, Path="5")
flatten_2 = FlattenTree(Tree=explode_2.Segments, Path="6")
merge_10 = Merge(Data1=flatten, Data2=flatten_2)

merge_11 = Merge(
    Data1=ln_15,
    Data2=ln_16,
    Data3=ln_17,
    Data4=ln_18,
    Data5=ln_19,
    Data6=ln_24,
    Data7=ln_25,
    Data8=ln_26,
    Data9=ln_27,
    Data10=ln_28,
    Data11=ln_20,
    Data12=ln_21,
    Data13=ln_22,
    Data14=ln_23)
flatten_3 = FlattenTree(Tree=merge_11, Path="10")

diagonais = CustomPreview(Geometry=merge_11, Shader=ColourSwatch(SwatchColor=RGBA(184, 181, 178, 144)))

pline_3 = PolyLine(Vertices=divide_2.Points, Closed=False)
pline_4 = PolyLine(Vertices=divide_3.Points, Closed=False)
pline_5 = PolyLine(Vertices=divide_7.Points, Closed=False)
pline_6 = PolyLine(Vertices=divide_8.Points, Closed=False)
explode_3 = Explode(Curve=pline_3, Recursive=True)  # -> Segments, Vertices
explode_4 = Explode(Curve=pline_4, Recursive=True)  # -> Segments, Vertices
explode_5 = Explode(Curve=pline_5, Recursive=True)  # -> Segments, Vertices
explode_6 = Explode(Curve=pline_6, Recursive=True)  # -> Segments, Vertices
flatten_4 = FlattenTree(Tree=explode_3.Segments, Path="0")
flatten_5 = FlattenTree(Tree=explode_4.Segments, Path="1")
flatten_6 = FlattenTree(Tree=explode_5.Segments, Path="2")
flatten_7 = FlattenTree(Tree=explode_6.Segments, Path="3")
merge_12 = Merge(Data1=flatten_4, Data2=flatten_5, Data3=flatten_6, Data4=flatten_7)

pline_7 = PolyLine(Vertices=divide_4.Points, Closed=False)
pline_8 = PolyLine(Vertices=divide_5.Points, Closed=False)
pline_9 = PolyLine(Vertices=divide_9.Points, Closed=False)
explode_7 = Explode(Curve=pline_7, Recursive=True)  # -> Segments, Vertices
explode_8 = Explode(Curve=pline_8, Recursive=True)  # -> Segments, Vertices
explode_9 = Explode(Curve=pline_9, Recursive=True)  # -> Segments, Vertices
flatten_8 = FlattenTree(Tree=explode_7.Segments, Path="7")
flatten_9 = FlattenTree(Tree=explode_8.Segments, Path="8")
flatten_10 = FlattenTree(Tree=explode_9.Segments, Path="9")
merge_13 = Merge(Data1=flatten_8, Data2=flatten_9, Data3=flatten_10)

rdlines = RemoveDuplicateLinesKaramba(Line=flatten(merge_10), LimitDistance=0.005)  # -> OutLine, Info, Indexes
llinter = LineLineIntersectionKaramba(Line=rdlines.OutLine, LengthTolerance=0.01)  # -> IntersectionPoints, flatten(LineSubSegements)
linetobeam = LineToBeamKaramba(Line=llinter.LineSubSegements, New=True, Remove=True, LimitDistance_m=0.005, BeamIdentifier="banzosuperior")  # -> Points, Element, Info

rdlines_2 = RemoveDuplicateLinesKaramba(Line=flatten(merge_12), LimitDistance=0.005)  # -> OutLine, Info, Indexes
llinter_2 = LineLineIntersectionKaramba(Line=rdlines_2.OutLine, LengthTolerance=0.01)  # -> IntersectionPoints, flatten(LineSubSegements)
linetobeam_2 = LineToBeamKaramba(Line=flatten(llinter_2.LineSubSegements), New=True, Remove=True, LimitDistance_m=0.005, BeamIdentifier="banzoinferior")  # -> Points, flatten(Element), Info

rdlines_3 = RemoveDuplicateLinesKaramba(Line=flatten(merge_13), LimitDistance=0.005)  # -> OutLine, Info, Indexes
llinter_3 = LineLineIntersectionKaramba(Line=rdlines_3.OutLine, LengthTolerance=0.01)  # -> IntersectionPoints, flatten(LineSubSegements)
linetobeam_3 = LineToBeamKaramba(Line=flatten(llinter_3.LineSubSegements), New=True, Remove=True, LimitDistance_m=0.005, BeamIdentifier="barra")  # -> Points, Element, Info

rdlines_4 = RemoveDuplicateLinesKaramba(Line=flatten(flatten_3), LimitDistance=0.005)  # -> OutLine, Info, Indexes
llinter_4 = LineLineIntersectionKaramba(Line=rdlines_4.OutLine, LengthTolerance=0.01)  # -> IntersectionPoints, flatten(LineSubSegements)
linetobeam_4 = LineToBeamKaramba(Line=llinter_4.LineSubSegements, New=True, Remove=True, LimitDistance_m=0.005, BeamIdentifier="diagonal")  # -> Points, Element, Info

len = Length(Curve=rdlines_4.OutLine)
ma = MassAddition(Input=len)  # -> Result, PartialResults
multiplication_20 = Multiplication(A=ma.Result, B=division_9)
multiplication_21 = Multiplication(A=multiplication_20, B=peso_do_aço_m3)
panel_27 = Panel(multiplication_21)

merge_14 = Merge(Data1=divide.Points, Data2=divide_4.Points, Data3=divide_5.Points, Data4=divide_6.Points, Data5=divide_9.Points)
matselect = MaterialSelectionKaramba(menu=[dropdown(1), dropdown(3)])
merge_15 = Merge(Data1=pt, Data2=pt_2, Data3=pt_4, Data4=pt_5)
supp = SupportKaramba(PosInd=merge_15, menu=[buttons(on, on, on, on, on, on)])
merge_16 = Merge(Data1=linetobeam_4.Element, Data2=linetobeam.Element, Data3=linetobeam_2.Element, Data4=linetobeam_3.Element)
range = Range(Domain=Domain(0, 1), Steps=10)
gradient = Gradient(LowerLimit=0, UpperLimit=1, Parameter=range, stops=[0: RGB(0, 128, 0), 0.5: RGB(255, 255, 0), 1: RGB(255, 0, 0)])

Z = UnitZ(Factor=multiplication_19)
loads = LoadsKaramba(ForceVector=Z, Local=False, PosInd=merge_14, LCase=0, mode="Point")
loads_2 = LoadsKaramba(Vector=Vector(0, 0, -1), LCase=0, mode="Gravity")

panel_28 = Panel("Escolha do Perfil")
resistência_kn_mm²_2 = Panel("0.25")
eval_10 = Evaluate(F="(3.14159*x^2)/4", x=diametro_mm_5)
eval_11 = Evaluate(F="(3.14159*x^2)/4", x=diametro_mm_3)
eval_12 = Evaluate(F="(3.14159*x^2)/4", x=diametro_mm_2)
eval_13 = Evaluate(F="(3.14159*(x-(y*2))^2)/4", x=diametro_mm_5, y=parede_mm_5)
eval_14 = Evaluate(F="(3.14159*(x-(y*2))^2)/4", x=diametro_mm_3, y=parede_mm_3)
eval_15 = Evaluate(F="(3.14159*(x-(y*2))^2)/4", x=diametro_mm_2, y=parede_mm_2)
eval_16 = Evaluate(F="(3.14159*(x-(y*2))^2)/4", x=diametro_mm_4, y=parede_mm_4)
eval_17 = Evaluate(F="(3.14159*x^2)/4", x=diametro_mm_4)
subtraction_2 = Subtraction(A=eval_10, B=eval_13)
subtraction_3 = Subtraction(A=eval_11, B=eval_14)
subtraction_4 = Subtraction(A=eval_12, B=eval_15)
subtraction_5 = Subtraction(A=eval_17, B=eval_16)

cross_sections = CrossSectionsKaramba(ElementsIdentifiers="diagonal", Diameter_cm=division, WallThickness_cm=division_2, mode="Circular Hollow")
cross_sections_2 = CrossSectionsKaramba(ElementsIdentifiers="banzosuperior", Diameter_cm=division_3, WallThickness_cm=division_4, mode="Circular Hollow")
cross_sections_3 = CrossSectionsKaramba(ElementsIdentifiers="banzoinferior", Diameter_cm=division_5, WallThickness_cm=division_6, mode="Circular Hollow")
cross_sections_4 = CrossSectionsKaramba(ElementsIdentifiers="barra", Diameter_cm=division_7, WallThickness_cm=division_8, mode="Circular Hollow")

área_do_perfil_mm2_2 = Panel(subtraction_3)
área_do_perfil_mm2_3 = Panel(subtraction_4)
área_do_perfil_mm2_4 = Panel(subtraction_5)
área_do_perfil_mm2_5 = Panel(subtraction_2)

merge_17 = Merge(Data1=cross_sections, Data2=cross_sections_2, Data3=cross_sections_3, Data4=cross_sections_4)
multiplication_22 = Multiplication(A=área_do_perfil_mm2_5, B=resistência_kn_mm²_2)
multiplication_23 = Multiplication(A=área_do_perfil_mm2_2, B=resistência_kn_mm²_2)
multiplication_24 = Multiplication(A=área_do_perfil_mm2_3, B=resistência_kn_mm²_2)
multiplication_25 = Multiplication(A=área_do_perfil_mm2_4, B=resistência_kn_mm²_2)

merge_18 = Merge(Data1=loads_2, Data2=loads)

assemble = AssembleModelKaramba(
    Elem=flatten(merge_16),
    Support=flatten(supp),
    Load=flatten(merge_18),
    CrossSection=flatten(merge_17),
    Material=flatten(matselect),
    LimitDistance_m=0.005)  # -> flatten(Model), Info, Mass_kg, CenterOfGravity
model_mass_kg = Panel(assemble.Mass_kg)

analyzethi = AnalyzeThIKaramba(Model=assemble.Model)  # -> CalculatedModel, MaximumDisplacement_m, ResultingForceOfGravity_kN, ElasticEnergy_kNm
max_displacement_m = Panel(analyzethi.MaximumDisplacement_m)

b_res_force = BeamResultantForcesKaramba(
    AnalyzedModel=analyzethi.CalculatedModel,
    BeamIdentifiers="banzoinferior",
    LoadCase=-1,
    MaximumProbingDistance_m=-1,
    NumberOfProbingPointsPerElement=3)  # -> AnalyzedModel, NormalForce_kN, ResultantBendingMoment_kNm, ResultantShearForce_kN

b_res_force_2 = BeamResultantForcesKaramba(
    AnalyzedModel=analyzethi.CalculatedModel,
    BeamIdentifiers="banzosuperior",
    LoadCase=-1,
    MaximumProbingDistance_m=-1,
    NumberOfProbingPointsPerElement=3)  # -> AnalyzedModel, NormalForce_kN, ResultantBendingMoment_kNm, ResultantShearForce_kN

b_res_force_3 = BeamResultantForcesKaramba(
    AnalyzedModel=analyzethi.CalculatedModel,
    BeamIdentifiers="barra",
    LoadCase=-1,
    MaximumProbingDistance_m=-1,
    NumberOfProbingPointsPerElement=3)  # -> AnalyzedModel, NormalForce_kN, ResultantBendingMoment_kNm, ResultantShearForce_kN

b_res_force_4 = BeamResultantForcesKaramba(
    AnalyzedModel=analyzethi.CalculatedModel,
    BeamIdentifiers="diagonal",
    LoadCase=-1,
    MaximumProbingDistance_m=-1,
    NumberOfProbingPointsPerElement=3)  # -> AnalyzedModel, NormalForce_kN, ResultantBendingMoment_kNm, ResultantShearForce_kN

modelview = ModelViewKaramba(
    Model=analyzethi.CalculatedModel,
    LoadCaseFactorsForLinearSuperposition=1,
    IndexIncrementOfVisibleLoadcase=0,
    ListOfColorsForColoringPlots=gradient)  # -> Model, DeformedMesh, DeformedAxes, DeformedModel
beamview = BeamViewKaramba(Model=modelview.Model)  # -> Model, MeshesOfRenderedBeams, DeformedBeamAxes, LegendColors, LegendTags
b_res_force_5 = BeamResultantForcesKaramba(AnalyzedModel=beamview.Model, LoadCase=-1, MaximumProbingDistance_m=-1, NumberOfProbingPointsPerElement=3)  # -> AnalyzedModel, NormalForce_kN, ResultantBendingMoment_kNm, ResultantShearForce_kN
python = PythonScript(x=beamview.LegendTags)  # -> out, a; inputs x: list
# ---------- python: Python ----------
import re

a = []

x.pop(0)

for val in x:
    try:
        a.append( float(re.sub(r'[^\d.-e+]+', '', val)) )
    except ValueError:
        continue
# ---------- end python ----------
abs = Absolute(Value=python.a)
bnd = Bounds(Numbers=b_res_force_5.NormalForce_kN)
bnd_2 = Bounds(Numbers=b_res_force_5.ResultantBendingMoment_kNm)
bnd_3 = Bounds(Numbers=b_res_force_5.ResultantShearForce_kN)
bnd_4 = Bounds(Numbers=abs)
dedomain = DeconstructDomain(Domain=bnd)  # -> Start, End
dedomain_2 = DeconstructDomain(Domain=bnd_2)  # -> Start, End
dedomain_3 = DeconstructDomain(Domain=bnd_3)  # -> Start, End
dedomain_4 = DeconstructDomain(Domain=bnd_4)  # -> Start, End
abs_2 = Absolute(Value=dedomain.Start)

flecha_máxima_aceitável_l_x = Panel("300")
vão_total = Panel("100")
division_11 = Division(A=vão_total, B=flecha_máxima_aceitável_l_x)
flecha_máxima_aceitável_m = Panel(division_11)
flecha_máxima_m = Panel(analyzethi.MaximumDisplacement_m)

max_utilization_percentage = Panel(dedomain_4.End)
max_compression_kn = Panel(abs_2)
max_tension_kn = Panel(dedomain.End)
max_moment_knm = Panel(dedomain_2.End)
max_shear_kn = Panel(dedomain_3.End)

bnd_5 = Bounds(Numbers=b_res_force_4.NormalForce_kN)
bnd_6 = Bounds(Numbers=b_res_force_2.NormalForce_kN)
bnd_7 = Bounds(Numbers=b_res_force.NormalForce_kN)
bnd_8 = Bounds(Numbers=b_res_force_3.NormalForce_kN)
dedomain_5 = DeconstructDomain(Domain=bnd_5)  # -> Start, End
dedomain_6 = DeconstructDomain(Domain=bnd_6)  # -> Start, End
dedomain_7 = DeconstructDomain(Domain=bnd_7)  # -> Start, End
dedomain_8 = DeconstructDomain(Domain=bnd_8)  # -> Start, End
abs_3 = Absolute(Value=dedomain_5.Start)
abs_4 = Absolute(Value=dedomain_6.Start)
abs_5 = Absolute(Value=dedomain_7.Start)
abs_6 = Absolute(Value=dedomain_8.Start)

tração_máxima_kn = Panel(dedomain_6.End)
compressão_máxima_kn = Panel(abs_4)

compressão_máxima_kn_2 = Panel(abs_6)
tração_máxima_kn_2 = Panel(dedomain_8.End)

compressão_máxima_kn_3 = Panel(abs_3)
tração_máxima_kn_3 = Panel(dedomain_5.End)

compressão_máxima_kn_4 = Panel(abs_5)
tração_máxima_kn_4 = Panel(dedomain_7.End)

abs_7 = Absolute(Value=[compressão_máxima_kn_3, tração_máxima_kn_3])
abs_8 = Absolute(Value=[compressão_máxima_kn, tração_máxima_kn])
abs_9 = Absolute(Value=[compressão_máxima_kn_4, tração_máxima_kn_4])
abs_10 = Absolute(Value=[compressão_máxima_kn_2, tração_máxima_kn_2])
sort = SortList(Keys=abs_7)  # -> Keys, ValuesA
sort_2 = SortList(Keys=abs_8)  # -> Keys, ValuesA
sort_3 = SortList(Keys=abs_9)  # -> Keys, ValuesA
sort_4 = SortList(Keys=abs_10)  # -> Keys, ValuesA
rev = ReverseList(List=sort.Keys)
rev_2 = ReverseList(List=sort_2.Keys)
rev_3 = ReverseList(List=sort_3.Keys)
rev_4 = ReverseList(List=sort_4.Keys)
item_13 = ListItem(List=rev, Index=0, Wrap=True)
item_14 = ListItem(List=rev_2, Index=0, Wrap=True)
item_15 = ListItem(List=rev_3, Index=0, Wrap=True)
item_16 = ListItem(List=rev_4, Index=0, Wrap=True)

# ----
# Diagonais
solicitação_máxima = Panel(item_13)
resistência_máxima_de_cada_peça_2 = Panel(multiplication_22)

# ----
# Banzo Sup.
solicitação_máxima_2 = Panel(item_15)
resistência_máxima_de_cada_peça_3 = Panel(multiplication_24)

resistência_máxima_de_cada_peça_4 = Panel(multiplication_25)
# Barra
solicitação_máxima_3 = Panel(item_16)

# ----
# Banzo Inf.
solicitação_máxima_4 = Panel(item_14)
resistência_máxima_de_cada_peça_5 = Panel(multiplication_23)

model_mass_kg_2 = Panel(assemble.Mass_kg)
subtraction_6 = Subtraction(A=flecha_máxima_m, B=flecha_máxima_aceitável_m)
subtraction_7 = Subtraction(A=solicitação_máxima, B=resistência_máxima_de_cada_peça_2)
subtraction_8 = Subtraction(A=solicitação_máxima_4, B=resistência_máxima_de_cada_peça_5)
subtraction_9 = Subtraction(A=solicitação_máxima_2, B=resistência_máxima_de_cada_peça_3)
subtraction_10 = Subtraction(A=solicitação_máxima_3, B=resistência_máxima_de_cada_peça_4)
max = Maximum(A=subtraction_6, B=0)
max_2 = Maximum(A=subtraction_7, B=0)
max_3 = Maximum(A=subtraction_8, B=0)
max_4 = Maximum(A=subtraction_9, B=0)
max_5 = Maximum(A=subtraction_10, B=0)
multiplication_26 = Multiplication(A=max, B=panel_21)
multiplication_27 = Multiplication(A=max_2, B=panel_21)
multiplication_28 = Multiplication(A=max_3, B=panel_21)
multiplication_29 = Multiplication(A=max_4, B=panel_21)
multiplication_30 = Multiplication(A=max_5, B=panel_21)
addition_23 = Addition(
    A=multiplication_26,
    B=multiplication_27,
    C=multiplication_28,
    D=multiplication_29,
    E=multiplication_30,
    F=model_mass_kg_2)
parâmetro_a_otimizar = Panel(addition_23)
equals = Equality(FirstNumber=parâmetro_a_otimizar, SecondNumber=model_mass_kg_2)  # -> Equality, Inequality
está_passando = Panel(equals.Equality)
